# Grasshopper definition occupancy_test.ghx (Grasshopper 1.0.8)

unit_x = UnitX(Factor="10")
unit_x_2 = UnitX(Factor="10")
unit_x_3 = UnitX(Factor="10")
unit_x_4 = UnitX(Factor="10")
unit_x_5 = UnitX(Factor="10")
unit_x_6 = UnitX(Factor="10")
point = Point(Point(10, 10, 10))
point_2 = Point(Point(0, 0, 0))
point_3 = Point(Point(10, 10, 10))
point_4 = Point(Point(10, 10, 10))
point_5 = Point(Point(0, 0, 0))
point_6 = Point(Point(10, 10, 10))
point_7 = Point(Point(0, 0, 0))
point_8 = Point(Point(0, 0, 0))
point_9 = Point(Point(10, 10, 10))
point_10 = Point(Point(10, 10, 10))
point_11 = Point(Point(0, 0, 0))
point_12 = Point(Point(0, 0, 0))
box_2pt = Box2Pt(PointA=point_2, PointB=point, Plane=PlaneXY(0, 0, 0))
move = Move(Geometry=box_2pt, Motion=unit_x)  # -> Geometry, Transform
box_2pt_2 = Box2Pt(PointA=point_5, PointB=point_3, Plane=PlaneXY(0, 0, 0))
move_2 = Move(Geometry=box_2pt_2, Motion=unit_x_2)  # -> Geometry, Transform
box_2pt_3 = Box2Pt(PointA=point_7, PointB=point_4, Plane=PlaneXY(0, 0, 0))
move_3 = Move(Geometry=box_2pt_3, Motion=unit_x_3)  # -> Geometry, Transform
box_2pt_4 = Box2Pt(PointA=point_8, PointB=point_6, Plane=PlaneXY(0, 0, 0))
move_4 = Move(Geometry=box_2pt_4, Motion=unit_x_4)  # -> Geometry, Transform
box_2pt_5 = Box2Pt(PointA=point_11, PointB=point_9, Plane=PlaneXY(0, 0, 0))
move_5 = Move(Geometry=box_2pt_5, Motion=unit_x_5)  # -> Geometry, Transform
box_2pt_6 = Box2Pt(PointA=point_12, PointB=point_10, Plane=PlaneXY(0, 0, 0))
move_6 = Move(Geometry=box_2pt_6, Motion=unit_x_6)  # -> Geometry, Transform
unit_y = UnitY(Factor="10")
unit_y_2 = UnitY(Factor="10")
unit_y_3 = UnitY(Factor="10")
unit_y_4 = UnitY(Factor="10")
merge = Merge(Data1=box_2pt, Data2=move.Geometry)
merge_2 = Merge(Data1=box_2pt_2, Data2=move_2.Geometry)
unit_y_5 = UnitY(Factor="10")
unit_y_6 = UnitY(Factor="10")
merge_3 = Merge(Data1=box_2pt_3, Data2=move_3.Geometry)
merge_4 = Merge(Data1=box_2pt_4, Data2=move_4.Geometry)
merge_5 = Merge(Data1=box_2pt_5, Data2=move_5.Geometry)
merge_6 = Merge(Data1=box_2pt_6, Data2=move_6.Geometry)
move_7 = Move(Geometry=merge, Motion=unit_y)  # -> Geometry, Transform
move_8 = Move(Geometry=merge_2, Motion=unit_y_2)  # -> Geometry, Transform
move_9 = Move(Geometry=merge_3, Motion=unit_y_3)  # -> Geometry, Transform
move_10 = Move(Geometry=merge_4, Motion=unit_y_4)  # -> Geometry, Transform
move_11 = Move(Geometry=merge_5, Motion=unit_y_5)  # -> Geometry, Transform
move_12 = Move(Geometry=merge_6, Motion=unit_y_6)  # -> Geometry, Transform

# ---- group: Non Res
point_13 = Point(Point(10, -10, 10))
point_14 = Point(Point(0, 0, 0))
box_2pt_7 = Box2Pt(PointA=point_14, PointB=point_13, Plane=PlaneXY(0, 0, 0))

# ----
phius_programs = HBPHPhiusProgramFinder(name="Hallway")  # -> out, flatten(programs)
# ---------- phius_programs: Python ----------
#
# Honeybee-PH: A Plugin for adding Passive-House data to LadybugTools Honeybee-Energy Models
# 
# This component is part of the PH-Tools toolkit <https://github.com/PH-Tools>.
# 
# Copyright (c) 2022, PH-Tools and bldgtyp, llc <phtools@bldgtyp.com> 
# Honeybee-PH is free software; you can redistribute it and/or modify 
# it under the terms of the GNU General Public License as published 
# by the Free Software Foundation; either version 3 of the License, 
# or (at your option) any later version. 
# 
# Honeybee-PH is distributed in the hope that it will be useful,
# but WITHOUT ANY WARRANTY; without even the implied warranty of 
# MERCHANTABILITY or FITNESS FOR A PARTICULAR PURPOSE. See the 
# GNU General Public License for more details.
# 
# For a copy of the GNU General Public License
# see <https://github.com/PH-Tools/honeybee_ph/blob/main/LICENSE>.
# 
# @license GPL-3.0+ <http://spdx.org/licenses/GPL-3.0+>
#
"""
Set the residential PH-Style occupancy for the Honeybee-Rooms input. For Phius, the 
total occupancy with be the number-of-bedrooms + 1 for each dwelling unit.
-
EM January 22, 2025
    Args:
        _name_: (str) The name of the Phius program to search the dataset for.
        
        description_: (Optional[str]) Search within the 'description' field of the Phius
            program data set instead of the name.
        
        protocol_: (Optional[str]) A sub-category "Protocol" to filter the Phius programs by. For
            instance - "PHIUS_MultiFamily" or "PHIUS_NonRes", etc...
            
        base_program_: (Optional[honeybee_energy.programtype.ProgramType]) A base program 
            to use for the Phius Program, to fill in any missing info (hot-water, gas, etc..)
            
    Returns:
        programs_ (List[honeybee_energy.programtype.ProgramType]) A list of the Honeybee
            ProgramTypes found in the Phius dataset which match the search criteria.
"""

import scriptcontext as sc
import Rhino as rh
import rhinoscriptsyntax as rs
import ghpythonlib.components as ghc
import Grasshopper as gh


try:
    from honeybee_ph_utils import preview
except ImportError as e:
    raise ImportError('\nFailed to import honeybee_ph_utils:\n\t{}'.format(e))

try:
    from honeybee_ph_rhino import gh_compo_io
except ImportError as e:
    raise ImportError('\nFailed to import honeybee_ph_rhino:\n\t{}'.format(e))

try:
    from ph_gh_component_io import gh_io
except ImportError as e:
    raise ImportError('\nFailed to import ph_gh_component_io:\n\t{}'.format(e))


#-------------------------------------------------------------------------------
import honeybee_ph_rhino._component_info_
reload(honeybee_ph_rhino._component_info_)
ghenv.Component.Name = "HBPH - Phius Program Finder"
DEV = honeybee_ph_rhino._component_info_.set_component_params(ghenv, dev=False)
if DEV:
    from honeybee_energy_ph.library import programtypes
    reload(programtypes)
    reload(gh_io)
    from honeybee_ph_standards.programtypes import PHIUS_programs
    reload(PHIUS_programs)
    from honeybee_ph_rhino.gh_compo_io.program import find_phius_program as gh_compo_io
    reload(gh_compo_io)


# ------------------------------------------------------------------------------
# -- GH Interface
IGH = gh_io.IGH( ghdoc, ghenv, sc, rh, rs, ghc, gh )


#-------------------------------------------------------------------------------
gh_compo_interface = gh_compo_io.GHCompo_FindPhiusProgram(
        IGH,
        _name_,
        description_,
        protocol_,
        base_program_,
    )
programs_ = gh_compo_interface.run()
# ---------- end phius_programs ----------
merge_7 = Merge(Data1=merge, Data2=move_7.Geometry)
merge_8 = Merge(Data1=merge_2, Data2=move_8.Geometry)
merge_9 = Merge(Data1=merge_3, Data2=move_9.Geometry)
merge_10 = Merge(Data1=merge_4, Data2=move_10.Geometry)
merge_11 = Merge(Data1=merge_5, Data2=move_11.Geometry)
merge_12 = Merge(Data1=merge_6, Data2=move_12.Geometry)
roomsolid = HBRoomFromSolid(geo=flatten(merge_7), conditioned=True)  # -> out, rooms; plug-in component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
roomsolid_2 = HBRoomFromSolid(geo=flatten(merge_8), conditioned=True)  # -> out, rooms; plug-in component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
roomsolid_3 = HBRoomFromSolid(geo=flatten(merge_9), conditioned=True)  # -> out, rooms; plug-in component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
roomsolid_4 = HBRoomFromSolid(geo=flatten(merge_10), conditioned=True)  # -> out, rooms; plug-in component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
roomsolid_5 = HBRoomFromSolid(geo=flatten(box_2pt_7), name="hallway", program=phius_programs.programs, conditioned=True)  # -> out, rooms; plug-in component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
roomsolid_6 = HBRoomFromSolid(geo=flatten(merge_11), conditioned=True)  # -> out, rooms; plug-in component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
roomsolid_7 = HBRoomFromSolid(geo=flatten(merge_12), name="Residence", conditioned=True)  # -> out, rooms; plug-in component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
solveadj = HBSolveAdjacency(rooms=flatten(roomsolid_3.rooms), run=Toggle(True))  # -> out, adj_rooms; plug-in component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
solveadj_2 = HBSolveAdjacency(rooms=flatten(roomsolid_4.rooms), run=Toggle(True))  # -> out, adj_rooms; plug-in component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
solveadj_3 = HBSolveAdjacency(rooms=flatten(roomsolid.rooms), run=Toggle(True))  # -> out, adj_rooms; plug-in component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
solveadj_4 = HBSolveAdjacency(rooms=flatten(roomsolid_6.rooms), run=Toggle(True))  # -> out, adj_rooms; plug-in component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
solveadj_5 = HBSolveAdjacency(rooms=flatten(roomsolid_2.rooms), run=Toggle(True))  # -> out, adj_rooms; plug-in component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
solveadj_6 = HBSolveAdjacency(rooms=flatten([roomsolid_7.rooms, roomsolid_5.rooms]), run=Toggle(True))  # -> out, adj_rooms; plug-in component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
create_spaces_from_rooms = HBPHCreateSpacesFromHBRooms(hb_rooms=solveadj.adj_rooms)  # -> out, hb_rooms; inputs hb_rooms: list
# ---------- create_spaces_from_rooms: Python ----------
#
# Honeybee-PH: A Plugin for adding Passive-House data to LadybugTools Honeybee-Energy Models
# 
# This component is part of the PH-Tools toolkit <https://github.com/PH-Tools>.
# 
# Copyright (c) 2022, PH-Tools and bldgtyp, llc <phtools@bldgtyp.com> 
# Honeybee-PH is free software; you can redistribute it and/or modify 
# it under the terms of the GNU General Public License as published 
# by the Free Software Foundation; either version 3 of the License, 
# or (at your option) any later version. 
# 
# Honeybee-PH is distributed in the hope that it will be useful,
# but WITHOUT ANY WARRANTY; without even the implied warranty of 
# MERCHANTABILITY or FITNESS FOR A PARTICULAR PURPOSE. See the 
# GNU General Public License for more details.
# 
# For a copy of the GNU General Public License
# see <https://github.com/PH-Tools/honeybee_ph/blob/main/LICENSE>.
# 
# @license GPL-3.0+ <http://spdx.org/licenses/GPL-3.0+>
#
"""
Create default PH-Spaces based on the Honeybee-Room geometry. Note that you 
may run into errors with complex Room shapes. This component is designed for 
simple rooms only. For complex rooms, build detailed Spaces with the "HBPH - Create Spaces" component.
-
EM March 19, 2022
    Args:
        _hb_rooms: (list[Room]) The list of honeybee-Rooms to add to the spaces to.
            
    Returns:
        hb_rooms_: The honeyee-Rooms with the PH Spaces added to them.
"""

import scriptcontext as sc
import Rhino as rh
import rhinoscriptsyntax as rs
import ghpythonlib.components as ghc
import Grasshopper as gh

from honeybee_ph_rhino import gh_compo_io, gh_io

# ------------------------------------------------------------------------------
import honeybee_ph_rhino._component_info_
reload(honeybee_ph_rhino._component_info_)
ghenv.Component.Name = "HBPH - Create Spaces from HB-Rooms"
DEV = honeybee_ph_rhino._component_info_.set_component_params(ghenv, dev=False)
if DEV:
    from honeybee_ph_rhino.gh_compo_io import space_create_from_hb_rooms as gh_compo_io
    reload(gh_compo_io)
    reload(gh_io)

# ------------------------------------------------------------------------------
# -- GH Interface
IGH = gh_io.IGH( ghdoc, ghenv, sc, rh, rs, ghc, gh )

# ------------------------------------------------------------------------------
gh_compo_interface = gh_compo_io.GHCompo_CreatePHSpacesFromHBRooms(
    IGH,
    _hb_rooms,
    )
hb_rooms_ = gh_compo_interface.run()
# ---------- end create_spaces_from_rooms ----------
explode_tree = ExplodeTree(Data=simplify(graft(solveadj_6.adj_rooms)))  # -> Branch0, Branch1, Branch2, Branch3, Branch4
model = HBModel(rooms=flatten(solveadj_3.adj_rooms))  # -> out, model; plug-in component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
panel = Panel("""0
1
2
4""")
explode_tree_2 = ExplodeTree(Data=simplify(graft(solveadj_4.adj_rooms)))  # -> Branch0, Branch1, Branch2, Branch3
panel_2 = Panel("""0
1
2
3""")
set_dwelling = HBPHSetDwelling(num_dwellings=simplify("1"), hb_rooms=simplify(solveadj_5.adj_rooms))  # -> out, hb_rooms; inputs num_dwellings: tree, hb_rooms: tree
# ---------- set_dwelling: Python ----------
#
# Honeybee-PH: A Plugin for adding Passive-House data to LadybugTools Honeybee-Energy Models
# 
# This component is part of the PH-Tools toolkit <https://github.com/PH-Tools>.
# 
# Copyright (c) 2022, PH-Tools and bldgtyp, llc <phtools@bldgtyp.com> 
# Honeybee-PH is free software; you can redistribute it and/or modify 
# it under the terms of the GNU General Public License as published 
# by the Free Software Foundation; either version 3 of the License, 
# or (at your option) any later version. 
# 
# Honeybee-PH is distributed in the hope that it will be useful,
# but WITHOUT ANY WARRANTY; without even the implied warranty of 
# MERCHANTABILITY or FITNESS FOR A PARTICULAR PURPOSE. See the 
# GNU General Public License for more details.
# 
# For a copy of the GNU General Public License
# see <https://github.com/PH-Tools/honeybee_ph/blob/main/LICENSE>.
# 
# @license GPL-3.0+ <http://spdx.org/licenses/GPL-3.0+>
#
"""
Set a group of HB-Rooms as a single 'Dwelling'. This is required in order to properly calculate
the Phius occupancy, lighting, and electrical equipment usage. 
-
If you are creating a single-family home, simply input all of your rooms
to this component. If you are creating a multi-unit (apartment) building, split up your rooms onto separate 
branches as appropriate. All of the Rooms on a single Branch will be set to the same 'dwelling'.
-
EM January 31, 2025
    Args:

        _num_dwellings_: (DataTree[int]) Default=1. Optional input for the number of dwellings 
            for the input hb-room. This is useful if you are doing multi-unit residential projects
            and are modeling HB-Rooms as 'blocks' or groups of dwellings in order to simplify 
            the overall model geometry. In this case, input a DataTree with values that match the 
            order of the HB-Rooms input. If you are modeling a single-family project, or each 
            HB-Room maps to a single dwelling, then leave this input blank.

        _hb_rooms: (DataTree[Room]) The HB-Rooms to set as a 'dwelling'
            
    Returns:
        hb_rooms_: (DataTree[Room]) The HB-Rooms with their 'dwelling' set.
"""


import scriptcontext as sc
import Rhino as rh
import rhinoscriptsyntax as rs
import ghpythonlib.components as ghc
import Grasshopper as gh


try:
    from honeybee_ph_utils import preview
except ImportError as e:
    raise ImportError('\nFailed to import honeybee_ph_utils:\n\t{}'.format(e))

try:
    from honeybee_ph_rhino import gh_compo_io
except ImportError as e:
    raise ImportError('\nFailed to import honeybee_ph_rhino:\n\t{}'.format(e))

try:
    from ph_gh_component_io import gh_io
except ImportError as e:
    raise ImportError('\nFailed to import ph_gh_component_io:\n\t{}'.format(e))


#-------------------------------------------------------------------------------
import honeybee_ph_rhino._component_info_
reload(honeybee_ph_rhino._component_info_)
ghenv.Component.Name = "HBPH - Set Dwelling"
DEV = honeybee_ph_rhino._component_info_.set_component_params(ghenv, dev=False)
if DEV:
    from honeybee_ph_rhino.gh_compo_io.program import set_dwelling as gh_compo_io
    reload(gh_compo_io)
    reload(gh_io)

# ------------------------------------------------------------------------------
# -- GH Interface
IGH = gh_io.IGH( ghdoc, ghenv, sc, rh, rs, ghc, gh )


#-------------------------------------------------------------------------------
gh_compo_interface = gh_compo_io.GHCompo_SetDwelling(
        IGH,
        _num_dwellings_,
        _hb_rooms,
    )
hb_rooms_ = gh_compo_interface.run()
# ---------- end set_dwelling ----------
panel_3 = Panel(explode_tree.Branch4)
set_res_occupancy = HBPHSetResOccupancy(num_bedrooms=panel_2, num_people=panel, hb_rooms=solveadj_2.adj_rooms)  # -> out, hb_rooms; inputs num_bedrooms: list of Int32, num_people: list of Int32, set_res_schedule: Boolean, hb_rooms: list
# ---------- set_res_occupancy: Python ----------
#
# Honeybee-PH: A Plugin for adding Passive-House data to LadybugTools Honeybee-Energy Models
# 
# This component is part of the PH-Tools toolkit <https://github.com/PH-Tools>.
# 
# Copyright (c) 2022, PH-Tools and bldgtyp, llc <phtools@bldgtyp.com> 
# Honeybee-PH is free software; you can redistribute it and/or modify 
# it under the terms of the GNU General Public License as published 
# by the Free Software Foundation; either version 3 of the License, 
# or (at your option) any later version. 
# 
# Honeybee-PH is distributed in the hope that it will be useful,
# but WITHOUT ANY WARRANTY; without even the implied warranty of 
# MERCHANTABILITY or FITNESS FOR A PARTICULAR PURPOSE. See the 
# GNU General Public License for more details.
# 
# For a copy of the GNU General Public License
# see <https://github.com/PH-Tools/honeybee_ph/blob/main/LICENSE>.
# 
# @license GPL-3.0+ <http://spdx.org/licenses/GPL-3.0+>
#
"""
Set the PH-Style occupancy for the Honeybee-Rooms input.
-
Note that this component will create a new, unique 'People' load for EACH HB-Room input, and will
set the values accordingly. On some larger projects with many rooms, creating these duplicate 'People'
objects may not be ideal, and may lead to longer run-times.
-
For Phius residential projects, a DWELLING's total "_num_people" should be the dwelling's
"number-of-bedrooms" + 1. Distribute that total across the dwelling's Rooms - do not repeat the
full dwelling value on every Room.
-
EM July 21, 2026
    Args:
        _num_bedrooms: (list[int]) A list of number of bedrooms for EACH Honeybee-Room input.
            This should ideally be the same length as the '_hb_rooms' input, and in the same
            order. If only a single value is input, that value will get applied to all of the
            Honeybee-Rooms input. Note that this value is the number of bedrooms PER-HB-ROOM,
            not the total number of bedrooms in the entire model.

        _num_people: (List[float]) A list of the number of people for EACH Honeybee-Room input.
            This should ideally be the same length as the '_hb_rooms' input, and in the same
            order. If only a single value is input, that value will get applied to all of the
            Honeybee-Rooms input. Note that this value is the number of people PER-HB-ROOM,
            not the total number of people in the entire model.
            -
            How these occupants get distributed depends on whether 'HBPH - Set Dwelling' has
            already been run on the Rooms:
            * Set Dwelling FIRST: the Rooms of each dwelling are normalized together, so the
              dwelling's total occupancy is spread evenly over the dwelling's total floor-area.
              This is what you want for multi-family, where each apartment should be normalized
              against its own area.
            * Set Dwelling NOT yet run: each Room is normalized on its own, so the occupants
              you enter for a Room stay in that Room. A Room given 0 people gets 0 people.
            Either way the model's TOTAL occupancy is the same - only the distribution differs.

        _set_res_schedule_: (bool) Default=True. Set the Room's Occupancy and Occupant-Activity schedule
            to the Passive-House defaults? If set to 'False', the Room's existing schedule will be
            maintained. If None, will re-set the schedule to match the PH res-typical schedule.

        _hb_rooms: (List[Room]) A list of Honeybee-Rooms to set the occupancy values on.

    Returns:
        hb_rooms_ (List[Room]) A list of the Honeybee Rooms with the ph-style occupancy set.
"""


import scriptcontext as sc
import Rhino as rh
import rhinoscriptsyntax as rs
import ghpythonlib.components as ghc
import Grasshopper as gh


try:
    from honeybee_ph_utils import preview
except ImportError as e:
    raise ImportError('\nFailed to import honeybee_ph_utils:\n\t{}'.format(e))

try:
    from honeybee_ph_rhino import gh_compo_io
except ImportError as e:
    raise ImportError('\nFailed to import honeybee_ph_rhino:\n\t{}'.format(e))

try:
    from ph_gh_component_io import gh_io
except ImportError as e:
    raise ImportError('\nFailed to import ph_gh_component_io:\n\t{}'.format(e))


#-------------------------------------------------------------------------------
import honeybee_ph_rhino._component_info_
reload(honeybee_ph_rhino._component_info_)
ghenv.Component.Name = "HBPH - Set Res Occupancy"
DEV = honeybee_ph_rhino._component_info_.set_component_params(ghenv, dev=False)
if DEV:
    from honeybee_ph_rhino.gh_compo_io.program import set_res_occupancy as gh_compo_io
    reload(gh_compo_io)
    reload(gh_io)

# ------------------------------------------------------------------------------
# -- GH Interface
IGH = gh_io.IGH( ghdoc, ghenv, sc, rh, rs, ghc, gh )


#-------------------------------------------------------------------------------
gh_compo_interface = gh_compo_io.GHCompo_SetResOccupancy(
        IGH,
        _num_bedrooms,
        _num_people,
        _set_res_schedule_,
        _hb_rooms,
    )
hb_rooms_= gh_compo_interface.run()
# ---------- end set_res_occupancy ----------
file_path = FilePath("/Users/em/Dropbox/bldgtyp-00/00_PH_Tools/PHX/planning/bug-fix/hbjson-occupancy-and-schedules/HBJSON/")
dumpobjects = HBDumpObjects(hb_objs=flatten(model.model), name="01_no_dwelling_no_occupancy", folder=file_path, dump=Toggle(False))  # -> out, hb_file; plug-in component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
set_dwelling_2 = HBPHSetDwelling(num_dwellings=simplify("1"), hb_rooms=simplify(create_spaces_from_rooms.hb_rooms))  # -> out, hb_rooms; inputs num_dwellings: tree, hb_rooms: tree; same code as set_dwelling

merge_13 = Merge(Data1=explode_tree.Branch2, Data2=explode_tree.Branch3)  # -> flatten(Result)
panel_4 = Panel("""2
3""")
panel_5 = Panel("""2
4""")
set_dwelling_3 = HBPHSetDwelling(num_dwellings=simplify("1"), hb_rooms=simplify(merge_13))  # -> out, hb_rooms; inputs num_dwellings: tree, hb_rooms: tree; same code as set_dwelling
set_res_occupancy_2 = HBPHSetResOccupancy(num_bedrooms=panel_4, num_people=panel_5, hb_rooms=set_dwelling_3.hb_rooms)  # -> out, hb_rooms; inputs num_bedrooms: list of Int32, num_people: list of Int32, set_res_schedule: Boolean, hb_rooms: list; same code as set_res_occupancy

merge_14 = Merge(Data1=explode_tree_2.Branch2, Data2=explode_tree_2.Branch3)  # -> flatten(Result)
panel_6 = Panel("""2
3""")
panel_7 = Panel("""2
4""")
set_dwelling_4 = HBPHSetDwelling(num_dwellings=simplify("1"), hb_rooms=simplify(merge_14))  # -> out, hb_rooms; inputs num_dwellings: tree, hb_rooms: tree; same code as set_dwelling
set_res_occupancy_3 = HBPHSetResOccupancy(num_bedrooms=panel_6, num_people=panel_7, hb_rooms=set_dwelling_4.hb_rooms)  # -> out, hb_rooms; inputs num_bedrooms: list of Int32, num_people: list of Int32, set_res_schedule: Boolean, hb_rooms: list; same code as set_res_occupancy

merge_15 = Merge(Data1=explode_tree.Branch0, Data2=explode_tree.Branch1)  # -> flatten(Result)
panel_8 = Panel("""0
1""")
panel_9 = Panel("""0
1""")
set_dwelling_5 = HBPHSetDwelling(num_dwellings=simplify("1"), hb_rooms=simplify(merge_15))  # -> out, hb_rooms; inputs num_dwellings: tree, hb_rooms: tree; same code as set_dwelling
set_res_occupancy_4 = HBPHSetResOccupancy(num_bedrooms=panel_8, num_people=panel_9, hb_rooms=set_dwelling_5.hb_rooms)  # -> out, hb_rooms; inputs num_bedrooms: list of Int32, num_people: list of Int32, set_res_schedule: Boolean, hb_rooms: list; same code as set_res_occupancy

panel_10 = Panel("""0
1
2
4""")

merge_16 = Merge(Data1=explode_tree_2.Branch0, Data2=explode_tree_2.Branch1)  # -> flatten(Result)
panel_11 = Panel("""0
1""")
panel_12 = Panel("""0
1""")
set_dwelling_6 = HBPHSetDwelling(num_dwellings=simplify("1"), hb_rooms=simplify(merge_16))  # -> out, hb_rooms; inputs num_dwellings: tree, hb_rooms: tree; same code as set_dwelling
set_res_occupancy_5 = HBPHSetResOccupancy(num_bedrooms=panel_11, num_people=panel_12, hb_rooms=set_dwelling_6.hb_rooms)  # -> out, hb_rooms; inputs num_bedrooms: list of Int32, num_people: list of Int32, set_res_schedule: Boolean, hb_rooms: list; same code as set_res_occupancy

panel_13 = Panel("""0
1
2
3""")
model_2 = HBModel(rooms=flatten(set_dwelling.hb_rooms))  # -> out, model; plug-in component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
set_res_occupancy_6 = HBPHSetResOccupancy(num_bedrooms=panel_13, num_people=panel_10, hb_rooms=set_dwelling_2.hb_rooms)  # -> out, hb_rooms; inputs num_bedrooms: list of Int32, num_people: list of Int32, set_res_schedule: Boolean, hb_rooms: list; same code as set_res_occupancy
model_3 = HBModel(rooms=flatten(set_res_occupancy.hb_rooms))  # -> out, model; plug-in component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
file_path_2 = FilePath("/Users/em/Dropbox/bldgtyp-00/00_PH_Tools/PHX/planning/bug-fix/hbjson-occupancy-and-schedules/HBJSON/")
dumpobjects_2 = HBDumpObjects(hb_objs=flatten(model_2.model), name="02_single_dwelling_no_occupancy", folder=file_path_2, dump=Toggle(False))  # -> out, hb_file; plug-in component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
file_path_3 = FilePath("/Users/em/Dropbox/bldgtyp-00/00_PH_Tools/PHX/planning/bug-fix/hbjson-occupancy-and-schedules/HBJSON/")
dumpobjects_3 = HBDumpObjects(hb_objs=flatten(model_3.model), name="04_no_dwelling_set_occupancy", folder=file_path_3, dump=Toggle(False))  # -> out, hb_file; plug-in component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
merge_17 = Merge(Data1=set_res_occupancy_5.hb_rooms, Data2=set_res_occupancy_3.hb_rooms)
ph_ventilator = HBPHVentilator()  # -> out, flatten(unit); inputs frost_protection: Boolean, inside: Boolean
# ---------- ph_ventilator: Python ----------
#
# Honeybee-PH: A Plugin for adding Passive-House data to LadybugTools Honeybee-Energy Models
# 
# This component is part of the PH-Tools toolkit <https://github.com/PH-Tools>.
# 
# Copyright (c) 2022, PH-Tools and bldgtyp, llc <phtools@bldgtyp.com> 
# Honeybee-PH is free software; you can redistribute it and/or modify 
# it under the terms of the GNU General Public License as published 
# by the Free Software Foundation; either version 3 of the License, 
# or (at your option) any later version. 
# 
# Honeybee-PH is distributed in the hope that it will be useful,
# but WITHOUT ANY WARRANTY; without even the implied warranty of 
# MERCHANTABILITY or FITNESS FOR A PARTICULAR PURPOSE. See the 
# GNU General Public License for more details.
# 
# For a copy of the GNU General Public License
# see <https://github.com/PH-Tools/honeybee_ph/blob/main/LICENSE>.
# 
# @license GPL-3.0+ <http://spdx.org/licenses/GPL-3.0+>
#
"""
Collects and organizes data for a PH-HVAC Ventilator Unit (HRV/ERV). Used as part of a 
PH-HVAC Ventilation System.
-
NOTE: Using the component will add ONLY the Passive House devices and will **NOT** add 
any components to the HB-Energy model. If you need to model mechancial equipment for an EnergyPlus
/ OpenStudio simulation then you must also use the Honeybee-Energy / IronBug components to setup
those devices separate from the inputs defined on the component here.
-
EM April 23, 2024
    Args:
        display_name_: (Optional[float]) The name of the Ventilator (ERV/HRV) Unit.
        
        sensible_hr_: (Optional[float]) Input the Ventialtion Unit's Heat Recovery %. Default is 75% 
        
        latent_hr_: (Optional[float]) Input the Ventialtion Unit's Moisture Recovery %. Default is 0% (HRV)
        
        elec_efficiency_: (Optional[float]) Input the Electrical Efficiency of the Ventialtion 
            Unit (W/m3h). Default is 0.55 W/m3h
        
        frost_protection: (bool): Unit requires frost-protection? Default=True. 
        
        frost_temp_: (Optional[float]) Min Temp [C] for frost protection to kick in. [deg.  C]. Default is -5 C
        
        inside_: (bool) Unt is installed inside the conditioned space? Default=True
    
    Returns:
        unit_: A Ventilator object for the Ventilation System. Connect to the 
            'ventUnit_' input on the 'Create Vent System' to build a PH-Style Ventilation System.
"""

import scriptcontext as sc
import Rhino as rh
import rhinoscriptsyntax as rs
import ghpythonlib.components as ghc
import Grasshopper as gh

from honeybee_ph_rhino import gh_compo_io, gh_io
from honeybee_ph_utils import preview


#-------------------------------------------------------------------------------
import honeybee_ph_rhino._component_info_
reload(honeybee_ph_rhino._component_info_)
ghenv.Component.Name = "HBPH - Ventilator"
DEV = honeybee_ph_rhino._component_info_.set_component_params(ghenv, dev=False)
if DEV:
    reload(gh_io)
    from honeybee_ph_rhino.gh_compo_io.hvac import create_ventilator as gh_compo_io
    reload(gh_compo_io)

# ------------------------------------------------------------------------------
# -- GH Interface
IGH = gh_io.IGH( ghdoc, ghenv, sc, rh, rs, ghc, gh )

# ------------------------------------------------------------------------------
gh_compo_interface = gh_compo_io.GHCompo_CreatePhVentilator(
        IGH,
        display_name_,
        sensible_hr_,
        latent_hr_,
        elec_efficiency_,
        frost_protection_,
        frost_temp_,
        inside_,
    )
unit_ = gh_compo_interface.run()

# ------------------------------------------------------------------------------
preview.object_preview(unit_)
# ---------- end ph_ventilator ----------
merge_18 = Merge(Data1=set_res_occupancy_4.hb_rooms, Data2=set_res_occupancy_2.hb_rooms, Data3=explode_tree.Branch4)  # -> flatten(Result)
model_4 = HBModel(rooms=flatten(merge_17))  # -> out, model; plug-in component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
model_5 = HBModel(rooms=flatten(merge_18))  # -> out, model; plug-in component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
create_vent = HBPHCreateVentilationSystem(vent_unit=ph_ventilator.unit)  # -> out, vent_system; inputs duct_01: list, duct_02: list
# ---------- create_vent: Python ----------
#
# Honeybee-PH: A Plugin for adding Passive-House data to LadybugTools Honeybee-Energy Models
# 
# This component is part of the PH-Tools toolkit <https://github.com/PH-Tools>.
# 
# Copyright (c) 2022, PH-Tools and bldgtyp, llc <phtools@bldgtyp.com> 
# Honeybee-PH is free software; you can redistribute it and/or modify 
# it under the terms of the GNU General Public License as published 
# by the Free Software Foundation; either version 3 of the License, 
# or (at your option) any later version. 
# 
# Honeybee-PH is distributed in the hope that it will be useful,
# but WITHOUT ANY WARRANTY; without even the implied warranty of 
# MERCHANTABILITY or FITNESS FOR A PARTICULAR PURPOSE. See the 
# GNU General Public License for more details.
# 
# For a copy of the GNU General Public License
# see <https://github.com/PH-Tools/honeybee_ph/blob/main/LICENSE>.
# 
# @license GPL-3.0+ <http://spdx.org/licenses/GPL-3.0+>
#
"""
Create a new PH-HVAC Ventilation System which can serve one or more HB-Rooms.
-
NOTE: Using the component will add ONLY the Passive House devices and will **NOT** add 
any components to the HB-Energy model. If you need to model mechancial equipment for an EnergyPlus
/ OpenStudio simulation then you must also use the Honeybee-Energy / IronBug components to setup
those devices separate from the inputs defined on the component here.
-
EM April 21, 2024
    Args:
        system_name_: (str) The name to give to the fresh-air ventilation system.
            
        system_type_: Choose either -
            1-Balanced PH ventilation with HR [Default]
            2-Extract air unit
            3-Only window ventilation
        
        vent_unit_: (Optional[]) The Venilator (ERV/HRV) to use to ventilate the
            honeybee-Rooms.
        
        duct_01_: The supply cold-air duct (from ventilator to the building-envelope)
        
        duct_02_: The exhaust cold-air duct (from ventilator to the building-envelope)
        
    Returns:
        vent_system_: The new PH-HVAC Ventilation System object.
"""

try:
    from honeybee_ph_utils import preview
except ImportError as e:
    raise ImportError('\nFailed to import honeybee_ph_utils:\n\t{}'.format(e))

try:
    from honeybee_ph_rhino import gh_compo_io
except ImportError as e:
    raise ImportError('\nFailed to import honeybee_ph_rhino:\n\t{}'.format(e))


# --- 
import honeybee_ph_rhino._component_info_
reload(honeybee_ph_rhino._component_info_)
ghenv.Component.Name = "HBPH - Create Ventilation System"
DEV = honeybee_ph_rhino._component_info_.set_component_params(ghenv, dev=False)
if DEV:
    from honeybee_ph_rhino.gh_compo_io.hvac import create_vent_sys as gh_compo_io
    reload(gh_compo_io)

# ------------------------------------------------------------------------------
gh_compo_interface = gh_compo_io.GHCompo_CreateVentSystem(
        system_name_,
        system_type_,
        vent_unit_,
        duct_01_,
        duct_02_,
    )
vent_system_ = gh_compo_interface.run()

# ------------------------------------------------------------------------------
preview.object_preview(vent_system_)
# ---------- end create_vent ----------
add_mech = HBPHAddMechSystems(ventilation_system=create_vent.vent_system, hb_rooms=set_res_occupancy_6.hb_rooms)  # -> out, hb_rooms; inputs space_conditioning_systems: list, supportive_devices: list, hb_rooms: list
# ---------- add_mech: Python ----------
#
# Honeybee-PH: A Plugin for adding Passive-House data to LadybugTools Honeybee-Energy Models
# 
# This component is part of the PH-Tools toolkit <https://github.com/PH-Tools>.
# 
# Copyright (c) 2022, PH-Tools and bldgtyp, llc <phtools@bldgtyp.com> 
# Honeybee-PH is free software; you can redistribute it and/or modify 
# it under the terms of the GNU General Public License as published 
# by the Free Software Foundation; either version 3 of the License, 
# or (at your option) any later version. 
# 
# Honeybee-PH is distributed in the hope that it will be useful,
# but WITHOUT ANY WARRANTY; without even the implied warranty of 
# MERCHANTABILITY or FITNESS FOR A PARTICULAR PURPOSE. See the 
# GNU General Public License for more details.
# 
# For a copy of the GNU General Public License
# see <https://github.com/PH-Tools/honeybee_ph/blob/main/LICENSE>.
# 
# @license GPL-3.0+ <http://spdx.org/licenses/GPL-3.0+>
#
"""
Set the PH-HVAC mechanical ventilation, heating, and cooling systems serving the Honeybee-Rooms.
-
NOTE: Using the component will add ONLY the Passive House devices and will **NOT** add 
any components to the HB-Energy model. If you need to model mechancial equipment for an EnergyPlus
/ OpenStudio simulation then you must also use the Honeybee-Energy / IronBug components to setup
those devices separate from the inputs defined on the component here.
-
EM May 2, 2024
    Args:
        _ventilation_system: (PhVentilationSystem) The Ventilation System serving the HB-Rooms.
        
        _space_conditioning_systems: (List) A list of the HBPH 'Space Conditioning' 
            (Heating/Cooling) Systems serving the HB-Rooms.
        
        _supportive_devices: (List) A list of any HBPH Supportive Devices (extra pumps, fans, etc)
            serving the HB-rooms.
        
        _hb_rooms: (List[Room]) A list of the hb-rooms served by the mechanical systems.
        
    Returns:
        hb_rooms_: The hb-rooms input, with the new PH-HVAC Mechanical Systems set.
"""

try:
    from honeybee_ph_rhino import gh_compo_io, gh_io
except ImportError as e:
    raise ImportError('\nFailed to import honeybee_ph_rhino:\n\t{}'.format(e))


#-------------------------------------------------------------------------------
import honeybee_ph_rhino._component_info_
reload(honeybee_ph_rhino._component_info_)
ghenv.Component.Name = "HBPH - Add Mech Systems"
DEV = honeybee_ph_rhino._component_info_.set_component_params(ghenv, dev=False)
if DEV:
    reload(gh_io)
    from honeybee_ph_rhino.gh_compo_io.hvac import add_systems as gh_compo_io
    reload(gh_compo_io)


#-------------------------------------------------------------------------------
# -- Add the new Systems to the HB-Rooms
gh_compo_interface = gh_compo_io.GHCompo_AddMechSystems(
        _ventilation_system,
        _space_conditioning_systems,
        _supportive_devices,
        _hb_rooms,
    )
hb_rooms_ = gh_compo_interface.run()
# ---------- end add_mech ----------
file_path_4 = FilePath("/Users/em/Dropbox/bldgtyp-00/00_PH_Tools/PHX/planning/bug-fix/hbjson-occupancy-and-schedules/HBJSON/")
dumpobjects_4 = HBDumpObjects(hb_objs=flatten(model_4.model), name="05_multiple_dweling_set_occupancy", folder=file_path_4, dump=Toggle(False))  # -> out, hb_file; plug-in component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
file_path_5 = FilePath("/Users/em/Dropbox/bldgtyp-00/00_PH_Tools/PHX/planning/bug-fix/hbjson-occupancy-and-schedules/HBJSON/")
dumpobjects_5 = HBDumpObjects(hb_objs=flatten(model_5.model), name="06_res_with_hallway", folder=file_path_5, dump=Toggle(False))  # -> out, hb_file; plug-in component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
file_path_6 = FilePath("/Users/em/Dropbox/bldgkraft/Codes & Standards/PHIUS/Climate Data Sets/2022 - Text Files (for Macs)/USA/NY/NEW_YORK_J_F_KENNEDY_INT_AR_NY-mon.txt")
create_site_from_file = HBPHCreateSiteFromPhiusFile(source_file_path=file_path_6)  # -> out, site
# ---------- create_site_from_file: Python ----------
#
# Honeybee-PH: A Plugin for adding Passive-House data to LadybugTools Honeybee-Energy Models
# 
# This component is part of the PH-Tools toolkit <https://github.com/PH-Tools>.
# 
# Copyright (c) 2022, PH-Tools and bldgtyp, llc <phtools@bldgtyp.com> 
# Honeybee-PH is free software; you can redistribute it and/or modify 
# it under the terms of the GNU General Public License as published 
# by the Free Software Foundation; either version 3 of the License, 
# or (at your option) any later version. 
# 
# Honeybee-PH is distributed in the hope that it will be useful,
# but WITHOUT ANY WARRANTY; without even the implied warranty of 
# MERCHANTABILITY or FITNESS FOR A PARTICULAR PURPOSE. See the 
# GNU General Public License for more details.
# 
# For a copy of the GNU General Public License
# see <https://github.com/PH-Tools/honeybee_ph/blob/main/LICENSE>.
# 
# @license GPL-3.0+ <http://spdx.org/licenses/GPL-3.0+>
#
"""
Create a new PH-Site object with all the relevant attributes and data based on
a Phius climate-data file (.TXT). For information on Phius climate data files and to 
download climate data, see:
https://www.phius.org/climate-data-sets
-
EM March 21, 2024
    Args:
        _source_file_path: (str) Input the full path to the Phius climate file you would 
            like to read in. Note: use only the 'TXT' files.
            
        _site_elevation: (float) The site's elevation (m). 
            If none provided, the station elevation will be used.
        
        _climate_zone: (str) For WUFI-Passive. Input either
1-Not defined (default)
11-US 1
12-US 2
13-US 3
14-US 4
141-US 4C
15-US 5
16-US 6
17-US 7
18-US 8

    Returns:
        site_: A new PHX-Site object with all the relevant Phius climate and location
            data for the site specified. This PHX-Site object can be added to a 
            "PHX-Building Segment."
"""

import scriptcontext as sc
import Rhino as rh
import rhinoscriptsyntax as rs
import ghpythonlib.components as ghc
import Grasshopper as gh


try:
    from honeybee_ph_utils import preview
except ImportError as e:
    raise ImportError('\nFailed to import honeybee_ph_utils:\n\t{}'.format(e))

try:
    from honeybee_ph_rhino import gh_compo_io, gh_io
except ImportError as e:
    raise ImportError('\nFailed to import honeybee_ph_rhino:\n\t{}'.format(e))


#-------------------------------------------------------------------------------
import honeybee_ph_rhino._component_info_
reload(honeybee_ph_rhino._component_info_)
ghenv.Component.Name = "HBPH - Create Site From Phius File"
DEV = honeybee_ph_rhino._component_info_.set_component_params(ghenv, dev=False)
if DEV:
    reload(gh_io)
    from honeybee_ph_rhino.gh_compo_io import climate_site_from_phius_file as gh_compo_io
    reload(gh_compo_io)


# ------------------------------------------------------------------------------
# -- GH Interface
IGH = gh_io.IGH( ghdoc, ghenv, sc, rh, rs, ghc, gh )


# -------------------------------------------------------------------------------------
gh_compo_interface = gh_compo_io.GHCompo_CreateSiteFromPhiusFile(
        IGH,
        _source_file_path,
        _site_elevation,
        _climate_zone
    )

site_ = gh_compo_interface.run()


# -------------------------------------------------------------------------------------
preview.object_preview(site_)
# ---------- end create_site_from_file ----------
phius_cert = HBPHPhiusCertification()  # -> out, phius_certification
# ---------- phius_cert: Python ----------
#
# Honeybee-PH: A Plugin for adding Passive-House data to LadybugTools Honeybee-Energy Models
# 
# This component is part of the PH-Tools toolkit <https://github.com/PH-Tools>.
# 
# Copyright (c) 2022, PH-Tools and bldgtyp, llc <phtools@bldgtyp.com> 
# Honeybee-PH is free software; you can redistribute it and/or modify 
# it under the terms of the GNU General Public License as published 
# by the Free Software Foundation; either version 3 of the License, 
# or (at your option) any later version. 
# 
# Honeybee-PH is distributed in the hope that it will be useful,
# but WITHOUT ANY WARRANTY; without even the implied warranty of 
# MERCHANTABILITY or FITNESS FOR A PARTICULAR PURPOSE. See the 
# GNU General Public License for more details.
# 
# For a copy of the GNU General Public License
# see <https://github.com/PH-Tools/honeybee_ph/blob/main/LICENSE>.
# 
# @license GPL-3.0+ <http://spdx.org/licenses/GPL-3.0+>
#
"""
Enter the relevant Phius Certification threshold data for the building-segment.
-
EM April 22, 2024
    Args:
        certification_program_: Input either -
            "1-Default"
            "2-PHIUS 2015"
            "3-PHIUS 2018"
            "4-Italian"
            "5-PHIUS 2018 CORE"
            "6-PHIUS 2018 ZERO"
            "7-PHIUS 2021 CORE"
            "8-PHIUS 2021 ZERO"
        
        building_category_type_: Input either -
            "1-Residential building" (default)
            "2-Non-residential building"
        
        building_use_type_: Input either - 
            "1-Residential" (default)
            "4-Office/Administrative building"
            "5-School"
            "6-Other"
            "7-Undefined/unfinished"
        
        building_status_: Input either -
            "1-In planning" (default)
            "2-Under construction"
            "3-Completed"
        
        
        building_type_: Input either -
            "1-New construction" (default)
            "2-Retrofit"
            "3-Mixed - new construction/retrofit"
        
        
        _PHIUS_annual_heating_demand_kWh_m2:
        
        _PHIUS_annual_cooling_demand_kWh_m2:
        
        _PHIUS_peak_heating_load_W_m2:
        
        _PHIUS_peak_cooling_load_W_m2:
        
    Returns:
        certification_: A New Phius Certification Settings object which can be 
            added to the "Building Sectio"
"""

import scriptcontext as sc
import Rhino as rh
import rhinoscriptsyntax as rs
import ghpythonlib.components as ghc
import Grasshopper as gh


try:
    from honeybee_ph_utils import preview
except ImportError as e:
    raise ImportError('\nFailed to import honeybee_ph_utils:\n\t{}'.format(e))

try:
    from honeybee_ph_rhino import gh_compo_io, gh_io
except ImportError as e:
    raise ImportError('\nFailed to import honeybee_ph_rhino:\n\t{}'.format(e))


#-------------------------------------------------------------------------------
import honeybee_ph_rhino._component_info_
reload(honeybee_ph_rhino._component_info_)
ghenv.Component.Name = "HBPH - Phius Certification"
DEV = honeybee_ph_rhino._component_info_.set_component_params(ghenv, dev=False)
if DEV:
    from honeybee_ph_rhino.gh_compo_io.cert import Phius as gh_compo_io
    reload(gh_compo_io)


# ------------------------------------------------------------------------------
# -- GH Interface
IGH = gh_io.IGH( ghdoc, ghenv, sc, rh, rs, ghc, gh )


# -------------------------------------------------------------------------------------
gh_compo_interface = gh_compo_io.GHCompo_PhiusCertification(
        IGH,
        certification_program_,
        building_category_type_,
        building_use_type_,
        building_status_,
        building_type_,
        _PHIUS_annual_heating_demand_kWh_m2,
        _PHIUS_annual_cooling_demand_kWh_m2,
        _PHIUS_peak_heating_load_W_m2,
        _PHIUS_peak_cooling_load_W_m2,
        _icfa_override,
    )

phius_certification_ = gh_compo_interface.run()


# -------------------------------------------------------------------------------------
preview.object_preview(phius_certification_)
# ---------- end phius_cert ----------
ph_bldg_segment = HBPHBldgSegment(
    site=create_site_from_file.site,
    phius_certification=phius_cert.phius_certification,
    hb_rooms=simplify(flatten(add_mech.hb_rooms)))  # -> out, hb_rooms; inputs num_floor_levels: Int32, num_dwelling_units: Int32, source_energy_factors: list, co2e_factors: list, hb_rooms: list
#   port segment_name: (str) The name to give the new Honeybee Room.
#   port hb_rooms: (list) The Honeybee Rooms that you would like to join into a new single Room.
# ---------- ph_bldg_segment: Python ----------
#
# Honeybee-PH: A Plugin for adding Passive-House data to LadybugTools Honeybee-Energy Models
# 
# This component is part of the PH-Tools toolkit <https://github.com/PH-Tools>.
# 
# Copyright (c) 2022, PH-Tools and bldgtyp, llc <phtools@bldgtyp.com> 
# Honeybee-PH is free software; you can redistribute it and/or modify 
# it under the terms of the GNU General Public License as published 
# by the Free Software Foundation; either version 3 of the License, 
# or (at your option) any later version. 
# 
# Honeybee-PH is distributed in the hope that it will be useful,
# but WITHOUT ANY WARRANTY; without even the implied warranty of 
# MERCHANTABILITY or FITNESS FOR A PARTICULAR PURPOSE. See the 
# GNU General Public License for more details.
# 
# For a copy of the GNU General Public License
# see <https://github.com/PH-Tools/honeybee_ph/blob/main/LICENSE>.
# 
# @license GPL-3.0+ <http://spdx.org/licenses/GPL-3.0+>
#
"""
Use this component to add one or more honeybee-Rooms to a PH-Building-Segment. This 
'building-segment' could be a single floor, a 'wing' or an entire building and will 
map to a single 'Case' in WUFI or a single PHPP file.
-
Since Passive House models only allow for a single thermal zone, any honeybee-rooms 
that are part of the building-segment will be merged / joined when exported to 
WUFI-Passive or PHPP. When merged, only the exterior surfaces will be retained, and 
any faces with a 'Surface' boundary condition well be removed from the Passive House 
model. Only Honeybee Faces with boundary conditions of "Outdoors", "Ground" and 
"Adiabatic" will be included in the new Honeybee Room. 
-
Use this before passing the honeybee-rooms on to the 'HB Model' component.
-
EM April 13, 2026
    Args:
        segment_name_: Name for the building-segment
               
        num_floor_levels_: (int) Total number of floor levels for the group of 
            Honeybee rooms input. Default=1
        
        num_dwelling_units_: (int) Total number of 'units' for the group of Honeybee rooms
            input For residential, this is the total number of dwelling units
            in the group of HB-Room. For non-residential, leave this set to "1".
        
        climate_: Optional Passive House monthly climate data.
        
        source_energy_factors_: (Optional) A list of source energy (site->source) energy 
            factors to use for assessing overall source (primary) energy usage. By default, 
            this component will use the standard Phius 2021 source energy factors which can be 
            found at https://www.phius.org/PHIUS+2021/Phius%20Core_Phius%20Zero_Final%20Modeling%20Protocol%20v1.1.pdf
            -
            Use the "Create Conversion Factor" component to define custom factors if you would 
            like to use your own. Be sure to define all of the fuel-factors required by Phius / WUFI.

        co2e_factors_: (Optional) A list of CO2e (site->CO2e) conversion 
            factors to use for assessing overall GHG emissions. By default, 
            this component will use the standard Phius 2021 CO2e factors which can be 
            found at https://www.phius.org/PHIUS+2021/Phius%20Core_Phius%20Zero_Final%20Modeling%20Protocol%20v1.1.pdf
            -
            Use the "Create Conversion Factor" component to define custom factors if you would 
            like to use your own. Be sure to define all of the fuel-factors required by Phius / WUFI.
        
        phius_certification_: Optional Phius certification thresholds.
        
        phi_certification_: Optional PHI certification configuration and settings.
        
        winter_set_temp_: default = 20C [68F]
        
        summer_set_temp_: default = 25C [77F]
        
        mech_room_temp_: default = 20C [68F] Supply in cases where the HRV/ERV is located 
            'outside' the normal conditioned space. For instance on the roof, or in a semi-
            heated outdoor space such as a garage or breezeway. For Phius Certification, 
            use the 'ERV_HRV_Outside Calculator' tool which can be downloaded from the 
            Phius website www.phius.org
            
        non_combustible_materials_: (bool) Default=False. Set True if the building is made 
            of non-combustible materials which allows for a higher air-leakage rate.
            
        _summer_ventilation_: (SummerVentilation) Optional settings for Summer Ventilation 
            due to windows, dedicated extract fans, and HRV/ERV.
    
    Returns:
        hb_rooms_: The honeyee-Rooms with building-segment information added.
"""

import scriptcontext as sc
import Rhino as rh
import rhinoscriptsyntax as rs
import ghpythonlib.components as ghc
import Grasshopper as gh


try:
    from honeybee_ph_utils import preview
except ImportError as e:
    raise ImportError('\nFailed to import honeybee_ph_utils:\n\t{}'.format(e))

try:
    from honeybee_ph_rhino import gh_compo_io, gh_io
except ImportError as e:
    raise ImportError('\nFailed to import honeybee_ph_rhino:\n\t{}'.format(e))
    
    
# -------------------------------------------------------------------------------------
import honeybee_ph_rhino._component_info_
reload(honeybee_ph_rhino._component_info_)
ghenv.Component.Name = "HBPH - Bldg Segment"
DEV = honeybee_ph_rhino._component_info_.set_component_params(ghenv, dev=False)
if DEV:
    reload(gh_compo_io)
    reload(gh_io)
    from honeybee_ph import bldg_segment
    reload(bldg_segment)
    from honeybee_ph_rhino.gh_compo_io import ghio_validators
    reload(ghio_validators)
    from honeybee_ph_rhino.gh_compo_io import building_segment as gh_compo_io
    reload(gh_compo_io)

# ------------------------------------------------------------------------------
# -- GH Interface
IGH = gh_io.IGH( ghdoc, ghenv, sc, rh, rs, ghc, gh )

# -------------------------------------------------------------------------------------
gh_compo_interface = gh_compo_io.GHCompo_BuildingSegment(
        IGH,
        _segment_name_,
        num_floor_levels_,
        num_dwelling_units_,
        site_,
        source_energy_factors_,
        co2e_factors_,
        phius_certification_,
        phi_certification_,
        winter_set_temp_,
        summer_set_temp_,
        mech_room_temp_,
        _hb_rooms,
        non_combustible_materials_,
        _summer_ventilation_,
        _exposure_type_,
)
hb_rooms_, hbph_segment = gh_compo_interface.run()

# -------------------------------------------------------------------------------------
preview.object_preview(hbph_segment)
# ---------- end ph_bldg_segment ----------
model_6 = HBModel(rooms=flatten(ph_bldg_segment.hb_rooms))  # -> out, model; plug-in component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
panel_14 = Panel("03_single_dwelling_set_occupancy")
file_path_7 = FilePath("/Users/em/Dropbox/bldgtyp-00/00_PH_Tools/PHX/planning/bug-fix/hbjson-occupancy-and-schedules/HBJSON/")
dumpobjects_6 = HBDumpObjects(hb_objs=flatten(model_6.model), name=panel_14, folder=file_path_7, dump=Toggle(False))  # -> out, hb_file; plug-in component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
file_path_8 = FilePath("/Users/em/Dropbox/bldgtyp-00/00_PH_Tools/PHX/planning/bug-fix/hbjson-occupancy-and-schedules/METr/")
write_metr_json = HBPHWriteMETRJSON(filename=panel_14, save_folder=file_path_8, hb_json_file=dumpobjects_6.hb_file, write_metr_json=Toggle(False))  # -> out, json_file
# ---------- write_metr_json: Python ----------
#
# Honeybee-PH: A Plugin for adding Passive-House data to LadybugTools Honeybee-Energy Models
# 
# This component is part of the PH-Tools toolkit <https://github.com/PH-Tools>.
# 
# Copyright (c) 2026, PH-Tools and bldgtyp, llc <phtools@bldgtyp.com> 
# Honeybee-PH is free software; you can redistribute it and/or modify 
# it under the terms of the GNU General Public License as published 
# by the Free Software Foundation; either version 3 of the License, 
# or (at your option) any later version. 
# 
# Honeybee-PH is distributed in the hope that it will be useful,
# but WITHOUT ANY WARRANTY; without even the implied warranty of 
# MERCHANTABILITY or FITNESS FOR A PARTICULAR PURPOSE. See the 
# GNU General Public License for more details.
# 
# For a copy of the GNU General Public License
# see <https://github.com/PH-Tools/honeybee_ph/blob/main/LICENSE>.
# 
# @license GPL-3.0+ <http://spdx.org/licenses/GPL-3.0+>
#
"""
Convert an HBJSON file into a new METR-JSON file which can then be opened using 
METR. This will read in the HBJSON, rebuild the HB-Model before converting the 
Model into a METR-JSON file.
-
EM March 28, 2026
    Args:
        _filename: (str) The filename for the METR-JSON file.
        
        _save_folder: (str) The folder path to save the METR-JSON file to.
        
        _hb_json_file: (str) The path to the HBJSON file to convert into METR-JSON.
        
        _settings: The WUFI/METR Settings object. Connect the "HBPH - Write WUFI XML Settings"
            'settings_' output.

        _write_json: (bool) Set True to run. 
            
    Returns:
        json_file_: The full path to the output METR-JSON file.
"""

import scriptcontext as sc
import Rhino as rh
import rhinoscriptsyntax as rs
import ghpythonlib.components as ghc
import Grasshopper as gh


try:
    from honeybee_ph_rhino import gh_compo_io, gh_io
except ImportError as e:
    raise ImportError('\nFailed to import honeybee_ph_rhino:\n\t{}'.format(e))


# ------------------------------------------------------------------------------
import honeybee_ph_rhino._component_info_
reload(honeybee_ph_rhino._component_info_)
ghenv.Component.Name = "HBPH - Write METR JSON"
DEV = honeybee_ph_rhino._component_info_.set_component_params(ghenv, dev=False)
if DEV:
    from PHX import run
    reload(run)
    from honeybee_ph_rhino.gh_compo_io import write_metr_json as gh_compo_io
    reload(gh_compo_io)
    reload(gh_io)
    
# ------------------------------------------------------------------------------
# -- GH Interface
IGH = gh_io.IGH( ghdoc, ghenv, sc, rh, rs, ghc, gh )


# ------------------------------------------------------------------------------
gh_compo_interface = gh_compo_io.GHCompo_WriteMetrJson(
        IGH,
        _filename,
        _save_folder,
        _hb_json_file,
        _settings,
        _write_metr_json,
)
json_file_ = gh_compo_interface.run()
# ---------- end write_metr_json ----------
file_path_9 = FilePath("/Users/em/Dropbox/bldgtyp-00/00_PH_Tools/PHX/planning/bug-fix/hbjson-occupancy-and-schedules/WUFI/")
write_wufi_xml = HBPHWriteWUFIXML(filename=panel_14, save_folder=file_path_9, hb_json_file=dumpobjects_6.hb_file, write_xml=Toggle(False))  # -> out, xml_file
# ---------- write_wufi_xml: Python ----------
#
# Honeybee-PH: A Plugin for adding Passive-House data to LadybugTools Honeybee-Energy Models
# 
# This component is part of the PH-Tools toolkit <https://github.com/PH-Tools>.
# 
# Copyright (c) 2022, PH-Tools and bldgtyp, llc <phtools@bldgtyp.com> 
# Honeybee-PH is free software; you can redistribute it and/or modify 
# it under the terms of the GNU General Public License as published 
# by the Free Software Foundation; either version 3 of the License, 
# or (at your option) any later version. 
# 
# Honeybee-PH is distributed in the hope that it will be useful,
# but WITHOUT ANY WARRANTY; without even the implied warranty of 
# MERCHANTABILITY or FITNESS FOR A PARTICULAR PURPOSE. See the 
# GNU General Public License for more details.
# 
# For a copy of the GNU General Public License
# see <https://github.com/PH-Tools/honeybee_ph/blob/main/LICENSE>.
# 
# @license GPL-3.0+ <http://spdx.org/licenses/GPL-3.0+>
#
"""
Convert an HBJSON file into a new WUFI-XML file which can then be opened using 
WUFI-Passive. This will read in the HBJSON, rebuild the HB-Model before converting the 
Model into a WUFI-Passive file.
-
EM June 5, 2024
    Args:
        _filename: (str) The filename for the WUFI XML file.
        
        _save_folder: (str) The folder path to save the WUFI XML file to.
        
        _hb_json_file: (str) The path to the HBJSON file to convert into WUFI XML.
        
        _settings: The WUFI Settings object. Connect the "HBPH - Write WUFI XML Settings"
            'settings_' output.

        _write_xml: (bool) Set True to run. 
            
    Returns:
        xml_file_: The full path to the output WUFI XML file.
"""

import scriptcontext as sc
import Rhino as rh
import rhinoscriptsyntax as rs
import ghpythonlib.components as ghc
import Grasshopper as gh


try:
    from honeybee_ph_rhino import gh_compo_io, gh_io
except ImportError as e:
    raise ImportError('\nFailed to import honeybee_ph_rhino:\n\t{}'.format(e))


# ------------------------------------------------------------------------------
import honeybee_ph_rhino._component_info_
reload(honeybee_ph_rhino._component_info_)
ghenv.Component.Name = "HBPH - Write WUFI XML"
DEV = honeybee_ph_rhino._component_info_.set_component_params(ghenv, dev=False)
if DEV:
    from PHX import run
    reload(run)
    from honeybee_ph_rhino.gh_compo_io import write_wuif_xml as gh_compo_io
    reload(gh_compo_io)
    reload(gh_io)
    
# ------------------------------------------------------------------------------
# -- GH Interface
IGH = gh_io.IGH( ghdoc, ghenv, sc, rh, rs, ghc, gh )


# ------------------------------------------------------------------------------
gh_compo_interface = gh_compo_io.GHCompo_WriteWufiXml(
        IGH,
        _filename,
        _save_folder,
        _hb_json_file,
        _settings,
        _write_xml,
)
xml_file_ = gh_compo_interface.run()
# ---------- end write_wufi_xml ----------
