# Grasshopper definition hbph_test_models.gh (Grasshopper 1.0.8)

inch = Panel("1")
panel = Panel("0.56")
multiplication = Multiplication(A=inch, B="0.0254")
multiplication_2 = Multiplication(A=panel, B="0.1761")
M = Panel(multiplication)
panel_2 = Panel(multiplication_2)
division = Division(A=M, B=panel_2)
panel_3 = Panel(division)
opaquemat = HBOpaqueMaterial(name="SS_GWB", thickness=M, conductivity=panel_3, density="999", spec_heat="999")  # -> mat; plug-in component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
set_mat_color = HBPHSetMaterialColor(material=opaquemat, color=ColourSwatch(SwatchColor=RGB(161, 161, 161)))  # -> out, material; inputs color: Color
# ---------- set_mat_color: Python ----------
#
# Honeybee-PH: A Plugin for adding Passive-House data to LadybugTools Honeybee-Energy Models
# 
# This component is part of the PH-Tools toolkit <https://github.com/PH-Tools>.
# 
# Copyright (c) 2022, PH-Tools and bldgtyp, llc <phtools@bldgtyp.com> 
# Honeybee-PH is free software; you can redistribute it and/or modify 
# it under the terms of the GNU General Public License as published 
# by the Free Software Foundation; either version 3 of the License, 
# or (at your option) any later version. 
# 
# Honeybee-PH is distributed in the hope that it will be useful,
# but WITHOUT ANY WARRANTY; without even the implied warranty of 
# MERCHANTABILITY or FITNESS FOR A PARTICULAR PURPOSE. See the 
# GNU General Public License for more details.
# 
# For a copy of the GNU General Public License
# see <https://github.com/PH-Tools/honeybee_ph/blob/main/LICENSE>.
# 
# @license GPL-3.0+ <http://spdx.org/licenses/GPL-3.0+>
#
"""
Set the color for a specific Honeybee-Material. This is only relevant for WUFI-Passive
model exports. For PHPP or other exports this color attribute is ignored.
-
EM March 6, 2024
    Args:
        _material: () A Honeybee Opaque Material to assign the color for.

        _color: (System.Display.Color) A Color to use for the Material.
    
    Returns:
        material_: () The Honeyboee Opaque Material with the color assigned.
"""

import scriptcontext as sc
import Rhino as rh
import rhinoscriptsyntax as rs
import ghpythonlib.components as ghc
import Grasshopper as gh

try:
    from honeybee_ph_rhino import gh_compo_io, gh_io
except ImportError as e:
    raise ImportError('\nFailed to import honeybee_ph_rhino:\n\t{}'.format(e))


# ------------------------------------------------------------------------------
import honeybee_ph_rhino._component_info_
reload(honeybee_ph_rhino._component_info_)
ghenv.Component.Name = "HBPH - Set Material Color"
DEV = honeybee_ph_rhino._component_info_.set_component_params(ghenv, dev=False)
if DEV:
    reload(gh_io)
    from honeybee_ph_rhino.gh_compo_io import assmbly_set_mat_color as gh_compo_io
    reload(gh_compo_io)

# ------------------------------------------------------------------------------
# -- GH Interface
IGH = gh_io.IGH( ghdoc, ghenv, sc, rh, rs, ghc, gh )


# ------------------------------------------------------------------------------
gh_compo_interface = gh_compo_io.GHCompo_SetMaterialColor(
            IGH,
            _material,
            _color,
        )
material_ = gh_compo_interface.run()
# ---------- end set_mat_color ----------

inch_2 = Panel("1")
panel_4 = Panel("0.07")
multiplication_3 = Multiplication(A=inch_2, B="0.0254")
multiplication_4 = Multiplication(A=panel_4, B="0.1761")
M_2 = Panel(multiplication_3)
panel_5 = Panel(multiplication_4)
division_2 = Division(A=M_2, B=panel_5)
panel_6 = Panel(division_2)
opaquemat_2 = HBOpaqueMaterial(name="SS_Cladding", thickness=M_2, conductivity=panel_6, density="999", spec_heat="999")  # -> mat; plug-in component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
set_mat_color_2 = HBPHSetMaterialColor(material=opaquemat_2, color=ColourSwatch(SwatchColor=RGB(212, 182, 99)))  # -> out, material; inputs color: Color; same code as set_mat_color

inch_3 = Panel("3.5")
panel_7 = Panel("13")
multiplication_5 = Multiplication(A=inch_3, B="0.0254")
multiplication_6 = Multiplication(A=panel_7, B="0.1761")
panel_8 = Panel(multiplication_6)
M_3 = Panel(multiplication_5)
division_3 = Division(A=M_3, B=panel_8)
panel_9 = Panel(division_3)
opaquemat_3 = HBOpaqueMaterial(name="SS_Roxul", thickness=M_3, conductivity=panel_9, density="999", spec_heat="999")  # -> mat; plug-in component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
set_mat_color_3 = HBPHSetMaterialColor(material=opaquemat_3, color=ColourSwatch(SwatchColor=RGB(85, 207, 76)))  # -> out, material; inputs color: Color; same code as set_mat_color

steel_stud_construction = HBPHCreateSteelStudConstruction(
    construction_name="My New Assembly",
    ext_claddings=set_mat_color_2.material,
    ext_sheathings=set_mat_color.material,
    stud_layer_insulation=set_mat_color_3.material,
    int_layers=set_mat_color.material)  # -> out, construction; inputs ext_claddings: list, ext_insulations: list, ext_sheathings: list, int_layers: list
# ---------- steel_stud_construction: Python ----------
#
# Honeybee-PH: A Plugin for adding Passive-House data to LadybugTools Honeybee-Energy Models
# 
# This component is part of the PH-Tools toolkit <https://github.com/PH-Tools>.
# 
# Copyright (c) 2025, PH-Tools and bldgtyp, llc <phtools@bldgtyp.com> 
# Honeybee-PH is free software; you can redistribute it and/or modify 
# it under the terms of the GNU General Public License as published 
# by the Free Software Foundation; either version 3 of the License, 
# or (at your option) any later version. 
# 
# Honeybee-PH is distributed in the hope that it will be useful,
# but WITHOUT ANY WARRANTY; without even the implied warranty of 
# MERCHANTABILITY or FITNESS FOR A PARTICULAR PURPOSE. See the 
# GNU General Public License for more details.
# 
# For a copy of the GNU General Public License
# see <https://github.com/PH-Tools/honeybee_ph/blob/main/LICENSE>.
# 
# @license GPL-3.0+ <http://spdx.org/licenses/GPL-3.0+>
#
"""
Create 'steel-stud' constructions with effective thermal conductivity values determined according to the 
American Iron and Steel Institute (AISI) S250-21 | “North American Standard for Thermal Transmittance of Building 
Envelopes With Cold-Formed Steel Framing, 2021 Edition.” The method outlined in this guide roughly aligns with the 
ASHRAE 'modified zone method' for numerical calculations of steel-stud wall thermal performance. It should be noted that
the values here are approximate only, and if more exact values are required then 2- or 3-dimensional heat flow 
simulations should be used in lieu of these numerical calculations. 
- 
Note that the surrounding layers will affect the effective performance of the insulated steel stud layer, and as such the 
stud-layer thermal conductivity values from this calculator will vary depending on all of the layers input. 
- 
For more information on the calculation methodology used, see:
https://www.steel.org/2021/09/aisi-publishes-aisi-s250-21-north-american-standard-for-thermal-transmittance-of-building-envelopes-with-cold-formed-steel-framing-2021-edition/
-
EM May 16, 2025
    Args:
        _construction_name_: [Optional] A name for the new Honeybee-Energy Construction.

        _ext_claddings_: (list[EnergyMaterial]) [Optional] A list of Honeybee-Energy 
            OpaqueMaterials, ordered from outside-to-inside. These materials should represent
            any 'cladding' layers which occur outside of any continuous insulation.
        
        _ext_insulations_: (list[EnergyMaterial]) [Optional] A list of Honeybee-Energy 
            OpaqueMaterials, ordered from outside-to-inside. These materials should represent
            any continuous insulation layer which occur outside of the steel-stud framing 
            and sheathing, but underneath any 'cladding'.

        _ext_sheathings_: (list[EnergyMaterial]) [Optional] A list of Honeybee-Energy 
            OpaqueMaterials, ordered from outside-to-inside. These materials should represent
            any 'sheathing' layers which occur outside of the primary steel-stud framing layer.
        
        _stud_layer_insulation_: (EnergyMaterial) [Default=AirCavity] The insulation material
            to use for the steel-stud layer. If None is provided, and empty air-cavity will be used.

        _stud_depth_mm_: (float) [Optional | Default=88.9mm (3-1/2")] The depth of the steel-stud.
        
        _stud_spacing_mm_: (float) [Optional | Default=400mm (16")] The center-to-center spacing of the steel-studs.
Input either - 
- 152.5 mm (6 in. OC)
- 304.8 mm (12 in. OC)
- 406.4 mm (16 in. OC)
- 609.6 mm (24 in. OC)

        _stud_thickness_mm_: (float) [Optional | Default=1.0922mm (43 Mil)] The thickness of the steel-stud walls. 
Input either - 
- 0.8382 mm (33 mil) 
- 1.0922 mm (43 mil)
- 1.3716 mm (54 mil)
- 1.7272 mm (68 mil)
        
        _stud_flange_width_mm_: (float) [Optional | Default=41mm (1-5/8")] The flange face-width.
        
        _steel_conductivity_W_mk_: (float) [Default=857 W/mk (495 Btu/hr-ft-F)] The steel-stud  
            material thermal conductivity.
        
        _int_layers_: (list[EnergyMaterial]) [Optional] A list of Honeybee-Energy 
            OpaqueMaterials, ordered from outside-to-inside. These materials should represent
            any interior finish materials such as gypsum board which occur on the 'inside' of
            the primary steel-stud framing layer.

    Returns:
        construction_: (OpaqueConstruction) A New Honeybee-Energy OpaqueConstruction which will 
            include all of the layers, as well as a new hybrid 'Steel-stud' layer with a 
            conductivity calculated based on the AISI S250-21w protocol.
"""

import scriptcontext as sc
import Rhino as rh
import rhinoscriptsyntax as rs
import ghpythonlib.components as ghc
import Grasshopper as gh

try:
    from honeybee_ph_plus_rhino import gh_compo_io
except ImportError as e:
    raise ImportError('\nFailed to import honeybee_ph_rhino:\n\t{}'.format(e))

try:
    from ph_gh_component_io import gh_io
except ImportError as e:
    raise ImportError('\nFailed to import ph_gh_component_io:\n\t{}'.format(e))

# ------------------------------------------------------------------------------
import honeybee_ph_plus_rhino._component_info_
reload(honeybee_ph_plus_rhino._component_info_)
ghenv.Component.Name = "HBPH+ - Create Steel-Stud Construction"
DEV = honeybee_ph_plus_rhino._component_info_.set_component_params(ghenv, dev="250630")
if DEV:
    reload(gh_io)
    from honeybee_ph_utils import aisi_s250_21
    reload(aisi_s250_21)
    from honeybee_ph_plus_rhino.gh_compo_io.hb_tools import steel_stud_construction as gh_compo_io
    reload(gh_compo_io)
    
# ------------------------------------------------------------------------------
# -- GH Interface
IGH = gh_io.IGH( ghdoc, ghenv, sc, rh, rs, ghc, gh )

# ------------------------------------------------------------------------------
gh_compo_interface = gh_compo_io.GHCompo_CreateSteelStudConstruction(
    IGH,
    _construction_name_,
    _ext_claddings_,
    _ext_insulations_, 
    _ext_sheathings_,
    _stud_layer_insulation_,
    _stud_depth_mm_,
    _stud_spacing_mm_,
    _stud_thickness_mm_,
    _stud_flange_width_mm_,
    _steel_conductivity_W_mk_,
    _int_layers_,
)
construction_ = gh_compo_interface.run()
# ---------- end steel_stud_construction ----------

opaquemat_4 = HBOpaqueMaterial(name="GWB", thickness="0.0127", conductivity="0.12", density="999", spec_heat="999")  # -> mat; plug-in component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
opaquemat_5 = HBOpaqueMaterial(name="Wood_1", thickness="0.45", conductivity="1", density="999", spec_heat="999")  # -> mat; plug-in component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
opaquemat_6 = HBOpaqueMaterial(name="Insulation_2", thickness="0.45", conductivity="0.04", density="999", spec_heat="999")  # -> mat; plug-in component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
opaquemat_7 = HBOpaqueMaterial(name="Plywood", thickness="0.019", conductivity="0.12", density="999", spec_heat="999")  # -> mat; plug-in component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
create_wood_framing_mat = HBPHCreateWoodFramingMaterial(
    insulation_material=opaquemat_6,
    wood_framing_material=opaquemat_5,
    top_plate_width="3.0 in",
    bottom_plate_width="1.5 in")  # -> out, preview, hb_material
# ---------- create_wood_framing_mat: Python ----------
#
# Honeybee-PH: A Plugin for adding Passive-House data to LadybugTools Honeybee-Energy Models
# 
# This component is part of the PH-Tools toolkit <https://github.com/PH-Tools>.
# 
# Copyright (c) 2024, PH-Tools and bldgtyp, llc <phtools@bldgtyp.com> 
# Honeybee-PH is free software; you can redistribute it and/or modify 
# it under the terms of the GNU General Public License as published 
# by the Free Software Foundation; either version 3 of the License, 
# or (at your option) any later version. 
# 
# Honeybee-PH is distributed in the hope that it will be useful,
# but WITHOUT ANY WARRANTY; without even the implied warranty of 
# MERCHANTABILITY or FITNESS FOR A PARTICULAR PURPOSE. See the 
# GNU General Public License for more details.
# 
# For a copy of the GNU General Public License
# see <https://github.com/PH-Tools/honeybee_ph/blob/main/LICENSE>.
# 
# @license GPL-3.0+ <http://spdx.org/licenses/GPL-3.0+>
#
"""
Create a simple heteregeneous Honeybee-Energy Material for a wood-stud + insulation material.
Note that ONLY wood studs/joists are supported - NOT steel studs. This component will create 
a mixed-material layer which will output detailed constructions for WUFI-Passive and PHPP.
If you need to create a material with more complex geometry, use the 
"HBPH - Create Heterogeneous Material" component. For all dimensions input, enter the values as if 
the material was being viewed from the inside or outside face, ie: in 'elevation' view.
-
EM April 5, 2024

    Args:
        _insulation_material: (EnergyMaterial) The base material to use for the cavities of the stud wall.

        _wood_framing_material: (EnergyMaterial) The wood-framing material to use for the studs/joists.

        _wood_framing_member_width: (float) Default=1.5in [0.038m] The thickness of the wood stud/joist, when
            viewed from the inside face (in 'elevation').

        _wood_framing_member_oc_spacing: (float) Default=16in [0.184m] The center-to-center spacing from one
            stud/joist element to the next.

        _top_plate_width: (float) Default=0.0 Optional face width (in 'elevation') of any top-plate elements
            that should be added to the material. In most cases, this would be either 1.5in (single plate) or 
            3.0in (double plate).

        _bottom_plate_width: (float) Default=0.0 Optional face width (in 'elevation') of any bottom-plate elements
            that should be added to the material. In most cases, this would be 1.5in (single plate).

        _element_total_length: (float) Default=96in [2.438m]. Optional 'length' of the material, when viewed
            in 'elevation'. For a wall, this is the distance from the top of the top-plate, to the bottom of the 
            bottom-plate. For a roof, this would be the distance from the Rim-Joist/edge to the ridge. Etc...
            This value only matters if you add top- and / or bottom-plate elements - otherwise it will have no 
            effect on the material's conductivity.

    Returns:
        preview_: A rhino-geometry preview of the grid generated for the Layer, for troubleshooting and validation.

        hb_material_: The new Honeybee-Energy material which can be used a part of any normal Honeybee-Energy Construction. 
            When exported to WUFI-Passive or PHPP, the mixed materials will be output as part of the assembly.
"""

import scriptcontext as sc
import Rhino as rh
import rhinoscriptsyntax as rs
import ghpythonlib.components as ghc
import Grasshopper as gh


try:
    from honeybee_ph_utils import preview
except ImportError as e:
    raise ImportError('\nFailed to import honeybee_ph_utils:\n\t{}'.format(e))

try:
    from honeybee_ph_rhino import gh_compo_io, gh_io
except ImportError as e:
    raise ImportError('\nFailed to import honeybee_ph_rhino:\n\t{}'.format(e))

#-------------------------------------------------------------------------------
import honeybee_ph_rhino._component_info_
reload(honeybee_ph_rhino._component_info_)
ghenv.Component.Name = "HBPH - Create Wood Framing Material"
DEV = True
honeybee_ph_rhino._component_info_.set_component_params(ghenv)
DEV = honeybee_ph_rhino._component_info_.set_component_params(ghenv, dev=False)
if DEV:
    from honeybee_energy_ph.properties.materials import opaque
    reload(opaque)
    reload(gh_io)
    from honeybee_ph_rhino.gh_compo_io import assmbly_create_wood_framing_material as gh_compo_io
    reload(gh_compo_io)


# ------------------------------------------------------------------------------
# -- GH Interface
IGH = gh_io.IGH( ghdoc, ghenv, sc, rh, rs, ghc, gh )


# ------------------------------------------------------------------------------
gh_compo_interface = gh_compo_io.GHCompo_CreateWoodFramingMaterial(
    IGH,
    _insulation_material,
    _wood_framing_material,
    _wood_framing_member_width,
    _wood_framing_member_oc_spacing,
    _top_plate_width,
    _bottom_plate_width,
    _element_total_length,
)
hb_material_, preview_ = gh_compo_interface.run()
# ---------- end create_wood_framing_mat ----------
opaqueconstr = HBOpaqueConstruction(name="Ext_Wall", materials=[opaquemat_7, create_wood_framing_mat.hb_material, opaquemat_4])  # -> constr; plug-in component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

opaquemat_8 = HBOpaqueMaterial(name="Mix_1", thickness="0.45", conductivity="1", density="999", spec_heat="999")  # -> mat; plug-in component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
opaquemat_9 = HBOpaqueMaterial(name="Mix_2", thickness="0.45", conductivity="1", density="999", spec_heat="999")  # -> mat; plug-in component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
opaquemat_10 = HBOpaqueMaterial(name="Insulation_1", thickness="0.45", conductivity="0.04", density="999", spec_heat="999")  # -> mat; plug-in component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
set_mat_column_row = HBPHSetMixedMaterialColumnAndRow(column_position="1", hb_material=opaquemat_8)  # -> out, hb_material; inputs column_position: Int32, row_position: Int32
# ---------- set_mat_column_row: Python ----------
#
# Honeybee-PH: A Plugin for adding Passive-House data to LadybugTools Honeybee-Energy Models
# 
# This component is part of the PH-Tools toolkit <https://github.com/PH-Tools>.
# 
# Copyright (c) 2022, PH-Tools and bldgtyp, llc <phtools@bldgtyp.com> 
# Honeybee-PH is free software; you can redistribute it and/or modify 
# it under the terms of the GNU General Public License as published 
# by the Free Software Foundation; either version 3 of the License, 
# or (at your option) any later version. 
# 
# Honeybee-PH is distributed in the hope that it will be useful,
# but WITHOUT ANY WARRANTY; without even the implied warranty of 
# MERCHANTABILITY or FITNESS FOR A PARTICULAR PURPOSE. See the 
# GNU General Public License for more details.
# 
# For a copy of the GNU General Public License
# see <https://github.com/PH-Tools/honeybee_ph/blob/main/LICENSE>.
# 
# @license GPL-3.0+ <http://spdx.org/licenses/GPL-3.0+>
#
"""
Set the column and row position for a material in a Mixed Material layer. Pass the output to a 
'HBPH - Create Heterogeneous Material' component in order to create mixed materials. Note that the 
columns and rows are specified from the upper-left to the lower-right, and both the row and column
counts start at '0', not '1'.
-
EM April 5, 2024

    Args:
        _column_position: (int) The column location. Note that columns start counting from '0', not '1'

        _row_position: (int) The row location. Note that columns start counting from '0', not '1'

        _hb_material: (EnergyMaterial) The Honeybee-Energy Material to use for the specified cell.
        
    Returns:
        hb_material_: The Honeybee-Energy Material with the column/row location specified.
"""

import scriptcontext as sc
import Rhino as rh
import rhinoscriptsyntax as rs
import ghpythonlib.components as ghc
import Grasshopper as gh


try:
    from honeybee_ph_utils import preview
except ImportError as e:
    raise ImportError('\nFailed to import honeybee_ph_utils:\n\t{}'.format(e))

try:
    from honeybee_ph_rhino import gh_compo_io, gh_io
except ImportError as e:
    raise ImportError('\nFailed to import honeybee_ph_rhino:\n\t{}'.format(e))

#-------------------------------------------------------------------------------
import honeybee_ph_rhino._component_info_
reload(honeybee_ph_rhino._component_info_)
ghenv.Component.Name = "HBPH - Set Mixed-Material Column and Row"
DEV = True
honeybee_ph_rhino._component_info_.set_component_params(ghenv)
DEV = honeybee_ph_rhino._component_info_.set_component_params(ghenv, dev=False)
if DEV:
    from honeybee_energy_ph.properties.materials import opaque
    reload(opaque)
    reload(gh_io)
    from honeybee_ph_rhino.gh_compo_io import assmbly_set_material_column_and_row as gh_compo_io
    reload(gh_compo_io)


# ------------------------------------------------------------------------------
# -- GH Interface
IGH = gh_io.IGH( ghdoc, ghenv, sc, rh, rs, ghc, gh )


# ------------------------------------------------------------------------------
gh_compo_interface = gh_compo_io.GHCompo_SetMaterialColumnAndRow(
    IGH, _column_position, _row_position, _hb_material)
hb_material_ = gh_compo_interface.run()
# ---------- end set_mat_column_row ----------
set_mat_column_row_2 = HBPHSetMixedMaterialColumnAndRow(column_position="2", hb_material=opaquemat_9)  # -> out, hb_material; inputs column_position: Int32, row_position: Int32; same code as set_mat_column_row
panel_10 = Panel("""0.5 in
3 in
0.5 in""")
create_heterogeneous_mat = HBPHCreateHeterogeneousMaterial(
    base_material=opaquemat_10,
    additional_materials=[set_mat_column_row.hb_material, set_mat_column_row_2.hb_material],
    column_widths=panel_10)  # -> out, preview, hb_material; inputs additional_materials: list, column_widths: list, row_heights: list
# ---------- create_heterogeneous_mat: Python ----------
#
# Honeybee-PH: A Plugin for adding Passive-House data to LadybugTools Honeybee-Energy Models
# 
# This component is part of the PH-Tools toolkit <https://github.com/PH-Tools>.
# 
# Copyright (c) 2024, PH-Tools and bldgtyp, llc <phtools@bldgtyp.com> 
# Honeybee-PH is free software; you can redistribute it and/or modify 
# it under the terms of the GNU General Public License as published 
# by the Free Software Foundation; either version 3 of the License, 
# or (at your option) any later version. 
# 
# Honeybee-PH is distributed in the hope that it will be useful,
# but WITHOUT ANY WARRANTY; without even the implied warranty of 
# MERCHANTABILITY or FITNESS FOR A PARTICULAR PURPOSE. See the 
# GNU General Public License for more details.
# 
# For a copy of the GNU General Public License
# see <https://github.com/PH-Tools/honeybee_ph/blob/main/LICENSE>.
# 
# @license GPL-3.0+ <http://spdx.org/licenses/GPL-3.0+>
#
"""
Use to build up a 'mixed' material layer. This is most commonly something like studs in an insulation layer.
The mixed layer is defined as a grid of 'cell's with each cell having a different material applied. Use the 
rows and columns inputs to define the cell organization. Note that the cells are built from the upper left to 
the lower right, so inputing '_column_widths' of [0.5, 1, 0.5] will yield a grid of three columns and one row:

...|.C0..|....C1....|.C2..|
R0 |.....|..........|.....|

-
EM April 5, 2024

    Args:
        _base_material: (EnergyMaterial) A material to use as the 'base' for the Layer. This material will
            be used for any row/column area where a specific material has not been set in the '_additional_materials'
            input list.

        _additional_materials: (List[EnergyMaterial]) A list of Honeybee-Energy Materials to use
            for the different areas of the divided layer. Be sure to use the 'HBPH - Set Mixed-Material Column/Row'
            on the EnergyMaterial FIRST in order to set the row/column location.

        _column_widths: A list of the widths of the columns. ie: for 3 columns, enter
            [0.5, 1.2, 0.5]. You may also enter valus with unit informtion, for instance ['7.25in', '1.5in', '7.25']
        
        _row_heights: (List[float]) A list of the heights of the rows. ie: for 3 rows, enter
            [0.5, 1.2, 0.5]. You may also enter valus with unit informtion, for instance ['1.5in', '94in', '1.5']
        
    Returns:
        preview_: A rhino-geometry preview of the grid generated for the Layer, for troubleshooting and validation.

        hb_material_: The new Honeybee-Energy material which can be used a part of any normal Honeybee-Energy Construction. 
            When exported to WUFI-Passive or PHPP, the mixed materials will be output as part of the assembly.
"""

import scriptcontext as sc
import Rhino as rh
import rhinoscriptsyntax as rs
import ghpythonlib.components as ghc
import Grasshopper as gh


try:
    from honeybee_ph_utils import preview
except ImportError as e:
    raise ImportError('\nFailed to import honeybee_ph_utils:\n\t{}'.format(e))

try:
    from honeybee_ph_rhino import gh_compo_io, gh_io
except ImportError as e:
    raise ImportError('\nFailed to import honeybee_ph_rhino:\n\t{}'.format(e))

#-------------------------------------------------------------------------------
import honeybee_ph_rhino._component_info_
reload(honeybee_ph_rhino._component_info_)
ghenv.Component.Name = "HBPH - Create Heterogeneous Material"
DEV = True
honeybee_ph_rhino._component_info_.set_component_params(ghenv)
DEV = honeybee_ph_rhino._component_info_.set_component_params(ghenv, dev=False)
if DEV:
    from honeybee_energy_ph.properties.materials import opaque
    reload(opaque)
    reload(gh_io)
    from honeybee_ph_rhino.gh_compo_io import assmbly_create_heterogeneous_material as gh_compo_io
    reload(gh_compo_io)


# ------------------------------------------------------------------------------
# -- GH Interface
IGH = gh_io.IGH( ghdoc, ghenv, sc, rh, rs, ghc, gh )


# ------------------------------------------------------------------------------
gh_compo_interface = gh_compo_io.GHCompo_CreateHeterogeneousMaterial(
    IGH, _base_material, _additional_materials, _column_widths, _row_heights)
hb_material_, preview_ = gh_compo_interface.run()
# ---------- end create_heterogeneous_mat ----------
set_mat_color_4 = HBPHSetMaterialColor(material=create_heterogeneous_mat.hb_material, color=ColourSwatch(SwatchColor=RGB(255, 84, 255)))  # -> out, material; inputs color: Color; same code as set_mat_color
opaqueconstr_2 = HBOpaqueConstruction(name="Ext_Roof", materials=[opaquemat_7, set_mat_color_4.material, opaquemat_4])  # -> constr; plug-in component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

path = FilePath("/Users/em/Dropbox/bldgtyp-00/00_PH_Tools/PHX/tests/reference_files/from_grasshopper_tests/wufi_xml/")
path_2 = FilePath("/Users/em/Dropbox/bldgtyp-00/00_PH_Tools/PHX/tests/reference_files/from_grasshopper_tests/metr_json/")
path_3 = FilePath("/Users/em/Dropbox/bldgtyp-00/00_PH_Tools/PHX/tests/reference_files/from_grasshopper_tests/hbjson/")
panel_11 = Panel(path)
panel_12 = Panel(path_2)
panel_13 = Panel(path_3)
data = Data(Toggle(False))
data_2 = Data("2")
data_3 = Data(panel_13)
data_4 = Data(panel_11)
data_5 = Data(panel_12)

box = Box2Pt(PointA="0,0,0", PointB="5,4,3", Plane=PlaneXY(0, 0, 0))
roomsolid = HBRoomFromSolid(geo=flatten(box), conditioned=True)  # -> report, rooms; plug-in component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
model = HBModel(rooms=flatten(roomsolid.rooms))  # -> report, model; plug-in component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
data_6 = Data(data_3)
data_7 = Data(data_2)
data_8 = Data(data)
dumpobjects = HBDumpObjects(hb_objs=flatten(model.model), name="Default_Model_Single_Zone", folder=data_6, indent=data_7, dump=data_8)  # -> report, hb_file; plug-in component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

box_2 = Box2Pt(PointA="0,0,0", PointB="5,4,3", Plane=PlaneXY(0, 0, 0))
roomsolid_2 = HBRoomFromSolid(geo=flatten(box_2), conditioned=True)  # -> report, rooms; plug-in component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
data_9 = Data(data_3)
data_10 = Data(data_2)
data_11 = Data(data)
dumpobjects_2 = HBDumpObjects(hb_objs=flatten(roomsolid_2.rooms), name="Default_Room_Single_Zone", folder=data_9, indent=data_10, dump=data_11)  # -> report, hb_file; plug-in component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

calc_phius_blind = HBPHCalculatePhiusBlindTransmittance(material_transmittance="0.75")  # -> out, transmittance_effective, reflectance_effective; inputs inside: Boolean
# ---------- calc_phius_blind: Python ----------
#
# Honeybee-PH: A Plugin for adding Passive-House data to LadybugTools Honeybee-Energy Models
# 
# This component is part of the PH-Tools toolkit <https://github.com/PH-Tools>.
# 
# Copyright (c) 2022, PH-Tools and bldgtyp, llc <phtools@bldgtyp.com> 
# Honeybee-PH is free software; you can redistribute it and/or modify 
# it under the terms of the GNU General Public License as published 
# by the Free Software Foundation; either version 3 of the License, 
# or (at your option) any later version. 
# 
# Honeybee-PH is distributed in the hope that it will be useful,
# but WITHOUT ANY WARRANTY; without even the implied warranty of 
# MERCHANTABILITY or FITNESS FOR A PARTICULAR PURPOSE. See the 
# GNU General Public License for more details.
# 
# For a copy of the GNU General Public License
# see <https://github.com/PH-Tools/honeybee_ph/blob/main/LICENSE>.
# 
# @license GPL-3.0+ <http://spdx.org/licenses/GPL-3.0+>
#
"""
Calculate an effective solar reduction factor for Phius WUFI-Passive Models. This 
calcualtor will output a solar transmittance and solar reflectance value which can 
be used in a Honeybee Energy "HB Shade Material" to create interior or exterior blinds.
The calculataion here follows the protocol described in the Phius Guidebook v3.1, Appenix N-8
-
If the shading reduction factor for a blind in the closed position is “_material_transmittance”, 
and “transmittance_efective_” is in the input in WUFI Passive then:

For exterior blinds use:
    Z eﬀective = 0.3 + 0.7 * z
    Example: If blinds allow 46% solar access (solar transmittance, Ts) when closed, 
    use that for "_material_transmittance", and "transmittance_efective_" turns out to be 62%.
    Z eﬀective = 0.3 + (0.7*0.46) = 0.622

For interior blinds use:
    Z eﬀective = 1- (1-z) * (1-0.6)
    Example: If blinds allow 46% solar access (solar transmittance, Ts) when closed, 
    use that for "_material_transmittance", and "transmittance_efective_" turns out to be 78%.
    Z eﬀective = 1 – (1-0.46) * (1-0.6) = 0.784

-
EM March 23, 2023
    Args:
        _material_transmittance: (float) A value from 0.0 to 1.0
        
        _inside: (bool) Default=True. Set to False if the blinds are mounted ouside.
        
    Returns:
        transmittance_effective_: The solar transmittance value. Input this result value 
            into the "_transmittance_" input on an "HB Shade Material" component.
        
        reflectance_effective_: The solar reflectance value. Input this result value 
            into the "_reflectance_" input on an "HB Shade Material" component.
"""
   
try:
    from honeybee_ph_utils import preview
except ImportError as e:
    raise ImportError('\nFailed to import honeybee_ph_utils:\n\t{}'.format(e))

try:
    from honeybee_ph_rhino import gh_compo_io, gh_io
except ImportError as e:
    raise ImportError('\nFailed to import honeybee_ph_rhino:\n\t{}'.format(e))


# -------------------------------------------------------------------------------------
import honeybee_ph_rhino._component_info_
reload(honeybee_ph_rhino._component_info_)
ghenv.Component.Name = "HBPH - Calculate Phius Blind Transmittance"
DEV = honeybee_ph_rhino._component_info_.set_component_params(ghenv, dev=False)
if DEV:
    reload(gh_io)
    from honeybee_ph_rhino.gh_compo_io import win_calc_phius_blind as gh_compo_io
    reload(gh_compo_io)


# -------------------------------------------------------------------------------------
gh_compo_interface = gh_compo_io.GHCompo_CalcPhiusShadeTransmittance(
        _material_transmittance,
        _inside,
    )
transmittance_effective_, reflectance_effective_ = gh_compo_interface.run()
# ---------- end calc_phius_blind ----------
create_frame_element = HBPHCreatePHWindowFrameElement()  # -> out, frame_element
# ---------- create_frame_element: Python ----------
#
# Honeybee-PH: A Plugin for adding Passive-House data to LadybugTools Honeybee-Energy Models
# 
# This component is part of the PH-Tools toolkit <https://github.com/PH-Tools>.
# 
# Copyright (c) 2022, PH-Tools and bldgtyp, llc <phtools@bldgtyp.com> 
# Honeybee-PH is free software; you can redistribute it and/or modify 
# it under the terms of the GNU General Public License as published 
# by the Free Software Foundation; either version 3 of the License, 
# or (at your option) any later version. 
# 
# Honeybee-PH is distributed in the hope that it will be useful,
# but WITHOUT ANY WARRANTY; without even the implied warranty of 
# MERCHANTABILITY or FITNESS FOR A PARTICULAR PURPOSE. See the 
# GNU General Public License for more details.
# 
# For a copy of the GNU General Public License
# see <https://github.com/PH-Tools/honeybee_ph/blob/main/LICENSE>.
# 
# @license GPL-3.0+ <http://spdx.org/licenses/GPL-3.0+>
#
"""
Create a new HBPH Window Frame Element. A full HBPH Window Frame is made of 4 of 
these elements (top, right, bottom, left).
-
EM July 16, 2024
    Args:
        _name_: (str) The display_name of the Frame-Element.
        
        _width: (float) Face width of the frame (rhino-model-units)
            default = 0.1m (4-inch). Input either a value, ie": "4" which will be in the 
            rhino-model's units, or input an explicit unit to have this component
            convert the units automatically, ie: "4 INCH"
            
        _u_factor: (float) Frame U-f (W/m2k) as per ISO-10077-2. Note that this value 
            is not the same as the NFRC value.
            default = 1.0 W/m2k
            
        psi_glazing_: (float) Psi-Value of the glazing edge (W/mk) as per ISO-10077-2
            default = 0.04 W/mk
            
        psi_install_: (float) Psi-Value of the window installation (W/mk) as per ISO-10077-2
            default = 0.04 W/mk
        
        chi_: (float) Optional extra Chi-value (W/k) for point thermal bridging due to 
            elements such as glass-carriers in curtain walls or sim.
    
    Returns:
        frame_element_: A new HBPH WindowFrameElement which can be used to build up a complete
            HBPH WindowFrame.
"""

try:
    from honeybee_ph_utils import preview
except ImportError as e:
    raise ImportError('\nFailed to import honeybee_ph_utils:\n\t{}'.format(e))

try:
    from honeybee_ph_rhino import gh_compo_io, gh_io
except ImportError as e:
    raise ImportError('\nFailed to import honeybee_ph_rhino:\n\t{}'.format(e))

import scriptcontext as sc
import Rhino as rh
import rhinoscriptsyntax as rs
import ghpythonlib.components as ghc
import Grasshopper as gh

# -------------------------------------------------------------------------------------
import honeybee_ph_rhino._component_info_
reload(honeybee_ph_rhino._component_info_)
ghenv.Component.Name = "HBPH - Create PH Window Frame Element"
DEV = honeybee_ph_rhino._component_info_.set_component_params(ghenv, dev=False)
if DEV:
    reload(gh_io)
    from honeybee_ph_rhino.gh_compo_io import win_create_frame_element as gh_compo_io
    reload(gh_compo_io)


# ------------------------------------------------------------------------------
# -- GH Interface
IGH = gh_io.IGH( ghdoc, ghenv, sc, rh, rs, ghc, gh )


# -------------------------------------------------------------------------------------
gh_compo_interface = gh_compo_io.GHCompo_CreatePhWinFrameElement(
        IGH,
        _name_,
        _width,
        _u_factor,
        psi_glazing_,
        psi_install_,
        chi_,
    )
frame_element_ = gh_compo_interface.run()


# -------------------------------------------------------------------------------------
preview.object_preview(frame_element_)
# ---------- end create_frame_element ----------
create_frame_element_2 = HBPHCreatePHWindowFrameElement(width="0.1 M", u_factor="0.123")  # -> out, frame_element; same code as create_frame_element
create_glazing = HBPHCreatePHGlazing()  # -> out, glazing
# ---------- create_glazing: Python ----------
#
# Honeybee-PH: A Plugin for adding Passive-House data to LadybugTools Honeybee-Energy Models
# 
# This component is part of the PH-Tools toolkit <https://github.com/PH-Tools>.
# 
# Copyright (c) 2022, PH-Tools and bldgtyp, llc <phtools@bldgtyp.com> 
# Honeybee-PH is free software; you can redistribute it and/or modify 
# it under the terms of the GNU General Public License as published 
# by the Free Software Foundation; either version 3 of the License, 
# or (at your option) any later version. 
# 
# Honeybee-PH is distributed in the hope that it will be useful,
# but WITHOUT ANY WARRANTY; without even the implied warranty of 
# MERCHANTABILITY or FITNESS FOR A PARTICULAR PURPOSE. See the 
# GNU General Public License for more details.
# 
# For a copy of the GNU General Public License
# see <https://github.com/PH-Tools/honeybee_ph/blob/main/LICENSE>.
# 
# @license GPL-3.0+ <http://spdx.org/licenses/GPL-3.0+>
#
"""
Create a new HBPH Window Glazing.
-
EM October 1, 2022
    Args:
        _name_: (Optional[str]) An optional name for the new PH-Style Glazing.
        
        _u_factor: (float) W/m2k - The COG U-value for the glazing, as per EN-673. Note that
            this value is not the same as the NFRC value.
            default = 0.8 W/m2k
        
        _g_value: (float) % - The g-Value of the glazing as per EN-410. Note that this 
            is not the same as the SHGC value.
            default = 0.4
    Returns:
        glazing_: A new HBPH WindowGlazing which can be used to build an HBPH Window Constrution.
"""
   
try:
    from honeybee_ph_utils import preview
except ImportError as e:
    raise ImportError('\nFailed to import honeybee_ph_utils:\n\t{}'.format(e))

try:
    from honeybee_ph_rhino import gh_compo_io, gh_io
except ImportError as e:
    raise ImportError('\nFailed to import honeybee_ph_rhino:\n\t{}'.format(e))


# -------------------------------------------------------------------------------------
import honeybee_ph_rhino._component_info_
reload(honeybee_ph_rhino._component_info_)
ghenv.Component.Name = "HBPH - Create PH Glazing"
DEV = honeybee_ph_rhino._component_info_.set_component_params(ghenv, dev=False)
if DEV:
    reload(gh_compo_io)
    reload(gh_io)


# -------------------------------------------------------------------------------------
gh_compo_interface = gh_compo_io.GHCompo_CreatePhGlazing(
        _name_,
        _u_factor,
        _g_value,
    )
glazing_ = gh_compo_interface.run()


# -------------------------------------------------------------------------------------
preview.object_preview(glazing_)
# ---------- end create_glazing ----------
create_frame = HBPHCreatePHWindowFrame(
    top=create_frame_element.frame_element,
    right=create_frame_element.frame_element,
    bottom=create_frame_element.frame_element,
    left=create_frame_element.frame_element)  # -> out, frame
# ---------- create_frame: Python ----------
#
# Honeybee-PH: A Plugin for adding Passive-House data to LadybugTools Honeybee-Energy Models
# 
# This component is part of the PH-Tools toolkit <https://github.com/PH-Tools>.
# 
# Copyright (c) 2022, PH-Tools and bldgtyp, llc <phtools@bldgtyp.com> 
# Honeybee-PH is free software; you can redistribute it and/or modify 
# it under the terms of the GNU General Public License as published 
# by the Free Software Foundation; either version 3 of the License, 
# or (at your option) any later version. 
# 
# Honeybee-PH is distributed in the hope that it will be useful,
# but WITHOUT ANY WARRANTY; without even the implied warranty of 
# MERCHANTABILITY or FITNESS FOR A PARTICULAR PURPOSE. See the 
# GNU General Public License for more details.
# 
# For a copy of the GNU General Public License
# see <https://github.com/PH-Tools/honeybee_ph/blob/main/LICENSE>.
# 
# @license GPL-3.0+ <http://spdx.org/licenses/GPL-3.0+>
#
"""
Create a new HBPH Window Frame. If only a single HBPH Frame Element is input (to the 'top') that
frame element will be used for all sides. Otherwise, input the various frame elements as needed.

-
EM October 2, 2022
    Args:
        _name_: (str)
        
        _top: (PhWindowFrameElement) Then HBPH Window Frame Element to use for the 'top'
            element of the full window frame.
            
        _right: (PhWindowFrameElement) Then HBPH Window Frame Element to use for the 'right'
            element of the full window frame.
            
        _bottom: (PhWindowFrameElement) Then HBPH Window Frame Element to use for the 'bottom'
            element of the full window frame.
            
        _left: (PhWindowFrameElement) Then HBPH Window Frame Element to use for the 'left'
            element of the full window frame.
    
    Returns:
        frame_: A new HBPH WindowFrame which can be used to build an HBPH Window Constrution.
"""

try:
    from honeybee_ph_utils import preview
except ImportError as e:
    raise ImportError('\nFailed to import honeybee_ph_utils:\n\t{}'.format(e))

try:
    from honeybee_ph_rhino import gh_compo_io, gh_io
except ImportError as e:
    raise ImportError('\nFailed to import honeybee_ph_rhino:\n\t{}'.format(e))


# -------------------------------------------------------------------------------------
import honeybee_ph_rhino._component_info_
reload(honeybee_ph_rhino._component_info_)
ghenv.Component.Name = "HBPH - Create PH Window Frame"
DEV = honeybee_ph_rhino._component_info_.set_component_params(ghenv, dev=False)
if DEV:
    reload(gh_compo_io)
    reload(gh_io)


# -------------------------------------------------------------------------------------
gh_compo_interface = gh_compo_io.GHCompo_CreatePhWinFrame(
        _name_,
        _top,
        _right,
        _bottom,
        _left,
    )
frame_ = gh_compo_interface.run()

# -------------------------------------------------------------------------------------
preview.object_preview(frame_)
# ---------- end create_frame ----------
create_glazing_2 = HBPHCreatePHGlazing()  # -> out, glazing; same code as create_glazing
create_frame_2 = HBPHCreatePHWindowFrame(
    top=create_frame_element_2.frame_element,
    right=create_frame_element_2.frame_element,
    bottom=create_frame_element_2.frame_element,
    left=create_frame_element_2.frame_element)  # -> out, frame; same code as create_frame
shademat = HBShadeMaterial(
    name="test-shade",
    thickness="0.1",
    transmittance=calc_phius_blind.transmittance_effective,
    reflectance=calc_phius_blind.reflectance_effective)  # -> mat; plug-in component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
create_ph_win_const = HBPHCreatePHWindowConstruction(frame=create_frame.frame, glazing=create_glazing.glazing, shade=shademat)  # -> out, construction
# ---------- create_ph_win_const: Python ----------
#
# Honeybee-PH: A Plugin for adding Passive-House data to LadybugTools Honeybee-Energy Models
# 
# This component is part of the PH-Tools toolkit <https://github.com/PH-Tools>.
# 
# Copyright (c) 2022, PH-Tools and bldgtyp, llc <phtools@bldgtyp.com> 
# Honeybee-PH is free software; you can redistribute it and/or modify 
# it under the terms of the GNU General Public License as published 
# by the Free Software Foundation; either version 3 of the License, 
# or (at your option) any later version. 
# 
# Honeybee-PH is distributed in the hope that it will be useful,
# but WITHOUT ANY WARRANTY; without even the implied warranty of 
# MERCHANTABILITY or FITNESS FOR A PARTICULAR PURPOSE. See the 
# GNU General Public License for more details.
# 
# For a copy of the GNU General Public License
# see <https://github.com/PH-Tools/honeybee_ph/blob/main/LICENSE>.
# 
# @license GPL-3.0+ <http://spdx.org/licenses/GPL-3.0+>
#
"""
Create a new HBPH Window Construction with PH-Style values.
- -
Note: For north-american modeling (code compliance) you must use NFRC values which are different
than the ISO values used for Passive House modeling. This component allows you to input both types of 
values and will approximate the NFRC values from the ISO inputs. However, do note that this approximation 
is NOT valid for north-american code compliance modeling and is included here only to help those doing 
Passive House modeling. Be sure to enter both the ISO *AND* NFRC values if you need both. The NFRC values 
will be used for all EnergyPlus simulatiuons, while the ISO values will be used for all Passive House
models and outputs.

-
EM March 22, 2023
    Args:
        _name_: (str)
        
        _frame: (PhWindowFrame) A HBPH Window Frame to build the window construction from.
        
        _glazing: (PhWindowGlazing) A HBPH Window Glazing to build the window construction from.
       
        _shade: (Optional[EnergyWindowMaterialShade]) An Optional solar shade (roller blind) to add to the 
            window construction. This will show up as a Solar Protection device in WUFI. Use an 
            "HB - Shade Material" and set the "_transmittance_" input to desired value. Note that
            for WUFI and PHPP, the other values such as thickness and emissivity are disregarded. If
            the window construction does not have solar shading simply leave this input blank.
       
        nfrc_u_factor_: (float) Optional NRFC U-Factor for the Window Construction. If none is supplied, 
            this value will be approximated from the ISO values of the _glazing and _frame. 
            Note that this is an approximation only. Strictly speaking this ISO value is not valid 
            as input for north-american code compliance modeling.
        
        nfrc_shgc_: (float) Optional NFRC SHGC-Value for the Window Construction. If none is supplied, 
            this value will be approximated from the ISO values of the _glazing. Note that this
            is an approximation only. Strictly speaking this ISO value is valid as input for 
            north-american code compliance modeling.
       
        t_vis_: (float) default=0.6 - Transmittance of the glazing system.
       
    Returns:
        construction_: A new HB Window Construction which can applied to the apertures 
            directly using the HBE "HB Apply Window Construction" component or used as 
            part of an HB Construction Set.
"""

import scriptcontext as sc
import Rhino as rh
import rhinoscriptsyntax as rs
import ghpythonlib.components as ghc
import Grasshopper as gh

try:
    from honeybee_ph_utils import preview
except ImportError as e:
    raise ImportError('\nFailed to import honeybee_ph_utils:\n\t{}'.format(e))

try:
    from honeybee_ph_rhino import gh_compo_io, gh_io
except ImportError as e:
    raise ImportError('\nFailed to import honeybee_ph_rhino:\n\t{}'.format(e))

# -------------------------------------------------------------------------------------
import honeybee_ph_rhino._component_info_
reload(honeybee_ph_rhino._component_info_)
ghenv.Component.Name = "HBPH - Create PH Window Construction"
DEV = honeybee_ph_rhino._component_info_.set_component_params(ghenv, dev=False)
if DEV:
    reload(gh_io)
    from honeybee_ph_rhino.gh_compo_io import win_create_constr as gh_compo_io 
    reload(gh_compo_io)


# ------------------------------------------------------------------------------
# -- GH Interface
IGH = gh_io.IGH( ghdoc, ghenv, sc, rh, rs, ghc, gh )


# -------------------------------------------------------------------------------------
gh_compo_interface = gh_compo_io.GHCompo_CreatePhConstruction(
    IGH,
    _name_,
    _frame,
    _glazing,
    nfrc_u_factor_,
    nfrc_shgc_,
    t_vis_,
    _shade,
)
construction_ = gh_compo_interface.run()

# ---------------------------------------------------------------------------------
if construction_:
    preview.object_preview(construction_.properties.ph)
# ---------- end create_ph_win_const ----------
create_ph_win_const_2 = HBPHCreatePHWindowConstruction(frame=create_frame_2.frame, glazing=create_glazing_2.glazing)  # -> out, construction; same code as create_ph_win_const
subfacesubset = HBSubfaceSubset(
    window=create_ph_win_const.construction,
    skylight=create_ph_win_const.construction,
    operable=create_ph_win_const.construction,
    glass_door=create_ph_win_const.construction)  # -> subface_set; plug-in component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
create_sd_const = HBPHCreateSDConstructions(const_names="test_floor", u_values="1")  # -> out, hb_constructions; inputs const_names: list, u_values: list
# ---------- create_sd_const: Python ----------
#
# Honeybee-PH: A Plugin for adding Passive-House data to LadybugTools Honeybee-Energy Models
# 
# This component is part of the PH-Tools toolkit <https://github.com/PH-Tools>.
# 
# Copyright (c) 2022, PH-Tools and bldgtyp, llc <phtools@bldgtyp.com> 
# Honeybee-PH is free software; you can redistribute it and/or modify 
# it under the terms of the GNU General Public License as published 
# by the Free Software Foundation; either version 3 of the License, 
# or (at your option) any later version. 
# 
# Honeybee-PH is distributed in the hope that it will be useful,
# but WITHOUT ANY WARRANTY; without even the implied warranty of 
# MERCHANTABILITY or FITNESS FOR A PARTICULAR PURPOSE. See the 
# GNU General Public License for more details.
# 
# For a copy of the GNU General Public License
# see <https://github.com/PH-Tools/honeybee_ph/blob/main/LICENSE>.
# 
# @license GPL-3.0+ <http://spdx.org/licenses/GPL-3.0+>
#
"""
Create new "SD-Level" Honeybee-Energy Constructions. This component takes a simple 
list of names and U-Values (W/m2-k) and builds up new Honeybee-Energy Mateials and Constructions
from them. This is useful during early stages of design when you might not know the
actual constructions or materials yet, but you would like to test various U-Values 
to guage the impact.
- -
This component will create new Constructions which have three layers:
1) A "Mass Layer" on the outside
2) A No-Mass layer in the middle
3) A "Mass Layer" on the inside
- -
This method uses the steps and attributes outlined in:
* https://www.youtube.com/watch?v=XSFHdPHJ7zA
* https://bigladdersoftware.com/epx/docs/8-7/engineering-reference/conduction-through-the-walls.html#conduction-transfer-function-ctf-calculations-special-case-r-value-only-layers
-
EM October 13, 2022

    Args:
        _const_names: (List[str]) A list of the Construction names to use.
        
        _u_values: (List[float]) A list of the Construction U-Values (W/m2-k) to use.
        
    Returns:
        hb_constructions_: (List[OpaqueConstruction]) A List of the new Honeybee-Energy
            Constructions created with the simplified whole-assembly U-Values.
"""

try:
    from honeybee_ph_rhino import gh_compo_io, gh_io
except ImportError as e:
    raise ImportError('\nFailed to import honeybee_ph_rhino:\n\t{}'.format(e))


#-------------------------------------------------------------------------------
import honeybee_ph_rhino._component_info_
reload(honeybee_ph_rhino._component_info_)
ghenv.Component.Name = "HBPH - Create SD Constructions"
DEV = True
honeybee_ph_rhino._component_info_.set_component_params(ghenv)
DEV = honeybee_ph_rhino._component_info_.set_component_params(ghenv, dev=False)
if DEV:
    reload(gh_compo_io)
    reload(gh_io)
    from honeybee_ph_utils import units
    reload(units)    
    from honeybee_ph_rhino.gh_compo_io import assmbly_create_sd_const as gh_compo_io
    reload(gh_compo_io)

    
# -------------------------------------------------------------------------------------
gh_compo_interface = gh_compo_io.GHCompo_CreateSDConstructions(
        _const_names,
        _u_values,
    )
hb_constructions_ = gh_compo_interface.run()
# ---------- end create_sd_const ----------
subfacesubset_2 = HBSubfaceSubset(
    window=create_ph_win_const_2.construction,
    skylight=create_ph_win_const_2.construction,
    operable=create_ph_win_const_2.construction,
    glass_door=create_ph_win_const_2.construction)  # -> subface_set; plug-in component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
exteriorsubset = HBExteriorConstructionSubset(exterior_wall=opaqueconstr, exterior_roof=opaqueconstr_2, exposed_floor=create_sd_const.hb_constructions)  # -> exterior_set; plug-in component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
groundsubset = HBGroundConstructionSubset(ground_wall=steel_stud_construction.construction)  # -> ground_set; plug-in component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
constructionset = HBConstructionSet(subface_subset=subfacesubset_2)  # -> constr_set; plug-in component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
constructionset_2 = HBConstructionSet(exterior_subset=exteriorsubset, ground_subset=groundsubset, subface_subset=subfacesubset)  # -> constr_set; plug-in component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
box_3 = Box2Pt(PointA="0,0,-5", PointB="5,4,0", Plane=PlaneXY(0, 0, 0))
box_4 = Box2Pt(PointA="0,0,0", PointB="5,4,5", Plane=PlaneXY(0, 0, 0))
roomsolid_3 = HBRoomFromSolid(geo=flatten(box_3), constr_set=constructionset_2, conditioned=True)  # -> report, rooms; plug-in component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
roomsolid_4 = HBRoomFromSolid(geo=flatten(box_4), constr_set=constructionset, conditioned=True)  # -> report, rooms; plug-in component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
setstory = HBSetStory(rooms=roomsolid_3.rooms, story="1")  # -> out, rooms; plug-in component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
setstory_2 = HBSetStory(rooms=roomsolid_4.rooms, story="2")  # -> out, rooms; plug-in component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

hbph_cooling_types = HBPHCoolingTypes({"Ventilation Air": 1, "Recirculating Air": 2, "Dehumidification": 3, "Radiant Panel": 4}, selected="Dehumidification")
hbph_cooling_types_2 = HBPHCoolingTypes({"Ventilation Air": 1, "Recirculating Air": 2, "Dehumidification": 3, "Radiant Panel": 4}, selected="Recirculating Air")
create_cooling_parameters = HBPHCreateCoolingParams(cooling_type=hbph_cooling_types_2)  # -> out, cooling_params; inputs single_speed: Boolean, flow_rate_variable: Boolean
#   port display_name: (str) Optional display name for the cooling system.
#   port percent_coverage: (float) default=1.0 The fraction of total cooling supplied by this system (0-1)
#   port annual_COP: (float) The Annual COP (W/W) of the equipment.
#   port single_speed: (bool) Cyclical operation works through an on/off regulation of the compressor. If this is set to False, then the assumption is that the unit has a VRF (variant refrigerant flow), which works by modulating the efficiency of the compressor.
#   port min_coil_temp: (float) Deg. C
#   port capacity: (float) Maximum kW output.
#   port flow_rate_m3_s: (float) The maximum airflow rate in m3/s
#   port flow_rate_variable: (bool) VAV system: The volume flow changes proportionally to the cooling capacity, thereby reducing the temperature remains constant (usually better dehumidification)
# ---------- create_cooling_parameters: Python ----------
#
# Honeybee-PH: A Plugin for adding Passive-House data to LadybugTools Honeybee-Energy Models
# 
# This component is part of the PH-Tools toolkit <https://github.com/PH-Tools>.
# 
# Copyright (c) 2022, PH-Tools and bldgtyp, llc <phtools@bldgtyp.com> 
# Honeybee-PH is free software; you can redistribute it and/or modify 
# it under the terms of the GNU General Public License as published 
# by the Free Software Foundation; either version 3 of the License, 
# or (at your option) any later version. 
# 
# Honeybee-PH is distributed in the hope that it will be useful,
# but WITHOUT ANY WARRANTY; without even the implied warranty of 
# MERCHANTABILITY or FITNESS FOR A PARTICULAR PURPOSE. See the 
# GNU General Public License for more details.
# 
# For a copy of the GNU General Public License
# see <https://github.com/PH-Tools/honeybee_ph/blob/main/LICENSE>.
# 
# @license GPL-3.0+ <http://spdx.org/licenses/GPL-3.0+>
#
"""
Define cooling-parameters which are set on a PH heat-pump system. Connect the 'cooling_params_'
output of this component to one of the '_cooling_params_' inputs on a 'Create Space 
Conditioning System' component in order to add the cooling attributes of the heat pump.
-
NOTE: Using the component will add ONLY the Passive House devices and will **NOT** add 
any components to the HB-Energy model. If you need to model mechancial equipment for an EnergyPlus
/ OpenStudio simulation then you must also use the Honeybee-Energy / IronBug components to setup
those devices separate from the inputs defined on the component here.
-
EM May 2, 2024
    Args:
        _cooling_type: (int) Enter the type of cooling parameters to define. Input either - 
"1-Ventilation Air"
"2-Recirculating Air"
"3-Dehumidification"
"4-Radiant Panel"

    Returns:
        cooling_params_: The new PH-HVAC Cooling Params which can be set on a space-conditioning 
            heat-pump system.
"""

import scriptcontext as sc
import Rhino as rh
import rhinoscriptsyntax as rs
import ghpythonlib.components as ghc
import Grasshopper as gh

try:
    from honeybee_ph_utils import preview
except ImportError as e:
    raise ImportError('\nFailed to import honeybee_ph_utils:\n\t{}'.format(e))

try:
    from honeybee_ph_rhino import gh_compo_io, gh_io
    from honeybee_ph_rhino.gh_compo_io.hvac import create_cooling_params
except ImportError as e:
    raise ImportError('\nFailed to import honeybee_ph_rhino:\n\t{}'.format(e))



#-------------------------------------------------------------------------------
import honeybee_ph_rhino._component_info_
reload(honeybee_ph_rhino._component_info_)
ghenv.Component.Name = "HBPH - Create Cooling Params"
DEV = honeybee_ph_rhino._component_info_.set_component_params(ghenv, dev=False)
if DEV:
    reload(gh_io)
    from honeybee_ph_rhino.gh_compo_io.hvac import create_cooling_params as gh_compo_io
    reload(gh_compo_io)


# ------------------------------------------------------------------------------
# -- GH Interface
IGH = gh_io.IGH( ghdoc, ghenv, sc, rh, rs, ghc, gh )


#-------------------------------------------------------------------------------
# -- Setup the input nodes, get all the user input values
input_dict = create_cooling_params.get_component_inputs(_cooling_type)
gh_io.setup_component_inputs(IGH, input_dict, _start_i=1)
input_values_dict = gh_io.get_component_input_values(ghenv)


#-------------------------------------------------------------------------------
# -- Build the new System
gh_compo_interface = gh_compo_io.GHCompo_CreateCoolingSystem(
        IGH,
        _cooling_type,
        input_values_dict,
    )
cooling_params_ = gh_compo_interface.run()


#-------------------------------------------------------------------------------
# -- Preview
preview.object_preview(cooling_params_)
# ---------- end create_cooling_parameters ----------
create_cooling_parameters_2 = HBPHCreateCoolingParams(cooling_type=hbph_cooling_types)  # -> out, cooling_params; inputs useful_heat_loss: Boolean; same code as create_cooling_parameters
panel_14 = Panel("""3.4
4.12""")
panel_15 = Panel("""-3.33
12""")
hbph_heating_types = HBPHHeatingTypes({"Direct Electric": 1, "Boiler (Gas, Oil)": 2, "Boiler (Wood)": 3, "District Heating": 4, "Heat Pump (Annual)": 5, "Heat Pump (Monthly)": 6}, selected="Heat Pump (Monthly)")
create_heating_cooling = HBPHCreateSpaceConditioningSystem(system_type=hbph_heating_types, percent_bldg_heating_covered="0.25")  # -> out, space_conditioning_system; inputs monthly_COPS: list, monthly_temps: list
#   port display_name: (str) Optional display name for the heating system.
#   port percent_bldg_heating_covered: (float) default=1.0 The fraction of the building's total heating covered by this system (0-1.0)
#   port monthly_COPS: (list[float]): A List of COP values.
#   port monthly_temps: (list[float]): A List of temp [deg C] values.
# ---------- create_heating_cooling: Python ----------
#
# Honeybee-PH: A Plugin for adding Passive-House data to LadybugTools Honeybee-Energy Models
# 
# This component is part of the PH-Tools toolkit <https://github.com/PH-Tools>.
# 
# Copyright (c) 2022, PH-Tools and bldgtyp, llc <phtools@bldgtyp.com> 
# Honeybee-PH is free software; you can redistribute it and/or modify 
# it under the terms of the GNU General Public License as published 
# by the Free Software Foundation; either version 3 of the License, 
# or (at your option) any later version. 
# 
# Honeybee-PH is distributed in the hope that it will be useful,
# but WITHOUT ANY WARRANTY; without even the implied warranty of 
# MERCHANTABILITY or FITNESS FOR A PARTICULAR PURPOSE. See the 
# GNU General Public License for more details.
# 
# For a copy of the GNU General Public License
# see <https://github.com/PH-Tools/honeybee_ph/blob/main/LICENSE>.
# 
# @license GPL-3.0+ <http://spdx.org/licenses/GPL-3.0+>
#
"""
Create a new PH-HVAC Space Conditioning (Heating, Cooling) System which can serve one or more HB-Rooms.
Connect the 'space_conditioning_system_' output to the '_space_conditioning_systems' input on a 
'HBPH - Add Mech Systems' component.
-
NOTE: Using the component will add ONLY the Passive House devices and will **NOT** add 
any components to the HB-Energy model. If you need to model mechancial equipment for an EnergyPlus
/ OpenStudio simulation then you must also use the Honeybee-Energy / IronBug components to setup
those devices separate from the inputs defined on the component here.
-
EM May 2, 2024
    Args:
        _system_type: (int) Enter the type of heating system.
        
    Returns:
        space_conditioning_system_: The new HBPH-Heating/Cooling System which can be 
            added to one or more HB-Rooms via the 'HBPH - Add Mech Systems' component.
"""

import scriptcontext as sc
import Rhino as rh
import rhinoscriptsyntax as rs
import ghpythonlib.components as ghc
import Grasshopper as gh

try:
    from honeybee_ph_utils import preview
except ImportError as e:
    raise ImportError('\nFailed to import honeybee_ph_utils:\n\t{}'.format(e))

try:
    from honeybee_ph_rhino import gh_compo_io, gh_io
    from honeybee_ph_rhino.gh_compo_io.hvac import create_space_conditioning_sys
except ImportError as e:
    raise ImportError('\nFailed to import honeybee_ph_rhino:\n\t{}'.format(e))

#-------------------------------------------------------------------------------
import honeybee_ph_rhino._component_info_
reload(honeybee_ph_rhino._component_info_)
ghenv.Component.Name = "HBPH - Create Space Conditioning System"
DEV = honeybee_ph_rhino._component_info_.set_component_params(ghenv, dev=False)
if DEV:
    reload(gh_io)
    from honeybee_ph_rhino.gh_compo_io.hvac import create_space_conditioning_sys as gh_compo_io
    reload(gh_compo_io)

# ------------------------------------------------------------------------------
# -- GH Interface
IGH = gh_io.IGH( ghdoc, ghenv, sc, rh, rs, ghc, gh )


#-------------------------------------------------------------------------------
# -- Setup the input nodes, get all the user input values
input_dict = create_space_conditioning_sys.get_component_inputs(_system_type)
gh_io.setup_component_inputs(IGH, input_dict, _start_i=1)
input_values_dict = gh_io.get_component_input_values(ghenv)


#-------------------------------------------------------------------------------
# -- Build the new System
gh_compo_interface = gh_compo_io.GHCompo_CreateSpaceConditioningSystem(
        IGH,
        _system_type,
        input_values_dict,
    )
space_conditioning_system_ = gh_compo_interface.run()


#-------------------------------------------------------------------------------
# -- Preview
preview.object_preview(space_conditioning_system_)
# ---------- end create_heating_cooling ----------
hbph_heating_types_2 = HBPHHeatingTypes({"Direct Electric": 1, "Boiler (Gas, Oil)": 2, "Boiler (Wood)": 3, "District Heating": 4, "Heat Pump (Annual)": 5, "Heat Pump (Monthly)": 6}, selected="Heat Pump (Monthly)")
create_heating_cooling_2 = HBPHCreateSpaceConditioningSystem(
    system_type=hbph_heating_types_2,
    display_name="Example_Heat_Pump",
    percent_bldg_heating_covered="0.75",
    monthly_COPS=panel_14,
    monthly_temps=panel_15,
    percent_bldg_cooling_covered="0.75",
    cooling_params_recirculation_air=create_cooling_parameters.cooling_params,
    cooling_params_dehumidification=create_cooling_parameters_2.cooling_params)  # -> out, space_conditioning_system; inputs monthly_COPS: list, monthly_temps: list; same code as create_heating_cooling
merge = Merge(Data1=create_heating_cooling_2.space_conditioning_system, Data2=create_heating_cooling.space_conditioning_system)  # -> flatten(Result)

planesrf = PlaneSurface(Plane="0.5, 0.5, -5", XSize="3", YSize="3")
planesrf_2 = PlaneSurface(Plane="0.5, 0.5, 0", XSize="3", YSize="3")
merge_2 = Merge(Data1=planesrf, Data2=planesrf_2)  # -> graft(Result)

list = ValueList({"1-Passive House", "2-EnerPHit", "3-PHI Low Energy Building", "4-Other"}, selected="1-Passive House")
list_2 = ValueList({"1-Component method", "2-Energy demand method"}, selected="2-Energy demand method")
list_3 = ValueList({"1-New building", "2-Retrofit", "3-Step-by-step retrofit"}, selected="1-New building")
list_4 = ValueList({"1-PE (non-renewable)", "2-PER (renewable)"}, selected="1-PE (non-renewable)")
list_5 = ValueList({"1-Classic", "2-Plus", "3-Premium"}, selected="1-Classic")

create_summer_ventilation = HBPHCreateSummerVentilation(ventilation_system_summer_bypass_model="2")  # -> out, summer_ventilation
# ---------- create_summer_ventilation: Python ----------
#
# Honeybee-PH: A Plugin for adding Passive-House data to LadybugTools Honeybee-Energy Models
# 
# This component is part of the PH-Tools toolkit <https://github.com/PH-Tools>.
# 
# Copyright (c) 2026, PH-Tools and bldgtyp, llc <phtools@bldgtyp.com> 
# Honeybee-PH is free software; you can redistribute it and/or modify 
# it under the terms of the GNU General Public License as published 
# by the Free Software Foundation; either version 3 of the License, 
# or (at your option) any later version. 
# 
# Honeybee-PH is distributed in the hope that it will be useful,
# but WITHOUT ANY WARRANTY; without even the implied warranty of 
# MERCHANTABILITY or FITNESS FOR A PARTICULAR PURPOSE. See the 
# GNU General Public License for more details.
# 
# For a copy of the GNU General Public License
# see <https://github.com/PH-Tools/honeybee_ph/blob/main/LICENSE>.
# 
# @license GPL-3.0+ <http://spdx.org/licenses/GPL-3.0+>
#
"""
Settings for the building-segment's Summer Ventilation. These are OPTIONAL extra attributes which 
can be used to set things like window ventilation (daytime and nighttime) as well as supplamental 
extract ventilation. Note that for Phius Certified projects, unless you are building a 'Passive' 
cooling building (one with NO active cooling systems) you should not assign these values and instead
should just leave Summer-Ventilation in WUFI set to automatic.
-
EM April 11, 2026

    Args:
        _ventilation_system_ach: The air-change-rate (ACH) of the primary ventilation system (ERV/HRV)
            in SUMMER. This is usually the same as winter. If NONE is set, this will default to match 
            the winter ventilation air-change-rate.

        _ventilation_system_summer_bypass_model: Input either -
"1-None"
"2-Auto TemperatureDifference"
"3-Auto Humidity Difference"
"4-Always" (Default)

        _daytime_extract_system_ach: [Optional, default=0.0] extra air-change-rate (ACH) provided by a
            dedicated supplemental extract-air ventilation system in the building segment during summer. 

        _daytime_extract_system_fan_power_wh_m3: [Optional, default=0.0] If a supplamental extract ventilation
            system is used, provide the fan-power (Wh/m3)

        _daytime_window_ach: [Optional, default=0.0] extra air-change-rate (ACH) provided by the windows 
            in the building segment during summer. 

        _nighttime_extract_system_ach: [Optional, default=0.0] extra air-change-rate (ACH) provided by a
            dedicated supplemental extract-air ventilation system in the building segment during summer. 

        _nighttime_extract_system_fan_power_wh_m3: [Optional, default=0.0] If a supplamental extract ventilation
            system is used, provide the fan-power (Wh/m3)

        _nighttime_extract_system_heat_fraction: [Optional, default=0.0] Fraction released as heat into the building.

        _nighttime_extract_system_control: Input either - 
"1-Temperature Controlled" (Default)
"2-Humidity Controlled"

        _nighttime_window_ach: [Optional, default=0.0] extra air-change-rate (ACH) provided by the windows 
            in the building segment during summer. 

        _nighttime_minimum_indoor_temp_C: [Optional, default=22.0 C] Minimum allowable temperature inside the building segment.
            
    Returns:
        summer_ventilation_: ....
"""
import scriptcontext as sc
import Rhino as rh
import rhinoscriptsyntax as rs
import ghpythonlib.components as ghc
import Grasshopper as gh


try:
    from honeybee_ph_utils import preview
except ImportError as e:
    raise ImportError('\nFailed to import honeybee_ph_utils:\n\t{}'.format(e))

try:
    from honeybee_ph_rhino import gh_compo_io
except ImportError as e:
    raise ImportError('\nFailed to import honeybee_ph_rhino:\n\t{}'.format(e))

try:
    from ph_gh_component_io import gh_io
except ImportError as e:
    raise ImportError('\nFailed to import ph_gh_component_io:\n\t{}'.format(e))


#-------------------------------------------------------------------------------
import honeybee_ph_rhino._component_info_
reload(honeybee_ph_rhino._component_info_)
ghenv.Component.Name = "HBPH - Create Summer Ventilation"
DEV = honeybee_ph_rhino._component_info_.set_component_params(ghenv, dev=False)
if DEV:
    from honeybee_ph_rhino.gh_compo_io import summer_ventilation as gh_compo_io
    reload(gh_compo_io)
    reload(gh_io)

#-------------------------------------------------------------------------------
# -- GH Interface
IGH = gh_io.IGH( ghdoc, ghenv, sc, rh, rs, ghc, gh )

#-------------------------------------------------------------------------------
# -- Create the new Summer-Ventilation
summer_ventilation_ = gh_compo_io.GHCompo_CreateSummerVentilation(
    IGH,
    _ventilation_system_ach,
    _ventilation_system_summer_bypass_model,
    _daytime_extract_system_ach,
    _daytime_extract_system_fan_power_wh_m3,
    _daytime_window_ach,
    _nighttime_extract_system_ach,
    _nighttime_extract_system_fan_power_wh_m3, 
    _nighttime_extract_system_heat_fraction,
    _nighttime_extract_system_control,
    _nighttime_window_ach,
    _nighttime_minimum_indoor_temp_C,
).run()

# -------------------------------------------------------------------------------
preview.object_preview(summer_ventilation_)
# ---------- end create_summer_ventilation ----------

Y = UnitY(Factor="-1")
ln = Line(StartPoint="0,0,3", EndPoint="5,0,3")
extr = Extrude(Base=ln, Direction=Y)

Y_2 = UnitY(Factor="-1")
ln_2 = Line(StartPoint="5,0,3", EndPoint="12,0,3")
extr_2 = Extrude(Base=ln_2, Direction=Y_2)

create_install_type = HBPHCreateApertureInstallType(display_name="test", psi_install="0.013")  # -> out, install_type
# ---------- create_install_type: Python ----------
#
# Honeybee-PH: A Plugin for adding Passive-House data to LadybugTools Honeybee-Energy Models
#
# This component is part of the PH-Tools toolkit <https://github.com/PH-Tools>.
#
# Copyright (c) 2026, PH-Tools and bldgtyp, llc <phtools@bldgtyp.com>
# Honeybee-PH is free software; you can redistribute it and/or modify
# it under the terms of the GNU General Public License as published
# by the Free Software Foundation; either version 3 of the License,
# or (at your option) any later version.
#
# Honeybee-PH is distributed in the hope that it will be useful,
# but WITHOUT ANY WARRANTY; without even the implied warranty of
# MERCHANTABILITY or FITNESS FOR A PARTICULAR PURPOSE. See the
# GNU General Public License for more details.
#
# For a copy of the GNU General Public License
# see <https://github.com/PH-Tools/honeybee_ph/blob/main/LICENSE>.
#
# @license GPL-3.0+ <http://spdx.org/licenses/GPL-3.0+>
#
"""
Create a new 'Install Type' - a named window-installation condition (mid-wall, buried jamb,
party-wall, ...) with its Psi-Install value. Assign Install Types to aperture edges using an
'HBPH - Set Aperture Psi-Installs' component. A Psi-Install of 0.0 is the 'no install
thermal bridge' state. Create each condition once and re-use it across the project - the
same named type on many windows keeps the model easy to QA and never duplicates any
window constructions.
-
EM August 12, 2026
    Args:

        _display_name: (str) The name for the Install Type (ie: "Phius Mid-Wall",
            "Buried Jamb", "Party Wall"). If none is supplied, a content-keyed name is
            generated from the value.

        _psi_install: (str) The Psi-Install value. Accepts a bare number (W/mK is assumed)
            or a value with a unit (ie: "0.021 BTU/HR-FT-F").

        _source: (str) Optional free-text provenance note (ie: "Phius 1.4.4.6",
            "Flixo calc 2026-08-01").

    Returns:

        install_type_: The new PhApertureInstallType. Connect to an
            'HBPH - Set Aperture Psi-Installs' component.
"""

import scriptcontext as sc
import Rhino as rh
import rhinoscriptsyntax as rs
import ghpythonlib.components as ghc
import Grasshopper as gh

try:
    from honeybee_ph_rhino import gh_compo_io
except ImportError as e:
    raise ImportError('\nFailed to import honeybee_ph_rhino:\n\t{}'.format(e))

try:
    from ph_gh_component_io import gh_io
except ImportError as e:
    raise ImportError('\nFailed to import ph_gh_component_io:\n\t{}'.format(e))


#-------------------------------------------------------------------------------
import honeybee_ph_rhino._component_info_
reload(honeybee_ph_rhino._component_info_)
ghenv.Component.Name = "HBPH - Create Aperture Install Type"
DEV = honeybee_ph_rhino._component_info_.set_component_params(ghenv, dev=False)
if DEV:
    from honeybee_ph_rhino.gh_compo_io import win_create_install_type as gh_compo_io
    reload(gh_compo_io)
    reload(gh_io)

# ------------------------------------------------------------------------------
# -- GH Interface
IGH = gh_io.IGH( ghdoc, ghenv, sc, rh, rs, ghc, gh )

#-------------------------------------------------------------------------------
gh_compo_interface = gh_compo_io.GHCompo_CreateApertureInstallType(
    IGH,
    _display_name,
    _psi_install,
    _source,
)

install_type_ = gh_compo_interface.run()
# ---------- end create_install_type ----------

aperturesbyratio = HBAperturesByRatio(hb_objs=flatten(setstory_2.rooms), ratio="0.45", subdivide=Toggle(False))  # -> report, hb_objs; plug-in component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
facesbytype = HBFacesByType(hb_objs=aperturesbyratio.hb_objs)  # -> walls, interior_walls, roofs, ceilings, exterior_floors, interior_floors, air_walls, apertures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; plug-in component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
set_shade_factor = HBPHSetMonthlyShadeFactor(apertures=facesbytype.apertures, correction_factors="0.75")  # -> out, apertures; inputs apertures: list, correction_factors: list
# ---------- set_shade_factor: Python ----------
#
# Honeybee-PH: A Plugin for adding Passive-House data to LadybugTools Honeybee-Energy Models
# 
# This component is part of the PH-Tools toolkit <https://github.com/PH-Tools>.
# 
# Copyright (c) 2022, PH-Tools and bldgtyp, llc <phtools@bldgtyp.com> 
# Honeybee-PH is free software; you can redistribute it and/or modify 
# it under the terms of the GNU General Public License as published 
# by the Free Software Foundation; either version 3 of the License, 
# or (at your option) any later version. 
# 
# Honeybee-PH is distributed in the hope that it will be useful,
# but WITHOUT ANY WARRANTY; without even the implied warranty of 
# MERCHANTABILITY or FITNESS FOR A PARTICULAR PURPOSE. See the 
# GNU General Public License for more details.
# 
# For a copy of the GNU General Public License
# see <https://github.com/PH-Tools/honeybee_ph/blob/main/LICENSE>.
# 
# @license GPL-3.0+ <http://spdx.org/licenses/GPL-3.0+>
#
"""
Set the WUFI Defaulty Monthly Shading Correction Factor. This is the value shown when 
you look at a specific Aperture component in WUFI, and look at the "Solar Protection"
tab, and then the "WUFI mean monthly shading factors". This value is used to set additional
shading correction factors beyond the normal physical shading elements which are already
calculated automatically by WUFI. Note that this component does not affect PHPP models at 
all and is only used for WUFI-Passive Models.
-
EM May 21, 2023
    Args:
        _apertures: (list[Aperture]) The list of HB-Apertures to set the 
            monthly shading correction factors on.
            
        _correction_factors: (List[float]]) The list of correction factors
            to apply to the Apertures. This list should ideally be in the same 
            order and the same length as the list of Apertures. If not, the first
            input value will be used for all the Apertures.
            
    Returns:
        hb_rooms_: The honeyee-Rooms with the PH Spaces added to them.
"""

import scriptcontext as sc
import Rhino as rh
import rhinoscriptsyntax as rs
import ghpythonlib.components as ghc
import Grasshopper as gh

from honeybee_ph_rhino import gh_compo_io, gh_io

# ------------------------------------------------------------------------------
import honeybee_ph_rhino._component_info_
reload(honeybee_ph_rhino._component_info_)
ghenv.Component.Name = "HBPH - Set Monthly Shade Factor"
DEV = honeybee_ph_rhino._component_info_.set_component_params(ghenv, dev=False)
if DEV:
    from honeybee_ph_rhino.gh_compo_io import win_set_monthly_shd_fac as gh_compo_io
    reload(gh_compo_io)
    reload(gh_io)

# ------------------------------------------------------------------------------
# -- GH Interface
IGH = gh_io.IGH( ghdoc, ghenv, sc, rh, rs, ghc, gh )

# ------------------------------------------------------------------------------
gh_compo_interface = gh_compo_io.GHCompo_SetWindowMonthlyShadeFactor(
    IGH,
    _apertures,
    _correction_factors,
    )
apertures_ = gh_compo_interface.run()
# ---------- end set_shade_factor ----------

set_aperture_psi_installs = HBPHSetAperturePsiInstalls(install_types=create_install_type.install_type, hb_apertures=set_shade_factor.apertures)  # -> out, hb_apertures; inputs install_types: tree, hb_apertures: tree
# ---------- set_aperture_psi_installs: Python ----------
#
# Honeybee-PH: A Plugin for adding Passive-House data to LadybugTools Honeybee-Energy Models
#
# This component is part of the PH-Tools toolkit <https://github.com/PH-Tools>.
#
# Copyright (c) 2026, PH-Tools and bldgtyp, llc <phtools@bldgtyp.com>
# Honeybee-PH is free software; you can redistribute it and/or modify
# it under the terms of the GNU General Public License as published
# by the Free Software Foundation; either version 3 of the License,
# or (at your option) any later version.
#
# Honeybee-PH is distributed in the hope that it will be useful,
# but WITHOUT ANY WARRANTY; without even the implied warranty of
# MERCHANTABILITY or FITNESS FOR A PARTICULAR PURPOSE. See the
# GNU General Public License for more details.
#
# For a copy of the GNU General Public License
# see <https://github.com/PH-Tools/honeybee_ph/blob/main/LICENSE>.
#
# @license GPL-3.0+ <http://spdx.org/licenses/GPL-3.0+>
#
"""
Assign per-edge Psi-Install 'Install Types' to Honeybee Apertures. The install condition
(mid-wall, buried jamb, party-wall, ...) is a property of WHERE a window sits, not of the
window construction - so this component sets aperture-instance data and NEVER duplicates
the window construction. An edge with no Install Type assigned inherits the psi-install
value from the construction's PH Frame Element (the type default).
-
EM August 12, 2026
    Args:

        _install_types: (DataTree) The Install Types to assign, in top / right / bottom / left
            order (up to 4 items per branch). Accepts 'PhApertureInstallType' objects from an
            'HBPH - Create Aperture Install Type' component, or bare numbers / unit-strings
            (ie: "0.04" or "0.021 BTU/HR-FT-F") which are wrapped in anonymous content-keyed
            Install Types. Supply a single item to apply it to all four edges. Assign a
            zero-value Install Type to an edge to model 'no install thermal bridge' (ie: at
            a party-wall or a buried jamb). Branches are matched to the '_hb_apertures'
            branches wherever possible.

        _hb_apertures: (DataTree[Aperture]) The Honeybee-Apertures to assign the per-edge
            Install Types to.

    Returns:

        hb_apertures_: The Honeybee-Apertures with the Install Types assigned.
"""

import scriptcontext as sc
import Rhino as rh
import rhinoscriptsyntax as rs
import ghpythonlib.components as ghc
import Grasshopper as gh

try:
    from honeybee_ph_rhino import gh_compo_io
except ImportError as e:
    raise ImportError('\nFailed to import honeybee_ph_rhino:\n\t{}'.format(e))

try:
    from ph_gh_component_io import gh_io
except ImportError as e:
    raise ImportError('\nFailed to import ph_gh_component_io:\n\t{}'.format(e))


#-------------------------------------------------------------------------------
import honeybee_ph_rhino._component_info_
reload(honeybee_ph_rhino._component_info_)
ghenv.Component.Name = "HBPH - Set Aperture Psi-Installs"
DEV = honeybee_ph_rhino._component_info_.set_component_params(ghenv, dev=False)
if DEV:
    from honeybee_ph_rhino.gh_compo_io import win_set_psi_install_values as gh_compo_io
    reload(gh_compo_io)
    reload(gh_io)

# ------------------------------------------------------------------------------
# -- GH Interface
IGH = gh_io.IGH( ghdoc, ghenv, sc, rh, rs, ghc, gh )

#-------------------------------------------------------------------------------
gh_compo_interface = gh_compo_io.GHCompo_SetAperturePsiInstallValues(
    IGH,
    _install_types,
    _hb_apertures,
)

hb_apertures_ = gh_compo_interface.run()
# ---------- end set_aperture_psi_installs ----------

addsubface = HBAddSubface(hb_obj=flatten(setstory_2.rooms), sub_faces=flatten(set_aperture_psi_installs.hb_apertures))  # -> out, hb_obj, unmatched; plug-in component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
skylightsbyratio = HBSkylightsByRatio(hb_objs=flatten(addsubface.hb_obj), ratio="0.5")  # -> report, hb_objs; plug-in component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

merge_3 = Merge(Data1=setstory.rooms, Data2=skylightsbyratio.hb_objs)  # -> flatten(Result)
solveadj = HBSolveAdjacency(rooms=flatten(merge_3), run=Toggle(True))  # -> report, adj_rooms; plug-in component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
facesbybc = HBFacesByBC(hb_objs=solveadj.adj_rooms)  # -> outdoors, surface, ground, adiabatic, other; plug-in component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
facesbytype_2 = HBFacesByType(hb_objs=facesbybc.ground)  # -> walls, interior_walls, roofs, ceilings, exterior_floors, interior_floors, air_walls, apertures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; plug-in component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
vizbybc = HBVisualizeByBC(hb_objs=solveadj.adj_rooms)  # -> outdoors, surface, ground, adiabatic, other, wire_frame; plug-in component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
hb_face_energy_attributes = HBFaceEnergyAttributes({"Construction": "properties.energy.construction.display_name", "Materials": "properties.energy.construction.layers", "Thickness [m]": "properties.energy.construction.thickness", "Density [kg/m2]": "properties.energy.construction.mass_area_density", "Heat Capacity [J/K-m2]": "properties.energy.construction.area_heat_capacity", "Construction R-Value [m2-K/W]": "properties.energy.construction.r_value", "Construction U-Value [W/m2-K]": "properties.energy.construction.u_value", "Construction U-Factor [W/m2-K]": "properties.energy.construction.u_factor", "Construction SHGC [Unshaded]": "properties.energy.construction.shgc", "R-Factor [m2-K/W]": "properties.energy.r_factor", "U-Factor [W/m2-K]": "properties.energy.u_factor", "SHGC [Unshaded]": "properties.energy.shgc", "Solar Transmitance [Unshaded]": "properties.energy.construction.solar_transmittance", "Visible Transmitance [Unshaded]": "properties.energy.construction.visible_transmittance", "Solar Reflectance [Outside]": "properties.energy.construction.outside_solar_reflectance", "Solar Reflectance [Inside]": "properties.energy.construction.inside_solar_reflectance", "Fraction Area Operable": "properties.energy.vent_opening.fraction_area_operable", "Fraction Height Operable": "properties.energy.vent_opening.fraction_height_operable", "Discharge Coefficient": "properties.energy.vent_opening.discharge_coefficient"}, selected="Construction U-Value [W/m2-K]")
hb_face_attributes = HBFaceAttributes({"Display Name": "display_name", "Simulation Name (Identifier)": "identifier", "Boundary Condition": "boundary_condition", "Has Parent": "has_parent", "Parent": "parent", "Azimuth": "azimuth", "Altitude": "altitude", "Area": "area", "Perimeter": "perimeter", "Face Type": "type", "Aperture Is Operable": "is_operable", "Door Is Glass": "is_glass"}, selected="Area")
hb_face_attributes_2 = HBFaceAttributes({"Display Name": "display_name", "Simulation Name (Identifier)": "identifier", "Boundary Condition": "boundary_condition", "Has Parent": "has_parent", "Parent": "parent", "Azimuth": "azimuth", "Altitude": "altitude", "Area": "area", "Perimeter": "perimeter", "Face Type": "type", "Aperture Is Operable": "is_operable", "Door Is Glass": "is_glass"}, selected="Perimeter")
lablefaces = HBLabelFaces(hb_objs=flatten(facesbytype_2.exterior_floors), attribute=hb_face_attributes)  # -> label_text, base_pts, labels, wire_frame; plug-in component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
lablefaces_2 = HBLabelFaces(hb_objs=flatten(facesbytype_2.exterior_floors), attribute=hb_face_energy_attributes)  # -> label_text, base_pts, labels, wire_frame; plug-in component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
lablefaces_3 = HBLabelFaces(hb_objs=flatten(facesbytype_2.exterior_floors), attribute=hb_face_attributes_2)  # -> label_text, base_pts, labels, wire_frame; plug-in component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
panel_16 = Panel(lablefaces.labels)
panel_17 = Panel(lablefaces_3.labels)
panel_18 = Panel(lablefaces_2.labels)
hbph_foundation_types = HBPHFoundationTypes({"1-Heated Basement": 1, "2-Unheated Basement": 2, "3-Slab-On-Grade": 3, "4-Vented Crawlspace": 4, "5-None": 5}, selected="3-Slab-On-Grade")
create_foundation = HBPHCreateFoundation(
    type=hbph_foundation_types,
    display_name="Example_Slab_On_Grade",
    floor_slab_area_m2=panel_16,
    floor_slab_u_value=panel_18,
    floor_slab_exposed_perimeter_m=panel_17)  # -> out, ph_foundation; inputs perim_insulation_position: Int32
#   port floor_slab_area_m2: (float) M2 area of the floor slab.
#   port floor_slab_u_value: (float) U-Value (W/m2k) of the floor slab.
#   port floor_slab_exposed_perimeter_m: (float) Input the total length (m) of the exposed perimeter edges.
#   port perim_insulation_position: (str) Input either - "1-Undefined" "2-Horizontal" "3-Vertical"
#   port perim_insulation_width_or_depth_m: (float) The width (m) (if horizontal) or depth (if vertical) of the perimeter insulation.
#   port perim_insulation_thickness_m: (float) The thickness (m) of the perimeter insulation.
#   port perim_insulation_conductivity: (float) The thermal conductivity (W/mk) of the perimeter insulation.
# ---------- create_foundation: Python ----------
#
# Honeybee-PH: A Plugin for adding Passive-House data to LadybugTools Honeybee-Energy Models
# 
# This component is part of the PH-Tools toolkit <https://github.com/PH-Tools>.
# 
# Copyright (c) 2022, PH-Tools and bldgtyp, llc <phtools@bldgtyp.com> 
# Honeybee-PH is free software; you can redistribute it and/or modify 
# it under the terms of the GNU General Public License as published 
# by the Free Software Foundation; either version 3 of the License, 
# or (at your option) any later version. 
# 
# Honeybee-PH is distributed in the hope that it will be useful,
# but WITHOUT ANY WARRANTY; without even the implied warranty of 
# MERCHANTABILITY or FITNESS FOR A PARTICULAR PURPOSE. See the 
# GNU General Public License for more details.
# 
# For a copy of the GNU General Public License
# see <https://github.com/PH-Tools/honeybee_ph/blob/main/LICENSE>.
# 
# @license GPL-3.0+ <http://spdx.org/licenses/GPL-3.0+>
#
"""
Create a new PH-Foundation object which can be added to one or more Honeybee-Rooms.
-
EM March 18, 2023
    Args:
        _type: (str) The Type of foundation. Input either-
"1-Heated Basement"
"2-Unheated Basement"
"3-Slab on Grade"
"4-Vented Crawlspace"
"5-None"
    
    Returns:
        ph_foundation: The new PH-Foundation object which can be added to one 
            or more Honeybee-Rooms using the "HBPH - Add Foundations" component.
"""

import scriptcontext as sc
import Rhino as rh
import rhinoscriptsyntax as rs
import ghpythonlib.components as ghc
import Grasshopper as gh


try:
    from honeybee_ph_utils import preview
except ImportError as e:
    raise ImportError('\nFailed to import honeybee_ph_utils:\n\t{}'.format(e))

try:
    from honeybee_ph_rhino import gh_compo_io, gh_io
    from honeybee_ph_rhino.gh_compo_io.foundations_create import get_component_inputs
except ImportError as e:
    raise ImportError('\nFailed to import honeybee_ph_rhino:\n\t{}'.format(e))
    
    
# -------------------------------------------------------------------------------------
import honeybee_ph_rhino._component_info_
reload(honeybee_ph_rhino._component_info_)
ghenv.Component.Name = "HBPH - Create Foundation"
DEV = honeybee_ph_rhino._component_info_.set_component_params(ghenv, dev=False)
if DEV:
    from honeybee_ph import foundations
    reload(foundations)
    from honeybee_ph_rhino.gh_compo_io import foundations_create as gh_compo_io
    reload(gh_compo_io)


# -------------------------------------------------------------------------------------
# -- GH Interface
IGH = gh_io.IGH( ghdoc, ghenv, sc, rh, rs, ghc, gh )


#-------------------------------------------------------------------------------
# -- Setup the input nodes, get all the user input values
input_dict = get_component_inputs(_type)
gh_io.setup_component_inputs(IGH, input_dict, _start_i=2)
input_values_dict = gh_io.get_component_input_values(ghenv)


# -------------------------------------------------------------------------------------
gh_compo_interface = gh_compo_io.GHCompo_CreateFoundations(
        IGH,
        _type,
        input_values_dict,
)
ph_foundation_ = gh_compo_interface.run()


# -------------------------------------------------------------------------------------
preview.object_preview(ph_foundation_)
# ---------- end create_foundation ----------
add_foundations = HBPHAddFoundations(ph_foundations=create_foundation.ph_foundation, hb_rooms=solveadj.adj_rooms)  # -> out, hb_rooms; inputs ph_foundations: list, hb_rooms: list
#   port ph_foundations: Name for the building-segment
# ---------- add_foundations: Python ----------
#
# Honeybee-PH: A Plugin for adding Passive-House data to LadybugTools Honeybee-Energy Models
# 
# This component is part of the PH-Tools toolkit <https://github.com/PH-Tools>.
# 
# Copyright (c) 2022, PH-Tools and bldgtyp, llc <phtools@bldgtyp.com> 
# Honeybee-PH is free software; you can redistribute it and/or modify 
# it under the terms of the GNU General Public License as published 
# by the Free Software Foundation; either version 3 of the License, 
# or (at your option) any later version. 
# 
# Honeybee-PH is distributed in the hope that it will be useful,
# but WITHOUT ANY WARRANTY; without even the implied warranty of 
# MERCHANTABILITY or FITNESS FOR A PARTICULAR PURPOSE. See the 
# GNU General Public License for more details.
# 
# For a copy of the GNU General Public License
# see <https://github.com/PH-Tools/honeybee_ph/blob/main/LICENSE>.
# 
# @license GPL-3.0+ <http://spdx.org/licenses/GPL-3.0+>
#
"""
Add PH-Foundation objects to the Honeybee-Rooms. Note that 
PHPP only allows 3 different Foundation types per Building-Segment.
-
EM March 18, 2023
    Args:
        _ph_foundation: One or more PH-Foundation Objects that you would like 
            to add to each of the Honyebee-Rooms input.
               
        _hb_rooms: List[room.Room] One or more Honeybee-Rooms you would like to 
            add the new PH-Foundations to.
    
    Returns:
        hb_rooms_: The honeyee-Rooms with building-segment information added.
"""

import scriptcontext as sc
import Rhino as rh
import rhinoscriptsyntax as rs
import ghpythonlib.components as ghc
import Grasshopper as gh


try:
    from honeybee_ph_rhino import gh_compo_io, gh_io
except ImportError as e:
    raise ImportError('\nFailed to import honeybee_ph_rhino:\n\t{}'.format(e))
    
    
# -------------------------------------------------------------------------------------
import honeybee_ph_rhino._component_info_
reload(honeybee_ph_rhino._component_info_)
ghenv.Component.Name = "HBPH - Add Foundations"
DEV = honeybee_ph_rhino._component_info_.set_component_params(ghenv, dev=False)
if DEV:
    from honeybee_ph_rhino.gh_compo_io import foundations_add as gh_compo_io
    reload(gh_compo_io)

# -------------------------------------------------------------------------------------
# -- GH Interface
IGH = gh_io.IGH( ghdoc, ghenv, sc, rh, rs, ghc, gh )


# -------------------------------------------------------------------------------------
gh_compo_interface = gh_compo_io.GHCompo_AddFoundations(
        IGH,
        _ph_foundations,
        _hb_rooms,
)
hb_rooms_ = gh_compo_interface.run()
# ---------- end add_foundations ----------
panel_19 = Panel("""Room_1
Room_2""")
panel_20 = Panel("""101
102""")
graft = GraftTree(Tree=panel_19, IncludeEmptyLists=True, IncludeNullItems=True)
graft_2 = GraftTree(Tree=panel_20, IncludeEmptyLists=True, IncludeNullItems=True)
ph_spaces = HBPHCreateSpaces(flr_seg_geom=simplify(merge_2), space_names=simplify(graft), space_numbers=simplify(graft_2))  # -> out, error, floor_breps, volume_breps, spaces; inputs flr_seg_geom: tree of GeometryBase, weighting_factors: tree, volume_geometry: tree, volume_heights: tree, space_names: tree, space_numbers: tree, space_ph_vent_rates: tree, flr_seg_net_areas: tree
# ---------- ph_spaces: Python ----------
#
# Honeybee-PH: A Plugin for adding Passive-House data to LadybugTools Honeybee-Energy Models
# 
# This component is part of the PH-Tools toolkit <https://github.com/PH-Tools>.
# 
# Copyright (c) 2022, PH-Tools and bldgtyp, llc <phtools@bldgtyp.com> 
# Honeybee-PH is free software; you can redistribute it and/or modify 
# it under the terms of the GNU General Public License as published 
# by the Free Software Foundation; either version 3 of the License, 
# or (at your option) any later version. 
# 
# Honeybee-PH is distributed in the hope that it will be useful,
# but WITHOUT ANY WARRANTY; without even the implied warranty of 
# MERCHANTABILITY or FITNESS FOR A PARTICULAR PURPOSE. See the 
# GNU General Public License for more details.
# 
# For a copy of the GNU General Public License
# see <https://github.com/PH-Tools/honeybee_ph/blob/main/LICENSE>.
# 
# @license GPL-3.0+ <http://spdx.org/licenses/GPL-3.0+>
#
"""
Create new PH-Spaces. 
-
Spaces represent smaller units than HB-Rooms and can be made up of one or more individual 
volumes. This is useful if you are calculating interior net-floor-area or volume 
as in the Passive House models. Each Space will map to a single entry in the WUFI 
'Ventilation Rooms' or a PHPP 'Additional Ventilation'.
-
A single Space is made of one or more 'Volumes'. ie: a bedroom might have a volume for 
the main space, and another volume for the closet which is separated by the thicknes of 
a wall. 
-
Each Volume is made of one or more floor-segments. Each floor-segment can have a
'weighting factor' applied for calculating the TFA/iCFA for Passive House certification.
-
EM June 25, 2024
    Args:
        _flr_seg_geom: (Tree[Geometry]) The Rhino geometry that you would like to use 
            to create the Floor-Segments of the various Spaces. Each branch should be a list 
            of Rhino geometry objects that will be used to create a single new Space.
        
        _weighting_factors: (Tree[float]) An optional input Tree of TFA/iCFA weighting
            factors to apply to the input floor-segment geometry.
        
        _volume_heights: (Tree[float]) Default=2.5m An optional input Tree of heights
            to use when building the volume geometry.
        
        _volume_geometry: (Tree[Geometry]) An optional input Tree of Rhino Geometry
            describing the space-shape of the individual volumes. 
        
        _space_names: (Tree[float]) Default="_Unnamed_" An optional input Tree of names
            to use when building the spaces
        
        _space_numbers: Default="000" An optional input Tree of space numbers
            to use when building the spaces

        _space_ph_vent_rates: (Tree[SpacePhVentFlowRates]) An optional tree of detailed
            PH-Style space-level fresh air ventilaton flow rate objets. These can be created
            using the "HBPH - Create Space PH Ventilation" component or gotten directly 
            from the Rhino scene using the "HBPH - Get FloorSegment Data" component.

        _flr_seg_net_area: (Tree[float]) Optional input for 'net' (interior) floor area
            for the floor-segments. This 'net' area is used for the Phius Multifamily calculator
            since they insist on using net-area instead for that calculator, but gross area
            for their iCFA, but only for the non-residential zones like hallways. The
            input data here (branches, items, ...) should ideally match the structure of the
            the '_flr_seg_geometry' input. In none is input, the area of the '_flr_seg_geometry'
            will be used for both the gross and net floor areas.
    
    Returns:
        floor_breps_: Preview of the Space Floor geometry created. Useful for debugging.
        
        volume_breps_: Preview of the Space Volume geometry created. Useful for debugging.
        
        spaces_: The new PH-Spaces created. These can be added to Honeybee-Rooms.
"""

import scriptcontext as sc
import Rhino as rh
import rhinoscriptsyntax as rs
import ghpythonlib.components as ghc
import Grasshopper as gh

from honeybee_ph_rhino import gh_io, gh_compo_io

# ------------------------------------------------------------------------------
import honeybee_ph_rhino._component_info_
reload(honeybee_ph_rhino._component_info_)
ghenv.Component.Name = "HBPH - Create Spaces"
DEV = honeybee_ph_rhino._component_info_.set_component_params(ghenv, dev=False)
if DEV:
    from honeybee_ph_rhino.gh_compo_io import space_create_spc as gh_compo_io
    from honeybee_ph_rhino.make_spaces import make_floor, make_floor_segment
    from honeybee_ph import space
    reload(space)
    reload(make_floor_segment)
    reload(make_floor)
    reload(gh_compo_io)
    reload(gh_io)

# ------------------------------------------------------------------------------
if _volume_geometry.BranchCount != 0:
    msg = " Sorry - Detailed input using '_volume_geometry' is not "\
            "implemented just yet. Coming soon."
    raise NotImplementedError(msg)


# ------------------------------------------------------------------------------
# -- GH Interface
IGH = gh_io.IGH( ghdoc, ghenv, sc, rh, rs, ghc, gh )


# ------------------------------------------------------------------------------
gh_compo_interface = gh_compo_io.GHCompo_CreatePHSpaces(
    IGH,
    _flr_seg_geom,
    _weighting_factors,
    _volume_geometry,
    _volume_heights,
    _space_names,
    _space_numbers,
    _space_ph_vent_rates,
    _flr_seg_net_areas,
    )
error_, floor_breps_, volume_breps_, spaces_ = gh_compo_interface.run()
# ---------- end ph_spaces ----------
add_ph_spaces = HBPHAddSpaces(spaces=ph_spaces.spaces, inherit_room_names=Toggle(True), hb_rooms=add_foundations.hb_rooms)  # -> out, check_pts, open_rooms, hb_rooms; inputs spaces: list, inherit_room_names: Boolean, hb_rooms: list
# ---------- add_ph_spaces: Python ----------
#
# Honeybee-PH: A Plugin for adding Passive-House data to LadybugTools Honeybee-Energy Models
# 
# This component is part of the PH-Tools toolkit <https://github.com/PH-Tools>.
# 
# Copyright (c) 2022, PH-Tools and bldgtyp, llc <phtools@bldgtyp.com> 
# Honeybee-PH is free software; you can redistribute it and/or modify 
# it under the terms of the GNU General Public License as published 
# by the Free Software Foundation; either version 3 of the License, 
# or (at your option) any later version. 
# 
# Honeybee-PH is distributed in the hope that it will be useful,
# but WITHOUT ANY WARRANTY; without even the implied warranty of 
# MERCHANTABILITY or FITNESS FOR A PARTICULAR PURPOSE. See the 
# GNU General Public License for more details.
# 
# For a copy of the GNU General Public License
# see <https://github.com/PH-Tools/honeybee_ph/blob/main/LICENSE>.
# 
# @license GPL-3.0+ <http://spdx.org/licenses/GPL-3.0+>
#
"""
Add PH-Spaces to honeybee-Rooms. Spaces represent smaller units than HB-Rooms and 
can be made up of one or more individual volumes. This is useful if you are calculating 
interior net-floor-area or volume as in the Passive House models. Each Space will map to 
a single entry in the WUFI 'Ventilation Rooms' or a PHPP 'Additional Ventilation'.
-
EM November 1, 2023
    Args:
        _spaces: (list[Space]) A list of the new PH-Spaces to add to the Honeybee-Rooms.
        
        _offset_dist_: (float) Default=0.1 An optional value to offset the 'test points' being 
            used to determine the right honeybee-Room to host the space in. This value 
            will be used to move the test point 'up' (world Z) by some dimension before 
            testing if it is 'inside' the honeybee-Room. This is useful you drew your
            floor-segments directly 'on' the floor surface of the honeybee room as this 
            sometimes leads to errors when testing for 'inside'.
        
        inherit_room_names_ (bool): default=False. Set to true if you would like all of the 
            PH-Spaces 'in' a Honeybee Room to automatically inherit the display name of the 
            Honeybee Room. Note: this will override any user-defined Space names.
        
        _hb_rooms: (list[Room]) The list of honeybee-Rooms to add to the spaces to.
            
    Returns:
        check_pts_: A preview of the test points being used to evaluate the right
            honeybee-Room to use for the host of the space. Useful for debugging 
            if you run into hosting problems.
            
        hb_rooms_: The honeyee-Rooms with the PH Spaces added to them.
"""

import scriptcontext as sc
import Rhino as rh
import rhinoscriptsyntax as rs
import ghpythonlib.components as ghc
import Grasshopper as gh

from honeybee_ph_rhino import gh_compo_io, gh_io

# ------------------------------------------------------------------------------
import honeybee_ph_rhino._component_info_
reload(honeybee_ph_rhino._component_info_)
ghenv.Component.Name = "HBPH - Add Spaces"
DEV = honeybee_ph_rhino._component_info_.set_component_params(ghenv, dev=False)
if DEV:
    from honeybee_ph_rhino.make_spaces import make_space
    reload(make_space)
    from honeybee_ph_rhino.gh_compo_io import space_add_spc as gh_compo_io
    reload(gh_compo_io)
    reload(gh_io)

# ------------------------------------------------------------------------------
# -- GH Interface
IGH = gh_io.IGH( ghdoc, ghenv, sc, rh, rs, ghc, gh )

# ------------------------------------------------------------------------------
gh_compo_interface = gh_compo_io.GHCompo_AddPHSpaces(
    IGH,
    _spaces,
    _offset_dist_,
    inherit_room_names_,
    _hb_rooms,
    )
hb_rooms_, check_pts_, open_rooms_ = gh_compo_interface.run()
# ---------- end add_ph_spaces ----------

organize_hbph_spaces = HBPHOrganizeSpaces(hb_rooms=add_ph_spaces.hb_rooms)  # -> out, spaces; inputs hb_rooms: list
# ---------- organize_hbph_spaces: Python ----------
#
# Honeybee-PH: A Plugin for adding Passive-House data to LadybugTools Honeybee-Energy Models
# 
# This component is part of the PH-Tools toolkit <https://github.com/PH-Tools>.
# 
# Copyright (c) 2022, PH-Tools and bldgtyp, llc <phtools@bldgtyp.com> 
# Honeybee-PH is free software; you can redistribute it and/or modify 
# it under the terms of the GNU General Public License as published 
# by the Free Software Foundation; either version 3 of the License, 
# or (at your option) any later version. 
# 
# Honeybee-PH is distributed in the hope that it will be useful,
# but WITHOUT ANY WARRANTY; without even the implied warranty of 
# MERCHANTABILITY or FITNESS FOR A PARTICULAR PURPOSE. See the 
# GNU General Public License for more details.
# 
# For a copy of the GNU General Public License
# see <https://github.com/PH-Tools/honeybee_ph/blob/main/LICENSE>.
# 
# @license GPL-3.0+ <http://spdx.org/licenses/GPL-3.0+>
#
"""
Get all the HBPH 'Spaces' from the input Room. Use 'HBPH - Visualize Spaces'
in order to see the space geometry in the Rhino scene.
-
EM May 10, 2023

    Args:
        _hb_rooms: (list[room.Room]) The Honeybee-Rooms to get all the 
            HBPH 'Spaces' from.
            
    Returns:
        spaces_: (DataTree[List[Space]]) The HBPH Spaces gotten from the 
            input Honeybee-Rooms.
"""

import scriptcontext as sc
import Rhino as rh
import rhinoscriptsyntax as rs
import ghpythonlib.components as ghc
import Grasshopper as gh

from honeybee_ph_rhino import gh_compo_io, gh_io

# ------------------------------------------------------------------------------
import honeybee_ph_rhino._component_info_
reload(honeybee_ph_rhino._component_info_)
ghenv.Component.Name = "HBPH - Organize Spaces"
DEV = honeybee_ph_rhino._component_info_.set_component_params(ghenv, dev=False)
if DEV:
    from honeybee_ph_rhino.gh_compo_io import organize_spaces as gh_compo_io
    reload(gh_compo_io)
    reload(gh_io)

# ------------------------------------------------------------------------------
# -- GH Interface
IGH = gh_io.IGH( ghdoc, ghenv, sc, rh, rs, ghc, gh )

# ------------------------------------------------------------------------------
gh_compo_interface = gh_compo_io.GHCompo_OrganizeSpaces(
    IGH,
    _hb_rooms,
    )
spaces_ = gh_compo_interface.run()
# ---------- end organize_hbph_spaces ----------
visualize_hbph_spaces = HBPHVisualizeSpaces(spaces=flatten(organize_hbph_spaces.spaces))  # -> out, space_floor_segments, space_volumes, wireframe, legend, values; inputs spaces: list
# ---------- visualize_hbph_spaces: Python ----------
#
# Honeybee-PH: A Plugin for adding Passive-House data to LadybugTools Honeybee-Energy Models
# 
# This component is part of the PH-Tools toolkit <https://github.com/PH-Tools>.
# 
# Copyright (c) 2022, PH-Tools and bldgtyp, llc <phtools@bldgtyp.com> 
# Honeybee-PH is free software; you can redistribute it and/or modify 
# it under the terms of the GNU General Public License as published 
# by the Free Software Foundation; either version 3 of the License, 
# or (at your option) any later version. 
# 
# Honeybee-PH is distributed in the hope that it will be useful,
# but WITHOUT ANY WARRANTY; without even the implied warranty of 
# MERCHANTABILITY or FITNESS FOR A PARTICULAR PURPOSE. See the 
# GNU General Public License for more details.
# 
# For a copy of the GNU General Public License
# see <https://github.com/PH-Tools/honeybee_ph/blob/main/LICENSE>.
# 
# @license GPL-3.0+ <http://spdx.org/licenses/GPL-3.0+>
#
"""
Visualize HBPH 'Spaces' as Rhino Geometry. Use the "Get Spaces" 
component in order collect all the HBPH Spaces from Hooneybee-Rooms.
-
EM October 18, 2023

    Args:
        _spaces: (list[Space]) A list of the HBPH Spaces that you would like
            to visualize in the Rhino scene.
        
        _attribute_: The Floor-Segment attribute to visualize by. Input either -
"display_name"
"weighting_factor"
"weighted_floor_area"
"floor_area"
            
    Returns:
        space_floor_segments_: The space floor-segments as Rhino surfaces.
        
        space_volumes_: The space volumes as Rhino Breps.
"""

import scriptcontext as sc
import Rhino as rh
import rhinoscriptsyntax as rs
import ghpythonlib.components as ghc
import Grasshopper as gh

from honeybee_ph_rhino import gh_compo_io, gh_io

# ------------------------------------------------------------------------------
import honeybee_ph_rhino._component_info_
reload(honeybee_ph_rhino._component_info_)
ghenv.Component.Name = "HBPH - Visualize Spaces"
DEV = honeybee_ph_rhino._component_info_.set_component_params(ghenv, dev=False)
if DEV:
    from honeybee_ph_rhino.gh_compo_io import visualize_spaces as gh_compo_io
    reload(gh_compo_io)
    reload(gh_io)

# ------------------------------------------------------------------------------
# -- GH Interface
IGH = gh_io.IGH( ghdoc, ghenv, sc, rh, rs, ghc, gh )

# ------------------------------------------------------------------------------
gh_compo_interface = gh_compo_io.GHCompo_VisualizeSpaces(
    IGH,
    _spaces,
    _attribute_,
    )
space_floor_segments_, space_volumes_, wireframe_, legend_, values_ = gh_compo_interface.run()
# ---------- end visualize_hbph_spaces ----------

line_sdl = LineSDL(Start="0,0,0", Direction=Vector(0, 0, 1), Length=1)
create_duct = HBPHCreateVentilationDuct(geometry=line_sdl)  # -> out, vent_duct; inputs geometry: list of GeometryBase, insul_reflective: Boolean
# ---------- create_duct: Python ----------
#
# Honeybee-PH: A Plugin for adding Passive-House data to LadybugTools Honeybee-Energy Models
# 
# This component is part of the PH-Tools toolkit <https://github.com/PH-Tools>.
# 
# Copyright (c) 2022, PH-Tools and bldgtyp, llc <phtools@bldgtyp.com> 
# Honeybee-PH is free software; you can redistribute it and/or modify 
# it under the terms of the GNU General Public License as published 
# by the Free Software Foundation; either version 3 of the License, 
# or (at your option) any later version. 
# 
# Honeybee-PH is distributed in the hope that it will be useful,
# but WITHOUT ANY WARRANTY; without even the implied warranty of 
# MERCHANTABILITY or FITNESS FOR A PARTICULAR PURPOSE. See the 
# GNU General Public License for more details.
# 
# For a copy of the GNU General Public License
# see <https://github.com/PH-Tools/honeybee_ph/blob/main/LICENSE>.
# 
# @license GPL-3.0+ <http://spdx.org/licenses/GPL-3.0+>
#
"""
Create a new PH-HVAC Ventilation Duct which can be added to a PH-HVAC Ventilation System.
-
NOTE: Using the component will add ONLY the Passive House devices and will **NOT** add 
any components to the HB-Energy model. If you need to model mechancial equipment for an EnergyPlus
/ OpenStudio simulation then you must also use the Honeybee-Energy / IronBug components to setup
those devices separate from the inputs defined on the component here.
-
EM April 23, 2024

    Args:
        _geometry: (List[Polyline Curves]) The Rhino Curves that describe the duct path.
            
        _display_name: (str) An optional name for the duct.
        
        _duct_type: Input either - 
"-Supply / outdoor air duct"
"2-Extract / Exhaust air duct"

        _insul_thickness: (float) Default=25.4 mm [1-inch] | The thickness (mm) of the duct insulation. 
        
        _insul_conductivity: (float) Default=0.04 W/mk | The conductivity (W/mk) of the duct insulation. 
        
        _insul_reflective: (bool) Default=True | If the insualtion has a reflective coating. 
        
        _diameter: (float) Default=160mm [6.2-inches] | The round-duct diameter (mm)
        
        _height: (Optional[float]) Default=None
        
        _width: (Optional[float]) Default=None
        
    Returns:
        
        vent_duct_: The new PH Ventilation Duct which can be added to a PH Ventilation System object.
"""

import scriptcontext as sc
import Rhino as rh
import rhinoscriptsyntax as rs
import ghpythonlib.components as ghc
import Grasshopper as gh

from honeybee_ph_rhino import gh_compo_io, gh_io
from honeybee_ph_utils import preview

#-------------------------------------------------------------------------------
import honeybee_ph_rhino._component_info_
reload(honeybee_ph_rhino._component_info_)
ghenv.Component.Name = "HBPH - Create Ventilation Duct"
DEV = honeybee_ph_rhino._component_info_.set_component_params(ghenv, dev=False)
if DEV:
    reload(gh_io)
    from honeybee_energy_ph.hvac import ducting
    reload(ducting)
    from honeybee_ph_rhino.gh_compo_io.hvac import create_vent_duct as gh_compo_io
    reload(gh_compo_io)

# ------------------------------------------------------------------------------
# -- GH Interface
IGH = gh_io.IGH( ghdoc, ghenv, sc, rh, rs, ghc, gh )

#-------------------------------------------------------------------------------
gh_compo_interface = gh_compo_io.GHCompo_CreateVentDuct(
        IGH,
        _geometry,
        _display_name,
        _duct_type,
        _insul_thickness,
        _insul_conductivity,
        _insul_reflective,
        _diameter,
        _height,
        _width,
    )
vent_duct_ = gh_compo_interface.run()
    
#-------------------------------------------------------------------------------
# -- Preview
preview.object_preview(vent_duct_)
# ---------- end create_duct ----------
hbph_vent_types = HBPHVentTypes({"1-Balanced PH ventilation with HR [Default]": "1", "2-Extract air unit": "2", "3-Only window ventilation": "3"}, selected="1-Balanced PH ventilation with HR [Default]")
create_supportive_device = HBPHCreateSupportiveDevice(
    display_name="Example Device",
    device_type="10",
    device_quantity="3",
    inside=Toggle(False),
    energy_demand_W="123",
    yearly_runtime_kHrs="6.5")  # -> out, supportive_device; inputs device_quantity: Int32, inside: Boolean
# ---------- create_supportive_device: Python ----------
#
# Honeybee-PH: A Plugin for adding Passive-House data to LadybugTools Honeybee-Energy Models
# 
# This component is part of the PH-Tools toolkit <https://github.com/PH-Tools>.
# 
# Copyright (c) 2022, PH-Tools and bldgtyp, llc <phtools@bldgtyp.com> 
# Honeybee-PH is free software; you can redistribute it and/or modify 
# it under the terms of the GNU General Public License as published 
# by the Free Software Foundation; either version 3 of the License, 
# or (at your option) any later version. 
# 
# Honeybee-PH is distributed in the hope that it will be useful,
# but WITHOUT ANY WARRANTY; without even the implied warranty of 
# MERCHANTABILITY or FITNESS FOR A PARTICULAR PURPOSE. See the 
# GNU General Public License for more details.
# 
# For a copy of the GNU General Public License
# see <https://github.com/PH-Tools/honeybee_ph/blob/main/LICENSE>.
# 
# @license GPL-3.0+ <http://spdx.org/licenses/GPL-3.0+>
#
"""
PH-HVAC Supportive devices such as pumps and fans add energy use (and internal heat
gains) to a hb-room. This component will create new devices which can then be 
added to the HBPH Mechanical System. These devices will be used to add to the 
WUFI-Passive "Supportive Device / Auixilliary Energy" section in Systems / Distribution.
-
NOTE: Using the component will add ONLY the Passive House devices and will **NOT** add 
any components to the HB-Energy model. If you need to model mechancial equipment for an EnergyPlus
/ OpenStudio simulation then you must also use the Honeybee-Energy / IronBug components to setup
those devices separate from the inputs defined on the component here.
-
EM April 12, 2026
    Args:
        _display_name: (str) Name for the new PH-HVAC Supportive Device created
        
        _device_type: (str) The type of device. Input either -
4-Heat Circulation Pump
6-DHW Circulation Pump
7-DHW Storage Pump
10-Other / Custom 
               
        _device_quantity: (int) The number of devices to include.
            
        _inside: (bool) True if the device is inside the conditioned space and 
            will affect the overall internal heat gain rate.
            
        _energy_demand_W: (float) The Wattage of the device
        
        _yearly_runtime_kHrs: (float) The total annual runtime of the devide 
            expressed in kilo-hours (ie: 8,760 hrs/year = 8.760 kHrs/year)

        _ihg_utilization_factor: (float) OPTIONAL Default=1.0 utilization factor to apply
            when calcultion the impact on internal-heat-gains from this device.

        _ihg_usage_profile: (int) OPTIONAL The PHPP season / block that this device's
            internal-heat-gain lands in. Leave blank to default off the '_device_type'
            (DHW pumps -> None, heat pumps -> Winter, others -> All Year). Input either -
1-All Year
2-Winter
3-Summer
4-None (DHW)

    Returns:
        supportive_device_: A PH-HVAC Supportive Device which can be added to a 
            mechanical system.
"""

import scriptcontext as sc
import Rhino as rh
import rhinoscriptsyntax as rs
import ghpythonlib.components as ghc
import Grasshopper as gh


try:
    from honeybee_ph_utils import preview
except ImportError as e:
    raise ImportError('\nFailed to import honeybee_ph_utils:\n\t{}'.format(e))

try:
    from honeybee_ph_rhino import gh_compo_io, gh_io
except ImportError as e:
    raise ImportError('\nFailed to import honeybee_ph_rhino:\n\t{}'.format(e))
    
    
# -------------------------------------------------------------------------------------
import honeybee_ph_rhino._component_info_
reload(honeybee_ph_rhino._component_info_)
ghenv.Component.Name = "HBPH - Create Supportive Device"
DEV = honeybee_ph_rhino._component_info_.set_component_params(ghenv, dev=False)
if DEV:
    from honeybee_ph_rhino.gh_compo_io import ghio_validators
    reload(ghio_validators)
    from honeybee_energy_ph.hvac import supportive_device
    reload(supportive_device)
    from honeybee_ph_rhino.gh_compo_io.hvac import create_supportive_device as gh_compo_io
    reload(gh_compo_io)

# ------------------------------------------------------------------------------
# -- GH Interface
IGH = gh_io.IGH( ghdoc, ghenv, sc, rh, rs, ghc, gh )


# -------------------------------------------------------------------------------------
gh_compo_interface = gh_compo_io.GHCompo_CreateSupportiveDevice(
    IGH,
    _display_name,
    _device_type,
    _device_quantity,
    _inside,
    _energy_demand_W,
    _yearly_runtime_kHrs,
    _ihg_utilization_factor,
    _ihg_usage_profile,
)
supportive_device_ = gh_compo_interface.run()

# -------------------------------------------------------------------------------------
preview.object_preview(supportive_device_)
# ---------- end create_supportive_device ----------
create_supportive_device_2 = HBPHCreateSupportiveDevice(
    display_name="Example Kitchen Fan",
    device_type="10",
    device_quantity="1",
    inside=Toggle(True),
    energy_demand_W="500",
    yearly_runtime_kHrs="0.08")  # -> out, supportive_device; inputs device_quantity: Int32, inside: Boolean; same code as create_supportive_device
ph_ventilator = HBPHVentilator(display_name="Test Unit", sensible_hr="0.83", elec_efficiency="0.333")  # -> out, flatten(unit); inputs frost_protection: Boolean, inside: Boolean
# ---------- ph_ventilator: Python ----------
#
# Honeybee-PH: A Plugin for adding Passive-House data to LadybugTools Honeybee-Energy Models
# 
# This component is part of the PH-Tools toolkit <https://github.com/PH-Tools>.
# 
# Copyright (c) 2022, PH-Tools and bldgtyp, llc <phtools@bldgtyp.com> 
# Honeybee-PH is free software; you can redistribute it and/or modify 
# it under the terms of the GNU General Public License as published 
# by the Free Software Foundation; either version 3 of the License, 
# or (at your option) any later version. 
# 
# Honeybee-PH is distributed in the hope that it will be useful,
# but WITHOUT ANY WARRANTY; without even the implied warranty of 
# MERCHANTABILITY or FITNESS FOR A PARTICULAR PURPOSE. See the 
# GNU General Public License for more details.
# 
# For a copy of the GNU General Public License
# see <https://github.com/PH-Tools/honeybee_ph/blob/main/LICENSE>.
# 
# @license GPL-3.0+ <http://spdx.org/licenses/GPL-3.0+>
#
"""
Collects and organizes data for a PH-HVAC Ventilator Unit (HRV/ERV). Used as part of a 
PH-HVAC Ventilation System.
-
NOTE: Using the component will add ONLY the Passive House devices and will **NOT** add 
any components to the HB-Energy model. If you need to model mechancial equipment for an EnergyPlus
/ OpenStudio simulation then you must also use the Honeybee-Energy / IronBug components to setup
those devices separate from the inputs defined on the component here.
-
EM April 23, 2024
    Args:
        display_name_: (Optional[float]) The name of the Ventilator (ERV/HRV) Unit.
        
        sensible_hr_: (Optional[float]) Input the Ventialtion Unit's Heat Recovery %. Default is 75% 
        
        latent_hr_: (Optional[float]) Input the Ventialtion Unit's Moisture Recovery %. Default is 0% (HRV)
        
        elec_efficiency_: (Optional[float]) Input the Electrical Efficiency of the Ventialtion 
            Unit (W/m3h). Default is 0.55 W/m3h
        
        frost_protection: (bool): Unit requires frost-protection? Default=True. 
        
        frost_temp_: (Optional[float]) Min Temp [C] for frost protection to kick in. [deg.  C]. Default is -5 C
        
        inside_: (bool) Unt is installed inside the conditioned space? Default=True
    
    Returns:
        unit_: A Ventilator object for the Ventilation System. Connect to the 
            'ventUnit_' input on the 'Create Vent System' to build a PH-Style Ventilation System.
"""

import scriptcontext as sc
import Rhino as rh
import rhinoscriptsyntax as rs
import ghpythonlib.components as ghc
import Grasshopper as gh

from honeybee_ph_rhino import gh_compo_io, gh_io
from honeybee_ph_utils import preview


#-------------------------------------------------------------------------------
import honeybee_ph_rhino._component_info_
reload(honeybee_ph_rhino._component_info_)
ghenv.Component.Name = "HBPH - Ventilator"
DEV = honeybee_ph_rhino._component_info_.set_component_params(ghenv, dev=False)
if DEV:
    reload(gh_io)
    from honeybee_ph_rhino.gh_compo_io.hvac import create_ventilator as gh_compo_io
    reload(gh_compo_io)

# ------------------------------------------------------------------------------
# -- GH Interface
IGH = gh_io.IGH( ghdoc, ghenv, sc, rh, rs, ghc, gh )

# ------------------------------------------------------------------------------
gh_compo_interface = gh_compo_io.GHCompo_CreatePhVentilator(
        IGH,
        display_name_,
        sensible_hr_,
        latent_hr_,
        elec_efficiency_,
        frost_protection_,
        frost_temp_,
        inside_,
    )
unit_ = gh_compo_interface.run()

# ------------------------------------------------------------------------------
preview.object_preview(unit_)
# ---------- end ph_ventilator ----------
create_vent = HBPHCreateVentilationSystem(system_name="Test Vent System", system_type=hbph_vent_types, vent_unit=ph_ventilator.unit, duct_01=create_duct.vent_duct)  # -> out, vent_system; inputs duct_01: list, duct_02: list
# ---------- create_vent: Python ----------
#
# Honeybee-PH: A Plugin for adding Passive-House data to LadybugTools Honeybee-Energy Models
# 
# This component is part of the PH-Tools toolkit <https://github.com/PH-Tools>.
# 
# Copyright (c) 2022, PH-Tools and bldgtyp, llc <phtools@bldgtyp.com> 
# Honeybee-PH is free software; you can redistribute it and/or modify 
# it under the terms of the GNU General Public License as published 
# by the Free Software Foundation; either version 3 of the License, 
# or (at your option) any later version. 
# 
# Honeybee-PH is distributed in the hope that it will be useful,
# but WITHOUT ANY WARRANTY; without even the implied warranty of 
# MERCHANTABILITY or FITNESS FOR A PARTICULAR PURPOSE. See the 
# GNU General Public License for more details.
# 
# For a copy of the GNU General Public License
# see <https://github.com/PH-Tools/honeybee_ph/blob/main/LICENSE>.
# 
# @license GPL-3.0+ <http://spdx.org/licenses/GPL-3.0+>
#
"""
Create a new PH-HVAC Ventilation System which can serve one or more HB-Rooms.
-
NOTE: Using the component will add ONLY the Passive House devices and will **NOT** add 
any components to the HB-Energy model. If you need to model mechancial equipment for an EnergyPlus
/ OpenStudio simulation then you must also use the Honeybee-Energy / IronBug components to setup
those devices separate from the inputs defined on the component here.
-
EM April 21, 2024
    Args:
        system_name_: (str) The name to give to the fresh-air ventilation system.
            
        system_type_: Choose either -
            1-Balanced PH ventilation with HR [Default]
            2-Extract air unit
            3-Only window ventilation
        
        vent_unit_: (Optional[]) The Venilator (ERV/HRV) to use to ventilate the
            honeybee-Rooms.
        
        duct_01_: The supply cold-air duct (from ventilator to the building-envelope)
        
        duct_02_: The exhaust cold-air duct (from ventilator to the building-envelope)
        
    Returns:
        vent_system_: The new PH-HVAC Ventilation System object.
"""

try:
    from honeybee_ph_utils import preview
except ImportError as e:
    raise ImportError('\nFailed to import honeybee_ph_utils:\n\t{}'.format(e))

try:
    from honeybee_ph_rhino import gh_compo_io
except ImportError as e:
    raise ImportError('\nFailed to import honeybee_ph_rhino:\n\t{}'.format(e))


# --- 
import honeybee_ph_rhino._component_info_
reload(honeybee_ph_rhino._component_info_)
ghenv.Component.Name = "HBPH - Create Ventilation System"
DEV = honeybee_ph_rhino._component_info_.set_component_params(ghenv, dev=False)
if DEV:
    from honeybee_ph_rhino.gh_compo_io.hvac import create_vent_sys as gh_compo_io
    reload(gh_compo_io)

# ------------------------------------------------------------------------------
gh_compo_interface = gh_compo_io.GHCompo_CreateVentSystem(
        system_name_,
        system_type_,
        vent_unit_,
        duct_01_,
        duct_02_,
    )
vent_system_ = gh_compo_interface.run()

# ------------------------------------------------------------------------------
preview.object_preview(vent_system_)
# ---------- end create_vent ----------
add_mech = HBPHAddMechSystems(
    ventilation_system=create_vent.vent_system,
    space_conditioning_systems=flatten(merge),
    supportive_devices=flatten([create_supportive_device.supportive_device, create_supportive_device_2.supportive_device]),
    hb_rooms=add_ph_spaces.hb_rooms)  # -> out, hb_rooms; inputs space_conditioning_systems: list, supportive_devices: list, hb_rooms: list
# ---------- add_mech: Python ----------
#
# Honeybee-PH: A Plugin for adding Passive-House data to LadybugTools Honeybee-Energy Models
# 
# This component is part of the PH-Tools toolkit <https://github.com/PH-Tools>.
# 
# Copyright (c) 2022, PH-Tools and bldgtyp, llc <phtools@bldgtyp.com> 
# Honeybee-PH is free software; you can redistribute it and/or modify 
# it under the terms of the GNU General Public License as published 
# by the Free Software Foundation; either version 3 of the License, 
# or (at your option) any later version. 
# 
# Honeybee-PH is distributed in the hope that it will be useful,
# but WITHOUT ANY WARRANTY; without even the implied warranty of 
# MERCHANTABILITY or FITNESS FOR A PARTICULAR PURPOSE. See the 
# GNU General Public License for more details.
# 
# For a copy of the GNU General Public License
# see <https://github.com/PH-Tools/honeybee_ph/blob/main/LICENSE>.
# 
# @license GPL-3.0+ <http://spdx.org/licenses/GPL-3.0+>
#
"""
Set the PH-HVAC mechanical ventilation, heating, and cooling systems serving the Honeybee-Rooms.
-
NOTE: Using the component will add ONLY the Passive House devices and will **NOT** add 
any components to the HB-Energy model. If you need to model mechancial equipment for an EnergyPlus
/ OpenStudio simulation then you must also use the Honeybee-Energy / IronBug components to setup
those devices separate from the inputs defined on the component here.
-
EM April 21, 2024
    Args:
        _ventilation_system: (PhVentilationSystem) The Ventilation System serving the HB-Rooms.
        
        _space_conditioning_systems: (List) A list of the HBPH 'Space Conditioning' 
            (Heating/Cooling) Systems serving the HB-Rooms.
        
        _supportive_devices: (List) A list of any HBPH Supportive Devices (extra pumps, fans, etc)
            serving the HB-rooms.
        
        _hb_rooms: (List[Room]) A list of the hb-rooms served by the mechanical systems.
        
    Returns:
        hb_rooms_: The hb-rooms input, with the new PH-HVAC Mechanical Systems set.
"""

try:
    from honeybee_ph_rhino import gh_compo_io, gh_io
except ImportError as e:
    raise ImportError('\nFailed to import honeybee_ph_rhino:\n\t{}'.format(e))


#-------------------------------------------------------------------------------
import honeybee_ph_rhino._component_info_
reload(honeybee_ph_rhino._component_info_)
ghenv.Component.Name = "HBPH - Add Mech Systems"
DEV = honeybee_ph_rhino._component_info_.set_component_params(ghenv, dev=False)
if DEV:
    reload(gh_io)
    from honeybee_ph_rhino.gh_compo_io.hvac import add_systems as gh_compo_io
    reload(gh_compo_io)


#-------------------------------------------------------------------------------
# -- Add the new Systems to the HB-Rooms
gh_compo_interface = gh_compo_io.GHCompo_AddMechSystems(
        _ventilation_system,
        _space_conditioning_systems,
        _supportive_devices,
        _hb_rooms,
    )
hb_rooms_ = gh_compo_interface.run()
# ---------- end add_mech ----------

ph_op_period = HBPHOperationPeriod(hours_per_day="12", operating_fraction="0.75")  # -> out, op_period
# ---------- ph_op_period: Python ----------
#
# Honeybee-PH: A Plugin for adding Passive-House data to LadybugTools Honeybee-Energy Models
# 
# This component is part of the PH-Tools toolkit <https://github.com/PH-Tools>.
# 
# Copyright (c) 2022, PH-Tools and bldgtyp, llc <phtools@bldgtyp.com> 
# Honeybee-PH is free software; you can redistribute it and/or modify 
# it under the terms of the GNU General Public License as published 
# by the Free Software Foundation; either version 3 of the License, 
# or (at your option) any later version. 
# 
# Honeybee-PH is distributed in the hope that it will be useful,
# but WITHOUT ANY WARRANTY; without even the implied warranty of 
# MERCHANTABILITY or FITNESS FOR A PARTICULAR PURPOSE. See the 
# GNU General Public License for more details.
# 
# For a copy of the GNU General Public License
# see <https://github.com/PH-Tools/honeybee_ph/blob/main/LICENSE>.
# 
# @license GPL-3.0+ <http://spdx.org/licenses/GPL-3.0+>
#
"""
Create a new Operation Period with a fractional rate and an hours/ day of operation. 
These Operationg Periods are used in the creation of HB-PH Schedules.
-
EM January 22, 2025
    Args:
        name_: (str) Optional name for the period (ie: "high", "low", "on", off", etc..)
        
        _hours_per_day: (0-24) The number of hours per day to operate at the
            specified rate.
        _operating_fraction: (0-1.0) The fractional value to operate at for the
            hours / day specified.
    
    Returns:
        op_period_: The HB-PH Operation Period. Connect this to an HB-PH Schedule
            in order to describe the operating fraction.
"""

import scriptcontext as sc
import Rhino as rh
import rhinoscriptsyntax as rs
import ghpythonlib.components as ghc
import Grasshopper as gh


try:
    from honeybee_ph_utils import preview
except ImportError as e:
    raise ImportError('\nFailed to import honeybee_ph_utils:\n\t{}'.format(e))

try:
    from honeybee_ph_rhino import gh_compo_io
except ImportError as e:
    raise ImportError('\nFailed to import honeybee_ph_rhino:\n\t{}'.format(e))

try:
    from ph_gh_component_io import gh_io
except ImportError as e:
    raise ImportError('\nFailed to import ph_gh_component_io:\n\t{}'.format(e))


# ------------------------------------------------------------------------------
import honeybee_ph_rhino._component_info_
reload(honeybee_ph_rhino._component_info_)
ghenv.Component.Name = "HBPH - Operation Period"
DEV = honeybee_ph_rhino._component_info_.set_component_params(ghenv, dev=False)
if DEV:
    from honeybee_ph_rhino.gh_compo_io.program import create_operating_period as gh_compo_io
    reload(gh_compo_io)
    reload(gh_io)

# ------------------------------------------------------------------------------
# -- GH Interface
IGH = gh_io.IGH( ghdoc, ghenv, sc, rh, rs, ghc, gh )


#-------------------------------------------------------------------------------
gh_compo_interface = gh_compo_io.GHCompo_CreateOccPeriod(
        IGH,
        name_,
        _hours_per_day,
        _operating_fraction,
    )
op_period_ = gh_compo_interface.run()


# ------------------------------------------------------------------------------
preview.object_preview(op_period_)
# ---------- end ph_op_period ----------
ph_op_period_2 = HBPHOperationPeriod(hours_per_day="1", operating_fraction="1")  # -> out, op_period; same code as ph_op_period
ph_op_period_3 = HBPHOperationPeriod(hours_per_day="6", operating_fraction="0.5")  # -> out, op_period; same code as ph_op_period
ph_op_period_4 = HBPHOperationPeriod(hours_per_day="5", operating_fraction="40")  # -> out, op_period; same code as ph_op_period
ph_vent_sched = HBPHVentSchedule(
    op_period_high=ph_op_period_2.op_period,
    op_period_standard=ph_op_period.op_period,
    op_period_basic=ph_op_period_3.op_period,
    op_period_minimum=ph_op_period_4.op_period)  # -> out, ventilation_sch
# ---------- ph_vent_sched: Python ----------
#
# Honeybee-PH: A Plugin for adding Passive-House data to LadybugTools Honeybee-Energy Models
# 
# This component is part of the PH-Tools toolkit <https://github.com/PH-Tools>.
# 
# Copyright (c) 2022, PH-Tools and bldgtyp, llc <phtools@bldgtyp.com> 
# Honeybee-PH is free software; you can redistribute it and/or modify 
# it under the terms of the GNU General Public License as published 
# by the Free Software Foundation; either version 3 of the License, 
# or (at your option) any later version. 
# 
# Honeybee-PH is distributed in the hope that it will be useful,
# but WITHOUT ANY WARRANTY; without even the implied warranty of 
# MERCHANTABILITY or FITNESS FOR A PARTICULAR PURPOSE. See the 
# GNU General Public License for more details.
# 
# For a copy of the GNU General Public License
# see <https://github.com/PH-Tools/honeybee_ph/blob/main/LICENSE>.
# 
# @license GPL-3.0+ <http://spdx.org/licenses/GPL-3.0+>
#
"""
Create a new Honeybee-Energy ScheduleRuleset for the fresh-air ventilation system 
operation using 'Passive House' style inputs. These inputs will be used to create an 
equivalent constant-value fresh air ventilation operation scheduled which can then be
used to control the Honeybee-Energy fresh air ventilation. Note that the values here
will also be stored and used as detailed inputs into  WUFI-Passive or PHPP upon export.
-
EM January 22, 2025
    Args:
        _name_: Optional name for the Ventilation Schedule
        
        operating_day_per_week_: (default=7) Value for the number of days/week to run
            at the specified flowrates.
        operating_weeks_per_year_: (default=52) Value for the number of weeks/year to 
            run at the specified flowrates.
        
        _op_period_high: Enter an Operation-Period decribing the high-speed period.
        _op_period_standard: Enter an Operation-Period decribing the normal-speed period.
        _op_period_basic: Enter an Operation-Period decribing the low-speed period.
        _op_period_minimum: Enter an Operation-Period decribing the minimum-speed period.
    
    Returns:
        ventilation_sch_: The HB-Ventilation Schedule which can be applied to HB Rooms
"""


import scriptcontext as sc
import Rhino as rh
import rhinoscriptsyntax as rs
import ghpythonlib.components as ghc
import Grasshopper as gh


try:
    from honeybee_ph_utils import preview
except ImportError as e:
    raise ImportError('\nFailed to import honeybee_ph_utils:\n\t{}'.format(e))

try:
    from honeybee_ph_rhino import gh_compo_io
except ImportError as e:
    raise ImportError('\nFailed to import honeybee_ph_rhino:\n\t{}'.format(e))

try:
    from ph_gh_component_io import gh_io
except ImportError as e:
    raise ImportError('\nFailed to import ph_gh_component_io:\n\t{}'.format(e))


# ------------------------------------------------------------------------------
import honeybee_ph_rhino._component_info_
reload(honeybee_ph_rhino._component_info_)
ghenv.Component.Name = "HBPH - Vent. Schedule"
DEV = honeybee_ph_rhino._component_info_.set_component_params(ghenv, dev=False)
if DEV:
    from honeybee_ph_rhino.gh_compo_io.program import create_vent_schd as gh_compo_io
    reload(gh_compo_io)
    reload(gh_io)

# ------------------------------------------------------------------------------
# -- GH Interface
IGH = gh_io.IGH( ghdoc, ghenv, sc, rh, rs, ghc, gh )


#-------------------------------------------------------------------------------
gh_compo_interface = gh_compo_io.GHCompo_CreateVentSched(
        IGH,
        _name_,
        operating_days_per_week_,
        operating_weeks_per_year_,
        _op_period_high,
        _op_period_standard,
        _op_period_basic,
        _op_period_minimum,
    )
ventilation_sch_ = gh_compo_interface.run()

# ------------------------------------------------------------------------------  
if ventilation_sch_:
    preview.object_preview(ventilation_sch_.properties.ph)
# ---------- end ph_vent_sched ----------
applyroomsch = HBApplyRoomSchedules(room_or_program=flatten(add_mech.hb_rooms), ventilation_sch=ph_vent_sched.ventilation_sch)  # -> out, mod_obj; plug-in component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

hbph_shw_heater_types = HBPHSHWHeaterTypes({"Elec. Resistance": "1-Electric", "Boiler (gas/oil)": "2-Boiler (gas/oil)", "Boiler (wood)": "3-Boiler (wood)", "District Heating": "4-District", "Heat Pump (annual COP)": "5-HeatPump (annual COP)", "Heat Pump (monthly COP)": "6-HeatPump (monthly COP)", "Heat Pump (inside)": "7-HeatPump (inside)"}, selected="Heat Pump (inside)")
create_exhaust_ventilator = HBPHCreateExhaustVentilator(name="example_dryer_vent", type="1", flow_rate_m3s="123", annual_runtime_minutes="7.625")  # -> out, exhaust_vent_device
# ---------- create_exhaust_ventilator: Python ----------
#
# Honeybee-PH: A Plugin for adding Passive-House data to LadybugTools Honeybee-Energy Models
# 
# This component is part of the PH-Tools toolkit <https://github.com/PH-Tools>.
# 
# Copyright (c) 2022, PH-Tools and bldgtyp, llc <phtools@bldgtyp.com> 
# Honeybee-PH is free software; you can redistribute it and/or modify 
# it under the terms of the GNU General Public License as published 
# by the Free Software Foundation; either version 3 of the License, 
# or (at your option) any later version. 
# 
# Honeybee-PH is distributed in the hope that it will be useful,
# but WITHOUT ANY WARRANTY; without even the implied warranty of 
# MERCHANTABILITY or FITNESS FOR A PARTICULAR PURPOSE. See the 
# GNU General Public License for more details.
# 
# For a copy of the GNU General Public License
# see <https://github.com/PH-Tools/honeybee_ph/blob/main/LICENSE>.
# 
# @license GPL-3.0+ <http://spdx.org/licenses/GPL-3.0+>
#
"""
Create a new PH-HVAC Exhaust Ventilator for use in WUFI-Passive models. This device 
can be added to one or more rooms using the "HBPH - Add Exhaust Ventilator" component 
in order to simulate the  effect of direct exhaust ventilation without heat-recovery. 
This is useful for devices such as direct-vent dryers, kitchen hoods or other elements.
-
NOTE: Using the component will add ONLY the Passive House devices and will **NOT** add 
any components to the HB-Energy model. If you need to model mechancial equipment for an EnergyPlus
/ OpenStudio simulation then you must also use the Honeybee-Energy / IronBug components to setup
those devices separate from the inputs defined on the component here.
-
EM April 21, 2024
    Args:
        _name: (str) Name for the new HBPH Exhaust Ventilator
        
        _type: (str) The type of device. Input either -
"1-Dryer"
"2-Kitchen Hood"
"3-User Defined"
               
        _flow_rate_m3s: (float) The total m3/s of airflow from the exhaust 
            ventilation device.
            
        _annual_runtime_minutes: (float) Optional. If device type is 'User Defined'
            input the annual runtime (minutes).
        
    Returns:
        exhaust_vent_device_: An HBPH Exhaust Ventilator object which can be 
            added to one or more honeybee-rooms.
"""

import scriptcontext as sc
import Rhino as rh
import rhinoscriptsyntax as rs
import ghpythonlib.components as ghc
import Grasshopper as gh


try:
    from honeybee_ph_utils import preview
except ImportError as e:
    raise ImportError('\nFailed to import honeybee_ph_utils:\n\t{}'.format(e))

try:
    from honeybee_ph_rhino import gh_compo_io, gh_io
except ImportError as e:
    raise ImportError('\nFailed to import honeybee_ph_rhino:\n\t{}'.format(e))
    
    
# -------------------------------------------------------------------------------------
import honeybee_ph_rhino._component_info_
reload(honeybee_ph_rhino._component_info_)
ghenv.Component.Name = "HBPH - Create Exhaust Ventilator"
DEV = honeybee_ph_rhino._component_info_.set_component_params(ghenv, dev=False)
if DEV:
    from honeybee_energy_ph.hvac import ventilation
    reload(ventilation)
    from honeybee_ph_rhino.gh_compo_io import ghio_validators
    reload(ghio_validators)
    from honeybee_ph_rhino.gh_compo_io.hvac import create_exhaust_vent as gh_compo_io
    reload(gh_compo_io)

# ------------------------------------------------------------------------------
# -- GH Interface
IGH = gh_io.IGH( ghdoc, ghenv, sc, rh, rs, ghc, gh )


# -------------------------------------------------------------------------------------
gh_compo_interface = gh_compo_io.GHCompo_CreateExhaustVent(
        IGH, _name, _type, _flow_rate_m3s, _annual_runtime_minutes)
exhaust_vent_device_ = gh_compo_interface.run()

# -------------------------------------------------------------------------------------
preview.object_preview(exhaust_vent_device_)
# ---------- end create_exhaust_ventilator ----------
create_exhaust_ventilator_2 = HBPHCreateExhaustVentilator(name="example_kitchen_hood", type="2", flow_rate_m3s="300 CFM", annual_runtime_minutes="0.08")  # -> out, exhaust_vent_device; same code as create_exhaust_ventilator
hbph_shw_heater_use_ttpe = HBPHSHWHeaterUseTtpe({"1-Consumer", "2-Instant", "3-Commercial"}, selected="1-Consumer")
line = LineSDL(Start="0,0,0", Direction=Vector(0, 0, 1), Length="5")
hbph_shw_pipe_material = HBPHSHWPipeMaterial({"1-COPPER_M": 1, "2-COPPER_L": 2, "3-COPPER_K": 3, "4-CPVC_CTS_SDR": 4, "5-CPVC_SCH_40": 5, "6-PEX": 6, "7-PE": 7, "8-PEX_CTS_SDR": 8}, selected="3-COPPER_K")
hbph_shw_pipe_material_2 = HBPHSHWPipeMaterial({"1-COPPER_M": 1, "2-COPPER_L": 2, "3-COPPER_K": 3, "4-CPVC_CTS_SDR": 4, "5-CPVC_SCH_40": 5, "6-PEX": 6, "7-PE": 7, "8-PEX_CTS_SDR": 8}, selected="6-PEX")
hbph_shw_pipe_material_3 = HBPHSHWPipeMaterial({"1-COPPER_M": 1, "2-COPPER_L": 2, "3-COPPER_K": 3, "4-CPVC_CTS_SDR": 4, "5-CPVC_SCH_40": 5, "6-PEX": 6, "7-PE": 7, "8-PEX_CTS_SDR": 8}, selected="1-COPPER_M")
merge_4 = Merge(Data1=create_exhaust_ventilator.exhaust_vent_device, Data2=create_exhaust_ventilator_2.exhaust_vent_device)  # -> flatten(Result)
create_exhaust_ventilator_3 = HBPHAddExhaustVentilator(exhaust_vent_devices=merge_4, hb_rooms=applyroomsch.mod_obj)  # -> out, hb_rooms; inputs exhaust_vent_devices: list, hb_rooms: list
# ---------- create_exhaust_ventilator_3: Python ----------
#
# Honeybee-PH: A Plugin for adding Passive-House data to LadybugTools Honeybee-Energy Models
# 
# This component is part of the PH-Tools toolkit <https://github.com/PH-Tools>.
# 
# Copyright (c) 2022, PH-Tools and bldgtyp, llc <phtools@bldgtyp.com> 
# Honeybee-PH is free software; you can redistribute it and/or modify 
# it under the terms of the GNU General Public License as published 
# by the Free Software Foundation; either version 3 of the License, 
# or (at your option) any later version. 
# 
# Honeybee-PH is distributed in the hope that it will be useful,
# but WITHOUT ANY WARRANTY; without even the implied warranty of 
# MERCHANTABILITY or FITNESS FOR A PARTICULAR PURPOSE. See the 
# GNU General Public License for more details.
# 
# For a copy of the GNU General Public License
# see <https://github.com/PH-Tools/honeybee_ph/blob/main/LICENSE>.
# 
# @license GPL-3.0+ <http://spdx.org/licenses/GPL-3.0+>
#
"""
Add one or more PH-HVAC Exhaust Ventilator devices to the Honeybee-Rooms. This is used
primarily for WUFI-Passive which has a separate input for dedicated exhaust equipment 
such as that used for Kitchens, Dryers and other typical uses.
-
NOTE: Using the component will add ONLY the Passive House devices and will **NOT** add 
any components to the HB-Energy model. If you need to model mechancial equipment for an EnergyPlus
/ OpenStudio simulation then you must also use the Honeybee-Energy / IronBug components to setup
those devices separate from the inputs defined on the component here.
-
EM April 21, 2024
    Args:
        _exhaust_vent_devices: (List[_ExhaustVentilatorBase]) A list of the Exhaust 
            Ventilator objects that you would like to add to the Honeybee-rooms.

        _hb_rooms: (List[room.Room]): A list of the rooms to add the Exhaust Ventilator
            to. Note that each ventilator created will only show up once in the
            WUFI-model. If you want more than one fan, you should create more than 
            one and add them to the approproate rooms.
        
    Returns:
        hb_rooms_: The Honeybee rooms with the new Exhaust Ventilators added.
"""

import scriptcontext as sc
import Rhino as rh
import rhinoscriptsyntax as rs
import ghpythonlib.components as ghc
import Grasshopper as gh


try:
    from honeybee_ph_utils import preview
except ImportError as e:
    raise ImportError('\nFailed to import honeybee_ph_utils:\n\t{}'.format(e))

try:
    from honeybee_ph_rhino import gh_compo_io, gh_io
except ImportError as e:
    raise ImportError('\nFailed to import honeybee_ph_rhino:\n\t{}'.format(e))
    
    
# -------------------------------------------------------------------------------------
import honeybee_ph_rhino._component_info_
reload(honeybee_ph_rhino._component_info_)
ghenv.Component.Name = "HBPH - Add Exhaust Ventilator"
DEV = honeybee_ph_rhino._component_info_.set_component_params(ghenv, dev=False)
if DEV:
    reload(gh_io)
    from honeybee_ph_rhino.gh_compo_io import ghio_validators
    reload(ghio_validators)
    from honeybee_ph_rhino.gh_compo_io.hvac import add_exhaust_vent as gh_compo_io
    reload(gh_compo_io)

# ------------------------------------------------------------------------------
# -- GH Interface
IGH = gh_io.IGH( ghdoc, ghenv, sc, rh, rs, ghc, gh )


# -------------------------------------------------------------------------------------
gh_compo_interface = gh_compo_io.GHCompo_AddExhaustVent(IGH, _exhaust_vent_devices, _hb_rooms)
hb_rooms_ = gh_compo_interface.run()
# ---------- end create_exhaust_ventilator_3 ----------
calc_water_heater_ef = HBPHCalculateWaterHeaterEnergyFactor(heater_type=hbph_shw_heater_types, use_type=hbph_shw_heater_use_ttpe, UEF="3")  # -> out, annual_energy_factor
# ---------- calc_water_heater_ef: Python ----------
#
# Honeybee-PH: A Plugin for adding Passive-House data to LadybugTools Honeybee-Energy Models
# 
# This component is part of the PH-Tools toolkit <https://github.com/PH-Tools>.
# 
# Copyright (c) 2025, PH-Tools and bldgtyp, llc <phtools@bldgtyp.com> 
# Honeybee-PH is free software; you can redistribute it and/or modify 
# it under the terms of the GNU General Public License as published 
# by the Free Software Foundation; either version 3 of the License, 
# or (at your option) any later version. 
# 
# Honeybee-PH is distributed in the hope that it will be useful,
# but WITHOUT ANY WARRANTY; without even the implied warranty of 
# MERCHANTABILITY or FITNESS FOR A PARTICULAR PURPOSE. See the 
# GNU General Public License for more details.
# 
# For a copy of the GNU General Public License
# see <https://github.com/PH-Tools/honeybee_ph/blob/main/LICENSE>.
# 
# @license GPL-3.0+ <http://spdx.org/licenses/GPL-3.0+>
#
"""
Convert a Water-Heater 'UEF' value into an equivalent 'EF' value. 
-
The Uniform Energy Factor (UEF) and Energy Factor (EF) are both efficiency ratings for 
water heaters, but UEF is the newer standard that replaced EF to provide more accurate 
and representative efficiency measurements. 
-
This is required for certain types of water-heaters in WUFI-Passive. The calculator 
here follows the conversion factors found in: 
    'RESNET Energy Factor Conversion Equations based on Water Heater Type'
    https://www.resnet.us/wp-content/uploads/RESNET-EF-Calculator-2017.xlsx
-
EM March 6, 2025
    Args:

        _heater_type: (str) Input either - 
1-Elec. Resistance
2-Boiler (gas/oil)
3-Boiler (wood)
4-District Heating
5-Heat Pump (annual COP)
6-Heat Pump (monthly COP)
7-Heat Pump (inside)

        _use_type: (str) Input either - 
1-Consumer (ie: single-family home, etc.)
2-Instant
3-Commercial (ie: apartment building, etc.)

        _UEF: (float) The manufacturer's stated 'UEF' value for the water-heater.
            
    Returns:
        annual_energy_factor_: The 'EF' value calculated from the input 'UEF'
"""


import scriptcontext as sc
import Rhino as rh
import rhinoscriptsyntax as rs
import ghpythonlib.components as ghc
import Grasshopper as gh


try:
    from honeybee_ph_utils import preview
except ImportError as e:
    raise ImportError('\nFailed to import honeybee_ph_utils:\n\t{}'.format(e))

try:
    from honeybee_ph_rhino import gh_compo_io
except ImportError as e:
    raise ImportError('\nFailed to import honeybee_ph_rhino:\n\t{}'.format(e))

try:
    from ph_gh_component_io import gh_io
except ImportError as e:
    raise ImportError('\nFailed to import ph_gh_component_io:\n\t{}'.format(e))


#-------------------------------------------------------------------------------
import honeybee_ph_rhino._component_info_
reload(honeybee_ph_rhino._component_info_)
ghenv.Component.Name = "HBPH - Calculate Water Heater Energy Factor"
DEV = honeybee_ph_rhino._component_info_.set_component_params(ghenv, dev=False)
if DEV:
    from honeybee_ph_rhino.gh_compo_io.hvac import calc_water_heater_EF as gh_compo_io
    reload(gh_compo_io)
    reload(gh_io)

# ------------------------------------------------------------------------------
# -- GH Interface
IGH = gh_io.IGH( ghdoc, ghenv, sc, rh, rs, ghc, gh )


#-------------------------------------------------------------------------------
gh_compo_interface = gh_compo_io.GHCompo_CalculateWaterHeaterEnergyFactor(
        IGH,
        _heater_type,
        _use_type,
        _UEF,
    )
annual_energy_factor_ = gh_compo_interface.run()
# ---------- end calc_water_heater_ef ----------
create_shading = HBPHCreateBuildingShading(hb_rooms=create_exhaust_ventilator_3.hb_rooms)  # -> out, window_surfaces, shading_surfaces, hb_rooms; inputs hb_rooms: list
# ---------- create_shading: Python ----------
#
# Honeybee-PH: A Plugin for adding Passive-House data to LadybugTools Honeybee-Energy Models
# 
# This component is part of the PH-Tools toolkit <https://github.com/PH-Tools>.
# 
# Copyright (c) 2022, PH-Tools and bldgtyp, llc <phtools@bldgtyp.com> 
# Honeybee-PH is free software; you can redistribute it and/or modify 
# it under the terms of the GNU General Public License as published 
# by the Free Software Foundation; either version 3 of the License, 
# or (at your option) any later version. 
# 
# Honeybee-PH is distributed in the hope that it will be useful,
# but WITHOUT ANY WARRANTY; without even the implied warranty of 
# MERCHANTABILITY or FITNESS FOR A PARTICULAR PURPOSE. See the 
# GNU General Public License for more details.
# 
# For a copy of the GNU General Public License
# see <https://github.com/PH-Tools/honeybee_ph/blob/main/LICENSE>.
# 
# @license GPL-3.0+ <http://spdx.org/licenses/GPL-3.0+>
#
"""
Create the 'punched' building geometry and all aperture 'reveals' which are
used when calculating detailed shading factors.
-
EM October 2, 2022
    Args:
        _hb_rooms: The Honeybee Rooms with apertures.
    
    Returns:
        window_surfaces_: The window surfaces as Brep objects, 'inset' into the 
            Honeybee-room. These are useful for visualization purposes.
        
        shading_surfaces_: The Honeybee-Room building surfaces as Brep objects
            with all the apertures 'punched' out and all side reveals for apertures
            added. These are used to calculate accurate shading factors for 
            apertures.
            
        hb_rooms_: The Honeybe Rooms.
"""

import scriptcontext as sc
import Rhino as rh
import rhinoscriptsyntax as rs
import ghpythonlib.components as ghc
import Grasshopper as gh


try:
    from honeybee_ph_utils import preview
except ImportError as e:
    raise ImportError('\nFailed to import honeybee_ph_utils:\n\t{}'.format(e))

try:
    from honeybee_ph_rhino import gh_compo_io, gh_io
except ImportError as e:
    raise ImportError('\nFailed to import honeybee_ph_rhino:\n\t{}'.format(e))

# ------------------------------------------------------------------------------
import honeybee_ph_rhino._component_info_
reload(honeybee_ph_rhino._component_info_)
ghenv.Component.Name = "HBPH - Create Building Shading"
DEV = honeybee_ph_rhino._component_info_.set_component_params(ghenv, dev=False)
if DEV:
    reload(gh_compo_io)
    reload(gh_io)

# ------------------------------------------------------------------------------
# -- GH Interface
IGH = gh_io.IGH( ghdoc, ghenv, sc, rh, rs, ghc, gh )


#-------------------------------------------------------------------------------
gh_compo_interface = gh_compo_io.GHCompo_CreateBuildingShading(
        IGH,
        _hb_rooms,
    )
window_surfaces_, shading_surfaces_, hb_rooms_ = gh_compo_interface.run()
# ---------- end create_shading ----------
create_fixture_twig_pipes = HBPHCreateSHWPipeFixtures(display_name="Test Fixture", material=hbph_shw_pipe_material_3, diameter="0.375in", water_temp="55 C", geometry=line)  # -> out, dhw_fixture_piping; inputs display_name: list, material: list, diameter: list, water_temp: list, geometry: list of GeometryBase
# ---------- create_fixture_twig_pipes: Python ----------
#
# Honeybee-PH: A Plugin for adding Passive-House data to LadybugTools Honeybee-Energy Models
# 
# This component is part of the PH-Tools toolkit <https://github.com/PH-Tools>.
# 
# Copyright (c) 2022, PH-Tools and bldgtyp, llc <phtools@bldgtyp.com> 
# Honeybee-PH is free software; you can redistribute it and/or modify 
# it under the terms of the GNU General Public License as published 
# by the Free Software Foundation; either version 3 of the License, 
# or (at your option) any later version. 
# 
# Honeybee-PH is distributed in the hope that it will be useful,
# but WITHOUT ANY WARRANTY; without even the implied warranty of 
# MERCHANTABILITY or FITNESS FOR A PARTICULAR PURPOSE. See the 
# GNU General Public License for more details.
# 
# For a copy of the GNU General Public License
# see <https://github.com/PH-Tools/honeybee_ph/blob/main/LICENSE>.
# 
# @license GPL-3.0+ <http://spdx.org/licenses/GPL-3.0+>
#
"""
Create a new Ph-HVAC Hot Water Fixture ("Twig") Piping Object.

Fixture pipes are connected to a 'Branch' pipe object.
-
NOTE: Using the component will add ONLY the Passive House devices and will **NOT** add 
any components to the HB-Energy model. If you need to model mechancial equipment for an EnergyPlus
/ OpenStudio simulation then you must also use the Honeybee-Energy / IronBug components to setup
those devices separate from the inputs defined on the component here.
-
EM May 21, 2024

    Args:
        _display_name: (Optional[str]) An optional name for the fixture line.
        
        _material: (str) Input either -
1-COPPER_M
2-COPPER_L
3-COPPER_K
4-CPVC_CTS_SDR
5-CPVC_SCH_40
6-PEX
7-PE
8-PEX_CTS_SDR
 
        _diameter: (List[float]) default=12.7mm (1/2in) | The pipe diameter (m)

        _water_temp: (List[float]) default=60.0C | The temperature of the water.

        _geometry: (List[Curve]): A list of curves representing the Hot-Water Fixture
            Piping elements.
            
    Returns:
        dhw_fixture_piping_: (List[PhPipeElement]) A list of the new HBPH Piping
            objects created. These can be added to an HBPH 'Branch' pipe object.
"""

import scriptcontext as sc
import Rhino as rh
import rhinoscriptsyntax as rs
import ghpythonlib.components as ghc
import Grasshopper as gh

from honeybee_ph_rhino import gh_compo_io, gh_io
from honeybee_ph_utils import preview

#-------------------------------------------------------------------------------
import honeybee_ph_rhino._component_info_
reload(honeybee_ph_rhino._component_info_)
ghenv.Component.Name = "HBPH - Create SHW Pipe | Fixtures"
DEV = honeybee_ph_rhino._component_info_.set_component_params(ghenv, dev=False)
if DEV:
    reload(gh_io)
    from honeybee_ph_rhino.gh_compo_io.shw import create_pipe_fixtures as gh_compo_io
    reload(gh_compo_io)

# ------------------------------------------------------------------------------
# -- GH Interface
IGH = gh_io.IGH( ghdoc, ghenv, sc, rh, rs, ghc, gh )

#-------------------------------------------------------------------------------
gh_compo_interface = gh_compo_io.GHCompo_CreateSHWFixturePipes(
        IGH,
        _display_name,
        _material,
        _diameter,
        _geometry,
        _water_temp,
    )
dhw_fixture_piping_ = gh_compo_interface.run()
    
#-------------------------------------------------------------------------------
# -- Preview
for pipe in dhw_fixture_piping_:
    preview.object_preview(pipe)
# ---------- end create_fixture_twig_pipes ----------
create_branch_pipes = HBPHCreateSHWPipeBranches(
    dhw_fixture_piping=create_fixture_twig_pipes.dhw_fixture_piping,
    display_name="Test Branch",
    material=hbph_shw_pipe_material,
    diameter="0.75in",
    geometry=line)  # -> out, dhw_branch_piping; inputs dhw_fixture_piping: list, display_name: list, material: list, diameter: list, water_temp: list, geometry: list of GeometryBase
# ---------- create_branch_pipes: Python ----------
#
# Honeybee-PH: A Plugin for adding Passive-House data to LadybugTools Honeybee-Energy Models
# 
# This component is part of the PH-Tools toolkit <https://github.com/PH-Tools>.
# 
# Copyright (c) 2022, PH-Tools and bldgtyp, llc <phtools@bldgtyp.com> 
# Honeybee-PH is free software; you can redistribute it and/or modify 
# it under the terms of the GNU General Public License as published 
# by the Free Software Foundation; either version 3 of the License, 
# or (at your option) any later version. 
# 
# Honeybee-PH is distributed in the hope that it will be useful,
# but WITHOUT ANY WARRANTY; without even the implied warranty of 
# MERCHANTABILITY or FITNESS FOR A PARTICULAR PURPOSE. See the 
# GNU General Public License for more details.
# 
# For a copy of the GNU General Public License
# see <https://github.com/PH-Tools/honeybee_ph/blob/main/LICENSE>.
# 
# @license GPL-3.0+ <http://spdx.org/licenses/GPL-3.0+>
#
"""
Create new PH-HVAC Hot Water Branch Piping Object.

A Branch will have one or more 'Fixture' pipes connected to it. Branch pipes are 
then connected to a 'Trunk' pipe. 
-
NOTE: Using the component will add ONLY the Passive House devices and will **NOT** add 
any components to the HB-Energy model. If you need to model mechancial equipment for an EnergyPlus
/ OpenStudio simulation then you must also use the Honeybee-Energy / IronBug components to setup
those devices separate from the inputs defined on the component here.
-
EM May 21, 2024

    Args:
        _dhw_fixture_piping: (List[PhPipeElement]) A list of the 'Fixture' (twig) pipes that should 
            be connected to this 'branch' line.
            
        _display_name: (Optional[str]) An optional name for the trunk line.
        
        _material: (str) Input either -
1-COPPER_M
2-COPPER_L
3-COPPER_K
4-CPVC_CTS_SDR
5-CPVC_SCH_40
6-PEX
7-PE
8-PEX_CTS_SDR
 
        _diameter: (List[float]) default=12.7mm (1/2in) | The pipe diameter (m)

        _water_temp: (List[float]) default=60.0C | The temperature of the water.

        _geometry: (List[Curve]): A list of curves representing the Hot-Water Branch
            Piping elements. Note that one new branch will be created from EACH curve input
            and EACH fixture input will be added to EACH branch line which may cause 
            double entry of the fixtures. If you are trying to build a single branch with 
            multiple segments, joing the curves together into a single polyline, or organize
            the fixture-piping into separate datatree-branches first.
            
    Returns:
        dhw_branch_piping_: (List[PhPipeBranch]) A list of the new HBPH Piping
            objects created. These branches can be added to an HBPH "Trunk" pipe object.
"""

import scriptcontext as sc
import Rhino as rh
import rhinoscriptsyntax as rs
import ghpythonlib.components as ghc
import Grasshopper as gh

from honeybee_ph_rhino import gh_compo_io, gh_io
from honeybee_ph_utils import preview

#-------------------------------------------------------------------------------
import honeybee_ph_rhino._component_info_
reload(honeybee_ph_rhino._component_info_)
ghenv.Component.Name = "HBPH - Create SHW Pipe | Branches"
DEV = honeybee_ph_rhino._component_info_.set_component_params(ghenv, dev=False)
if DEV:
    reload(gh_io)
    from honeybee_ph_rhino.gh_compo_io.shw import create_pipe_branches as gh_compo_io
    reload(gh_compo_io)

# ------------------------------------------------------------------------------
# -- GH Interface
IGH = gh_io.IGH( ghdoc, ghenv, sc, rh, rs, ghc, gh )

#-------------------------------------------------------------------------------
gh_compo_interface = gh_compo_io.GHCompo_CreateSHWBranchPipes(
        IGH,
        _dhw_fixture_piping,
        _display_name,
        _material,
        _diameter,
        _geometry,
        _water_temp,
    )
dhw_branch_piping_ = gh_compo_interface.run()
    
#-------------------------------------------------------------------------------
# -- Preview
for pipe in dhw_branch_piping_:
    preview.object_preview(pipe)
# ---------- end create_branch_pipes ----------
create_trunk_pipes = HBPHCreateSHWPipeTrunks(
    dhw_branches=create_branch_pipes.dhw_branch_piping,
    display_name="Test Trunk",
    demand_recirculation=Toggle(True),
    material=hbph_shw_pipe_material_2,
    diameter="1.5\"",
    geometry=line)  # -> out, dhw_trunk_piping; inputs dhw_branches: list, multiplier: list of Int32, display_name: list, demand_recirculation: list of Boolean, material: list, diameter: list, water_temp: list, geometry: list of GeometryBase
# ---------- create_trunk_pipes: Python ----------
#
# Honeybee-PH: A Plugin for adding Passive-House data to LadybugTools Honeybee-Energy Models
# 
# This component is part of the PH-Tools toolkit <https://github.com/PH-Tools>.
# 
# Copyright (c) 2022, PH-Tools and bldgtyp, llc <phtools@bldgtyp.com> 
# Honeybee-PH is free software; you can redistribute it and/or modify 
# it under the terms of the GNU General Public License as published 
# by the Free Software Foundation; either version 3 of the License, 
# or (at your option) any later version. 
# 
# Honeybee-PH is distributed in the hope that it will be useful,
# but WITHOUT ANY WARRANTY; without even the implied warranty of 
# MERCHANTABILITY or FITNESS FOR A PARTICULAR PURPOSE. See the 
# GNU General Public License for more details.
# 
# For a copy of the GNU General Public License
# see <https://github.com/PH-Tools/honeybee_ph/blob/main/LICENSE>.
# 
# @license GPL-3.0+ <http://spdx.org/licenses/GPL-3.0+>
#
"""
Create new PH-HVAC Hot-Water 'Trunk' Piping Object.

A 'Trunk' pipe will have one or more 'Branch' pipes connected to it. Trunk pipes are 
addded directly to a PH-HVAC Hot Water System.
-
NOTE: Using the component will add ONLY the Passive House devices and will **NOT** add 
any components to the HB-Energy model. If you need to model mechancial equipment for an EnergyPlus
/ OpenStudio simulation then you must also use the Honeybee-Energy / IronBug components to setup
those devices separate from the inputs defined on the component here.
-
EM May 21, 2024

    Args:
        _dhw_branches: (List[PhPipeBranch]) A list of the 'Branch' pipes that should 
            be connected to this 'trunk' line.
            
        _multiplier: (List[int]) default=1. A list of multiplier values. In WUFI, this will set the 
            'Count Units or floors" attribute for the trunk. This is useful if you want to 
            model one floor's set of fixture/branches and then use the multiplier to 
            set the number of identical floors with the same fixtures.
            
        _display_name: (Optional[str]) An optional name for the trunk line.
        
        _demand_recirculation: (bool) Default=False. Mark true if this line includes
            demand-bassed recirculation of hot-water.
        
        _material: (str) Input either -
1-COPPER_M
2-COPPER_L
3-COPPER_K
4-CPVC_CTS_SDR
5-CPVC_SCH_40
6-PEX
7-PE
8-PEX_CTS_SDR=
 
        _diameter: (List[float]) default=12.7mm (1/2in) | The pipe diameter (m)

        _water_temp: (List[float]) default=60.0C | The temperature of the water.

        _geometry: (List[Curve]): A list of curves representing the Hot-Water Trunk
            Piping elements. Note that one new trunk will be created from EACH curve input
            and EACH branch input will be added to EACH trunk line which may cause 
            double entry of the branches. If you are trying to build a single trunk with 
            multiple segments, joing the curves together into a single polyline, or organize
            the branch-piping into separate datatree-branches first.
            
    Returns:
        dhw_trunk_piping_: (List[PhPipeTrunk]) A list of the new HBPH Trunk Pipe
            objects created. These can be added to an HBPH-SHW System.
"""

import scriptcontext as sc
import Rhino as rh
import rhinoscriptsyntax as rs
import ghpythonlib.components as ghc
import Grasshopper as gh

from honeybee_ph_rhino import gh_compo_io, gh_io
from honeybee_ph_utils import preview

#-------------------------------------------------------------------------------
import honeybee_ph_rhino._component_info_
reload(honeybee_ph_rhino._component_info_)
ghenv.Component.Name = "HBPH - Create SHW Pipe | Trunks"
DEV = honeybee_ph_rhino._component_info_.set_component_params(ghenv, dev=False)
if DEV:
    reload(gh_io)
    from honeybee_ph_rhino.gh_compo_io.shw import create_pipe_trunks as gh_compo_io
    reload(gh_compo_io)

# ------------------------------------------------------------------------------
# -- GH Interface
IGH = gh_io.IGH( ghdoc, ghenv, sc, rh, rs, ghc, gh )

#-------------------------------------------------------------------------------
gh_compo_interface = gh_compo_io.GHCompo_CreateSHWTrunkPipes(
        IGH,
        _dhw_branches,
        _multiplier,
        _display_name,
        _demand_recirculation,
        _material,
        _diameter,
        _geometry,
        _water_temp,
    )
dhw_trunk_piping_ = gh_compo_interface.run()
    
#-------------------------------------------------------------------------------
# -- Preview
for trunk in dhw_trunk_piping_:
    preview.object_preview(trunk)
# ---------- end create_trunk_pipes ----------
create_shw_heater = HBPHCreateSHWHeater(
    heater_type=hbph_shw_heater_types,
    annual_COP="2.0",
    total_system_perf_ratio="0.5",
    annual_energy_factor=calc_water_heater_ef.annual_energy_factor)  # -> out, heater; inputs in_conditioned_space: Boolean
#   port display_name: (str) An optional name for the HW-Heater.
#   port percent_coverage: (float) The % of total HW energy covered by this device.
#   port in_conditioned_space: (bool) Is the heater installed inside the conditioned space? default=True.
#   port annual_COP: (float) Annual Coefficient of Performance (COP). Defined as: energy-out/energy-in.
#   port total_system_perf_ratio: (float) Total annual system performance ratio of heat generator. Inverse of the COP. Defined as: energy-in/energy-out
#   port annual_energy_factor: (float) Annual energy-factor (EF) of the heat pump.
# ---------- create_shw_heater: Python ----------
#
# Honeybee-PH: A Plugin for adding Passive-House data to LadybugTools Honeybee-Energy Models
# 
# This component is part of the PH-Tools toolkit <https://github.com/PH-Tools>.
# 
# Copyright (c) 2022, PH-Tools and bldgtyp, llc <phtools@bldgtyp.com> 
# Honeybee-PH is free software; you can redistribute it and/or modify 
# it under the terms of the GNU General Public License as published 
# by the Free Software Foundation; either version 3 of the License, 
# or (at your option) any later version. 
# 
# Honeybee-PH is distributed in the hope that it will be useful,
# but WITHOUT ANY WARRANTY; without even the implied warranty of 
# MERCHANTABILITY or FITNESS FOR A PARTICULAR PURPOSE. See the 
# GNU General Public License for more details.
# 
# For a copy of the GNU General Public License
# see <https://github.com/PH-Tools/honeybee_ph/blob/main/LICENSE>.
# 
# @license GPL-3.0+ <http://spdx.org/licenses/GPL-3.0+>
#
"""
Create a new PH-HVAC Hot-Water Heater with detailed Passive-House style inputs which 
can then be added to the PH-HVAC Hot Water System.
-
NOTE: Using the component will add ONLY the Passive House devices and will **NOT** add 
any components to the HB-Energy model. If you need to model mechancial equipment for an EnergyPlus
/ OpenStudio simulation then you must also use the Honeybee-Energy / IronBug components to setup
those devices separate from the inputs defined on the component here.
-
EM April 21, 20224

"""

import scriptcontext as sc
import Rhino as rh
import rhinoscriptsyntax as rs
import ghpythonlib.components as ghc
import Grasshopper as gh

try:
    from honeybee_ph_utils import preview
except ImportError as e:
    raise ImportError('\nFailed to import honeybee_ph_utils:\n\t{}'.format(e))

try:
    from honeybee_ph_rhino import gh_compo_io, gh_io
except ImportError as e:
    raise ImportError('\nFailed to import honeybee_ph_rhino:\n\t{}'.format(e))


#-------------------------------------------------------------------------------
import honeybee_ph_rhino._component_info_
reload(honeybee_ph_rhino._component_info_)
ghenv.Component.Name = "HBPH - Create SHW Heater"
DEV = honeybee_ph_rhino._component_info_.set_component_params(ghenv, dev=False)
if DEV:
    reload(gh_io)
    #from honeybee_ph_rhino.gh_compo_io.shw import create_heater as gh_compo_io
    reload(gh_compo_io)


# ------------------------------------------------------------------------------
# -- GH Interface
IGH = gh_io.IGH( ghdoc, ghenv, sc, rh, rs, ghc, gh )


#-------------------------------------------------------------------------------
# -- Setup the input nodes, get all the user input values
input_dict = gh_compo_io.shw.create_heater.get_component_inputs(heater_type)
gh_io.setup_component_inputs(IGH, input_dict)
input_values_dict = gh_io.get_component_input_values(ghenv)


#-------------------------------------------------------------------------------
# -- Build the new heater
gh_compo_interface = gh_compo_io.GHCompo_CreateSHWHeater(
        IGH,
        heater_type,
        input_values_dict,
    )
heater_ = gh_compo_interface.run()


#-------------------------------------------------------------------------------
# -- Preview
preview.object_preview(heater_)
# ---------- end create_shw_heater ----------
hbph_shw_tank_types = HBPHSHWTankTypes({"0-No storage tank": 0, "1-DHW and heating": 1, "2-DHW only": 2}, selected="2-DHW only")
create_shw_tank = HBPHCreateSHWTank(tank_type=hbph_shw_tank_types)  # -> out, storage_tank; inputs quantity: Int32, for_solar: Boolean, in_conditioned_space: Boolean
# ---------- create_shw_tank: Python ----------
#
# Honeybee-PH: A Plugin for adding Passive-House data to LadybugTools Honeybee-Energy Models
# 
# This component is part of the PH-Tools toolkit <https://github.com/PH-Tools>.
# 
# Copyright (c) 2022, PH-Tools and bldgtyp, llc <phtools@bldgtyp.com> 
# Honeybee-PH is free software; you can redistribute it and/or modify 
# it under the terms of the GNU General Public License as published 
# by the Free Software Foundation; either version 3 of the License, 
# or (at your option) any later version. 
# 
# Honeybee-PH is distributed in the hope that it will be useful,
# but WITHOUT ANY WARRANTY; without even the implied warranty of 
# MERCHANTABILITY or FITNESS FOR A PARTICULAR PURPOSE. See the 
# GNU General Public License for more details.
# 
# For a copy of the GNU General Public License
# see <https://github.com/PH-Tools/honeybee_ph/blob/main/LICENSE>.
# 
# @license GPL-3.0+ <http://spdx.org/licenses/GPL-3.0+>
#
"""
Creates PH-HVAC Hot Water Tank which can be added to the a PH-HVAC Hot Water System.
-
NOTE: Using the component will add ONLY the Passive House devices and will **NOT** add 
any components to the HB-Energy model. If you need to model mechancial equipment for an EnergyPlus
/ OpenStudio simulation then you must also use the Honeybee-Energy / IronBug components to setup
those devices separate from the inputs defined on the component here.
-
EM April 21, 20224
    Args:
        _tank_type: ("0-No storage tank", "1-DHW and heating", "2-DHW only") The type of use for this tank.
        
        _name_: (str) The name / identifier for the hot water tank.
        
        quantity_: (int) Optional number of tanks. Default=1
        
        for_solar_: (bool) Is this tank hooked up to a Solar HW system?
        
        heat_loss_rate_: (W/k) Heat Loss rate from the tank. Default is 4.0 W/k
        
        volume_: (litres) Nominal tank volume. Default is 300 litres (80 gallons)
        
        standby_frac_: (%) The Standby Fraction. Default is 0.30 (30%)
        
        in_conditioned_space_: (bool) Default=True.
        
        location_temp_: (Deg C) The avg. air-temp of the tank location, if the tank is outside the building. 
        
        water_temp_: (Deg C) The avg. water temp in the tank. Default=60-C
    
    Returns:
        storage_tank_: A new HW Tank Object. You can add this tank to a Service Hot Water system.
"""

from honeybee_ph_rhino import gh_compo_io, gh_io
from honeybee_ph_utils import preview

#-------------------------------------------------------------------------------
import honeybee_ph_rhino._component_info_
reload(honeybee_ph_rhino._component_info_)
ghenv.Component.Name = "HBPH - Create SHW Tank"
DEV = honeybee_ph_rhino._component_info_.set_component_params(ghenv, dev=False)
if DEV:
    reload(gh_io)
    from honeybee_ph_rhino.gh_compo_io.shw import create_tank as gh_compo_io
    reload(gh_compo_io)


#-------------------------------------------------------------------------------
gh_compo_interface = gh_compo_io.GHCompo_CreateSHWTank(
        _tank_type,
        _display_name_,
        quantity_,
        for_solar_,
        heat_loss_rate_,
        volume_,
        standby_frac_,
        in_conditioned_space_,
        location_temp_,
        water_temp_,
    )
storage_tank_ = gh_compo_interface.run()


# ------------------------------------------------------------------------------
preview.object_preview(storage_tank_)
# ---------- end create_shw_tank ----------
create_pv = HBPHCreatePVSystem(display_name="my_PV_system", annual_kWh="1000")  # -> out, pv_system
# ---------- create_pv: Python ----------
#
# Honeybee-PH: A Plugin for adding Passive-House data to LadybugTools Honeybee-Energy Models
# 
# This component is part of the PH-Tools toolkit <https://github.com/PH-Tools>.
# 
# Copyright (c) 2022, PH-Tools and bldgtyp, llc <phtools@bldgtyp.com> 
# Honeybee-PH is free software; you can redistribute it and/or modify 
# it under the terms of the GNU General Public License as published 
# by the Free Software Foundation; either version 3 of the License, 
# or (at your option) any later version. 
# 
# Honeybee-PH is distributed in the hope that it will be useful,
# but WITHOUT ANY WARRANTY; without even the implied warranty of 
# MERCHANTABILITY or FITNESS FOR A PARTICULAR PURPOSE. See the 
# GNU General Public License for more details.
# 
# For a copy of the GNU General Public License
# see <https://github.com/PH-Tools/honeybee_ph/blob/main/LICENSE>.
# 
# @license GPL-3.0+ <http://spdx.org/licenses/GPL-3.0+>
#
"""
Create HBPH Photovoltaic Energy System.
-
NOTE: Using the component will add ONLY the Passive House devices and will **NOT** add 
any components to the HB-Energy model. If you need to model mechancial equipment for an EnergyPlus
/ OpenStudio simulation then you must also use the Honeybee-Energy / IronBug components to setup
those devices separate from the inputs defined on the component here.
-
EM April 19, 2024
    Args:
        _display_name: (str): The display name for the PV-System.
        
        _annual_kWh: (float) The total annual PV System yield in kWh
        
        _array_size: (float) Optional total area of the PV Array
        
        _utilization_factor: (float) 0.0-1.0
        
    Returns:
        pv_system_: The new HBPH PV System which can be added to one or more
            Honeybee-Rooms using the "HBPH - Add Renewable Energy Systems" component.
"""

import scriptcontext as sc
import Rhino as rh
import rhinoscriptsyntax as rs
import ghpythonlib.components as ghc
import Grasshopper as gh


try:
    from honeybee_ph_utils import preview
except ImportError as e:
    raise ImportError('\nFailed to import honeybee_ph_utils:\n\t{}'.format(e))

try:
    from honeybee_ph_rhino import gh_compo_io, gh_io
except ImportError as e:
    raise ImportError('\nFailed to import honeybee_ph_rhino:\n\t{}'.format(e))


#-------------------------------------------------------------------------------
import honeybee_ph_rhino._component_info_
reload(honeybee_ph_rhino._component_info_)
ghenv.Component.Name = "HBPH - Create PV System"
DEV = honeybee_ph_rhino._component_info_.set_component_params(ghenv, dev=False)
if DEV:
    reload(gh_io)
    from honeybee_ph_rhino.gh_compo_io.hvac import create_pv_system as gh_compo_io
    reload(gh_compo_io)
    

# ------------------------------------------------------------------------------
# -- GH Interface
IGH = gh_io.IGH( ghdoc, ghenv, sc, rh, rs, ghc, gh )


#-------------------------------------------------------------------------------
# -- Create the new PV System
gh_compo_interface = gh_compo_io.GHCompo_CreatePVDevice(
        IGH,
        _display_name,
        _annual_kWh,
        _array_size,
        _utilization_factor,
    )
pv_system_ = gh_compo_interface.run()

# -------------------------------------------------------------------------------------
preview.object_preview(pv_system_)
# ---------- end create_pv ----------
line_2 = LineSDL(Start="0,0,0", Direction=Vector(0, 0, 1), Length=1)
list_length = ListLength(List=create_trunk_pipes.dhw_trunk_piping)
create_recirc_pipes = HBPHCreateSHWRecirculationPipes(geometry=line_2, insul_quality="2-Moderate", daily_period="23", water_temp="48")  # -> out, flatten(dhw_recirc_piping); inputs geometry: list of GeometryBase, name: list, diameter: list, insul_thickness: list, insul_conductivity: list, insul_reflective: list of Boolean, insul_quality: list, daily_period: list, water_temp: list
# ---------- create_recirc_pipes: Python ----------
#
# Honeybee-PH: A Plugin for adding Passive-House data to LadybugTools Honeybee-Energy Models
# 
# This component is part of the PH-Tools toolkit <https://github.com/PH-Tools>.
# 
# Copyright (c) 2022, PH-Tools and bldgtyp, llc <phtools@bldgtyp.com> 
# Honeybee-PH is free software; you can redistribute it and/or modify 
# it under the terms of the GNU General Public License as published 
# by the Free Software Foundation; either version 3 of the License, 
# or (at your option) any later version. 
# 
# Honeybee-PH is distributed in the hope that it will be useful,
# but WITHOUT ANY WARRANTY; without even the implied warranty of 
# MERCHANTABILITY or FITNESS FOR A PARTICULAR PURPOSE. See the 
# GNU General Public License for more details.
# 
# For a copy of the GNU General Public License
# see <https://github.com/PH-Tools/honeybee_ph/blob/main/LICENSE>.
# 
# @license GPL-3.0+ <http://spdx.org/licenses/GPL-3.0+>
#
"""
Create new PH-HVAC Hot Water Recirculation-Piping.
-
NOTE: Using the component will add ONLY the Passive House devices and will **NOT** add 
any components to the HB-Energy model. If you need to model mechancial equipment for an EnergyPlus
/ OpenStudio simulation then you must also use the Honeybee-Energy / IronBug components to setup
those devices separate from the inputs defined on the component here.
-
EM May 21, 2024

    Args:
        _geometry: (List[Curve]) A list of curves representing the SHW Recirculation
            Piping elements.
        
        _name: (List[str]) A list of names (Optional).
            
        _diameter: (List[float]) Default=25.4mm (1") A list of diameters (mm) of 
            each DHW Recirculation Piping element input. If the length of this list matches 
            the _geometry input list, the diameter values will be used in order. 
            Otherwise the first element in this list will be used as the 
            default diameter for all pipe elements created.
            
        _insul_thickness: (List[float]) Default=25.4mm (1"). A list of thicknesses (mm)
            for the pipe insulation. If the length of this list matches 
            the _geometry input list, the thickness values will be used in order. 
            Otherwise the first element in this list will be used as the 
            default thickness for all pipe elements created.
        
        _insul_conductivity: (List[float]) Default=0.04 W/mk (~R-3.6/in). A list of conductivity values
            for the pipe insulation. If the length of this list matches 
            the _geometry input list, the conductivity values will be used in order. 
            Otherwise the first element in this list will be used as the 
            default conductivity for all pipe elements created.
            
        _insul_reflective: (List[bool]) Default=True. A list of boolean values
            for the pipe insulation. If the length of this list matches 
            the _geometry input list, the values will be used in order. 
            Otherwise the first element in this list will be used as the 
            default value for all pipe elements created.
        
        _insul_quality: (List[str]) The quality of the insulation installed at the 
            mountings, suspension elements, and other thermal-bridges.
            input either -
            - "1-None"
            - "2-Moderate"
            - "3-Good"
        
        _daily_period: (List[float]) The daily operating period in hours.
        
        _water_temp: (List[float]) default=60C | The temp (deg-C) of the water in the recirculation piping.
        
    Returns:
        dhw_recirc_piping_: (List[PhPipeElement]) A list of the new HBPH Piping
            objects created. These can be added to HB Rooms using the 'Add PH DHW Piping'
            component.
"""

import scriptcontext as sc
import Rhino as rh
import rhinoscriptsyntax as rs
import ghpythonlib.components as ghc
import Grasshopper as gh

from honeybee_ph_rhino import gh_compo_io, gh_io
from honeybee_ph_utils import preview



#-------------------------------------------------------------------------------
import honeybee_ph_rhino._component_info_
reload(honeybee_ph_rhino._component_info_)
ghenv.Component.Name = "HBPH - Create SHW Recirculation Pipes"
DEV = honeybee_ph_rhino._component_info_.set_component_params(ghenv, dev=False)
if DEV:
    reload(gh_io)
    from honeybee_ph_rhino.gh_compo_io.shw import create_recirc_pipes as gh_compo_io
    reload(gh_compo_io)

# ------------------------------------------------------------------------------
# -- GH Interface
IGH = gh_io.IGH( ghdoc, ghenv, sc, rh, rs, ghc, gh )


#-------------------------------------------------------------------------------
gh_compo_interface = gh_compo_io.GHCompo_CreateSHWRecircPipes(
    IGH,
    _geometry,
    _name,
    _diameter,
    _insul_thickness,
    _insul_conductivity,
    _insul_reflective,
    _insul_quality,
    _daily_period,
    _water_temp,
)
dhw_recirc_piping_ = gh_compo_interface.run()

#-------------------------------------------------------------------------------
# -- Preview
for pipe in dhw_recirc_piping_:
    preview.object_preview(pipe)
# ---------- end create_recirc_pipes ----------
create_shw_sys = HBPHCreateSHWSystem(
    solar_tank=create_shw_tank.storage_tank,
    heaters=create_shw_heater.heater,
    distribution_piping=create_trunk_pipes.dhw_trunk_piping,
    num_tap_points=list_length,
    recirc_piping=create_recirc_pipes.dhw_recirc_piping)  # -> out, hb_shw; inputs heaters: list, distribution_piping: list, num_tap_points: Int32, recirc_piping: list
# ---------- create_shw_sys: Python ----------
#
# Honeybee-PH: A Plugin for adding Passive-House data to LadybugTools Honeybee-Energy Models
# 
# This component is part of the PH-Tools toolkit <https://github.com/PH-Tools>.
# 
# Copyright (c) 2022, PH-Tools and bldgtyp, llc <phtools@bldgtyp.com> 
# Honeybee-PH is free software; you can redistribute it and/or modify 
# it under the terms of the GNU General Public License as published 
# by the Free Software Foundation; either version 3 of the License, 
# or (at your option) any later version. 
# 
# Honeybee-PH is distributed in the hope that it will be useful,
# but WITHOUT ANY WARRANTY; without even the implied warranty of 
# MERCHANTABILITY or FITNESS FOR A PARTICULAR PURPOSE. See the 
# GNU General Public License for more details.
# 
# For a copy of the GNU General Public License
# see <https://github.com/PH-Tools/honeybee_ph/blob/main/LICENSE>.
# 
# @license GPL-3.0+ <http://spdx.org/licenses/GPL-3.0+>
#
"""
Create new PH-HVAC Hot-Water System. This system can serve one or more Honeybee Rooms 
using the 'Apply SHW System' component. 
-
NOTE: Each unique device in the system will only be added ONCE to the PHPP or 
WUFI-Passive model, regardless of how many rooms the System is applied to. If each room needs
to have its own equipment, build devices for each room separately.
-
NOTE: Using the component will add ONLY the Passive House devices and will **NOT** add 
any components to the HB-Energy model. If you need to model mechancial equipment for an EnergyPlus
/ OpenStudio simulation then you must also use the Honeybee-Energy / IronBug components to setup
those devices separate from the inputs defined on the component here.
-
EM April 21, 2024

    Args:
        
        _name_: [str] Text to set the name for the PhHotWaterSystem and to be
            incorporated into unique system identifier. If the name is not
            provided, a random name will be assigned.
        
        _tank_1_: [PhHvacHotWaterTank] A new Passive House hot-water storage tank to add to the System.
        
        _tank_2_: [PhHvacHotWaterTank] A new Passive House hot-water storage tank to add to the System.        
        
        _buffer_tank_: [PhHvacHotWaterTank] A new Passive House hot-water buffer tank to add to the System.
        
        _solar_tank_: [PhHvacHotWaterTank] A new Passive House Solar-thermal hot-water storage tank to add 
            to the System.
    
        _heaters: List[PhHvacHotWaterHeater] A list of any PH style HW-Heaters to add to the System.
    
        _distribution_piping: List[PhPipeTrunk] A list of PH-HVAC 'Trunk' pipes which are part of this
            system. These 'Trunks' should have branches and fixtures which will also become part 
            of this hot-water system. 
            -
            Note that you can also pass in 'Fixture' elements directly, and it 
            will automatically create a 0-length 'trunk' and 'branch' for each fixture.
        
        _num_tap_points_: (Optional[int]) Allows for manual setting of the number 
            of 'tap points' (faucets or sim.) in the system.
            
        _recirc_piping: List[PhPipeElement] A List of any Recirculation Piping elements to
            add to the System.
    
    Returns:
        hb_shw_: [PhHotWaterSystem] A new PH-HVAC Hot Water System object which can be applied 
            to one or more Honeybee Rooms using the 'Apply SHW System' component.
"""

import scriptcontext as sc
import Rhino as rh
import rhinoscriptsyntax as rs
import ghpythonlib.components as ghc
import Grasshopper as gh

try:
    from honeybee_ph_utils import preview
except ImportError as e:
    raise ImportError('\nFailed to import honeybee_ph_utils:\n\t{}'.format(e))

try:
    from honeybee_ph_rhino import gh_compo_io, gh_io
except ImportError as e:
    raise ImportError('\nFailed to import honeybee_ph_rhino:\n\t{}'.format(e))


#-------------------------------------------------------------------------------
import honeybee_ph_rhino._component_info_
reload(honeybee_ph_rhino._component_info_)
ghenv.Component.Name = "HBPH - Create SHW System"
DEV = honeybee_ph_rhino._component_info_.set_component_params(ghenv, dev=False)
if DEV:
    reload(gh_io)
    from honeybee_ph_rhino.gh_compo_io.shw import create_system as gh_compo_io
    reload(gh_compo_io)


# ------------------------------------------------------------------------------
# -- GH Interface
IGH = gh_io.IGH( ghdoc, ghenv, sc, rh, rs, ghc, gh )

# ------------------------------------------------------------------------------
gh_compo_interface = gh_compo_io.GHCompo_CreateSHWSystem(
    IGH,
    _name_,
    _tank_1_,
    _tank_2_,
    _buffer_tank_,
    _solar_tank_,
    _heaters, 
    _distribution_piping,
    _num_tap_points_,
    _recirc_piping,
)

hb_shw_ = gh_compo_interface.run()

#-------------------------------------------------------------------------------
if hb_shw_:
    preview.object_preview(hb_shw_)
# ---------- end create_shw_sys ----------
apply_shw_sys = HBPHApplySHWSystem(hb_shw=create_shw_sys.hb_shw, hb_rooms=create_shading.hb_rooms)  # -> out, flatten(hb_rooms); inputs hb_rooms: list
# ---------- apply_shw_sys: Python ----------
#
# Honeybee-PH: A Plugin for adding Passive-House data to LadybugTools Honeybee-Energy Models
# 
# This component is part of the PH-Tools toolkit <https://github.com/PH-Tools>.
# 
# Copyright (c) 2022, PH-Tools and bldgtyp, llc <phtools@bldgtyp.com> 
# Honeybee-PH is free software; you can redistribute it and/or modify 
# it under the terms of the GNU General Public License as published 
# by the Free Software Foundation; either version 3 of the License, 
# or (at your option) any later version. 
# 
# Honeybee-PH is distributed in the hope that it will be useful,
# but WITHOUT ANY WARRANTY; without even the implied warranty of 
# MERCHANTABILITY or FITNESS FOR A PARTICULAR PURPOSE. See the 
# GNU General Public License for more details.
# 
# For a copy of the GNU General Public License
# see <https://github.com/PH-Tools/honeybee_ph/blob/main/LICENSE>.
# 
# @license GPL-3.0+ <http://spdx.org/licenses/GPL-3.0+>
#
"""
Apply a Ph-HVAC Hot Water System to a Honeybee Room or Rooms. Note that. If 
the room does not already have a Honeybee-Energy 'service_hot_water' Program, one will 
be added automatically with a nominal load of 0.001 L/hour.
-
NOTE: Using the component will add ONLY the Passive House devices and will **NOT** add 
any components to the HB-Energy model. If you need to model mechancial equipment for an EnergyPlus
/ OpenStudio simulation then you must also use the Honeybee-Energy / IronBug components to setup
those devices separate from the inputs defined on the component here.
-
EM April 21, 2024

    Args:
        _hb_shw: [PhHotWaterSystem] A PH-HVAC Hot Water System  
            to assign to each of the input Honeybee Rooms.
        
        _hb_rooms: List[Room] A list of the Honeneybee Rooms to assign
            the PH-HVAC Hot Water System object to.
            
    Returns:
        hb_rooms_: (List[Room]) The Honeybee Rooms with the new 
            PH-HVAC Hot Water System applied.
"""

try:
    from honeybee_ph_utils import preview
except ImportError as e:
    raise ImportError('\nFailed to import honeybee_ph_utils:\n\t{}'.format(e))

try:
    from honeybee_ph_rhino import gh_compo_io, gh_io
except ImportError as e:
    raise ImportError('\nFailed to import honeybee_ph_rhino:\n\t{}'.format(e))


#-------------------------------------------------------------------------------
import honeybee_ph_rhino._component_info_
reload(honeybee_ph_rhino._component_info_)
ghenv.Component.Name = "HBPH - Apply SHW System"
DEV = honeybee_ph_rhino._component_info_.set_component_params(ghenv, dev=False)
if DEV:
    reload(gh_compo_io)
    reload(gh_io)
    from honeybee_ph_rhino.gh_compo_io.shw import apply_shw as gh_compo_io
    reload(gh_compo_io)

#-------------------------------------------------------------------------------
gh_compo_interface = gh_compo_io.GHCompo_ApplySHWSys(
        _hb_shw,
        _hb_rooms,
    )
hb_rooms_ = gh_compo_interface.run()
# ---------- end apply_shw_sys ----------
add_renewables = HBPHAddRenewableEnergyDevices(renewable_systems=create_pv.pv_system, hb_rooms=apply_shw_sys.hb_rooms)  # -> out, hb_rooms; inputs renewable_systems: list, hb_rooms: list
# ---------- add_renewables: Python ----------
#
# Honeybee-PH: A Plugin for adding Passive-House data to LadybugTools Honeybee-Energy Models
# 
# This component is part of the PH-Tools toolkit <https://github.com/PH-Tools>.
# 
# Copyright (c) 2022, PH-Tools and bldgtyp, llc <phtools@bldgtyp.com> 
# Honeybee-PH is free software; you can redistribute it and/or modify 
# it under the terms of the GNU General Public License as published 
# by the Free Software Foundation; either version 3 of the License, 
# or (at your option) any later version. 
# 
# Honeybee-PH is distributed in the hope that it will be useful,
# but WITHOUT ANY WARRANTY; without even the implied warranty of 
# MERCHANTABILITY or FITNESS FOR A PARTICULAR PURPOSE. See the 
# GNU General Public License for more details.
# 
# For a copy of the GNU General Public License
# see <https://github.com/PH-Tools/honeybee_ph/blob/main/LICENSE>.
# 
# @license GPL-3.0+ <http://spdx.org/licenses/GPL-3.0+>
#
"""
Set the PH-HVAC Renewable Energy Systems (PV, etc..) serving one or more Honeybee Rooms.
-
NOTE: Using the component will add ONLY the Passive House devices and will **NOT** add 
any components to the HB-Energy model. If you need to model mechancial equipment for an EnergyPlus
/ OpenStudio simulation then you must also use the Honeybee-Energy / IronBug components to setup
those devices separate from the inputs defined on the component here.
-
EM April 21, 2024
    Args:
        _renewable_systems: (PhRenewableEnergySystem) The renewable energy systems to add.
    
        _hb_rooms: (list[Room]) A list of the hb-rooms to add the renewable energy systems to.
        
    Returns:
        hb_rooms_: The input hb-rooms served by new PH-HVAC Renewable Systems added.
"""

import scriptcontext as sc
import Rhino as rh
import rhinoscriptsyntax as rs
import ghpythonlib.components as ghc
import Grasshopper as gh


try:
    from honeybee_ph_rhino import gh_compo_io, gh_io
except ImportError as e:
    raise ImportError('\nFailed to import honeybee_ph_rhino:\n\t{}'.format(e))


#-------------------------------------------------------------------------------
import honeybee_ph_rhino._component_info_
reload(honeybee_ph_rhino._component_info_)
ghenv.Component.Name = "HBPH - Add Renewable Energy Devices"
DEV = honeybee_ph_rhino._component_info_.set_component_params(ghenv, dev=False)
if DEV:
    from honeybee_ph_rhino.gh_compo_io.hvac import add_renewable_system as gh_compo_io
    reload(gh_compo_io)
    reload(gh_io)
    

# ------------------------------------------------------------------------------
# -- GH Interface
IGH = gh_io.IGH( ghdoc, ghenv, sc, rh, rs, ghc, gh )


#-------------------------------------------------------------------------------
# -- Add the new Systems to the HB-Rooms
gh_compo_interface = gh_compo_io.GHCompo_AddRenewableEnergyDevices(
        IGH,
        _renewable_systems,
        _hb_rooms,
    )
hb_rooms_ = gh_compo_interface.run()
# ---------- end add_renewables ----------

shading_dims = HBPHAddShadingDims(shading_surfaces=flatten(create_shading.shading_surfaces), hb_rooms=create_shading.hb_rooms, run=Toggle(True))  # -> out, checklines, hb_rooms; inputs shading_surfaces: list of GeometryBase, hb_rooms: list, run: Boolean
# ---------- shading_dims: Python ----------
#
# Honeybee-PH: A Plugin for adding Passive-House data to LadybugTools Honeybee-Energy Models
# 
# This component is part of the PH-Tools toolkit <https://github.com/PH-Tools>.
# 
# Copyright (c) 2022, PH-Tools and bldgtyp, llc <phtools@bldgtyp.com> 
# Honeybee-PH is free software; you can redistribute it and/or modify 
# it under the terms of the GNU General Public License as published 
# by the Free Software Foundation; either version 3 of the License, 
# or (at your option) any later version. 
# 
# Honeybee-PH is distributed in the hope that it will be useful,
# but WITHOUT ANY WARRANTY; without even the implied warranty of 
# MERCHANTABILITY or FITNESS FOR A PARTICULAR PURPOSE. See the 
# GNU General Public License for more details.
# 
# For a copy of the GNU General Public License
# see <https://github.com/PH-Tools/honeybee_ph/blob/main/LICENSE>.
# 
# @license GPL-3.0+ <http://spdx.org/licenses/GPL-3.0+>
#
"""
Will calculate dimensions to shading-objects for each window in the project. These 
are written to the 'Shading' worksheet in the PHPP which will then calculate 
shading factors based on these dimensions. 
-
Reference: Shading factors will go from 0.0 (fully shaded) to 1.0 (fully unshaded) and are 
calculated using the simplified numerical method as implemented in the Passive 
House Planning Package and DesignPH 1.5 or earlier. 
-
Note that this method matches the 'old' style PHPP input (before DesignPH 2). It is 
a pretty fast way for the PHPP to calc. shading factors, but might be a bit less 
accurate than other methods for irregular situations (asymetric shading, irregular trees, etc).
It's useful if you want to match the exact procedure of an older style PHPP document.
-
For background and reference on the methodology used, see: "Solar Gains in a 
Passive House: A Monthly Approach to Calculating Global Irradiaton Entering a 
Shaded Window" By Andrew Peel, 2007.
-
EM October 2, 2022
    Args:
        _shading_surfaces: (List[Brep]) <Optional> Any shading geometry (walls, overhangs, side-reveals
            neighbors, trees, etc...) you'd like to take into account when generating 
            shading factors. Note that the more elements included, the slower this will run.
            You can use the "HBPH - Create Building Shading" component to easily generate the 
            building-surface and window reveal shading.
                
        _hb_rooms: (List[room.Room]) The Honeybee Rooms with apertures.
        
        _run: (Bool) Set True to run the shading-object finder.
    
    Returns:
        checklines_: (List[LineCurve]) Preview geometry showing the search lines used to find shading geometry.
            
        hb_rooms_: (List[room.Room]) The Honeybe Rooms with the shading-object dimensions added to all the apertures.
"""


import scriptcontext as sc
import Rhino as rh
import rhinoscriptsyntax as rs
import ghpythonlib.components as ghc
import Grasshopper as gh


try:
    from honeybee_ph_utils import preview
except ImportError as e:
    raise ImportError('\nFailed to import honeybee_ph_utils:\n\t{}'.format(e))

try:
    from honeybee_ph_rhino import gh_compo_io, gh_io
except ImportError as e:
    raise ImportError('\nFailed to import honeybee_ph_rhino:\n\t{}'.format(e))

# ------------------------------------------------------------------------------
import honeybee_ph_rhino._component_info_
reload(honeybee_ph_rhino._component_info_)
ghenv.Component.Name = "HBPH - Add Shading Dims"
DEV = honeybee_ph_rhino._component_info_.set_component_params(ghenv, dev=False)
if DEV:
    reload(gh_compo_io)
    reload(gh_io)

# ------------------------------------------------------------------------------
# -- GH Interface
IGH = gh_io.IGH( ghdoc, ghenv, sc, rh, rs, ghc, gh )


#-------------------------------------------------------------------------------
gh_compo_interface = gh_compo_io.GHCompo_SolveShadingDims(
        IGH,
        _shading_surfaces,
        _hb_rooms, 
        _run)
checklines_, hb_rooms_ = gh_compo_interface.run()
# ---------- end shading_dims ----------

# ----
# Should get: Deprecation Warning
toggle = BooleanToggle(True)
add_ph_equipment = HBPHAddPHEquipment(phius_defaults=toggle, hb_rooms=apply_shw_sys.hb_rooms)  # -> out, flatten(hb_rooms); inputs phius_defaults: Int32, phi_defaults: Int32, equipment: list, hb_rooms: list
# ---------- add_ph_equipment: Python ----------
#
# Honeybee-PH: A Plugin for adding Passive-House data to LadybugTools Honeybee-Energy Models
# 
# This component is part of the PH-Tools toolkit <https://github.com/PH-Tools>.
# 
# Copyright (c) 2022, PH-Tools and bldgtyp, llc <phtools@bldgtyp.com> 
# Honeybee-PH is free software; you can redistribute it and/or modify 
# it under the terms of the GNU General Public License as published 
# by the Free Software Foundation; either version 3 of the License, 
# or (at your option) any later version. 
# 
# Honeybee-PH is distributed in the hope that it will be useful,
# but WITHOUT ANY WARRANTY; without even the implied warranty of 
# MERCHANTABILITY or FITNESS FOR A PARTICULAR PURPOSE. See the 
# GNU General Public License for more details.
# 
# For a copy of the GNU General Public License
# see <https://github.com/PH-Tools/honeybee_ph/blob/main/LICENSE>.
# 
# @license GPL-3.0+ <http://spdx.org/licenses/GPL-3.0+>
#
"""
Add one or more detailed Passive House style electric-equipment objects to the 
honeybee Rooms.
-
EM October 2, 2022

    Args:
        phius_defaults_: (int) Optional. Input either:
        > "1" for Single Family Residential appliance set.
        > "2" for Multifamily Residential appliance set.
            Note - for Multifamily, be sure to add in the Int. / Ext. Lighting and MEL from
            the Phius MF Calculator using a 'Create PH Appliance' HBPH Component.
        > "3" for Multifamily NonResidential appliance set (none).
            Note - for Multifamily, be sure to add in the Int. / Ext. Lighting and MEL from
            the Phius MF Calculator using a 'Create PH Appliance' HBPH Component.
        
        phi_defaults_: (bool) default=False. Set True to add the default PHI equipment
            set to the model.
        
        equipment_: (List[PhEquipment]) A List of Passive-House style electric
            equipment to add onto the Honeybee-Room.
            
    Returns:
        hb_rooms_: (List[Room]) A list of the Honeybee Rooms with the new appliances
            added to them.
"""

import scriptcontext as sc
import Rhino as rh
import rhinoscriptsyntax as rs
import ghpythonlib.components as ghc
import Grasshopper as gh


try:
    from honeybee_ph_utils import preview
except ImportError as e:
    raise ImportError('\nFailed to import honeybee_ph_utils:\n\t{}'.format(e))

try:
    from honeybee_ph_rhino import gh_compo_io, gh_io
except ImportError as e:
    raise ImportError('\nFailed to import honeybee_ph_rhino:\n\t{}'.format(e))


#-------------------------------------------------------------------------------
import honeybee_ph_rhino._component_info_
reload(honeybee_ph_rhino._component_info_)
ghenv.Component.Name = "HBPH - Add PH Equipment"
DEV = honeybee_ph_rhino._component_info_.set_component_params(ghenv, dev=False)
if DEV:
    reload(gh_compo_io)
    reload(gh_io)
    
# ------------------------------------------------------------------------------
# -- GH Interface
IGH = gh_io.IGH( ghdoc, ghenv, sc, rh, rs, ghc, gh )


#-------------------------------------------------------------------------------
gh_compo_interface = gh_compo_io.GHCompo_AddElecEquip(
        IGH,
        phius_defaults_,
        phi_defaults_,
        equipment_,
        _hb_rooms,
    )
hb_rooms_, ph_equipment = gh_compo_interface.run()


#-------------------------------------------------------------------------------
# -- Preview
for device in ph_equipment:
    preview.object_preview(device)
# ---------- end add_ph_equipment ----------
panel_21 = Panel(add_ph_equipment.out)

set_dwelling = HBPHSetDwelling(hb_rooms=simplify(add_renewables.hb_rooms))  # -> out, hb_rooms; inputs num_dwellings: tree, hb_rooms: tree
# ---------- set_dwelling: Python ----------
#
# Honeybee-PH: A Plugin for adding Passive-House data to LadybugTools Honeybee-Energy Models
# 
# This component is part of the PH-Tools toolkit <https://github.com/PH-Tools>.
# 
# Copyright (c) 2022, PH-Tools and bldgtyp, llc <phtools@bldgtyp.com> 
# Honeybee-PH is free software; you can redistribute it and/or modify 
# it under the terms of the GNU General Public License as published 
# by the Free Software Foundation; either version 3 of the License, 
# or (at your option) any later version. 
# 
# Honeybee-PH is distributed in the hope that it will be useful,
# but WITHOUT ANY WARRANTY; without even the implied warranty of 
# MERCHANTABILITY or FITNESS FOR A PARTICULAR PURPOSE. See the 
# GNU General Public License for more details.
# 
# For a copy of the GNU General Public License
# see <https://github.com/PH-Tools/honeybee_ph/blob/main/LICENSE>.
# 
# @license GPL-3.0+ <http://spdx.org/licenses/GPL-3.0+>
#
"""
Set a group of HB-Rooms as a single 'Dwelling'. This is required in order to properly calculate
the Phius occupancy, lighting, and electrical equipment usage. 
-
If you are creating a single-family home, simply input all of your rooms
to this component. If you are creating a multi-unit (apartment) building, split up your rooms onto separate 
branches as appropriate. All of the Rooms on a single Branch will be set to the same 'dwelling'.
-
EM January 31, 2025
    Args:

        _num_dwellings_: (DataTree[int]) Default=1. Optional input for the number of dwellings 
            for the input hb-room. This is useful if you are doing multi-unit residential projects
            and are modeling HB-Rooms as 'blocks' or groups of dwellings in order to simplify 
            the overall model geometry. In this case, input a DataTree with values that match the 
            order of the HB-Rooms input. If you are modeling a single-family project, or each 
            HB-Room maps to a single dwelling, then leave this input blank.

        _hb_rooms: (DataTree[Room]) The HB-Rooms to set as a 'dwelling'
            
    Returns:
        hb_rooms_: (DataTree[Room]) The HB-Rooms with their 'dwelling' set.
"""


import scriptcontext as sc
import Rhino as rh
import rhinoscriptsyntax as rs
import ghpythonlib.components as ghc
import Grasshopper as gh


try:
    from honeybee_ph_utils import preview
except ImportError as e:
    raise ImportError('\nFailed to import honeybee_ph_utils:\n\t{}'.format(e))

try:
    from honeybee_ph_rhino import gh_compo_io
except ImportError as e:
    raise ImportError('\nFailed to import honeybee_ph_rhino:\n\t{}'.format(e))

try:
    from ph_gh_component_io import gh_io
except ImportError as e:
    raise ImportError('\nFailed to import ph_gh_component_io:\n\t{}'.format(e))


#-------------------------------------------------------------------------------
import honeybee_ph_rhino._component_info_
reload(honeybee_ph_rhino._component_info_)
ghenv.Component.Name = "HBPH - Set Dwelling"
DEV = honeybee_ph_rhino._component_info_.set_component_params(ghenv, dev=False)
if DEV:
    from honeybee_ph_rhino.gh_compo_io.program import set_dwelling as gh_compo_io
    reload(gh_compo_io)
    reload(gh_io)

# ------------------------------------------------------------------------------
# -- GH Interface
IGH = gh_io.IGH( ghdoc, ghenv, sc, rh, rs, ghc, gh )


#-------------------------------------------------------------------------------
gh_compo_interface = gh_compo_io.GHCompo_SetDwelling(
        IGH,
        _num_dwellings_,
        _hb_rooms,
    )
hb_rooms_ = gh_compo_interface.run()
# ---------- end set_dwelling ----------
panel_22 = Panel("""1
3""")
panel_23 = Panel("""1
2""")
set_res_occupancy = HBPHSetResOccupancy(num_bedrooms=panel_23, num_people=panel_22, hb_rooms=set_dwelling.hb_rooms)  # -> out, hb_rooms; inputs num_bedrooms: list of Int32, num_people: list of Int32, set_res_schedule: Boolean, hb_rooms: list
# ---------- set_res_occupancy: Python ----------
#
# Honeybee-PH: A Plugin for adding Passive-House data to LadybugTools Honeybee-Energy Models
# 
# This component is part of the PH-Tools toolkit <https://github.com/PH-Tools>.
# 
# Copyright (c) 2022, PH-Tools and bldgtyp, llc <phtools@bldgtyp.com> 
# Honeybee-PH is free software; you can redistribute it and/or modify 
# it under the terms of the GNU General Public License as published 
# by the Free Software Foundation; either version 3 of the License, 
# or (at your option) any later version. 
# 
# Honeybee-PH is distributed in the hope that it will be useful,
# but WITHOUT ANY WARRANTY; without even the implied warranty of 
# MERCHANTABILITY or FITNESS FOR A PARTICULAR PURPOSE. See the 
# GNU General Public License for more details.
# 
# For a copy of the GNU General Public License
# see <https://github.com/PH-Tools/honeybee_ph/blob/main/LICENSE>.
# 
# @license GPL-3.0+ <http://spdx.org/licenses/GPL-3.0+>
#
"""
Set the PH-Style occupancy for the Honeybee-Rooms input.
-
Note that this componet will create a new, unique 'People' load for EACH HB-Room input, and will
set the values accordigly. On some larger projects with many rooms, creating these duplicate 'People' 
objects may not be ideal, and may lead to longer run-times. As an alternative, use the 'Set People 
PH Attributes' component to create a Honeybee-Energy Program, which can then be assigned to multiple rooms at once.
-
For Phius residential projects, a room's "_num_people" should be the rooms's "number-of-bedrooms" + 1
-
EM January 28, 2025
    Args:
        _num_bedrooms: (list[int]) A list of number of bedrooms for EACH Honeybee-Room input.
            This should ideally be the same length as the '_hb_rooms' input, and in the same 
            order. If only a single value is input, that value will get applied to all of the 
            Honeybee-Rooms input. Note that this value is the number of bedrooms PER-HB-ROOM, 
            not the total number of bedrooms in the entire model.
        
        _num_people: (List[float]) A list of the number of people for EACH Honeybee-Room input.
            This should ideally be the same length as the '_hb_rooms' input, and in the same 
            order. If only a single value is input, that value will get applied to all of the 
            Honeybee-Rooms input. Note that this value is the number of people PER-HB-ROOM, 
            not the total number of people in the entire model.      

        _set_res_schedule_: (bool) Default=True. Set the Room's Occupancy and Occupant-Activity schedule
            to the Passive-House deffaults? If set to 'False', the Room's existing schedule will be 
            maintained. If None, will re-set the schedule to match the PH res-typical schedule.
        
        _hb_rooms: (List[Room]) A list of Honeybee-Rooms to set the occupancy values on.
            
    Returns:
        hb_rooms_ (List[Room]) A list of the Honeybee Rooms with the ph-style occupancy set.
"""


import scriptcontext as sc
import Rhino as rh
import rhinoscriptsyntax as rs
import ghpythonlib.components as ghc
import Grasshopper as gh


try:
    from honeybee_ph_utils import preview
except ImportError as e:
    raise ImportError('\nFailed to import honeybee_ph_utils:\n\t{}'.format(e))

try:
    from honeybee_ph_rhino import gh_compo_io
except ImportError as e:
    raise ImportError('\nFailed to import honeybee_ph_rhino:\n\t{}'.format(e))

try:
    from ph_gh_component_io import gh_io
except ImportError as e:
    raise ImportError('\nFailed to import ph_gh_component_io:\n\t{}'.format(e))


#-------------------------------------------------------------------------------
import honeybee_ph_rhino._component_info_
reload(honeybee_ph_rhino._component_info_)
ghenv.Component.Name = "HBPH - Set Res Occupancy"
DEV = honeybee_ph_rhino._component_info_.set_component_params(ghenv, dev=False)
if DEV:
    from honeybee_ph_rhino.gh_compo_io.program import set_res_occupancy as gh_compo_io
    reload(gh_compo_io)
    reload(gh_io)

# ------------------------------------------------------------------------------
# -- GH Interface
IGH = gh_io.IGH( ghdoc, ghenv, sc, rh, rs, ghc, gh )


#-------------------------------------------------------------------------------
gh_compo_interface = gh_compo_io.GHCompo_SetResOccupancy(
        IGH,
        _num_bedrooms,
        _num_people,
        _set_res_schedule_,
        _hb_rooms,
    )
hb_rooms_= gh_compo_interface.run()
# ---------- end set_res_occupancy ----------
create_sfh_program = HBPHSetResidentialProgram(hb_rooms=set_res_occupancy.hb_rooms)  # -> out, hb_rooms; inputs hb_rooms: list
# ---------- create_sfh_program: Python ----------
#
# Honeybee-PH: A Plugin for adding Passive-House data to LadybugTools Honeybee-Energy Models
# 
# This component is part of the PH-Tools toolkit <https://github.com/PH-Tools>.
# 
# Copyright (c) 2025, PH-Tools and bldgtyp, llc <phtools@bldgtyp.com> 
# Honeybee-PH is free software; you can redistribute it and/or modify 
# it under the terms of the GNU General Public License as published 
# by the Free Software Foundation; either version 3 of the License, 
# or (at your option) any later version. 
# 
# Honeybee-PH is distributed in the hope that it will be useful,
# but WITHOUT ANY WARRANTY; without even the implied warranty of 
# MERCHANTABILITY or FITNESS FOR A PARTICULAR PURPOSE. See the 
# GNU General Public License for more details.
# 
# For a copy of the GNU General Public License
# see <https://github.com/PH-Tools/honeybee_ph/blob/main/LICENSE>.
# 
# @license GPL-3.0+ <http://spdx.org/licenses/GPL-3.0+>
#
"""
Set HB-Rooms to have typical "Residential" style program attributes: 
* Infiltration: HB-Standard 'Average'=0.0003 m3/s-m2
* Ventilation: Phius Standard=0.4ACH
* Setpoints: Phius Standard Heating=20C [68F], Cooling=25C [77F], Dehumid=60%RH
* Elecrical Equipment: Phius Default Residential Equipment Set.
* Interior Lighting, Hot-Water:
    2014 Building America House Simulation Protocols
    E. Wilson, C. Engebrecht Metzger, S. Horowitz, and R. Hendron
    National Renewable Energy Laboratory
    https://www.nrel.gov/docs/fy14osti/60988.pdf
-
* Occupancy: Set from HBE-Occupancy 
NOTE: If you wish to set 'Passive House' style residential occupancy values, 
use the "HBPH - Set Res Occupancy" component BEFORE using this one. If no PH-Style
occupancy values are found, this component will keep the existing HB-Energy values.
-
EM January 28, 2025
    Args:

        _hb_rooms: (list[Room]) A list of HB-Rooms to re-set the Honeybee-Energy
            properties on.

    Returns:
        hb_rooms_: The Honeybee-Rooms with the new Residential attributes set.
"""

import scriptcontext as sc
import Rhino as rh
import rhinoscriptsyntax as rs
import ghpythonlib.components as ghc
import Grasshopper as gh

try:
    from honeybee_ph_rhino import gh_compo_io
except ImportError as e:
    raise ImportError('\nFailed to import honeybee_ph_rhino:\n\t{}'.format(e))

try:
    from ph_gh_component_io import gh_io
except ImportError as e:
    raise ImportError('\nFailed to import ph_gh_component_io:\n\t{}'.format(e))


#-------------------------------------------------------------------------------
import honeybee_ph_rhino._component_info_
reload(honeybee_ph_rhino._component_info_)
ghenv.Component.Name = "HBPH - Set Residential Program"
DEV = honeybee_ph_rhino._component_info_.set_component_params(ghenv, dev=False)
if DEV:
    from honeybee_ph_rhino.gh_compo_io.program import set_res_program as gh_compo_io
    reload(gh_compo_io)
    reload(gh_io)

# ------------------------------------------------------------------------------
# -- GH Interface
IGH = gh_io.IGH( ghdoc, ghenv, sc, rh, rs, ghc, gh )


#-------------------------------------------------------------------------------
# -- Create the new Single-Family Home Program from the Rooms
gh_compo_interface = gh_compo_io.GHCompo_CreatePHProgramSingleFamilyHome(
    IGH,
    _hb_rooms,
)
hb_rooms_ = gh_compo_interface.run()
# ---------- end create_sfh_program ----------
hbph_ph_appliance_types = HBPHPHApplianceTypes({"1-dishwasher", "2-clothes_washer", "3-clothes_dryer", "4-fridge", "5-freezer", "6-fridge_freezer", "7-cooking", "13-PHIUS_MEL", "14-PHIUS_Lighting_Int", "15-PHIUS_Lighting_Ext", "16-PHIUS_Lighting_Garage", "11-Custom_Electric_per_Year", "17-Custom_Electric_Lighting_per_Year", "18-Custom_Electric_MEL_per_Use", "21-Commercial_Dishwasher", "22-Commercial_Refrigerator", "23-Commercial_Cooking", "24-Commercial_Custom"}, selected="1-dishwasher")
hbph_ph_appliance_types_2 = HBPHPHApplianceTypes({"1-dishwasher", "2-clothes_washer", "3-clothes_dryer", "4-fridge", "5-freezer", "6-fridge_freezer", "7-cooking", "13-PHIUS_MEL", "14-PHIUS_Lighting_Int", "15-PHIUS_Lighting_Ext", "16-PHIUS_Lighting_Garage", "11-Custom_Electric_per_Year", "17-Custom_Electric_Lighting_per_Year", "18-Custom_Electric_MEL_per_Use", "21-Commercial_Dishwasher", "22-Commercial_Refrigerator", "23-Commercial_Cooking", "24-Commercial_Custom"}, selected="2-clothes_washer")
hbph_ph_appliance_types_3 = HBPHPHApplianceTypes({"1-dishwasher", "2-clothes_washer", "3-clothes_dryer", "4-fridge", "5-freezer", "6-fridge_freezer", "7-cooking", "13-PHIUS_MEL", "14-PHIUS_Lighting_Int", "15-PHIUS_Lighting_Ext", "16-PHIUS_Lighting_Garage", "11-Custom_Electric_per_Year", "17-Custom_Electric_Lighting_per_Year", "18-Custom_Electric_MEL_per_Use", "21-Commercial_Dishwasher", "22-Commercial_Refrigerator", "23-Commercial_Cooking", "24-Commercial_Custom"}, selected="3-clothes_dryer")
hbph_ph_appliance_types_4 = HBPHPHApplianceTypes({"1-dishwasher", "2-clothes_washer", "3-clothes_dryer", "4-fridge", "5-freezer", "6-fridge_freezer", "7-cooking", "13-PHIUS_MEL", "14-PHIUS_Lighting_Int", "15-PHIUS_Lighting_Ext", "16-PHIUS_Lighting_Garage", "11-Custom_Electric_per_Year", "17-Custom_Electric_Lighting_per_Year", "18-Custom_Electric_MEL_per_Use", "21-Commercial_Dishwasher", "22-Commercial_Refrigerator", "23-Commercial_Cooking", "24-Commercial_Custom"}, selected="6-fridge_freezer")
hbph_ph_appliance_types_5 = HBPHPHApplianceTypes({"1-dishwasher", "2-clothes_washer", "3-clothes_dryer", "4-fridge", "5-freezer", "6-fridge_freezer", "7-cooking", "13-PHIUS_MEL", "14-PHIUS_Lighting_Int", "15-PHIUS_Lighting_Ext", "16-PHIUS_Lighting_Garage", "11-Custom_Electric_per_Year", "17-Custom_Electric_Lighting_per_Year", "18-Custom_Electric_MEL_per_Use", "21-Commercial_Dishwasher", "22-Commercial_Refrigerator", "23-Commercial_Cooking", "24-Commercial_Custom"}, selected="7-cooking")
hbph_ph_appliance_types_6 = HBPHPHApplianceTypes({"1-dishwasher", "2-clothes_washer", "3-clothes_dryer", "4-fridge", "5-freezer", "6-fridge_freezer", "7-cooking", "13-PHIUS_MEL", "14-PHIUS_Lighting_Int", "15-PHIUS_Lighting_Ext", "16-PHIUS_Lighting_Garage", "11-Custom_Electric_per_Year", "17-Custom_Electric_Lighting_per_Year", "18-Custom_Electric_MEL_per_Use", "21-Commercial_Dishwasher", "22-Commercial_Refrigerator", "23-Commercial_Cooking", "24-Commercial_Custom"}, selected="14-PHIUS_Lighting_Int")
hbph_ph_appliance_types_7 = HBPHPHApplianceTypes({"1-dishwasher", "2-clothes_washer", "3-clothes_dryer", "4-fridge", "5-freezer", "6-fridge_freezer", "7-cooking", "13-PHIUS_MEL", "14-PHIUS_Lighting_Int", "15-PHIUS_Lighting_Ext", "16-PHIUS_Lighting_Garage", "11-Custom_Electric_per_Year", "17-Custom_Electric_Lighting_per_Year", "18-Custom_Electric_MEL_per_Use", "21-Commercial_Dishwasher", "22-Commercial_Refrigerator", "23-Commercial_Cooking", "24-Commercial_Custom"}, selected="15-PHIUS_Lighting_Ext")
hbph_ph_appliance_types_8 = HBPHPHApplianceTypes({"1-dishwasher", "2-clothes_washer", "3-clothes_dryer", "4-fridge", "5-freezer", "6-fridge_freezer", "7-cooking", "13-PHIUS_MEL", "14-PHIUS_Lighting_Int", "15-PHIUS_Lighting_Ext", "16-PHIUS_Lighting_Garage", "11-Custom_Electric_per_Year", "17-Custom_Electric_Lighting_per_Year", "18-Custom_Electric_MEL_per_Use", "21-Commercial_Dishwasher", "22-Commercial_Refrigerator", "23-Commercial_Cooking", "24-Commercial_Custom"}, selected="13-PHIUS_MEL")
explode_tree = ExplodeTree(Data=graft(create_sfh_program.hb_rooms))  # -> Branch0, Branch1
get_occupancy = HBPHGetOccupancy(hb_rooms=explode_tree.Branch1)  # -> out, total_num_bedrooms, total_num_people, total_num_dwellings; inputs hb_rooms: list
# ---------- get_occupancy: Python ----------
#
# Honeybee-PH: A Plugin for adding Passive-House data to LadybugTools Honeybee-Energy Models
# 
# This component is part of the PH-Tools toolkit <https://github.com/PH-Tools>.
# 
# Copyright (c) 2025, PH-Tools and bldgtyp, llc <phtools@bldgtyp.com> 
# Honeybee-PH is free software; you can redistribute it and/or modify 
# it under the terms of the GNU General Public License as published 
# by the Free Software Foundation; either version 3 of the License, 
# or (at your option) any later version. 
# 
# Honeybee-PH is distributed in the hope that it will be useful,
# but WITHOUT ANY WARRANTY; without even the implied warranty of 
# MERCHANTABILITY or FITNESS FOR A PARTICULAR PURPOSE. See the 
# GNU General Public License for more details.
# 
# For a copy of the GNU General Public License
# see <https://github.com/PH-Tools/honeybee_ph/blob/main/LICENSE>.
# 
# @license GPL-3.0+ <http://spdx.org/licenses/GPL-3.0+>
#
"""
Report out the occupancy related information for a set of Honenybee-Rooms.
-
EM January 26, 2025
    Args:

        _hb_rooms: (list[Room]) A list of HB-Rooms to get the data from. 
        
    Returns:
        total_num_bedrooms_: The total number of bedrooms found in the
            HB-Rooms input.

        total_num_people_: The total number of occupants found in the 
            HB-Rooms input.

        total_num_dwellings_: The total number of 'dwelling units' found in the 
            HB-Rooms input.
"""

import scriptcontext as sc
import Rhino as rh
import rhinoscriptsyntax as rs
import ghpythonlib.components as ghc
import Grasshopper as gh

try:
    from honeybee_ph_rhino import gh_compo_io
except ImportError as e:
    raise ImportError('\nFailed to import honeybee_ph_rhino:\n\t{}'.format(e))

try:
    from ph_gh_component_io import gh_io
except ImportError as e:
    raise ImportError('\nFailed to import ph_gh_component_io:\n\t{}'.format(e))


#-------------------------------------------------------------------------------
import honeybee_ph_rhino._component_info_
reload(honeybee_ph_rhino._component_info_)
ghenv.Component.Name = "HBPH - Get Occupancy"
DEV = honeybee_ph_rhino._component_info_.set_component_params(ghenv, dev=False)
if DEV:
    from honeybee_ph_rhino.gh_compo_io.program import get_res_occupancy as gh_compo_io
    reload(gh_compo_io)
    reload(gh_io)


# ------------------------------------------------------------------------------
# -- GH Interface
IGH = gh_io.IGH( ghdoc, ghenv, sc, rh, rs, ghc, gh )


#-------------------------------------------------------------------------------
# -- Create the new Single-Family Home Program from the Rooms
gh_compo_interface = gh_compo_io.GHCompo_GetResOccupancy(
    IGH,
    _hb_rooms,
)
total_num_bedrooms_, total_num_people_, total_num_dwellings_ = gh_compo_interface.run()
# ---------- end get_occupancy ----------
get_occupancy_2 = HBPHGetOccupancy(hb_rooms=explode_tree.Branch1)  # -> out, total_num_bedrooms, total_num_people, total_num_dwellings; inputs hb_rooms: list; same code as get_occupancy
panel_24 = Panel(get_occupancy.total_num_bedrooms)
panel_25 = Panel(get_occupancy.total_num_dwellings)
panel_26 = Panel(get_occupancy.total_num_people)
hbph_ph_appliance_types_9 = HBPHPHApplianceTypes({"1-dishwasher", "2-clothes_washer", "3-clothes_dryer", "4-fridge", "5-freezer", "6-fridge_freezer", "7-cooking", "13-PHIUS_MEL", "14-PHIUS_Lighting_Int", "15-PHIUS_Lighting_Ext", "16-PHIUS_Lighting_Garage", "11-Custom_Electric_per_Year", "17-Custom_Electric_Lighting_per_Year", "18-Custom_Electric_MEL_per_Use", "21-Commercial_Dishwasher", "22-Commercial_Refrigerator", "23-Commercial_Cooking", "24-Commercial_Custom", "100-Phius_Defaults": "100-Phius _Defaults", "200-PHI_Defaults"}, selected="100-Phius_Defaults")
hbph_ph_appliance_types_10 = HBPHPHApplianceTypes({"1-dishwasher", "2-clothes_washer", "3-clothes_dryer", "4-fridge", "5-freezer", "6-fridge_freezer", "7-cooking", "13-PHIUS_MEL", "14-PHIUS_Lighting_Int", "15-PHIUS_Lighting_Ext", "16-PHIUS_Lighting_Garage", "11-Custom_Electric_per_Year", "17-Custom_Electric_Lighting_per_Year", "18-Custom_Electric_MEL_per_Use", "21-Commercial_Dishwasher", "22-Commercial_Refrigerator", "23-Commercial_Cooking", "24-Commercial_Custom", "100-Phius_Defaults": "100-Phius _Defaults", "200-PHI_Defaults"}, selected="100-Phius_Defaults")
merge_5 = Merge(
    Data1=hbph_ph_appliance_types,
    Data2=hbph_ph_appliance_types_2,
    Data3=hbph_ph_appliance_types_3,
    Data4=hbph_ph_appliance_types_4,
    Data5=hbph_ph_appliance_types_5,
    Data6=hbph_ph_appliance_types_6,
    Data7=hbph_ph_appliance_types_7,
    Data8=hbph_ph_appliance_types_8)
add_process_equipment = HBPHAddProcessEquipment(
    equipment=hbph_ph_appliance_types_9,
    num_bedrooms=get_occupancy.total_num_bedrooms,
    num_occupants=get_occupancy.total_num_people,
    num_dwellings=get_occupancy.total_num_dwellings,
    hb_rooms=explode_tree.Branch1)  # -> out, hb_rooms; inputs equipment: list, hb_rooms: list
# ---------- add_process_equipment: Python ----------
#
# Honeybee-PH: A Plugin for adding Passive-House data to LadybugTools Honeybee-Energy Models
# 
# This component is part of the PH-Tools toolkit <https://github.com/PH-Tools>.
# 
# Copyright (c) 2025, PH-Tools and bldgtyp, llc <phtools@bldgtyp.com> 
# Honeybee-PH is free software; you can redistribute it and/or modify 
# it under the terms of the GNU General Public License as published 
# by the Free Software Foundation; either version 3 of the License, 
# or (at your option) any later version. 
# 
# Honeybee-PH is distributed in the hope that it will be useful,
# but WITHOUT ANY WARRANTY; without even the implied warranty of 
# MERCHANTABILITY or FITNESS FOR A PARTICULAR PURPOSE. See the 
# GNU General Public License for more details.
# 
# For a copy of the GNU General Public License
# see <https://github.com/PH-Tools/honeybee_ph/blob/main/LICENSE>.
# 
# @license GPL-3.0+ <http://spdx.org/licenses/GPL-3.0+>
#
"""
Add new PH Equipment (Appliances) to the HB-Rooms. 
-
Note that ALL of the equipment input will be added to ALL of the Honeybee-Rooms. 
This may not always be what you want, and so if you want to add equipment ONLY 
to certain rooms (ie: add a Cooktopto ONLY the Kitchen), then break up your 
Rooms accordingly and only pass in the relevant Honeybee-Room(s).
-
EM January 26, 2025
    Args:

        _equipment: (list[str | PHEquipment]) A List of new HBPH 'Equipment' to add 
            to the Honeybee Rooms. If a string is input (ie: "1-Dishwasher") a default
            ph-equipment of that type will be added. If you wish to input detailed
            equipment with specific values, use the "Create PH Equipment" component 
            to create that equipment and add it here.

        _num_bedrooms: (float) Enter the TOTAL number of bedrooms represented
            by the Honeybee-Rooms input. This is use to determine the total Phius
            appliance, lighting, and Misc. Electrical loads. 

        _num_occupants: (float) Enter the TOTAL number of occupants represented
            by the Honeybee-Rooms input. This is use to determine the total Phius
            appliance, lighting, and Misc. Electrical loads. 

        _num_dwellings: (float) default=1. Enter the TOTAL number of dwellings
            represented by the Honeybee-Rooms input. For single-family home and
            non-residential, enter '1' or leave empty. For Multi-Unit (apartment)
            buildings, enter the TOTAL number of dwellings. This values is used 
            to calculate Phius lighting and Misc. Electrical loads.

        _hb_rooms: (list[Room]) A list of HB-Rooms to add the PH-Equuipment to.
        
    Returns:
        hb_rooms_: The HB-Rooms with the .... added to them.
"""

import scriptcontext as sc
import Rhino as rh
import rhinoscriptsyntax as rs
import ghpythonlib.components as ghc
import Grasshopper as gh

try:
    from honeybee_ph_rhino import gh_compo_io
except ImportError as e:
    raise ImportError('\nFailed to import honeybee_ph_rhino:\n\t{}'.format(e))

try:
    from ph_gh_component_io import gh_io
except ImportError as e:
    raise ImportError('\nFailed to import ph_gh_component_io:\n\t{}'.format(e))


#-------------------------------------------------------------------------------
import honeybee_ph_rhino._component_info_
reload(honeybee_ph_rhino._component_info_)
ghenv.Component.Name = "HBPH - Add Process Equipment"
DEV = honeybee_ph_rhino._component_info_.set_component_params(ghenv, dev=False)
if DEV:
    from honeybee_ph_rhino.gh_compo_io.program import add_process_equip as gh_compo_io
    reload(gh_compo_io)
    reload(gh_io)


# ------------------------------------------------------------------------------
# -- GH Interface
IGH = gh_io.IGH( ghdoc, ghenv, sc, rh, rs, ghc, gh )


#-------------------------------------------------------------------------------
# -- Create the new Single-Family Home Program from the Rooms
gh_compo_interface = gh_compo_io.GHCompo_AddProcessEquip(
    IGH,
    _equipment,
    _num_bedrooms,
    _num_occupants,
    _num_dwellings,
    _hb_rooms,
)
hb_rooms_ = gh_compo_interface.run()
# ---------- end add_process_equipment ----------
create_ph_equipment = HBPHCreatePHEquipment(type=hbph_ph_appliance_types_10)  # -> out, equipment
# ---------- create_ph_equipment: Python ----------
#
# Honeybee-PH: A Plugin for adding Passive-House data to LadybugTools Honeybee-Energy Models
# 
# This component is part of the PH-Tools toolkit <https://github.com/PH-Tools>.
# 
# Copyright (c) 2022, PH-Tools and bldgtyp, llc <phtools@bldgtyp.com> 
# Honeybee-PH is free software; you can redistribute it and/or modify 
# it under the terms of the GNU General Public License as published 
# by the Free Software Foundation; either version 3 of the License, 
# or (at your option) any later version. 
# 
# Honeybee-PH is distributed in the hope that it will be useful,
# but WITHOUT ANY WARRANTY; without even the implied warranty of 
# MERCHANTABILITY or FITNESS FOR A PARTICULAR PURPOSE. See the 
# GNU General Public License for more details.
# 
# For a copy of the GNU General Public License
# see <https://github.com/PH-Tools/honeybee_ph/blob/main/LICENSE>.
# 
# @license GPL-3.0+ <http://spdx.org/licenses/GPL-3.0+>
#
"""
Create a new detailed Passive House style equipment which can be added to the 
honeybee Rooms.
-
EM March 4, 2025
    Args:
        _type: (str) Input either -
1-dishwasher,
2-clothes_washer,
3-clothes_dryer,
4-fridge,
5-freezer,
6-fridge_freezer,
7-cooking,
13-PHIUS_MEL,
14-PHIUS_Lighting_Int,
15-PHIUS_Lighting_Ext,
16-PHIUS_Lighting_Garage,
11-Custom_Electric_per_Year,
17-Custom_Electric_Lighting_per_Year,
18-Custom_Electric_MEL_per_Use,
100-PhiUS_Defaults,
200-Phi_Defaults,

        _display_name: (str) Optional display name
    
    Returns:
        equipment_: (list[PhEquipment]) New HBPH Electric Equipment which can be added to one 
            or more Honeybee-Rooms using the "HBPH - Add Process Equipment" component.
"""

import scriptcontext as sc
import Rhino as rh
import rhinoscriptsyntax as rs
import ghpythonlib.components as ghc
import Grasshopper as gh

try:
    from honeybee_ph_utils import preview
except ImportError as e:
    raise ImportError('\nFailed to import honeybee_ph_utils:\n\t{}'.format(e))

try:
    from honeybee_ph_rhino import gh_compo_io
    from honeybee_ph_rhino.gh_compo_io.program import create_elec_equip
except ImportError as e:
    raise ImportError('\nFailed to import honeybee_ph_rhino:\n\t{}'.format(e))

try:
    from ph_gh_component_io import gh_io
except ImportError as e:
    raise ImportError('\nFailed to import ph_gh_component_io:\n\t{}'.format(e))



#-------------------------------------------------------------------------------
import honeybee_ph_rhino._component_info_
reload(honeybee_ph_rhino._component_info_)
ghenv.Component.Name = "HBPH - Create PH Equipment"
DEV = True
honeybee_ph_rhino._component_info_.set_component_params(ghenv)
DEV = honeybee_ph_rhino._component_info_.set_component_params(ghenv, dev=False)
if DEV:
    from honeybee_ph_rhino.gh_compo_io.program import create_elec_equip as gh_compo_io
    reload(gh_compo_io)
    reload(create_elec_equip)
    reload(gh_io)


# ------------------------------------------------------------------------------
# -- GH Interface
IGH = gh_io.IGH( ghdoc, ghenv, sc, rh, rs, ghc, gh )


#-------------------------------------------------------------------------------
# -- Setup the input nodes, get all the user input values
input_dict = create_elec_equip.get_component_inputs(_type)
gh_io.setup_component_inputs(IGH, input_dict, _start_i=2)
input_values_dict = gh_io.get_component_input_values(ghenv)


#-------------------------------------------------------------------------------
gh_compo_interface = gh_compo_io.GHCompo_CreateElecEquip(
        IGH,
        _type,
        input_values_dict
    )
equipment_ = gh_compo_interface.run()


#-------------------------------------------------------------------------------
# -- Preview
for e in equipment_:
    preview.object_preview(e)
# ---------- end create_ph_equipment ----------
add_process_equipment_2 = HBPHAddProcessEquipment(
    equipment=merge_5,
    num_bedrooms=get_occupancy_2.total_num_bedrooms,
    num_occupants=get_occupancy_2.total_num_people,
    num_dwellings=get_occupancy_2.total_num_dwellings,
    hb_rooms=explode_tree.Branch0)  # -> out, hb_rooms; inputs equipment: list, hb_rooms: list
# ---------- add_process_equipment_2: Python ----------
#
# Honeybee-PH: A Plugin for adding Passive-House data to LadybugTools Honeybee-Energy Models
# 
# This component is part of the PH-Tools toolkit <https://github.com/PH-Tools>.
# 
# Copyright (c) 2025, PH-Tools and bldgtyp, llc <phtools@bldgtyp.com> 
# Honeybee-PH is free software; you can redistribute it and/or modify 
# it under the terms of the GNU General Public License as published 
# by the Free Software Foundation; either version 3 of the License, 
# or (at your option) any later version. 
# 
# Honeybee-PH is distributed in the hope that it will be useful,
# but WITHOUT ANY WARRANTY; without even the implied warranty of 
# MERCHANTABILITY or FITNESS FOR A PARTICULAR PURPOSE. See the 
# GNU General Public License for more details.
# 
# For a copy of the GNU General Public License
# see <https://github.com/PH-Tools/honeybee_ph/blob/main/LICENSE>.
# 
# @license GPL-3.0+ <http://spdx.org/licenses/GPL-3.0+>
#
"""
Add new PH Equipment (Appliances) to the HB-Rooms. 
-
Note that ALL of the equipment input will be added to ALL of the Honeybee-Rooms. 
This may not always be what you want, and so if you want to add equipment ONLY 
to certain rooms (ie: add a Cooktopto ONLY the Kitchen), then break up your 
Rooms accordingly and only pass in the relevant Honeybee-Room(s).
-
EM January 28, 2025
    Args:

        _equipment: (list[str | PHEquipment]) A List of new HBPH 'Equipment' to add 
            to the Honeybee Rooms. If a string is input (ie: "1-Dishwasher") a default
            ph-equipment of that type will be added. If you wish to input detailed
            equipment with specific values, use the "Create PH Equipment" component 
            to create that equipment and add it here.

        _num_bedrooms: (float) Enter the TOTAL number of bedrooms represented
            by the Honeybee-Rooms input. This is use to determine the total Phius
            appliance, lighting, and Misc. Electrical loads. 

        _num_occupants: (float) Enter the TOTAL number of occupants represented
            by the Honeybee-Rooms input. This is use to determine the total Phius
            appliance, lighting, and Misc. Electrical loads. 

        _num_dwellings: (float) default=1. Enter the TOTAL number of dwellings
            represented by the Honeybee-Rooms input. For single-family home and
            non-residential, enter '1' or leave empty. For Multi-Unit (apartment)
            buildings, enter the TOTAL number of dwellings. This values is used 
            to calculate Phius lighting and Misc. Electrical loads.

        _hb_rooms: (list[Room]) A list of HB-Rooms to add the PH-Equuipment to.
        
    Returns:
        hb_rooms_: The HB-Rooms with the .... added to them.
"""

import scriptcontext as sc
import Rhino as rh
import rhinoscriptsyntax as rs
import ghpythonlib.components as ghc
import Grasshopper as gh

try:
    from honeybee_ph_rhino import gh_compo_io
except ImportError as e:
    raise ImportError('\nFailed to import honeybee_ph_rhino:\n\t{}'.format(e))

try:
    from ph_gh_component_io import gh_io
except ImportError as e:
    raise ImportError('\nFailed to import ph_gh_component_io:\n\t{}'.format(e))


#-------------------------------------------------------------------------------
import honeybee_ph_rhino._component_info_
reload(honeybee_ph_rhino._component_info_)
ghenv.Component.Name = "HBPH - Add Process Equipment"
DEV = honeybee_ph_rhino._component_info_.set_component_params(ghenv, dev=False)
if DEV:
    from honeybee_ph_rhino.gh_compo_io.program import add_process_equip as gh_compo_io
    reload(gh_compo_io)
    reload(gh_io)


# ------------------------------------------------------------------------------
# -- GH Interface
IGH = gh_io.IGH( ghdoc, ghenv, sc, rh, rs, ghc, gh )


#-------------------------------------------------------------------------------
# -- Create the new Single-Family Home Program from the Rooms
gh_compo_interface = gh_compo_io.GHCompo_AddProcessEquip(
    IGH,
    _equipment,
    _num_bedrooms,
    _num_occupants,
    _num_dwellings,
    _hb_rooms,
)
hb_rooms_ = gh_compo_interface.run()
# ---------- end add_process_equipment_2 ----------
merge_6 = Merge(Data1=add_process_equipment_2.hb_rooms, Data2=add_process_equipment.hb_rooms)  # -> flatten(Result)

vizwiref = HBVisualizeWireframe(hb_objs=flatten(merge_6))  # -> geo; plug-in component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
reduce = RandomReduce(List=vizwiref, Reduction="10", Seed=1)

create_thermal_bridges = HBPHCreateThermalBridges(geometry=reduce, psi_values="0.01")  # -> out, thermal_bridges; inputs geometry: list of GeometryBase, names: list, psi_values: list, fRsi_values: list, types: list, quantities: list
# ---------- create_thermal_bridges: Python ----------
#
# Honeybee-PH: A Plugin for adding Passive-House data to LadybugTools Honeybee-Energy Models
# 
# This component is part of the PH-Tools toolkit <https://github.com/PH-Tools>.
# 
# Copyright (c) 2022, PH-Tools and bldgtyp, llc <phtools@bldgtyp.com> 
# Honeybee-PH is free software; you can redistribute it and/or modify 
# it under the terms of the GNU General Public License as published 
# by the Free Software Foundation; either version 3 of the License, 
# or (at your option) any later version. 
# 
# Honeybee-PH is distributed in the hope that it will be useful,
# but WITHOUT ANY WARRANTY; without even the implied warranty of 
# MERCHANTABILITY or FITNESS FOR A PARTICULAR PURPOSE. See the 
# GNU General Public License for more details.
# 
# For a copy of the GNU General Public License
# see <https://github.com/PH-Tools/honeybee_ph/blob/main/LICENSE>.
# 
# @license GPL-3.0+ <http://spdx.org/licenses/GPL-3.0+>
#
"""
Create a new HBPH Thermal Bridge object which can be added to an HB Model. Note that
these thermal bridges will have no effect on the EnergyPlus/OpenStudio simualtion and 
will only be considered when the model is exported to the PHPP/WUFI-Passive.
-
EM October 2, 2022

    Args:
        _names: (List[str]) A list of the HBPH Thermal Bridge names.
            
        _psi_values: (List[float]) The Psi-Values (W/mk) values to use. If 
            None are provied, default=0.1 W/mk
            
        _fRsi_values: (List[float]) The temperature-factor (fRsi) values. If 
            None are provided, default=0.75
        
        _lengths: (List[float]) The lengths (m). If None are provided, 
            default=0.0 m
            
        _types: (List[str]): Input either -
        - "15-Ambient" (default)
        - "16-Perimeter"
        - "17-FS/BC"
            
        _quantities: (List[float]): The number of times the bridge element occurs.
            
    Returns:
        thermal_bridges_: (List[PhThermalBridge]) A list of the new HBPH
            thermal bridge objects. These can be added to a Honeybee room
            using the "HBPH - Add Thermal Bridges" component.
"""

import scriptcontext as sc
import Rhino as rh
import rhinoscriptsyntax as rs
import ghpythonlib.components as ghc
import Grasshopper as gh

try:
    from honeybee_ph_rhino import gh_io, gh_compo_io
except ImportError as e:
    raise ImportError('\nFailed to import honeybee_ph_rhino:\n\t{}'.format(e))

try:
    from honeybee_ph_utils import preview
except ImportError as e:
    raise ImportError('\nFailed to import honeybee_ph_utils:\n\t{}'.format(e))
    
#-------------------------------------------------------------------------------
import honeybee_ph_rhino._component_info_
reload(honeybee_ph_rhino._component_info_)
ghenv.Component.Name = "HBPH - Create Thermal Bridges"
DEV = honeybee_ph_rhino._component_info_.set_component_params(ghenv, dev=False)
if DEV:
    reload(gh_compo_io)
    reload(gh_io)

# ------------------------------------------------------------------------------
# -- GH Interface
IGH = gh_io.IGH( ghdoc, ghenv, sc, rh, rs, ghc, gh )

#-------------------------------------------------------------------------------
gh_compo_interface = gh_compo_io.GHCompo_CreateTB(
        IGH,
        _geometry,
        _names, 
        _psi_values,
        _fRsi_values,
        _types,
        _quantities,
    )
thermal_bridges_ = gh_compo_interface.run()
    
#-------------------------------------------------------------------------------
# -- Preview
for tb in thermal_bridges_:
    preview.object_preview(tb)
# ---------- end create_thermal_bridges ----------
add_thermal_bridges = HBPHAddThermalBridgesToRooms(thermal_bridges=create_thermal_bridges.thermal_bridges, hb_rooms=merge_6)  # -> out, hb_rooms; inputs thermal_bridges: list, hb_rooms: list
# ---------- add_thermal_bridges: Python ----------
#
# Honeybee-PH: A Plugin for adding Passive-House data to LadybugTools Honeybee-Energy Models
# 
# This component is part of the PH-Tools toolkit <https://github.com/PH-Tools>.
# 
# Copyright (c) 2022, PH-Tools and bldgtyp, llc <phtools@bldgtyp.com> 
# Honeybee-PH is free software; you can redistribute it and/or modify 
# it under the terms of the GNU General Public License as published 
# by the Free Software Foundation; either version 3 of the License, 
# or (at your option) any later version. 
# 
# Honeybee-PH is distributed in the hope that it will be useful,
# but WITHOUT ANY WARRANTY; without even the implied warranty of 
# MERCHANTABILITY or FITNESS FOR A PARTICULAR PURPOSE. See the 
# GNU General Public License for more details.
# 
# For a copy of the GNU General Public License
# see <https://github.com/PH-Tools/honeybee_ph/blob/main/LICENSE>.
# 
# @license GPL-3.0+ <http://spdx.org/licenses/GPL-3.0+>
#
"""
Add new PH Thermal Bridge objects to a Honeybee Room or Rooms. Note that the 
thermal bridges here are added to the Room's PH Building Segment. If Rooms are 
combined together into a single building segment before export to the PHPP / WUFI-Passive, 
the thermal bridges here will only get accounted for once. If the same thermal bridge object
is added to more than one room, it will only show up once for each building-segment.
-
EM October 2, 2022

    Args:
        _thermal_bridges: (List[PhThermalBridge]) A list of the new PH Thermal Bridge
            objects to add to the Honeybee Rooms.
            
        _hb_rooms: (List[float]) A list of the Honeybee Rooms to have the 
            thermal bridges added. 
            
    Returns:
        hb_rooms_: (List[room.Room]) A list of Honeybee-Rooms with the new 
            thermal bridges added to the Room's PH Building-Segment.
"""

try:
    from honeybee_ph_rhino import gh_compo_io, gh_io
except ImportError as e:
    raise ImportError('\nFailed to import honeybee_ph_rhino:\n\t{}'.format(e))

#-------------------------------------------------------------------------------
import honeybee_ph_rhino._component_info_
reload(honeybee_ph_rhino._component_info_)
ghenv.Component.Name = "HBPH - Add Thermal Bridges to Rooms"
DEV = True
honeybee_ph_rhino._component_info_.set_component_params(ghenv)
DEV = honeybee_ph_rhino._component_info_.set_component_params(ghenv, dev=False)
if DEV:
    reload(gh_compo_io)
    reload(gh_io)


#-------------------------------------------------------------------------------
gh_compo_interface = gh_compo_io.GHCompo_AddTBs(
        _hb_rooms,
        _thermal_bridges
    )
hb_rooms_ = gh_compo_interface.run()
# ---------- end add_thermal_bridges ----------

get_phius_mf_non_res_loads = HBPHGetPhiusMultiFamilyNonResidentialRoomLoads(hb_rooms=merge_6)  # -> out, program_data, room_data, totals, port, total_mel, total_lighting, port_2, hb_non_residential_rooms; inputs hb_rooms: list
# ---------- get_phius_mf_non_res_loads: Python ----------
#
# Honeybee-PH: A Plugin for adding Passive-House data to LadybugTools Honeybee-Energy Models
# 
# This component is part of the PH-Tools toolkit <https://github.com/PH-Tools>.
# 
# Copyright (c) 2025, PH-Tools and bldgtyp, llc <phtools@bldgtyp.com> 
# Honeybee-PH is free software; you can redistribute it and/or modify 
# it under the terms of the GNU General Public License as published 
# by the Free Software Foundation; either version 3 of the License, 
# or (at your option) any later version. 
# 
# Honeybee-PH is distributed in the hope that it will be useful,
# but WITHOUT ANY WARRANTY; without even the implied warranty of 
# MERCHANTABILITY or FITNESS FOR A PARTICULAR PURPOSE. See the 
# GNU General Public License for more details.
# 
# For a copy of the GNU General Public License
# see <https://github.com/PH-Tools/honeybee_ph/blob/main/LICENSE>.
# 
# @license GPL-3.0+ <http://spdx.org/licenses/GPL-3.0+>
#
"""
This component will read and extract all of the 'NON-Residential' Electric-Equipment Loads from a set of Honeybee-Rooms
in order to calculate the Phius Multi-Family NON-Residential Loads for Lighting 
and MEL. The calculations here align with the 'Phius Multifamily Calculator v24.0.2 | 2024 11'
> https://www.phius.org/phius-multifamily-lighting-misc-load-calculator
-
The results of this component can be passed to the "HBPH - Set Phius Multi-Family Non-Residential Room Loads"
in order to create the actual Equipment objects and add them to the Honeybee-Rooms.
-
EM April 8, 2025
    Args:

        _hb_rooms: (list[Room]) The Honeybee-Rooms to get the Non-Residential data from.

    Returns:

        program_data_: The non-residential Programs found in the Model, in text
            which an be copy/pasted into the Phius Multifamily Calculator.

        room_data_: The non-residential data for each room in the model, in text
            which an be copy/pasted into the Phius Multifamily Calculator.

        totals_: The Non-Residentital total energy consumption values (for checking 
            againt the Phius Multifamily Calculator)

        total_mel_: (kWh/a) The total annual Misc Electrical (MEL) energy consumption of all the Non-Residential
            Honeybee-Rooms input. This can be used to create a new MEL Equipment object
            which will match the values calculated by the Phius Multifamily Calculator.

        total_lighting_: (kWh/a) The total annual Lighting energy consumption of all the Non-Residential
            Honeybee-Rooms input. This can be used to create a new Lighting Equipment object
            which will match the values calculated by the Phius Multifamily Calculator.

        hb_rooms_: (list[Room]) The input Honeybee Rooms. Note that no modificiations have been made to the
            rooms, and no equipment has been added. In order to add electric-equipment to the model, use the 
            typical "HBPH - Add Process Equipment" or the "HBPH - Set Phius Multi-Family Non-Residential Room Loads".
"""

import scriptcontext as sc
import Rhino as rh
import rhinoscriptsyntax as rs
import ghpythonlib.components as ghc
import Grasshopper as gh

try:
    from honeybee_ph_rhino import gh_compo_io
except ImportError as e:
    raise ImportError('\nFailed to import honeybee_ph_rhino:\n\t{}'.format(e))

try:
    from ph_gh_component_io import gh_io
except ImportError as e:
    raise ImportError('\nFailed to import ph_gh_component_io:\n\t{}'.format(e))


#-------------------------------------------------------------------------------
import honeybee_ph_rhino._component_info_
reload(honeybee_ph_rhino._component_info_)
ghenv.Component.Name = "HBPH - Get Phius Multi-Family Non-Residential Room Loads"
DEV = honeybee_ph_rhino._component_info_.set_component_params(ghenv, dev=False)
if DEV:
    from honeybee_ph_rhino.gh_compo_io.program import get_phius_mf_nonres_data as gh_compo_io
    reload(gh_compo_io)
    reload(gh_io)

# ------------------------------------------------------------------------------
# -- GH Interface
IGH = gh_io.IGH( ghdoc, ghenv, sc, rh, rs, ghc, gh )

#-------------------------------------------------------------------------------
gh_compo_interface = gh_compo_io.GHCompo_GetPhiusMFNonResidentialLoadData(
    IGH,
    _hb_rooms,
)

(
    program_data_,
    room_data_,
    totals_,
    total_mel_,
    total_lighting_,
    hb_non_residential_rooms_,
) = gh_compo_interface.run()
# ---------- end get_phius_mf_non_res_loads ----------
get_phius_mf_res_room_loads = HBPHGetPhiusMultiFamilyResidentialRoomLoads(hb_rooms=merge_6)  # -> out, res_data_by_story, res_totals, port, total_mel, total_lighting_int, total_lighting_ext, total_lighting_garage, port_2, hb_residential_rooms; inputs hb_rooms: list
# ---------- get_phius_mf_res_room_loads: Python ----------
#
# Honeybee-PH: A Plugin for adding Passive-House data to LadybugTools Honeybee-Energy Models
# 
# This component is part of the PH-Tools toolkit <https://github.com/PH-Tools>.
# 
# Copyright (c) 2025, PH-Tools and bldgtyp, llc <phtools@bldgtyp.com> 
# Honeybee-PH is free software; you can redistribute it and/or modify 
# it under the terms of the GNU General Public License as published 
# by the Free Software Foundation; either version 3 of the License, 
# or (at your option) any later version. 
# 
# Honeybee-PH is distributed in the hope that it will be useful,
# but WITHOUT ANY WARRANTY; without even the implied warranty of 
# MERCHANTABILITY or FITNESS FOR A PARTICULAR PURPOSE. See the 
# GNU General Public License for more details.
# 
# For a copy of the GNU General Public License
# see <https://github.com/PH-Tools/honeybee_ph/blob/main/LICENSE>.
# 
# @license GPL-3.0+ <http://spdx.org/licenses/GPL-3.0+>
#
"""
This component will read and extract all of the 'Residential' Electric-Equipment Loads from a set of Honeybee-Rooms
in order to calculate the Phius Multi-Family Residential (Dwelling) Loads for Lighting 
and MEL. The calculations here align with the 'Phius Multifamily Calculator v24.0.2 | 2024 11'
> https://www.phius.org/phius-multifamily-lighting-misc-load-calculator
-
The results of this component can be passed to the "HBPH - Set Phius Multi-Family Residential Room Loads"
in order to create the actual Equipment objects and add them to the Honeybee-Rooms.
-
NOTE: BEFORE using this component, be sure to set the Occupancy using the "HBPH - Set Res Occupancy" component
and set the Dwelling-Units using the "HBPH - Set Dwelling" component.
-
EM April 8, 2025
    Args:

        _hb_rooms: (list[Room]) The Honeybee-Rooms to get the Residential Loads from.

    Returns:

        res_data_by_story_: The residential data for each 'story' in the model, in text
            which an be copy/pasted into the Phius Multifamily Calculator.

        res_totals_: The residentital total energy consumption values (for checking 
            againt the Phius Multifamily Calculator)

        total_mel_: (kWh/a) The total annual Misc Electrical (MEL) energy consumption of all the 
            Honeybee-Rooms input. This can be used to create a new MEL Equipment object
            which will match the values calculated by the Phius Multifamily Calculator.

        total_lighting_int_: (kWh/a) The total annual Lighting (interior) energy consumption of all the 
            Honeybee-Rooms input. This can be used to create a new Lighting Equipment object
            which will match the values calculated by the Phius Multifamily Calculator.

        total_lighting_ext_: (kWh/a) The total annual Lighting (exterior) energy consumption of all the 
            Honeybee-Rooms input. This can be used to create a new Lighting Equipment object
            which will match the values calculated by the Phius Multifamily Calculator.

        total_lighting_garage_: (kWh/a) The total annual Lighting (garage) energy consumption of all the 
            Honeybee-Rooms input. This can be used to create a new Lighting Equipment object
            which will match the values calculated by the Phius Multifamily Calculator.

        hb_residential_rooms_: (list[Room]) The Honeybee 'Residential' Rooms. Note that no modificiations have been made to the
            rooms, and no equipment has been added. In order to add electric-equipment to the model, use the 
            typical "HBPH - Add Process Equipment" or the "HBPH - Set Phius Multi-Family Residential Room Loads".
"""

import scriptcontext as sc
import Rhino as rh
import rhinoscriptsyntax as rs
import ghpythonlib.components as ghc
import Grasshopper as gh

try:
    from honeybee_ph_rhino import gh_compo_io
except ImportError as e:
    raise ImportError('\nFailed to import honeybee_ph_rhino:\n\t{}'.format(e))

try:
    from ph_gh_component_io import gh_io
except ImportError as e:
    raise ImportError('\nFailed to import ph_gh_component_io:\n\t{}'.format(e))


#-------------------------------------------------------------------------------
import honeybee_ph_rhino._component_info_
reload(honeybee_ph_rhino._component_info_)
ghenv.Component.Name = "HBPH - Get Phius Multi-Family Residential Room Loads"
DEV = honeybee_ph_rhino._component_info_.set_component_params(ghenv, dev=False)
if DEV:
    from honeybee_ph_rhino.gh_compo_io.program import get_phius_mf_res_data as gh_compo_io
    reload(gh_compo_io)
    reload(gh_io)

# ------------------------------------------------------------------------------
# -- GH Interface
IGH = gh_io.IGH( ghdoc, ghenv, sc, rh, rs, ghc, gh )

#-------------------------------------------------------------------------------
gh_compo_interface = gh_compo_io.GHCompo_GetPhiusMFResidentialLoadData(
    IGH,
    _hb_rooms,
)

(
    res_data_by_story_,
    res_totals_,
    total_mel_,
    total_lighting_int_,
    total_lighting_ext_,
    total_lighting_garage_,
    hb_residential_rooms_
) = gh_compo_interface.run()
# ---------- end get_phius_mf_res_room_loads ----------

infiltration_from_ach = HBPHInfiltrationFromACH(ach_at_50Pa="0.6", hb_rooms=add_thermal_bridges.hb_rooms)  # -> out, infilt_per_exterior_at_4Pa, infilt_per_exterior_at_50Pa; inputs hb_rooms: list
# ---------- infiltration_from_ach: Python ----------
#
# Honeybee-PH: A Plugin for adding Passive-House data to LadybugTools Honeybee-Energy Models
# 
# This component is part of the PH-Tools toolkit <https://github.com/PH-Tools>.
# 
# Copyright (c) 2025, PH-Tools and bldgtyp, llc <phtools@bldgtyp.com> 
# Honeybee-PH is free software; you can redistribute it and/or modify 
# it under the terms of the GNU General Public License as published 
# by the Free Software Foundation; either version 3 of the License, 
# or (at your option) any later version. 
# 
# Honeybee-PH is distributed in the hope that it will be useful,
# but WITHOUT ANY WARRANTY; without even the implied warranty of 
# MERCHANTABILITY or FITNESS FOR A PARTICULAR PURPOSE. See the 
# GNU General Public License for more details.
# 
# For a copy of the GNU General Public License
# see <https://github.com/PH-Tools/honeybee_ph/blob/main/LICENSE>.
# 
# @license GPL-3.0+ <http://spdx.org/licenses/GPL-3.0+>
#
"""
Calculate an envelope infiltration rate (m3/s-m2) base on a specified ACH (Air Change Rate) value. This
is typical for PHI Passive House projects which use an ACH limiting value for Certification. Note that
this component will use the NET interior volume of the Spaces, so ensure that all of your Honeybee-Rooms
have Spaces added BEFORE using this component. The exterior envelope area will include all faces exposed
to the Ouotdoor air, or Ground, but not faces expose to Adiabatic or Surface conditions.
-
EM December 16, 2025
    Args:
        _ach_at_50Pa: The Air Change Rate (ACH) at 50Pa. Typical Values:
- PHI New Construction: 0.6 ACH@50Pa
- PHI EnerPHit: 1.0 ACH@50Pa
- PHI Low Energy Building: 1.0 ACH@50PA

        _hb_rooms: The Honeybee-Rooms to use as the reference volume and envelope area.
    
    Returns:
        infilt_per_exterior_at_4Pa_: The envelope air infiltration rate (m3/s-m2)
            ---
            This value can be passed directly into the Honeybee 'Apply Load Values' component 
            as the 'infilt_per_area' value. Note that this value is calculated at 4Pa of pressure, 
            which is an approximate for the 'resting' normal pressure difference.

        infilt_per_exterior_at_50Pa_: The envelope air infiltration rate (m3/s-m2)
            --- 
            This value can be  passed into the Honeybee 'Blower Pressure Converter' in order 
            to determine the infiltration rate at a specific resting pressure. Note that this 
            value should NOT be passed directly into the Honeybee 'Apply Load Values' component as 
            the 'infilt_per_area'. For this, use the 'infilt_per_exterior_at_4Pa_' value instead.
"""


import scriptcontext as sc
import Rhino as rh
import rhinoscriptsyntax as rs
import ghpythonlib.components as ghc
import Grasshopper as gh

from ph_gh_component_io import gh_io
from honeybee_ph_plus_rhino import gh_compo_io

# ------------------------------------------------------------------------------
import honeybee_ph_plus_rhino._component_info_
reload(honeybee_ph_plus_rhino._component_info_)
ghenv.Component.Name = "HBPH+ - Infiltration from ACH"
DEV = honeybee_ph_plus_rhino._component_info_.set_component_params(ghenv, dev=False)
if DEV:
    reload(gh_io)
    from honeybee_ph_plus_rhino.gh_compo_io.hb_tools import infiltration_from_ach as gh_compo_io
    reload(gh_compo_io)

# ------------------------------------------------------------------------------
# -- GH Interface
IGH = gh_io.IGH( ghdoc, ghenv, sc, rh, rs, ghc, gh )


#-------------------------------------------------------------------------------
gh_compo_interface = gh_compo_io.GHCompo_CalculateInfiltrationFromACH(
        IGH,
        _ach_at_50Pa,
        _hb_rooms,
    )
infilt_per_exterior_at_4Pa_, infilt_per_exterior_at_50Pa_ = gh_compo_interface.run()
# ---------- end infiltration_from_ach ----------
hbph_unit_converter = HBPHUnitConverter(in="0.08 CFM/FT2 as M3/S-M2")  # -> out
# ---------- hbph_unit_converter: Python ----------
#
# Honeybee-PH: A Plugin for adding Passive-House data to LadybugTools Honeybee-Energy Models
# 
# This component is part of the PH-Tools toolkit <https://github.com/PH-Tools>.
# 
# Copyright (c) 2022, PH-Tools and bldgtyp, llc <phtools@bldgtyp.com> 
# Honeybee-PH is free software; you can redistribute it and/or modify 
# it under the terms of the GNU General Public License as published 
# by the Free Software Foundation; either version 3 of the License, 
# or (at your option) any later version. 
# 
# Honeybee-PH is distributed in the hope that it will be useful,
# but WITHOUT ANY WARRANTY; without even the implied warranty of 
# MERCHANTABILITY or FITNESS FOR A PARTICULAR PURPOSE. See the 
# GNU General Public License for more details.
# 
# For a copy of the GNU General Public License
# see <https://github.com/PH-Tools/honeybee_ph/blob/main/LICENSE>.
# 
# @license GPL-3.0+ <http://spdx.org/licenses/GPL-3.0+>
#
"""
Convert any arbitrary unit. To use, input the value, starting-unit and 'target-unit' as a 
string such as: 
    - '23.4 M to INCHES'
    - '14.5 W/M2K as HR-FT2-F/BTU'

us the 'as' or 'to' key word to deliniate the starting unit from the target-unit. To see a 
listing of all valid unit-types, check the 'out_' node before proceeding.
-
EM January 6, 2025
    Args:
        _in: (str) The path (or paths) to the Flixo .csv files you would like 
            to import as Honeybee-Energy Materials.
            
    Returns:
        out_: The new Honeybee-Energy materials which were created from the 
            Flixo .csv files.
"""

import scriptcontext as sc
import Rhino as rh
import rhinoscriptsyntax as rs
import ghpythonlib.components as ghc
import Grasshopper as gh

from honeybee_ph_rhino import gh_io
from honeybee_ph_plus_rhino import gh_compo_io

# ------------------------------------------------------------------------------
import honeybee_ph_plus_rhino._component_info_
reload(honeybee_ph_plus_rhino._component_info_)
ghenv.Component.Name = "HBPH+ - Unit Converter"
DEV = honeybee_ph_plus_rhino._component_info_.set_component_params(ghenv, dev=False)
if DEV:
    from ph_units import converter
    reload(converter)
    from honeybee_ph_plus_rhino.gh_compo_io.hb_tools import convert_unit as gh_compo_io
    reload(gh_compo_io)

# ------------------------------------------------------------------------------
# -- GH Interface
IGH = gh_io.IGH( ghdoc, ghenv, sc, rh, rs, ghc, gh )

# ------------------------------------------------------------------------------
gh_compo_interface = gh_compo_io.GHCompo_ConvertValueToUnit(
    IGH,
    _in
)
out_ = gh_compo_interface.run()
# ---------- end hbph_unit_converter ----------
blowerpressure = HBBlowerPressureConverter(infilt_per_exterior=hbph_unit_converter, blower_pressure="50", bldg_pressure="4")  # -> infilt, C_qa; plug-in component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
applyloadvals = HBApplyLoadValues(room_or_program=flatten(add_thermal_bridges.hb_rooms), infilt_per_exterior=blowerpressure.infilt)  # -> out, mod_obj; plug-in component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

genes = GenePool(
    Decimals=2,
    Maximum=25,
    Minimum=0,
    Value=[0, 3.3325, 8.3325, 16.4575, 17.9175, 20.625, 17.695, 13.2075, 9.78, 6.485, 5.06, 3.615])
genes_2 = GenePool(Decimals=2, Maximum=20, Minimum=0, Value=[0, 2.666, 6.666, 7.958, 5.132, 6.952, 4.954, 4.142, 1.054, 1.542, 1.618, 4.28])
genes_3 = GenePool(
    Decimals=2,
    Maximum=30,
    Minimum=0,
    Value=[0, 3.999, 9.999, 19.749, 21.501, 24.75, 21.234, 15.849, 11.736, 7.782, 6.072, 4.338])
genes_4 = GenePool(Decimals=2, Maximum=200, Minimum=0, Value=[0, 26.66, 66.66, 131.66, 149.97, 165, 200, 145.61, 104.03, 74.32, 42.05, 0])
panel_27 = Panel("""test_peak_heat_1
test_peak_heat_2
test_peak_cooling_1
test_peak_cooling_2""")
ph_peak_load = HBPHPHClimatePeakLoad(display_name=graft(panel_27))  # -> out, peak_load
# ---------- ph_peak_load: Python ----------
#
# Honeybee-PH: A Plugin for adding Passive-House data to LadybugTools Honeybee-Energy Models
# 
# This component is part of the PH-Tools toolkit <https://github.com/PH-Tools>.
# 
# Copyright (c) 2022, PH-Tools and bldgtyp, llc <phtools@bldgtyp.com> 
# Honeybee-PH is free software; you can redistribute it and/or modify 
# it under the terms of the GNU General Public License as published 
# by the Free Software Foundation; either version 3 of the License, 
# or (at your option) any later version. 
# 
# Honeybee-PH is distributed in the hope that it will be useful,
# but WITHOUT ANY WARRANTY; without even the implied warranty of 
# MERCHANTABILITY or FITNESS FOR A PARTICULAR PURPOSE. See the 
# GNU General Public License for more details.
# 
# For a copy of the GNU General Public License
# see <https://github.com/PH-Tools/honeybee_ph/blob/main/LICENSE>.
# 
# @license GPL-3.0+ <http://spdx.org/licenses/GPL-3.0+>
#
"""

Input for PH-Style 'Peak-Load' case. For PH Certification, two peak-load cases are evaluated for 
heating, and 2 for cooling. These cases represent daily average values and take into account both 
air-temp as well as solar radiation. This data will be used to configure the 'Climate' inputs in 
the Passive House models. Information on climate data can be found at:
-
    - PHI: https://passipedia.org/planning/climate_data_tool
    - PHIUS: https://www.phius.org/climate-data
-
Note also that this component will *NOT* reset any of the Honeybee EnergyPlus climate, and you will need to set
that separately using a normal EPW file with hourly data.
-
EM October 2, 2022
    Args:
        _display_name: (str) Optional display-name
        
        _temp: (float) An air-temp value (deg-C) value for the peak-load case. If 
            none is input, values will be set to 0.
            
        _rad_north: (float) A NORTH Radiation value (kWh/m2) value for the peak-load case. If 
            none is input, values will be set to 0.     
        
        _rad_east: (float) An EAST Radiation value (kWh/m2) value for the peak-load case. If 
            none is input, values will be set to 0.     
        
        _rad_south: (float) A SOUTH Radiation value (kWh/m2) value for the peak-load case. If 
            none is input, values will be set to 0.     
        
        _rad_west: (float) A WEST Radiation value (kWh/m2) value for the peak-load case. If 
            none is input, values will be set to 0.     
        
        _rad_global: (float) A GLOBAL Radiation value (kWh/m2) value for the peak-load case. If 
            none is input, values will be set to 0.     
                     
        _dewpoint_temp_: (float) A dewpoint temperature value (deg-C) value for the peak-load case. If 
            none is input, values will be set to None.  
        
        _ground_temp_: (float) A ground temperature value (deg-C) value for the peak-load case. If 
            none is input, values will be set to None.    
            
        _sky_temp_: (float) A sky temperature value (deg-C) value for the peak-load case. If 
            none is input, values will be set to None.    
                   
    Returns:
        peak_load_: A new HBPH Peak-Load object which can be passed to an "HBPH - PH Climate Data"
            component.
"""

import scriptcontext as sc
import Rhino as rh
import rhinoscriptsyntax as rs
import ghpythonlib.components as ghc
import Grasshopper as gh


try:
    from honeybee_ph_utils import preview
except ImportError as e:
    raise ImportError('\nFailed to import honeybee_ph_utils:\n\t{}'.format(e))

try:
    from honeybee_ph_rhino import gh_compo_io, gh_io
except ImportError as e:
    raise ImportError('\nFailed to import honeybee_ph_rhino:\n\t{}'.format(e))

# -------------------------------------------------------------------------------------
import honeybee_ph_rhino._component_info_
reload(honeybee_ph_rhino._component_info_)
ghenv.Component.Name = "HBPH - PH Climate Peak Load"
DEV = honeybee_ph_rhino._component_info_.set_component_params(ghenv, dev=False)
if DEV:
    reload(gh_compo_io)
    reload(gh_io)
    

# ------------------------------------------------------------------------------
# -- GH Interface
IGH = gh_io.IGH( ghdoc, ghenv, sc, rh, rs, ghc, gh )


# -------------------------------------------------------------------------------------
gh_compo_interface = gh_compo_io.GHCompo_CreatePeakLoad(
        IGH,
        _display_name,
        _temp,
        _rad_north,
        _rad_east,
        _rad_south,
        _rad_west,
        _rad_global,
        _dewpoint_temp_,
        _ground_temp_,
        _sky_temp_,
    )

peak_load_ = gh_compo_interface.run()

# -------------------------------------------------------------------------------------
preview.object_preview(peak_load_)
# ---------- end ph_peak_load ----------
ph_monthly_radiation = HBPHPHClimateMonthlyRadiation(north=genes_4, east=genes_4, west=genes_4, global=genes_4)  # -> out, monthly_radiation; inputs north: list, east: list, south: list, west: list, global: list
# ---------- ph_monthly_radiation: Python ----------
#
# Honeybee-PH: A Plugin for adding Passive-House data to LadybugTools Honeybee-Energy Models
# 
# This component is part of the PH-Tools toolkit <https://github.com/PH-Tools>.
# 
# Copyright (c) 2022, PH-Tools and bldgtyp, llc <phtools@bldgtyp.com> 
# Honeybee-PH is free software; you can redistribute it and/or modify 
# it under the terms of the GNU General Public License as published 
# by the Free Software Foundation; either version 3 of the License, 
# or (at your option) any later version. 
# 
# Honeybee-PH is distributed in the hope that it will be useful,
# but WITHOUT ANY WARRANTY; without even the implied warranty of 
# MERCHANTABILITY or FITNESS FOR A PARTICULAR PURPOSE. See the 
# GNU General Public License for more details.
# 
# For a copy of the GNU General Public License
# see <https://github.com/PH-Tools/honeybee_ph/blob/main/LICENSE>.
# 
# @license GPL-3.0+ <http://spdx.org/licenses/GPL-3.0+>
#
"""
Input PH-Style monthly average solar radiation values (kWh/m2) for the different orientations. This data 
will be used to configure the 'Climate' inputs in the Passive House models. Note that this data should
represent monthly average values. Information on climate data can be found at:
-
    - PHI: https://passipedia.org/planning/climate_data_tool
    - PHIUS: https://www.phius.org/climate-data
-
Note also that this component will *NOT* reset any of the Honeybee EnergyPlus climate, and you will need to set
that separately using a normal EPW file with hourly data.
-
EM October 2, 2022
    Args:
        _north_: (List[float]) A list of 12 monthly average radiation (kWh/m2) values for the NORTH. If 
            none are input, all values will be set to 0.

        _east_: (List[float]) A list of 12 monthly average radiation (kWh/m2) values for the EAST. If 
            none are input, all values will be set to 0.

        _south_: (List[float]) A list of 12 monthly average radiation (kWh/m2) values for the SOUTH. If 
            none are input, all values will be set to 0.

        _west_: (List[float]) A list of 12 monthly average radiation (kWh/m2) values for the WEST. If 
            none are input, all values will be set to 0.

        _global_: (List[float]) A list of 12 monthly average radiation (kWh/m2) values for the GLOBAL (Horiz.). If 
            none are input, all values will be set to 0.

    Returns:
        monthly_radiation_: A new HBPH Monthly-Radiation object which can be passed to an "HBPH - PH Climate Data"
            component.
"""

import scriptcontext as sc
import Rhino as rh
import rhinoscriptsyntax as rs
import ghpythonlib.components as ghc
import Grasshopper as gh


try:
    from honeybee_ph_utils import preview
except ImportError as e:
    raise ImportError('\nFailed to import honeybee_ph_utils:\n\t{}'.format(e))

try:
    from honeybee_ph_rhino import gh_compo_io, gh_io
except ImportError as e:
    raise ImportError('\nFailed to import honeybee_ph_rhino:\n\t{}'.format(e))
    
# -------------------------------------------------------------------------------------
import honeybee_ph_rhino._component_info_
reload(honeybee_ph_rhino._component_info_)
ghenv.Component.Name = "HBPH - PH Climate Monthly Radiation"
DEV = honeybee_ph_rhino._component_info_.set_component_params(ghenv, dev=False)
if DEV:
    reload(gh_compo_io)
    reload(gh_io)
    

# ------------------------------------------------------------------------------
# -- GH Interface
IGH = gh_io.IGH( ghdoc, ghenv, sc, rh, rs, ghc, gh )


# -------------------------------------------------------------------------------------
gh_compo_interface = gh_compo_io.GHCompo_CreateMonthlyRadiation(
        IGH,
        _north_,
        _east_,
        _south_,
        _west_,
        _global_,
    )

monthly_radiation_ = gh_compo_interface.run()


# -------------------------------------------------------------------------------------
preview.object_preview(monthly_radiation_)
# ---------- end ph_monthly_radiation ----------
ph_monthly_temps = HBPHPHClimateMonthlyTemps(air_temps=genes_3, dewpoints=genes_2, sky_temps=genes)  # -> out, monthly_temps; inputs air_temps: list, dewpoints: list, sky_temps: list, ground_temps: list
# ---------- ph_monthly_temps: Python ----------
#
# Honeybee-PH: A Plugin for adding Passive-House data to LadybugTools Honeybee-Energy Models
# 
# This component is part of the PH-Tools toolkit <https://github.com/PH-Tools>.
# 
# Copyright (c) 2022, PH-Tools and bldgtyp, llc <phtools@bldgtyp.com> 
# Honeybee-PH is free software; you can redistribute it and/or modify 
# it under the terms of the GNU General Public License as published 
# by the Free Software Foundation; either version 3 of the License, 
# or (at your option) any later version. 
# 
# Honeybee-PH is distributed in the hope that it will be useful,
# but WITHOUT ANY WARRANTY; without even the implied warranty of 
# MERCHANTABILITY or FITNESS FOR A PARTICULAR PURPOSE. See the 
# GNU General Public License for more details.
# 
# For a copy of the GNU General Public License
# see <https://github.com/PH-Tools/honeybee_ph/blob/main/LICENSE>.
# 
# @license GPL-3.0+ <http://spdx.org/licenses/GPL-3.0+>
#
"""
Input PH-Style monthly average temperature values for the air, dewpoint, sky and ground. This data 
will be used to configure the 'Climate' inputs in the Passive House models. Note that this data should
represent monthly average values. Information on climate data can be found at:
-
    - PHI: https://passipedia.org/planning/climate_data_tool
    - PHIUS: https://www.phius.org/climate-data
-
Note also that this component will *NOT* reset any of the Honeybee EnergyPlus climate, and you will need to set
that separately using a normal EPW file with hourly data.
-
EM October 2, 2022
    Args:
        _air_temps_: (List[float]) A list of 12 monthly air temperature values (deg. C). If none are 
            input, all values will be set to 0
        
        _dewpoints_: (List[float]) A list of 12 monthly dewpoint temperature values (deg. C). If none are 
            input, all values will be set to 0
            
        _sky_temps_: (List[float]) A list of 12 monthly sky temperature values (deg. C). If none are 
            input, all values will be set to 0
        
        _ground_temps_: (List[float]) A list of 12 monthly ground temperature values (deg. C). If none are 
            input, all values will be set to 0

    Returns:
        monthly_temps_: A new HBPH Monthly-Temps object which can be passed to an "HBPH - PH Climate Data"
            component.
"""

import scriptcontext as sc
import Rhino as rh
import rhinoscriptsyntax as rs
import ghpythonlib.components as ghc
import Grasshopper as gh


try:
    from honeybee_ph_utils import preview
except ImportError as e:
    raise ImportError('\nFailed to import honeybee_ph_utils:\n\t{}'.format(e))

try:
    from honeybee_ph_rhino import gh_compo_io, gh_io
except ImportError as e:
    raise ImportError('\nFailed to import honeybee_ph_rhino:\n\t{}'.format(e))

#-------------------------------------------------------------------------------
import honeybee_ph_rhino._component_info_
reload(honeybee_ph_rhino._component_info_)
ghenv.Component.Name = "HBPH - PH Climate Monthly Temps"
DEV = honeybee_ph_rhino._component_info_.set_component_params(ghenv, dev=False)
if DEV:
    reload(gh_compo_io)
    reload(gh_io)


# ------------------------------------------------------------------------------
# -- GH Interface
IGH = gh_io.IGH( ghdoc, ghenv, sc, rh, rs, ghc, gh )


# -------------------------------------------------------------------------------------
gh_compo_interface = gh_compo_io.GHCompo_MonthlyTemps(
        IGH,
        _air_temps_,
        _dewpoints_,
        _sky_temps_,
        _ground_temps_,
    )

monthly_temps_ = gh_compo_interface.run()


# -------------------------------------------------------------------------------------
preview.object_preview(monthly_temps_)
# ---------- end ph_monthly_temps ----------
bang = ExplodeTree(Data=ph_peak_load.peak_load)  # -> Branch0, Branch1, Branch2, Branch3
ph_climate_data = HBPHPHClimateData(
    display_name="My_Test_Climate",
    daily_temp_swing="10",
    monthly_temps=ph_monthly_temps.monthly_temps,
    monthly_radiation=ph_monthly_radiation.monthly_radiation,
    peak_heat_load_1=bang.Branch0,
    peak_heat_load_2=bang.Branch1,
    peak_cooling_load_1=bang.Branch2,
    peak_cooling_load_2=bang.Branch3)  # -> out, climate_data
# ---------- ph_climate_data: Python ----------
#
# Honeybee-PH: A Plugin for adding Passive-House data to LadybugTools Honeybee-Energy Models
# 
# This component is part of the PH-Tools toolkit <https://github.com/PH-Tools>.
# 
# Copyright (c) 2022, PH-Tools and bldgtyp, llc <phtools@bldgtyp.com> 
# Honeybee-PH is free software; you can redistribute it and/or modify 
# it under the terms of the GNU General Public License as published 
# by the Free Software Foundation; either version 3 of the License, 
# or (at your option) any later version. 
# 
# Honeybee-PH is distributed in the hope that it will be useful,
# but WITHOUT ANY WARRANTY; without even the implied warranty of 
# MERCHANTABILITY or FITNESS FOR A PARTICULAR PURPOSE. See the 
# GNU General Public License for more details.
# 
# For a copy of the GNU General Public License
# see <https://github.com/PH-Tools/honeybee_ph/blob/main/LICENSE>.
# 
# @license GPL-3.0+ <http://spdx.org/licenses/GPL-3.0+>
#
"""
Set the detailed monthly and peak-load climate data to use for the Passive House models.
- 
    - PHI: https://passipedia.org/planning/climate_data_tool
    - PHIUS: https://www.phius.org/climate-data
-
Note also that this component will *NOT* reset any of the Honeybee EnergyPlus climate, and you will need to set
that separately using a normal EPW file with hourly data.
-
Note: if you would like to use one of the pre-loaded PHPP climate data sets instead of providing detailed
info here (for PHPP only) you can use the "HBPH - PH PHPP Climate" component to simply specify the dataset to load.
-
EM October 2, 2022
    Args:
        _display_name_: (str) Optional name for the climate data set.
        
        _station_elevation_: (m) default = 5.0 The elevation of the weather station the data
            is coming from is located.
        
        _daily_temp_swing_: (deg K) default = 8.0K The summer average dailty temperature swing.
        
        _avg_wind_speed_: (m/s) default = 4.0 m/s The summer average wind speed.
        
        _monthly_temps_: Connect a 'HBPH - PH Climate Monthly Temps' component to set the climate data.
            If none is input, all Zero values will be set as the default.
            
        _monthly_radiation_: Connect a 'HBPH - PH Climate Monthly Radiation' component to set the climate data.
            If none is input, all Zero values will be set as the default.
            
        _peak_heat_load_1_: (HBPH_Climate_PeakLoadValueSet) Connect a "HBPH - PH Climate Peak Load"
            component to set the data for the peak heat load 1 case.
        
        _peak_heat_load_2_: (HBPH_Climate_PeakLoadValueSet) Connect a "HBPH - PH Climate Peak Load"
            component to set the data for the peak heat load 2 case.   
            
        _peak_cooling_load_1_: (HBPH_Climate_PeakLoadValueSet) Connect a "HBPH - PH Climate Peak Load"
            component to set the data for the peak cooling load 1 case.
        
        _peak_cooling_load_2_: (HBPH_Climate_PeakLoadValueSet) Connect a "HBPH - PH Climate Peak Load"
            component to set the data for the peak cooling load 2 case.        
            
    Returns:
        climate_data_: A new HBPH Climate Data object that can passed along to an "HBPH - PH Site" component.
"""

import scriptcontext as sc
import Rhino as rh
import rhinoscriptsyntax as rs
import ghpythonlib.components as ghc
import Grasshopper as gh


try:
    from honeybee_ph_utils import preview
except ImportError as e:
    raise ImportError('\nFailed to import honeybee_ph_utils:\n\t{}'.format(e))

try:
    from honeybee_ph_rhino import gh_compo_io, gh_io
except ImportError as e:
    raise ImportError('\nFailed to import honeybee_ph_rhino:\n\t{}'.format(e))

# -------------------------------------------------------------------------------------
import honeybee_ph_rhino._component_info_
reload(honeybee_ph_rhino._component_info_)
ghenv.Component.Name = "HBPH - PH Climate Data"
DEV = honeybee_ph_rhino._component_info_.set_component_params(ghenv, dev=False)
if DEV:
    reload(gh_compo_io)
    reload(gh_io)


# ------------------------------------------------------------------------------
# -- GH Interface
IGH = gh_io.IGH( ghdoc, ghenv, sc, rh, rs, ghc, gh )

    
# -------------------------------------------------------------------------------------
gh_compo_interface = gh_compo_io.GHCompo_ClimateData(
        IGH,
        _display_name_,
        _station_elevation_,
        _daily_temp_swing_,
        _avg_wind_speed_,
        _monthly_temps_,
        _monthly_radiation_,
        _peak_heat_load_1_,
        _peak_heat_load_2_,
        _peak_cooling_load_1_,
        _peak_cooling_load_2_,
)
climate_data_ = gh_compo_interface.run()


# -------------------------------------------------------------------------------------
preview.object_preview(climate_data_)
# ---------- end ph_climate_data ----------
ph_phpp_climate = HBPHPHPHPPClimate()  # -> out, phpp_climate
# ---------- ph_phpp_climate: Python ----------
#
# Honeybee-PH: A Plugin for adding Passive-House data to LadybugTools Honeybee-Energy Models
# 
# This component is part of the PH-Tools toolkit <https://github.com/PH-Tools>.
# 
# Copyright (c) 2022, PH-Tools and bldgtyp, llc <phtools@bldgtyp.com> 
# Honeybee-PH is free software; you can redistribute it and/or modify 
# it under the terms of the GNU General Public License as published 
# by the Free Software Foundation; either version 3 of the License, 
# or (at your option) any later version. 
# 
# Honeybee-PH is distributed in the hope that it will be useful,
# but WITHOUT ANY WARRANTY; without even the implied warranty of 
# MERCHANTABILITY or FITNESS FOR A PARTICULAR PURPOSE. See the 
# GNU General Public License for more details.
# 
# For a copy of the GNU General Public License
# see <https://github.com/PH-Tools/honeybee_ph/blob/main/LICENSE>.
# 
# @license GPL-3.0+ <http://spdx.org/licenses/GPL-3.0+>
#
"""
Set the PHPP Climate Data set to use from the PHPP pre-loaded libraries. This component 
will only affect the PHPP, not WUFI-Passive.
-
Note: be sure that the inputs match the text in the  PHPP library exactly. The easiest 
way to do that is to just open the PHPP, find the dataset you would like to use, and 
copy/past the text into a GH Panel.
-
EM October 2, 2022
    Args:
        _country_code: (str) default = "US-United States of America" Optional country-code
            that matches the PHPP datasets. Note: be sure that the input matches the text in the 
            PHPP library exactly. The easiest way to do that is to just open the PHPP, find the 
            dataset you would like to use, and copy/past the text into a GH Panel.
        
        _region_code: (str) default = "New York" Optional region/state-code
            that matches the PHPP datasets. Note: be sure that the input matches the text in the 
            PHPP library exactly. The easiest way to do that is to just open the PHPP, find the 
            dataset you would like to use, and copy/past the text into a GH Panel.
        
        _dataset_name: (str) default = "US0055b-New York" Optional metro / dataset -code
            that matches the PHPP datasets. Note: be sure that the input matches the text in the 
            PHPP library exactly. The easiest way to do that is to just open the PHPP, find the 
            dataset you would like to use, and copy/past the text into a GH Panel.

    Returns:
        phpp_climate_: A new HBPH PHPP Code object that can passed along to an "HBPH - Site" component.
"""

import scriptcontext as sc
import Rhino as rh
import rhinoscriptsyntax as rs
import ghpythonlib.components as ghc
import Grasshopper as gh


try:
    from honeybee_ph_utils import preview
except ImportError as e:
    raise ImportError('\nFailed to import honeybee_ph_utils:\n\t{}'.format(e))

try:
    from honeybee_ph_rhino import gh_compo_io, gh_io
except ImportError as e:
    raise ImportError('\nFailed to import honeybee_ph_rhino:\n\t{}'.format(e))

# -------------------------------------------------------------------------------------
import honeybee_ph_rhino._component_info_
reload(honeybee_ph_rhino._component_info_)
ghenv.Component.Name = "HBPH - PH PHPP Climate"
DEV = honeybee_ph_rhino._component_info_.set_component_params(ghenv, dev=False)
if DEV:
    reload(gh_compo_io)
    reload(gh_io)

# ------------------------------------------------------------------------------
# -- GH Interface
IGH = gh_io.IGH( ghdoc, ghenv, sc, rh, rs, ghc, gh )
    
    
# -------------------------------------------------------------------------------------
gh_compo_interface = gh_compo_io.GHCompo_PHPPCodes(
                IGH,
                _country_code,
                _region_code,
                _dataset_name,
            )

phpp_climate_ = gh_compo_interface.run()

# -------------------------------------------------------------------------------------
preview.object_preview(phpp_climate_)
# ---------- end ph_phpp_climate ----------
ph_location = HBPHPHLocation()  # -> out, location
# ---------- ph_location: Python ----------
#
# Honeybee-PH: A Plugin for adding Passive-House data to LadybugTools Honeybee-Energy Models
# 
# This component is part of the PH-Tools toolkit <https://github.com/PH-Tools>.
# 
# Copyright (c) 2022, PH-Tools and bldgtyp, llc <phtools@bldgtyp.com> 
# Honeybee-PH is free software; you can redistribute it and/or modify 
# it under the terms of the GNU General Public License as published 
# by the Free Software Foundation; either version 3 of the License, 
# or (at your option) any later version. 
# 
# Honeybee-PH is distributed in the hope that it will be useful,
# but WITHOUT ANY WARRANTY; without even the implied warranty of 
# MERCHANTABILITY or FITNESS FOR A PARTICULAR PURPOSE. See the 
# GNU General Public License for more details.
# 
# For a copy of the GNU General Public License
# see <https://github.com/PH-Tools/honeybee_ph/blob/main/LICENSE>.
# 
# @license GPL-3.0+ <http://spdx.org/licenses/GPL-3.0+>
#
"""
Set the geographic location data for the Passive House model. Note: if none is supplied, the default
values for NYC, USA will be used.
-
Note also that this component will *NOT* reset any of the Honeybee EnergyPlus climate, and you will need to set
that separately using a normal EPW file with hourly data.
-
EM October 2, 2022
    Args:
        _latitude: (deg) default = 40.6 (NYC)
        
        _longitude: (deg) default = -73.8 (NYC)
        
        _site_elevation: (m) default = None. If None, the weather-station elevation will be 
            used as the site-elevation.
            
        _climate_zone: (int) For WUFI-Passive.
        
        _hours_from_UTC: (hours) For WUFI-Passive.

    Returns:
        location_: A new HBPH Location object which can be passed to an "HBPH - PH Site"
            component.
"""

import scriptcontext as sc
import Rhino as rh
import rhinoscriptsyntax as rs
import ghpythonlib.components as ghc
import Grasshopper as gh


try:
    from honeybee_ph_utils import preview
except ImportError as e:
    raise ImportError('\nFailed to import honeybee_ph_utils:\n\t{}'.format(e))

try:
    from honeybee_ph_rhino import gh_compo_io, gh_io
except ImportError as e:
    raise ImportError('\nFailed to import honeybee_ph_rhino:\n\t{}'.format(e))

# -------------------------------------------------------------------------------------
import honeybee_ph_rhino._component_info_
reload(honeybee_ph_rhino._component_info_)
ghenv.Component.Name = "HBPH - PH Location"
DEV = honeybee_ph_rhino._component_info_.set_component_params(ghenv, dev=False)
if DEV:
    reload(gh_compo_io)
    reload(gh_io)


# ------------------------------------------------------------------------------
# -- GH Interface
IGH = gh_io.IGH( ghdoc, ghenv, sc, rh, rs, ghc, gh )

    
# -------------------------------------------------------------------------------------
# -- Create the new Location Object
gh_compo_interface = gh_compo_io.GHCompo_Location(
        IGH,
        _display_name,
        _latitude,
        _longitude,
        _site_elevation,
        _climate_zone,
        _hours_from_UTC,
    )

location_ = gh_compo_interface.run()

# -------------------------------------------------------------------------------------
preview.object_preview(location_)
# ---------- end ph_location ----------
phi_cert = HBPHPHICertification(certification_type=list, certification_class=list_5, primary_energy_type=list_4, enerphit_type=list_2, retrofit=list_3)  # -> out, phi_certification; inputs phpp_version: Int32
#   port building_category_type: (str) Input either - 1-Residential building (default) 2-Non-residential building
#   port building_use_type: (str) Input either - 10-Dwelling (default) 11-Nursing home / students 12-Other 20-Office / Admin. building 21-School 22-Other
#   port ihg_type: (str) Input either - 2-Standard (default) 3-PHPP calculation ('IHG' worksheet) 4-PHPP calculation ('IHG non-res' worksheet)
#   port occupancy_type: (str) Input either - 1-Standard (only for residential buildings) 2-User determined
#   port certification_type: (str) Input either - 1-Passive House (default) 2-EnerPHit 3-PHI Low Energy Building 4-Other
#   port certification_class: (str) Input either - 1-Classic (default) 2-Plus 3-Premium
#   port primary_energy_type: (str) Input either - 1-PE (non-renewable) 2-PER (renewable) (default)
#   port enerphit_type: (str) Input either - 1-Component method 2-Energy demand method (default)
#   port retrofit: (str) Input either - 1-New building (default) 2-Retrofit 3-Step-by-step retrofit
#   port tfa_override: Optional user-override of TFA input.
# ---------- phi_cert: Python ----------
#
# Honeybee-PH: A Plugin for adding Passive-House data to LadybugTools Honeybee-Energy Models
# 
# This component is part of the PH-Tools toolkit <https://github.com/PH-Tools>.
# 
# Copyright (c) 2022, PH-Tools and bldgtyp, llc <phtools@bldgtyp.com> 
# Honeybee-PH is free software; you can redistribute it and/or modify 
# it under the terms of the GNU General Public License as published 
# by the Free Software Foundation; either version 3 of the License, 
# or (at your option) any later version. 
# 
# Honeybee-PH is distributed in the hope that it will be useful,
# but WITHOUT ANY WARRANTY; without even the implied warranty of 
# MERCHANTABILITY or FITNESS FOR A PARTICULAR PURPOSE. See the 
# GNU General Public License for more details.
# 
# For a copy of the GNU General Public License
# see <https://github.com/PH-Tools/honeybee_ph/blob/main/LICENSE>.
# 
# @license GPL-3.0+ <http://spdx.org/licenses/GPL-3.0+>
#
"""
Enter the relevant PHI PHPP configuration settings. Note that PHPP-9 and PHPP-10 
use different options, so enter the correct info for the version you will be 
writing your data to.
-
EM April 22, 2024
    Args:
        _phpp_version: Enter either "9" or "10" to configure the inputs for the
            PHPP version you will be writing to.
        
    Returns:
        phi_certification_: A new PHI Certifiction config object which can 
            be added to a "Building Segment" to control the PHPP settings.
"""

import scriptcontext as sc
import Rhino as rh
import rhinoscriptsyntax as rs
import ghpythonlib.components as ghc
import Grasshopper as gh

from honeybee_ph_rhino import gh_compo_io, gh_io
from honeybee_ph_utils import preview

#-------------------------------------------------------------------------------
import honeybee_ph_rhino._component_info_
reload(honeybee_ph_rhino._component_info_)
ghenv.Component.Name = "HBPH - PHI Certification"
DEV = honeybee_ph_rhino._component_info_.set_component_params(ghenv, dev=False)

# ------------------------------------------------------------------------------
# -- GH Interface
IGH = gh_io.IGH( ghdoc, ghenv, sc, rh, rs, ghc, gh )


#-------------------------------------------------------------------------------
# -- Setup the input nodes, get all the user input values
input_dict = gh_compo_io.cert.Phi.get_component_inputs(_phpp_version)
gh_io.setup_component_inputs(IGH, input_dict)
input_values_dict = gh_io.get_component_input_values(ghenv)


#-------------------------------------------------------------------------------
# reload AFTER the component configuration
if DEV:   
    reload(gh_io)
    from honeybee_ph_rhino.gh_compo_io.cert import Phi as gh_compo_io
    reload(gh_compo_io)


#-------------------------------------------------------------------------------
# -- Build the new PHI Settings object
gh_compo_interface = gh_compo_io.GHCompo_PhiCertification(
        IGH,
        _phpp_version,
        input_values_dict,
    )
phi_certification_ = gh_compo_interface.run()


# -------------------------------------------------------------------------------------
preview.object_preview(phi_certification_)
# ---------- end phi_cert ----------
ph_site = HBPHPHSite(location=ph_location.location, climate_data=ph_climate_data.climate_data, phpp_climate=ph_phpp_climate.phpp_climate)  # -> out, site
# ---------- ph_site: Python ----------
#
# Honeybee-PH: A Plugin for adding Passive-House data to LadybugTools Honeybee-Energy Models
# 
# This component is part of the PH-Tools toolkit <https://github.com/PH-Tools>.
# 
# Copyright (c) 2022, PH-Tools and bldgtyp, llc <phtools@bldgtyp.com> 
# Honeybee-PH is free software; you can redistribute it and/or modify 
# it under the terms of the GNU General Public License as published 
# by the Free Software Foundation; either version 3 of the License, 
# or (at your option) any later version. 
# 
# Honeybee-PH is distributed in the hope that it will be useful,
# but WITHOUT ANY WARRANTY; without even the implied warranty of 
# MERCHANTABILITY or FITNESS FOR A PARTICULAR PURPOSE. See the 
# GNU General Public License for more details.
# 
# For a copy of the GNU General Public License
# see <https://github.com/PH-Tools/honeybee_ph/blob/main/LICENSE>.
# 
# @license GPL-3.0+ <http://spdx.org/licenses/GPL-3.0+>
#
"""
Set the Site (Climate, location) data for the Passive House model.
For PHI / PHPP, you can also set the optional Country / Region / Data-Set codes 
to use one of the climates pre-loaded into the PHPP.
-
Note also that this component will *NOT* reset any of the Honeybee EnergyPlus climate, and you will need to set
that separately using a normal EPW file with hourly data.
-
EM October 2, 2022
    Args:
        _display_name: (str) Optional display name for the Site.
        
        _location: Optional - detailed geographic location data to use for the project.
        
        _climate_data: Optional - detailed climate data to use for the project.
        
        _phpp_climate: Optional - input a "HBPH - PHPP Climate" object here with 
            the PHPP region, country and dataset codes specfied. This will then set the PHPP
            climate to the input values, allowing you to select a pre-loaded PHPP Climate data set
            as the active climate for your project. Note: this has no effect on WUFI-Passive and is
            only used for PHPP climate data.

    Returns:
        site_: A new HBPH Site object which can be passed along the "Building Segment" and will 
            be used to set location and climate information in the PHPP and WUFI-Passive models.
"""

import scriptcontext as sc
import Rhino as rh
import rhinoscriptsyntax as rs
import ghpythonlib.components as ghc
import Grasshopper as gh


try:
    from honeybee_ph_utils import preview
except ImportError as e:
    raise ImportError('\nFailed to import honeybee_ph_utils:\n\t{}'.format(e))

try:
    from honeybee_ph_rhino import gh_compo_io, gh_io
except ImportError as e:
    raise ImportError('\nFailed to import honeybee_ph_rhino:\n\t{}'.format(e))

# -------------------------------------------------------------------------------------
import honeybee_ph_rhino._component_info_
reload(honeybee_ph_rhino._component_info_)
ghenv.Component.Name = "HBPH - PH Site"
DEV = honeybee_ph_rhino._component_info_.set_component_params(ghenv, dev=False)
if DEV:
    reload(gh_compo_io)
    reload(gh_io)


# ------------------------------------------------------------------------------
# -- GH Interface
IGH = gh_io.IGH( ghdoc, ghenv, sc, rh, rs, ghc, gh )
  

# -------------------------------------------------------------------------------------
gh_compo_interface = gh_compo_io.GHCompo_Site(
        IGH,
        _display_name,
        _location,
        _climate_data,
        _phpp_climate,
)
site_ = gh_compo_interface.run()

# -------------------------------------------------------------------------------------
preview.object_preview(site_)
# ---------- end ph_site ----------
phius_cert = HBPHPhiusCertification()  # -> out, phius_certification
# ---------- phius_cert: Python ----------
#
# Honeybee-PH: A Plugin for adding Passive-House data to LadybugTools Honeybee-Energy Models
# 
# This component is part of the PH-Tools toolkit <https://github.com/PH-Tools>.
# 
# Copyright (c) 2022, PH-Tools and bldgtyp, llc <phtools@bldgtyp.com> 
# Honeybee-PH is free software; you can redistribute it and/or modify 
# it under the terms of the GNU General Public License as published 
# by the Free Software Foundation; either version 3 of the License, 
# or (at your option) any later version. 
# 
# Honeybee-PH is distributed in the hope that it will be useful,
# but WITHOUT ANY WARRANTY; without even the implied warranty of 
# MERCHANTABILITY or FITNESS FOR A PARTICULAR PURPOSE. See the 
# GNU General Public License for more details.
# 
# For a copy of the GNU General Public License
# see <https://github.com/PH-Tools/honeybee_ph/blob/main/LICENSE>.
# 
# @license GPL-3.0+ <http://spdx.org/licenses/GPL-3.0+>
#
"""
Enter the relevant Phius Certification threshold data for the building-segment.
-
EM April 22, 2024
    Args:
        certification_program_: Input either -
            "1-Default"
            "2-PHIUS 2015"
            "3-PHIUS 2018"
            "4-Italian"
            "5-PHIUS 2018 CORE"
            "6-PHIUS 2018 ZERO"
            "7-PHIUS 2021 CORE"
            "8-PHIUS 2021 ZERO"
        
        building_category_type_: Input either -
            "1-Residential building" (default)
            "2-Non-residential building"
        
        building_use_type_: Input either - 
            "1-Residential" (default)
            "4-Office/Administrative building"
            "5-School"
            "6-Other"
            "7-Undefined/unfinished"
        
        building_status_: Input either -
            "1-In planning" (default)
            "2-Under construction"
            "3-Completed"
        
        
        building_type_: Input either -
            "1-New construction" (default)
            "2-Retrofit"
            "3-Mixed - new construction/retrofit"
        
        
        _PHIUS_annual_heating_demand_kWh_m2:
        
        _PHIUS_annual_cooling_demand_kWh_m2:
        
        _PHIUS_peak_heating_load_W_m2:
        
        _PHIUS_peak_cooling_load_W_m2:
        
    Returns:
        certification_: A New Phius Certification Settings object which can be 
            added to the "Building Sectio"
"""

import scriptcontext as sc
import Rhino as rh
import rhinoscriptsyntax as rs
import ghpythonlib.components as ghc
import Grasshopper as gh


try:
    from honeybee_ph_utils import preview
except ImportError as e:
    raise ImportError('\nFailed to import honeybee_ph_utils:\n\t{}'.format(e))

try:
    from honeybee_ph_rhino import gh_compo_io, gh_io
except ImportError as e:
    raise ImportError('\nFailed to import honeybee_ph_rhino:\n\t{}'.format(e))


#-------------------------------------------------------------------------------
import honeybee_ph_rhino._component_info_
reload(honeybee_ph_rhino._component_info_)
ghenv.Component.Name = "HBPH - Phius Certification"
DEV = honeybee_ph_rhino._component_info_.set_component_params(ghenv, dev=False)
if DEV:
    from honeybee_ph_rhino.gh_compo_io.cert import Phius as gh_compo_io
    reload(gh_compo_io)


# ------------------------------------------------------------------------------
# -- GH Interface
IGH = gh_io.IGH( ghdoc, ghenv, sc, rh, rs, ghc, gh )


# -------------------------------------------------------------------------------------
gh_compo_interface = gh_compo_io.GHCompo_PhiusCertification(
        IGH,
        certification_program_,
        building_category_type_,
        building_use_type_,
        building_status_,
        building_type_,
        _PHIUS_annual_heating_demand_kWh_m2,
        _PHIUS_annual_cooling_demand_kWh_m2,
        _PHIUS_peak_heating_load_W_m2,
        _PHIUS_peak_cooling_load_W_m2,
        _icfa_override,
    )

phius_certification_ = gh_compo_interface.run()


# -------------------------------------------------------------------------------------
preview.object_preview(phius_certification_)
# ---------- end phius_cert ----------
ph_bldg_segment = HBPHBldgSegment(
    site=ph_site.site,
    phius_certification=phius_cert.phius_certification,
    phi_certification=phi_cert.phi_certification,
    winter_set_temp="21",
    summer_set_temp="24",
    summer_ventilation=create_summer_ventilation.summer_ventilation,
    hb_rooms=simplify(flatten(applyloadvals.mod_obj)))  # -> out, hb_rooms; inputs num_floor_levels: Int32, num_dwelling_units: Int32, source_energy_factors: list, co2e_factors: list, hb_rooms: list
#   port segment_name: (str) The name to give the new Honeybee Room.
#   port hb_rooms: (list) The Honeybee Rooms that you would like to join into a new single Room.
# ---------- ph_bldg_segment: Python ----------
#
# Honeybee-PH: A Plugin for adding Passive-House data to LadybugTools Honeybee-Energy Models
# 
# This component is part of the PH-Tools toolkit <https://github.com/PH-Tools>.
# 
# Copyright (c) 2022, PH-Tools and bldgtyp, llc <phtools@bldgtyp.com> 
# Honeybee-PH is free software; you can redistribute it and/or modify 
# it under the terms of the GNU General Public License as published 
# by the Free Software Foundation; either version 3 of the License, 
# or (at your option) any later version. 
# 
# Honeybee-PH is distributed in the hope that it will be useful,
# but WITHOUT ANY WARRANTY; without even the implied warranty of 
# MERCHANTABILITY or FITNESS FOR A PARTICULAR PURPOSE. See the 
# GNU General Public License for more details.
# 
# For a copy of the GNU General Public License
# see <https://github.com/PH-Tools/honeybee_ph/blob/main/LICENSE>.
# 
# @license GPL-3.0+ <http://spdx.org/licenses/GPL-3.0+>
#
"""
Use this component to add one or more honeybee-Rooms to a PH-Building-Segment. This 
'building-segment' could be a single floor, a 'wing' or an entire building and will 
map to a single 'Case' in WUFI or a single PHPP file.
-
Since Passive House models only allow for a single thermal zone, any honeybee-rooms 
that are part of the building-segment will be merged / joined when exported to 
WUFI-Passive or PHPP. When merged, only the exterior surfaces will be retained, and 
any faces with a 'Surface' boundary condition well be removed from the Passive House 
model. Only Honeybee Faces with boundary conditions of "Outdoors", "Ground" and 
"Adiabatic" will be included in the new Honeybee Room. 
-
Use this before passing the honeybee-rooms on to the 'HB Model' component.
-
EM April 11, 2026
    Args:
        segment_name_: Name for the building-segment
               
        num_floor_levels_: (int) Total number of floor levels for the group of 
            Honeybee rooms input. Default=1
        
        num_dwelling_units_: (int) Total number of 'units' for the group of Honeybee rooms
            input For residential, this is the total number of dwelling units
            in the group of HB-Room. For non-residential, leave this set to "1".
        
        climate_: Optional Passive House monthly climate data.
        
        source_energy_factors_: (Optional) A list of source energy (site->source) energy 
            factors to use for assessing overall source (primary) energy usage. By default, 
            this component will use the standard Phius 2021 source energy factors which can be 
            found at https://www.phius.org/PHIUS+2021/Phius%20Core_Phius%20Zero_Final%20Modeling%20Protocol%20v1.1.pdf
            -
            Use the "Create Conversion Factor" component to define custom factors if you would 
            like to use your own. Be sure to define all of the fuel-factors required by Phius / WUFI.

        co2e_factors_: (Optional) A list of CO2e (site->CO2e) conversion 
            factors to use for assessing overall GHG emissions. By default, 
            this component will use the standard Phius 2021 CO2e factors which can be 
            found at https://www.phius.org/PHIUS+2021/Phius%20Core_Phius%20Zero_Final%20Modeling%20Protocol%20v1.1.pdf
            -
            Use the "Create Conversion Factor" component to define custom factors if you would 
            like to use your own. Be sure to define all of the fuel-factors required by Phius / WUFI.
        
        phius_certification_: Optional Phius certification thresholds.
        
        phi_certification_: Optional PHI certification configuration and settings.
        
        winter_set_temp_: default = 20C [68F]
        
        summer_set_temp_: default = 25C [77F]
        
        mech_room_temp_: default = 20C [68F] Supply in cases where the HRV/ERV is located 
            'outside' the normal conditioned space. For instance on the roof, or in a semi-
            heated outdoor space such as a garage or breezeway. For Phius Certification, 
            use the 'ERV_HRV_Outside Calculator' tool which can be downloaded from the 
            Phius website www.phius.org
            
        non_combustible_materials_: (bool) Default=False. Set True if the building is made 
            of non-combustible materials which allows for a higher air-leakage rate.
            
        _summer_ventilation_: (SummerVentilation) Optional settings for Summer Ventilation 
            due to windows, dedicated extract fans, and HRV/ERV.
    
    Returns:
        hb_rooms_: The honeyee-Rooms with building-segment information added.
"""

import scriptcontext as sc
import Rhino as rh
import rhinoscriptsyntax as rs
import ghpythonlib.components as ghc
import Grasshopper as gh


try:
    from honeybee_ph_utils import preview
except ImportError as e:
    raise ImportError('\nFailed to import honeybee_ph_utils:\n\t{}'.format(e))

try:
    from honeybee_ph_rhino import gh_compo_io, gh_io
except ImportError as e:
    raise ImportError('\nFailed to import honeybee_ph_rhino:\n\t{}'.format(e))
    
    
# -------------------------------------------------------------------------------------
import honeybee_ph_rhino._component_info_
reload(honeybee_ph_rhino._component_info_)
ghenv.Component.Name = "HBPH - Bldg Segment"
DEV = honeybee_ph_rhino._component_info_.set_component_params(ghenv, dev=False)
if DEV:
    reload(gh_compo_io)
    reload(gh_io)
    from honeybee_ph import bldg_segment
    reload(bldg_segment)
    from honeybee_ph_rhino.gh_compo_io import ghio_validators
    reload(ghio_validators)
    from honeybee_ph_rhino.gh_compo_io import building_segment as gh_compo_io
    reload(gh_compo_io)

# ------------------------------------------------------------------------------
# -- GH Interface
IGH = gh_io.IGH( ghdoc, ghenv, sc, rh, rs, ghc, gh )

# -------------------------------------------------------------------------------------
gh_compo_interface = gh_compo_io.GHCompo_BuildingSegment(
        IGH,
        _segment_name_,
        num_floor_levels_,
        num_dwelling_units_,
        site_,
        source_energy_factors_,
        co2e_factors_,
        phius_certification_,
        phi_certification_,
        winter_set_temp_,
        summer_set_temp_,
        mech_room_temp_,
        _hb_rooms,
        non_combustible_materials_,
        _summer_ventilation_,
)
hb_rooms_, hbph_segment = gh_compo_interface.run()

# -------------------------------------------------------------------------------------
preview.object_preview(hbph_segment)
# ---------- end ph_bldg_segment ----------

create_shading_2 = HBPHCreateBuildingShading(hb_rooms=ph_bldg_segment.hb_rooms)  # -> out, window_surfaces, shading_surfaces, hb_rooms; inputs hb_rooms: list
# ---------- create_shading_2: Python ----------
#
# Honeybee-PH: A Plugin for adding Passive-House data to LadybugTools Honeybee-Energy Models
# 
# This component is part of the PH-Tools toolkit <https://github.com/PH-Tools>.
# 
# Copyright (c) 2022, PH-Tools and bldgtyp, llc <phtools@bldgtyp.com> 
# Honeybee-PH is free software; you can redistribute it and/or modify 
# it under the terms of the GNU General Public License as published 
# by the Free Software Foundation; either version 3 of the License, 
# or (at your option) any later version. 
# 
# Honeybee-PH is distributed in the hope that it will be useful,
# but WITHOUT ANY WARRANTY; without even the implied warranty of 
# MERCHANTABILITY or FITNESS FOR A PARTICULAR PURPOSE. See the 
# GNU General Public License for more details.
# 
# For a copy of the GNU General Public License
# see <https://github.com/PH-Tools/honeybee_ph/blob/main/LICENSE>.
# 
# @license GPL-3.0+ <http://spdx.org/licenses/GPL-3.0+>
#
"""
Create the 'punched' building geometry and all aperture 'reveals' which are
used when calculating detailed shading factors.
-
EM February 11, 2025
    Args:
        _hb_rooms: The Honeybee Rooms with apertures.
    
    Returns:
        window_surfaces_: The window surfaces as Brep objects, 'inset' into the 
            Honeybee-room. These are useful for visualization purposes.
        
        shading_surfaces_: The Honeybee-Room building surfaces as Brep objects
            with all the apertures 'punched' out and all side reveals for apertures
            added. These are used to calculate accurate shading factors for 
            apertures.
            
        hb_rooms_: The Honeybe Rooms.
"""

import scriptcontext as sc
import Rhino as rh
import rhinoscriptsyntax as rs
import ghpythonlib.components as ghc
import Grasshopper as gh


try:
    from honeybee_ph_utils import preview
except ImportError as e:
    raise ImportError('\nFailed to import honeybee_ph_utils:\n\t{}'.format(e))

try:
    from honeybee_ph_rhino import gh_compo_io
except ImportError as e:
    raise ImportError('\nFailed to import honeybee_ph_rhino:\n\t{}'.format(e))

try:
    from ph_gh_component_io import gh_io
except ImportError as e:
    raise ImportError("\nFailed to import honeybee_ph_rhino:\n\t{}".format(e))


# ------------------------------------------------------------------------------
import honeybee_ph_rhino._component_info_
reload(honeybee_ph_rhino._component_info_)
ghenv.Component.Name = "HBPH - Create Building Shading"
DEV = honeybee_ph_rhino._component_info_.set_component_params(ghenv, dev=False)
if DEV:
    from honeybee_ph_rhino.gh_compo_io.shading import shade_create_bldg_shd as gh_compo_io
    reload(gh_compo_io)
    reload(gh_io)

# ------------------------------------------------------------------------------
# -- GH Interface
IGH = gh_io.IGH( ghdoc, ghenv, sc, rh, rs, ghc, gh )


#-------------------------------------------------------------------------------
gh_compo_interface = gh_compo_io.GHCompo_CreateBuildingShading(
        IGH,
        _hb_rooms,
    )
window_surfaces_, shading_surfaces_, hb_rooms_ = gh_compo_interface.run()
# ---------- end create_shading_2 ----------
panel_28 = Panel("https://energyplus-weather.s3.amazonaws.com/north_and_central_america_wmo_region_4/USA/NY/USA_NY_New.York-J.F.Kennedy.Intl.AP.744860_TMY3/USA_NY_New.York-J.F.Kennedy.Intl.AP.744860_TMY3.zip")
data_12 = Data(data)
downloadepw = LBDownloadWeather(weather_URL=panel_28)  # -> epw_file, stat_file, ddy_file; plug-in component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
settings = HBPHShadingFactorSettingsLBTRad(epw_file=downloadepw.epw_file, grid_size="16 in")  # -> out, settings
# ---------- settings: Python ----------
#
# Honeybee-PH: A Plugin for adding Passive-House data to LadybugTools Honeybee-Energy Models
# 
# This component is part of the PH-Tools toolkit <https://github.com/PH-Tools>.
# 
# Copyright (c) 2022, PH-Tools and bldgtyp, llc <phtools@bldgtyp.com> 
# Honeybee-PH is free software; you can redistribute it and/or modify 
# it under the terms of the GNU General Public License as published 
# by the Free Software Foundation; either version 3 of the License, 
# or (at your option) any later version. 
# 
# Honeybee-PH is distributed in the hope that it will be useful,
# but WITHOUT ANY WARRANTY; without even the implied warranty of 
# MERCHANTABILITY or FITNESS FOR A PARTICULAR PURPOSE. See the 
# GNU General Public License for more details.
# 
# For a copy of the GNU General Public License
# see <https://github.com/PH-Tools/honeybee_ph/blob/main/LICENSE>.
# 
# @license GPL-3.0+ <http://spdx.org/licenses/GPL-3.0+>
#
"""
Settings and parameter values used when calculating the Window Shading Factors
using the Passive House LBT-Radiation solver.
-
EM February 11, 2025
    Args:
        _epw_file: The EPW file to use to generate the sky-matrix objects.
        
        north_: Optional North Vetor or angle.
        
        _winter_sky_matrix: Optional winter-period Ladybug Sky Matrix. Default
            if None is supplied is October 1 - March 31
            
        _summer_sky_matrix: Optional summer-period Ladybug Sky Matrix. Default
            if None is supplied is June 1 - September 30
            
        _window_mesh_settings_: Optional Rhino Mesh Settings for the window 
            surface geometry. Use this if you want to control exactly how the 
            window surfaces are gridded for analysis. For instance, if you supply a 
            Grasshopper Mesh Settings Custom, and set the "Min" and "Max" to "16", 
            you will always get exactly 16 segments for your analysis, which can 
            then be used to match other tools like DesignPH.
            
        _shading_mesh_setings: Optional Rhino Mesh settings for the shading geometry. 
            default = Rhino.Geometry.MeshingParameters.Default
            
        _grid_size_: (default=6-INCH) If no unit is specified, this input will use the 
            Rhino-document's unit-type. For instance, if the Rhino-Doc is set to "INCH"
            and the user inputs "8", this will be understood as a grid-spacing of 8"x8".
            Best practice is to specify the units explicitely. So instead of inputing 
            just "8", input "8-INCH" to ensure that you will always get the same grid-size
            no matter which unit type the Rhino-doc is set to.
            
        _legend_par_: Optional Ladybug legend parameter object to control the 
            output visualizations.
            
        _cpus_: (int) Optional. The number of computer CPUs to use to calculate the result.
    
    Returns:
        settings_: The new HBPH Settings which are used to configure the LBT-Radiation
            shading solver.
"""


import scriptcontext as sc
import Rhino as rh
import rhinoscriptsyntax as rs
import ghpythonlib.components as ghc
import Grasshopper as gh


try:
    from honeybee_ph_utils import preview
except ImportError as e:
    raise ImportError('\nFailed to import honeybee_ph_utils:\n\t{}'.format(e))

try:
    from honeybee_ph_rhino import gh_compo_io
except ImportError as e:
    raise ImportError('\nFailed to import honeybee_ph_rhino:\n\t{}'.format(e))

try:
    from ph_gh_component_io import gh_io
except ImportError as e:
    raise ImportError("\nFailed to import honeybee_ph_rhino:\n\t{}".format(e))


# ------------------------------------------------------------------------------
import honeybee_ph_rhino._component_info_
reload(honeybee_ph_rhino._component_info_)
ghenv.Component.Name = "HBPH - Shading Factor Settings - LBT Rad"
DEV = honeybee_ph_rhino._component_info_.set_component_params(ghenv, dev=False)
if DEV:
    from honeybee_ph_rhino.gh_compo_io.shading import shade_LBT_rad_settings as gh_compo_io
    reload(gh_compo_io)
    reload(gh_io)

# ------------------------------------------------------------------------------
# -- GH Interface
IGH = gh_io.IGH( ghdoc, ghenv, sc, rh, rs, ghc, gh )


#-------------------------------------------------------------------------------
gh_compo_interface = gh_compo_io.GHCompo_CreateLBTRadSettings(
        IGH,
        _epw_file,
        _north_,
        _winter_sky_matrix_,
        _summer_sky_matrix_,
        _shading_mesh_settings_,
        _grid_size_,
        _legend_par_,
        _cpus_,
        _window_mesh_settings_,
    )
settings_ = gh_compo_interface.run()


# ------------------------------------------------------------------------------  
preview.object_preview(settings_)
# ---------- end settings ----------
shading_factors = HBPHAddShadingFactorsLBTRad(
    settings=settings.settings,
    shading_surfaces_winter=flatten(create_shading_2.shading_surfaces),
    shading_surfaces_summer=flatten(create_shading_2.shading_surfaces),
    hb_rooms=create_shading_2.hb_rooms,
    run=data_12)  # -> out, legend, winter_rad_mesh, summer_rad_mesh, hb_rooms, port, aperture_names, winter_shading_factors, summer_shading_factors; inputs shading_surfaces_winter: list of GeometryBase, shading_surfaces_summer: list of GeometryBase, hb_rooms: list, run: Boolean
# ---------- shading_factors: Python ----------
#
# Honeybee-PH: A Plugin for adding Passive-House data to LadybugTools Honeybee-Energy Models
# 
# This component is part of the PH-Tools toolkit <https://github.com/PH-Tools>.
# 
# Copyright (c) 2022, PH-Tools and bldgtyp, llc <phtools@bldgtyp.com> 
# Honeybee-PH is free software; you can redistribute it and/or modify 
# it under the terms of the GNU General Public License as published 
# by the Free Software Foundation; either version 3 of the License, 
# or (at your option) any later version. 
# 
# Honeybee-PH is distributed in the hope that it will be useful,
# but WITHOUT ANY WARRANTY; without even the implied warranty of 
# MERCHANTABILITY or FITNESS FOR A PARTICULAR PURPOSE. See the 
# GNU General Public License for more details.
# 
# For a copy of the GNU General Public License
# see <https://github.com/PH-Tools/honeybee_ph/blob/main/LICENSE>.
# 
# @license GPL-3.0+ <http://spdx.org/licenses/GPL-3.0+>
#
"""
Calculate detailed winter/summer seasonal shading factors and add them to all apertures in the 
Honeybee Rooms input.
---
This component uses the LadybugTools 'IncidentRadiation' method. As stated on that component:
---
"Note that NO REFLECTIONS OF SOLAR ENERGY ARE INCLUDED IN THE ANALYSIS
PERFORMED BY THIS COMPONENT and it is important to bear in mind that vertical
surfaces typically receive 20% - 30% of their solar energy from reflection off
of the ground. Also note that this component uses the CAD environment's ray
intersection methods, which can be fast for geometries with low complexity
but does not scale well for complex geometries or many test points. For such
complex cases and situations where relfection of solar energy are important,
honeybee-radiance should be used."
-
EM February 11, 2025
    Args:
        _setttings: The Settings to use for the shading calculations. Connect a 
            'HBPH - Shading Factor Settings - LBT Rad'
            
        _shading_surfaces_winter: (List) A flat list of all the surfaces to consider when calculating 
            the detailed shading factors for WINTER. At the least, these should include all of the 
            building surfaces 'punched' with the apertures and all the aperture side
            'reveals'. This may also include additional site or building shading surfaces
            as desired. Use the 'HBPH - Create Building Shading' to generate 'punched' building shading.
        
        _shading_surfaces_summer: (List) A flat list of all the surfaces to consider when calculating 
            the detailed shading factors for SUMMER. At the least, these should include all of the 
            building surfaces 'punched' with the apertures and all the aperture side
            'reveals'. This may also include additional site or building shading surfaces
            as desired. Use the 'HBPH - Create Building Shading' to generate 'punched' building shading.
        
        _hb_rooms: (List[room.Room]) The Honeybee Rooms with apertures.
        
        _run: (bool) Set True to run the simulation.
    
    Returns:
        legend_: The Ladybug Legend for output / visualizations.
        
        winter_rad_mesh_: (kWh) The colored mesh showing the winter-period 
            incident solar radiation on the apertures (for output / visualizations).
        
        summer_rad_mesh_: (kWh) The colored mesh showing the summer-period 
            incident solar radiation on the apertures (for output / visualizations).
            
        hb_rooms_: The Honeybe Rooms with the shading factors added to all the apertures.
"""

import scriptcontext as sc
import Rhino as rh
import rhinoscriptsyntax as rs
import ghpythonlib.components as ghc
import Grasshopper as gh


try:
    from honeybee_ph_utils import preview
except ImportError as e:
    raise ImportError('\nFailed to import honeybee_ph_utils:\n\t{}'.format(e))

try:
    from honeybee_ph_rhino import gh_compo_io
except ImportError as e:
    raise ImportError('\nFailed to import honeybee_ph_rhino:\n\t{}'.format(e))

try:
    from ph_gh_component_io import gh_io
except ImportError as e:
    raise ImportError("\nFailed to import honeybee_ph_rhino:\n\t{}".format(e))


# ------------------------------------------------------------------------------
import honeybee_ph_rhino._component_info_
reload(honeybee_ph_rhino._component_info_)
ghenv.Component.Name = "HBPH - Add Shading Factors - LBT Rad"
DEV = honeybee_ph_rhino._component_info_.set_component_params(ghenv, dev=False)
if DEV:
    from honeybee_ph_rhino.gh_compo_io.shading import shade_solve_LBT_rad as gh_compo_io
    reload(gh_compo_io)
    reload(gh_io)

# ------------------------------------------------------------------------------
# -- GH Interface
IGH = gh_io.IGH( ghdoc, ghenv, sc, rh, rs, ghc, gh )


#-------------------------------------------------------------------------------
gh_compo_interface = gh_compo_io.GHCompo_SolveLBTRad(
        IGH,
        _settings,
        _shading_surfaces_winter,
        _shading_surfaces_summer,
        _hb_rooms, 
        _run)
(legend_, 
winter_rad_mesh_, winter_shading_factors_,
summer_rad_mesh_, summer_shading_factors_,
hb_rooms_, aperture_names_) = gh_compo_interface.run()
# ---------- end shading_factors ----------

shade = HBShade(geo=[extr, extr_2])  # -> report, shades; plug-in component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
vector = Vector(Vector(0, 5, 0))
plane = Plane(PlaneXZ(0, 0, 0))
model_2 = HBModel(rooms=flatten(shading_factors.hb_rooms), shades=flatten(shade.shades))  # -> report, model; plug-in component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
rotate = HBRotate(hb_objs=flatten(model_2.model), angle="10")  # -> hb_objs; plug-in component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
move = HBMove(hb_objs=flatten(rotate), vector=vector)  # -> hb_objs; plug-in component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
mirror = HBMirror(hb_objs=flatten(move), plane=plane)  # -> hb_objs; plug-in component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
scale = HBScale(hb_objs=flatten(mirror), factor="1.1")  # -> hb_objs; plug-in component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
data_13 = Data(data_2)
data_14 = Data(data_3)
data_15 = Data(data)
dumpobjects_3 = HBDumpObjects(hb_objs=flatten(scale), name="Multi_Room_Complete", folder=data_14, indent=data_13, dump=data_15)  # -> report, hb_file; plug-in component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
data_16 = Data(data_5)
data_17 = Data(data)
data_18 = Data(data_4)
data_19 = Data(data)
wufi_settings = HBPHWriteWUFIXMLSettings(merge_faces=Toggle(True), generate_log_files="0")  # -> out, settings; inputs group_components: Boolean, merge_spaces_by_erv: Boolean, generate_log_files: Int32
# ---------- wufi_settings: Python ----------
#
# Honeybee-PH: A Plugin for adding Passive-House data to LadybugTools Honeybee-Energy Models
# 
# This component is part of the PH-Tools toolkit <https://github.com/PH-Tools>.
# 
# Copyright (c) 2022, PH-Tools and bldgtyp, llc <phtools@bldgtyp.com> 
# Honeybee-PH is free software; you can redistribute it and/or modify 
# it under the terms of the GNU General Public License as published 
# by the Free Software Foundation; either version 3 of the License, 
# or (at your option) any later version. 
# 
# Honeybee-PH is distributed in the hope that it will be useful,
# but WITHOUT ANY WARRANTY; without even the implied warranty of 
# MERCHANTABILITY or FITNESS FOR A PARTICULAR PURPOSE. See the 
# GNU General Public License for more details.
# 
# For a copy of the GNU General Public License
# see <https://github.com/PH-Tools/honeybee_ph/blob/main/LICENSE>.
# 
# @license GPL-3.0+ <http://spdx.org/licenses/GPL-3.0+>
#
"""
Settings and congiguration options for the WUFI-Writer.
-
EM June 5, 2024
    Args:
        _group_components: (bool) Default=True. Set 'False' to keep each component
            (face) in the WUFI Model separate.
        
        _merge_faces: (bool | float [tolerance]) Default=False. Set 'True' to try and merge  
            together touching faces in order to simplify the model. This operation can 
            somethimes have unexpected results with some geometry, so only use 
            it if you really need to reduce the complexity of the WUFI model and 
            be sure to careufully check the resulting model faces for errors. If you
            have errors when merging, try passing in a different tolerance value here 
            (0.0001, 0.1, etc) and see if that helps.

        _merge_spaces_by_erv: (bool) Default=False. Set 'True' to have the WUFI-XML
            report out the spaces as 'merged' elements. In the WUFI "Rooms Ventilation"
            section there will be only a single 'room' entry for each ERV. This is 
            sometimes requested by Phiue when reviewing a project for Certification.
            Best practice is to leave it 'False' and to report out all the detailed
            rooms one at a time.

        _merge_exhaust_vent_devices: (bool) Default=False. Set 'True' to have the WUFI-XML
            report out the exhaust-ventilation (fans, kitchen hoods) 'merged' by type in order
            to simplify and shorten the WUFI-model. 

        _generate_log_files: (int) Default=0. Input a log-level here if 
            you would like PHX to generate log-files which record the operations 
            and progress of the HBJSON->XML process. Input either:

50 = CRITICAL
40 = ERROR
30 = WARNING
20 = INFO
10 = DEBUG
0 = NO LOGS (DEFAULT)
        
    Returns:
        settings_: The settings for the WUFI-Write operation.
"""

import scriptcontext as sc
import Rhino as rh
import rhinoscriptsyntax as rs
import ghpythonlib.components as ghc
import Grasshopper as gh

try:
    from honeybee_ph_utils import preview
except ImportError as e:
    raise ImportError('\nFailed to import honeybee_ph_utils:\n\t{}'.format(e))

try:
    from honeybee_ph_rhino import gh_compo_io, gh_io
except ImportError as e:
    raise ImportError('\nFailed to import honeybee_ph_rhino:\n\t{}'.format(e))


# ------------------------------------------------------------------------------
import honeybee_ph_rhino._component_info_
reload(honeybee_ph_rhino._component_info_)
ghenv.Component.Name = "HBPH - Write WUFI XML Settings"
DEV = honeybee_ph_rhino._component_info_.set_component_params(ghenv, dev=False)
if DEV:
    reload(gh_io)
    from honeybee_ph_rhino.gh_compo_io import write_wufi_xml_settings as gh_compo_io
    reload(gh_compo_io)

# ------------------------------------------------------------------------------
# -- GH Interface
IGH = gh_io.IGH( ghdoc, ghenv, sc, rh, rs, ghc, gh )


# ------------------------------------------------------------------------------
gh_compo_interface = gh_compo_io.GHCompo_WriteWufiXmlSettings(
    _IGH=IGH,
    _group_components=_group_components,
    _merge_faces=_merge_faces,
    _merge_spaces_by_erv=_merge_spaces_by_erv,
    _merge_exhaust_vent_devices=_merge_exhaust_vent_devices,
    _generate_log_files=_generate_log_files,
)
settings_ = gh_compo_interface.run()


# ------------------------------------------------------------------------------
preview.object_preview(settings_)
# ---------- end wufi_settings ----------
write_metr_json = HBPHWriteMETRJSON(
    filename="Multi_Room_Complete",
    save_folder=data_16,
    hb_json_file=dumpobjects_3.hb_file,
    settings=wufi_settings.settings,
    write_metr_json=data_17)  # -> out, json_file
# ---------- write_metr_json: Python ----------
#
# Honeybee-PH: A Plugin for adding Passive-House data to LadybugTools Honeybee-Energy Models
# 
# This component is part of the PH-Tools toolkit <https://github.com/PH-Tools>.
# 
# Copyright (c) 2026, PH-Tools and bldgtyp, llc <phtools@bldgtyp.com> 
# Honeybee-PH is free software; you can redistribute it and/or modify 
# it under the terms of the GNU General Public License as published 
# by the Free Software Foundation; either version 3 of the License, 
# or (at your option) any later version. 
# 
# Honeybee-PH is distributed in the hope that it will be useful,
# but WITHOUT ANY WARRANTY; without even the implied warranty of 
# MERCHANTABILITY or FITNESS FOR A PARTICULAR PURPOSE. See the 
# GNU General Public License for more details.
# 
# For a copy of the GNU General Public License
# see <https://github.com/PH-Tools/honeybee_ph/blob/main/LICENSE>.
# 
# @license GPL-3.0+ <http://spdx.org/licenses/GPL-3.0+>
#
"""
Convert an HBJSON file into a new METR-JSON file which can then be opened using 
METR. This will read in the HBJSON, rebuild the HB-Model before converting the 
Model into a METR-JSON file.
-
EM March 28, 2026
    Args:
        _filename: (str) The filename for the METR-JSON file.
        
        _save_folder: (str) The folder path to save the METR-JSON file to.
        
        _hb_json_file: (str) The path to the HBJSON file to convert into METR-JSON.
        
        _settings: The WUFI/METR Settings object. Connect the "HBPH - Write WUFI XML Settings"
            'settings_' output.

        _write_json: (bool) Set True to run. 
            
    Returns:
        json_file_: The full path to the output METR-JSON file.
"""

import scriptcontext as sc
import Rhino as rh
import rhinoscriptsyntax as rs
import ghpythonlib.components as ghc
import Grasshopper as gh


try:
    from honeybee_ph_rhino import gh_compo_io, gh_io
except ImportError as e:
    raise ImportError('\nFailed to import honeybee_ph_rhino:\n\t{}'.format(e))


# ------------------------------------------------------------------------------
import honeybee_ph_rhino._component_info_
reload(honeybee_ph_rhino._component_info_)
ghenv.Component.Name = "HBPH - Write METR JSON"
DEV = honeybee_ph_rhino._component_info_.set_component_params(ghenv, dev=False)
if DEV:
    from PHX import run
    reload(run)
    from honeybee_ph_rhino.gh_compo_io import write_metr_json as gh_compo_io
    reload(gh_compo_io)
    reload(gh_io)
    
# ------------------------------------------------------------------------------
# -- GH Interface
IGH = gh_io.IGH( ghdoc, ghenv, sc, rh, rs, ghc, gh )


# ------------------------------------------------------------------------------
gh_compo_interface = gh_compo_io.GHCompo_WriteMetrJson(
        IGH,
        _filename,
        _save_folder,
        _hb_json_file,
        _settings,
        _write_metr_json,
)
json_file_ = gh_compo_interface.run()
# ---------- end write_metr_json ----------
write_wufi_xml = HBPHWriteWUFIXML(
    filename="Multi_Room_Complete",
    save_folder=data_18,
    hb_json_file=dumpobjects_3.hb_file,
    settings=wufi_settings.settings,
    write_xml=data_19)  # -> out, xml_file
# ---------- write_wufi_xml: Python ----------
#
# Honeybee-PH: A Plugin for adding Passive-House data to LadybugTools Honeybee-Energy Models
# 
# This component is part of the PH-Tools toolkit <https://github.com/PH-Tools>.
# 
# Copyright (c) 2022, PH-Tools and bldgtyp, llc <phtools@bldgtyp.com> 
# Honeybee-PH is free software; you can redistribute it and/or modify 
# it under the terms of the GNU General Public License as published 
# by the Free Software Foundation; either version 3 of the License, 
# or (at your option) any later version. 
# 
# Honeybee-PH is distributed in the hope that it will be useful,
# but WITHOUT ANY WARRANTY; without even the implied warranty of 
# MERCHANTABILITY or FITNESS FOR A PARTICULAR PURPOSE. See the 
# GNU General Public License for more details.
# 
# For a copy of the GNU General Public License
# see <https://github.com/PH-Tools/honeybee_ph/blob/main/LICENSE>.
# 
# @license GPL-3.0+ <http://spdx.org/licenses/GPL-3.0+>
#
"""
Convert an HBJSON file into a new WUFI-XML file which can then be opened using 
WUFI-Passive. This will read in the HBJSON, rebuild the HB-Model before converting the 
Model into a WUFI-Passive file.
-
EM June 5, 2024
    Args:
        _filename: (str) The filename for the WUFI XML file.
        
        _save_folder: (str) The folder path to save the WUFI XML file to.
        
        _hb_json_file: (str) The path to the HBJSON file to convert into WUFI XML.
        
        _settings: The WUFI Settings object. Connect the "HBPH - Write WUFI XML Settings"
            'settings_' output.

        _write_xml: (bool) Set True to run. 
            
    Returns:
        xml_file_: The full path to the output WUFI XML file.
"""

import scriptcontext as sc
import Rhino as rh
import rhinoscriptsyntax as rs
import ghpythonlib.components as ghc
import Grasshopper as gh


try:
    from honeybee_ph_rhino import gh_compo_io, gh_io
except ImportError as e:
    raise ImportError('\nFailed to import honeybee_ph_rhino:\n\t{}'.format(e))


# ------------------------------------------------------------------------------
import honeybee_ph_rhino._component_info_
reload(honeybee_ph_rhino._component_info_)
ghenv.Component.Name = "HBPH - Write WUFI XML"
DEV = honeybee_ph_rhino._component_info_.set_component_params(ghenv, dev=False)
if DEV:
    from PHX import run
    reload(run)
    from honeybee_ph_rhino.gh_compo_io import write_wuif_xml as gh_compo_io
    reload(gh_compo_io)
    reload(gh_io)
    
# ------------------------------------------------------------------------------
# -- GH Interface
IGH = gh_io.IGH( ghdoc, ghenv, sc, rh, rs, ghc, gh )


# ------------------------------------------------------------------------------
gh_compo_interface = gh_compo_io.GHCompo_WriteWufiXml(
        IGH,
        _filename,
        _save_folder,
        _hb_json_file,
        _settings,
        _write_xml,
)
xml_file_ = gh_compo_interface.run()
# ---------- end write_wufi_xml ----------
write_phpp = HBPHWriteToPHPP(hbjson_file=dumpobjects_3.hb_file, write=Toggle(False))  # -> out; inputs write: Boolean
# ---------- write_phpp: Python ----------
#
# Honeybee-PH: A Plugin for adding Passive-House data to LadybugTools Honeybee-Energy Models
# 
# This component is part of the PH-Tools toolkit <https://github.com/PH-Tools>.
# 
# Copyright (c) 2022, PH-Tools and bldgtyp, llc <phtools@bldgtyp.com> 
# Honeybee-PH is free software; you can redistribute it and/or modify 
# it under the terms of the GNU General Public License as published 
# by the Free Software Foundation; either version 3 of the License, 
# or (at your option) any later version. 
# 
# Honeybee-PH is distributed in the hope that it will be useful,
# but WITHOUT ANY WARRANTY; without even the implied warranty of 
# MERCHANTABILITY or FITNESS FOR A PARTICULAR PURPOSE. See the 
# GNU General Public License for more details.
# 
# For a copy of the GNU General Public License
# see <https://github.com/PH-Tools/honeybee_ph/blob/main/LICENSE>.
# 
# @license GPL-3.0+ <http://spdx.org/licenses/GPL-3.0+>
#
"""
Convert an existing HBJSON file to a Passive House Exchange (PHX) model and write out 
the model data to a PHPP document. 
NOTE:
    - You must have a valid PHPP document to write to. The PHPP is *NOT* part of the 
    honeybee-ph plugin and must be purchased from PHI or your local reseller. For more 
    information, see: "https://passivehouse.com/04_phpp/04_phpp.htm"
    - The PHPP document you would like to write to should be open alongside Rhino, 
    and must be the the 'active' excel document. To ensure best results and least 
    likelihood of conflicts, it is recommended to close all other excel documents 
    on your system except the PHPP.
    - Once the PHPP file is open, set _write to True to run the writer. 
    - IMPORTANT: This component simply writes the data to the PHPP file. Once writen, 
    be sure to save your PHPP file with the new data to the appropriate location on 
    your computer.
-
EM October 2, 2022
    Args:
        _hbjson_file: (str) The full file path to the HBJSON you would like to write 
            out to PHPP.
        
        _activate_variants: (bool) Default="False", Set True if you would like to 
            connect all of the various PHPP inputs to the 'Variants' worksheet. This
            is used when testing various combinations of attributes during the 
            early design phase. Note that if activated, any inputs will get overwritten
            when the connection to the 'Variants' worksheet is made.
            Note: Args must be strings, not actual boolean True/False.
            
        _write: (bool) Set True to run the PHPP writer.
            
    Returns:
        hb_rooms_ (List[Room]) A list of the Honeybee Rooms with the ph-style occupancy set.
"""

import scriptcontext as sc
import Rhino as rh
import rhinoscriptsyntax as rs
import ghpythonlib.components as ghc
import Grasshopper as gh


try:
    from honeybee_ph_utils import preview
except ImportError as e:
    raise ImportError('\nFailed to import honeybee_ph_utils:\n\t{}'.format(e))

try:
    from honeybee_ph_rhino import gh_compo_io, gh_io
except ImportError as e:
    raise ImportError('\nFailed to import honeybee_ph_rhino:\n\t{}'.format(e))


#-------------------------------------------------------------------------------
import honeybee_ph_rhino._component_info_
reload(honeybee_ph_rhino._component_info_)
ghenv.Component.Name = "HBPH - Write to PHPP"
DEV = honeybee_ph_rhino._component_info_.set_component_params(ghenv, dev=False)
if DEV:
    reload(gh_compo_io)
    reload(gh_io)

# ------------------------------------------------------------------------------
# -- GH Interface
IGH = gh_io.IGH( ghdoc, ghenv, sc, rh, rs, ghc, gh )


# -------------------------------------------------------------------------------------
gh_compo_interface = gh_compo_io.GHCompo_WriteToPHPP(
        IGH,
        _hbjson_file,
        _activate_variants,
        _write,
)
gh_compo_interface.run()
# ---------- end write_phpp ----------

create_model_simple_wireframe = HBPHCreateModelSimpleWireframe(hb_model=scale, color=ColourSwatch(SwatchColor=RGB(255, 0, 255)))  # -> out, faces, coplanar_face_groups, merged_hb_faces, rh_surfaces, construction_names, wireframe, material; inputs color: Color
# ---------- create_model_simple_wireframe: Python ----------
#
# Honeybee-PH: A Plugin for adding Passive-House data to LadybugTools Honeybee-Energy Models
# 
# This component is part of the PH-Tools toolkit <https://github.com/PH-Tools>.
# 
# Copyright (c) 2022, PH-Tools and bldgtyp, llc <phtools@bldgtyp.com> 
# Honeybee-PH is free software; you can redistribute it and/or modify 
# it under the terms of the GNU General Public License as published 
# by the Free Software Foundation; either version 3 of the License, 
# or (at your option) any later version. 
# 
# Honeybee-PH is distributed in the hope that it will be useful,
# but WITHOUT ANY WARRANTY; without even the implied warranty of 
# MERCHANTABILITY or FITNESS FOR A PARTICULAR PURPOSE. See the 
# GNU General Public License for more details.
# 
# For a copy of the GNU General Public License
# see <https://github.com/PH-Tools/honeybee_ph/blob/main/LICENSE>.
# 
# @license GPL-3.0+ <http://spdx.org/licenses/GPL-3.0+>
#
"""
This component will create a simplified wireframe ModelObject of the Honeybee-Mode which 
is useful as refernce geometry when exporting / printing / making diagrams, etc.
-
EM Jan 8, 2026
    Args:

        _hb_model: (Model) The Honeybee-Model object to pull the ERV Ducting out of.

        _color_: (Color) Default=Gray. Optional color swatch for the 'material_' color. 

    Returns:

        faces_: (list[Face]) The 'exterior' honeybee-faces of the Honeybee-Model

        coplanar_face_groups_: (DataTree[Face]) The honeybee-faces grouped onto branches based on 
            they co-planarity.

        merged_hb_faces_: (DataTree[Face]) The co-planar honeybee-faces merged together.

        rh_surfaces_: (DataTree[Brep]) The co-planar faces as Rhino surfaces.

        construction_names_: (DataTree[str]) The names of the constructions for each of the 
            co-planar face groups.

        wireframe_: (list[Model Curve]) The simplified wireframe ModelObjects which can be passed along
            for export or printing.

        material_: (Model Material) A new RenderMaterial which can be passed directly to
            to the 'Render' input on a Model-Object.
"""

import scriptcontext as sc
import Rhino as rh
import rhinoscriptsyntax as rs
import ghpythonlib.components as ghc
import Grasshopper as gh

try:
    from honeybee_ph_plus_rhino import gh_compo_io
except ImportError as e:
    raise ImportError('\nFailed to import honeybee_ph_rhino:\n\t{}'.format(e))

try:
    from ph_gh_component_io import gh_io
except ImportError as e:
    raise ImportError('\nFailed to import ph_gh_component_io:\n\t{}'.format(e))


# ------------------------------------------------------------------------------
import honeybee_ph_plus_rhino._component_info_
reload(honeybee_ph_plus_rhino._component_info_)
ghenv.Component.Name = "HBPH+ - Create Model Simple Wireframe"
DEV = honeybee_ph_plus_rhino._component_info_.set_component_params(ghenv, dev=False)
if DEV:
    from honeybee_ph_plus_rhino.gh_compo_io.reporting import build_simplified_wireframe as gh_compo_io
    reload(gh_compo_io)
    reload(gh_io)

# ------------------------------------------------------------------------------
# -- GH Interface
IGH = gh_io.IGH( ghdoc, ghenv, sc, rh, rs, ghc, gh )

# ------------------------------------------------------------------------------
gh_compo_interface = gh_compo_io.GHCompo_BuildHbModelSimplifiedWireframe(
    IGH,
    _hb_model,
    _color_,
)

(
    faces_,
    coplanar_face_groups_,
    merged_hb_faces_,
    rh_surfaces_,
    construction_names_,
    wireframe_,
    material_,
) = gh_compo_interface.run()
# ---------- end create_model_simple_wireframe ----------
create_erv_duct_model_objects = HBPHCreateERVDuctModelObjects(hb_model=scale)  # -> out, duct_objects
# ---------- create_erv_duct_model_objects: Python ----------
#
# Honeybee-PH: A Plugin for adding Passive-House data to LadybugTools Honeybee-Energy Models
# 
# This component is part of the PH-Tools toolkit <https://github.com/PH-Tools>.
# 
# Copyright (c) 2022, PH-Tools and bldgtyp, llc <phtools@bldgtyp.com> 
# Honeybee-PH is free software; you can redistribute it and/or modify 
# it under the terms of the GNU General Public License as published 
# by the Free Software Foundation; either version 3 of the License, 
# or (at your option) any later version. 
# 
# Honeybee-PH is distributed in the hope that it will be useful,
# but WITHOUT ANY WARRANTY; without even the implied warranty of 
# MERCHANTABILITY or FITNESS FOR A PARTICULAR PURPOSE. See the 
# GNU General Public License for more details.
# 
# For a copy of the GNU General Public License
# see <https://github.com/PH-Tools/honeybee_ph/blob/main/LICENSE>.
# 
# @license GPL-3.0+ <http://spdx.org/licenses/GPL-3.0+>
#
"""
Pull out the ERV Ducting objects as 'Model Objects' which can be exported. This is especially
useful when exporting to Sketchup or other 3D model formats outside of Rhino.
-
EM Nov 06, 2025
    Args:

        _hb_model: (Model) The Honeybee-Model object to pull the ERV Ducting out of.
         
        _duct_type: (str) Input either -
- "1-Supply" (default)
- "2-Exhaust"
            
    Returns:

        duct_objects_: (DataTree[]) The Duct Model-Objects for exporting.
"""

import scriptcontext as sc
import Rhino as rh
import rhinoscriptsyntax as rs
import ghpythonlib.components as ghc
import Grasshopper as gh

try:
    from honeybee_ph_plus_rhino import gh_compo_io
except ImportError as e:
    raise ImportError('\nFailed to import honeybee_ph_rhino:\n\t{}'.format(e))

try:
    from ph_gh_component_io import gh_io
except ImportError as e:
    raise ImportError('\nFailed to import ph_gh_component_io:\n\t{}'.format(e))


# ------------------------------------------------------------------------------
import honeybee_ph_plus_rhino._component_info_
reload(honeybee_ph_plus_rhino._component_info_)
ghenv.Component.Name = "HBPH+ - Create ERV Duct Model Objects"
DEV = honeybee_ph_plus_rhino._component_info_.set_component_params(ghenv, dev=False)
if DEV:
    from honeybee_ph_plus_rhino.gh_compo_io.reporting import build_erv_duct_objects as gh_compo_io
    reload(gh_compo_io)

# ------------------------------------------------------------------------------
# -- GH Interface
IGH = gh_io.IGH( ghdoc, ghenv, sc, rh, rs, ghc, gh )

# ------------------------------------------------------------------------------
gh_compo_interface = gh_compo_io.GHCompo_BuildErvDucting(
    IGH,
    _hb_model,
    _duct_type,
)
duct_objects_ = gh_compo_interface.run()
# ---------- end create_erv_duct_model_objects ----------
